# Grasshopper definition improved_datarecorder.gh (Grasshopper 1.0.4)
# plug-ins: Python Interpreter

circle = Circle({Plane=PlaneXY(0, 0, 0), Radius=10})
curvepoint = PointOnCurve(circle, parameter=0.649)
merge = Merge(Data1=circle, Data2=curvepoint, Data3=Slider(0.34, range=0..1))  # -> graft(Result)
data_rec = PythonScript(x=merge, enable=Toggle(True), reset=Button(), limit=Slider(4, range=0..10))  # -> x; inputs x: tree, enable: Boolean, reset: Boolean, limit: Int32
# ---------- data_rec: Python ----------
from Grasshopper import DataTree
if reset or 'rec' not in globals(): rec = DataTree[object]()
if enable and not reset: rec.MergeTree(x)
if limit > 0:
  for branch in rec.Branches:
    if branch.Count > limit:
      branch.RemoveRange(0, branch.Count - limit)
x = rec
# ---------- end data_rec ----------
panel = Panel(data_rec)
