# Grasshopper definition vectorgraphics_LOFT_04.gh (Grasshopper 0.9.76)
# plug-ins: Python Interpreter

integer = Integer(1)
timer = Timer(TimerInterval=20, Target=data_recorder)
data_recorder = DataRecorder(integer, DataLimit=-360, RecordData=True)
mass_addition = MassAddition(Input=data_recorder)  # -> Result, PartialResults
panel = Panel(mass_addition.Result)
multiplication = Multiplication(A=panel, B=Slider(2, range=0..10))
_1 = Integer(1)
addition = Addition(A=_1, B=Slider(2, range=0..10))
number_slider = Slider(36, range=0..100)
number_slider_2 = Slider(8, range=0..10)
series = Series(Start=panel, Step=multiplication, Count=number_slider_2)
list_length = ListLength(List=series)
panel_2 = Panel(series)
panel_3 = Panel(list_length)
random = Random(Range=Domain(0, 1), Number=_1, Seed=panel_2)
panel_4 = Panel(random)
unit_z = UnitZ(Factor=_1)
addition_2 = Addition(A=panel_4, B=Slider(1, range=0..5))  # -> flatten(Result)
series_2 = Series(Start=unit_z, Step=addition, Count=number_slider_2)
multiplication_2 = Multiplication(A=mass_addition.Result, B=number_slider)
panel_5 = Panel(series_2)
construct_point = ConstructPoint(XCoordinate=addition_2, YCoordinate=Slider(0, range=0..3), ZCoordinate=series_2)
series_3 = Series(Start=multiplication_2, Step=30, Count=number_slider_2)
panel_6 = Panel(series_3)
panel_7 = Panel(construct_point)
division = Division(A=Slider(360, range=0..1000), B=number_slider)
multiplication_3 = Multiplication(A=number_slider_2, B=division)
rotate_3d = Rotate3D(Geometry=construct_point, Angle=degrees(panel_6), Center=Point(0, 0, 0), Axis=unit_z)  # -> graft(Geometry), Transform
panel_8 = Panel(division)
panel_9 = Panel(rotate_3d.Geometry)
data_rec = PythonScript(x=rotate_3d.Geometry, enable=Toggle(True), reset=Button(), limit=panel_8)  # -> x; inputs x: tree, enable: Boolean, reset: Boolean, limit: Int32
# ---------- data_rec: Python ----------
from Grasshopper import DataTree
if reset or 'rec' not in globals(): rec = DataTree[object]()
if enable and not reset: rec.MergeTree(x)
if limit > 0:
  for branch in rec.Branches:
    if branch.Count > limit:
      branch.RemoveRange(0, branch.Count - limit)
x = rec
# ---------- end data_rec ----------
panel_10 = Panel(data_rec)
interpolate = Interpolate(Vertices=panel_10, Degree=Slider(5, range=1..11), Periodic=True, KnotStyle=1)  # -> flatten(Curve), Length, Domain
panel_11 = Panel(interpolate.Curve)
loft = Loft(
    Curves=interpolate.Curve,
    Options={Adjust=False, Closed=False, LoftEnds=0, LoftSimp=0, LoftType=1, Rebuild=10, Refit=0.01})
evaluate_surface = EvaluateSurface()  # -> Point, Normal, Frame

integer_2 = Integer(1)
panel_12 = Panel("ANIMATION TUTORIAL")
data_recorder_2 = DataRecorder(integer_2, DataLimit=-10, RecordData=True)
timer_2 = Timer(TimerInterval=20, Target=[data_recorder_3, data_recorder_2])
mass_addition_2 = MassAddition(Input=data_recorder_2)  # -> Result, PartialResults
integer_3 = Integer(100)
panel_13 = Panel(mass_addition_2.Result)
random_2 = Random(Range=Slider(51, range=0..300), Number=integer_3, Seed=mass_addition_2.Result)
multiplication_4 = Multiplication(A=panel_13, B=Slider(0.2, range=0..5))
panel_14 = Panel(random_2)
data_recorder_3 = DataRecorder(reverse(simplify(multiplication_4)), DataLimit=100, RecordData=False)
sine = Sine(Value=data_recorder_3)
series_4 = Series(Start=Slider(67, range=0..100), Step=Slider(2, range=0..10), Count=Slider(100, range=0..100))
panel_15 = Panel(sine)
circle = Circle(Plane=PlaneXY(0, 0, 0), Radius=series_4)
multiplication_5 = Multiplication(A=panel_15, B=Slider(6, range=0..10))
unit_z_2 = UnitZ(Factor=multiplication_5)
point = Point([Point(382, 447, 0), Point(264, 602, 0), Point(143, 474, 0), Point(74, 577, 0), Point(-201, 411, 0), Point(-170, 584, 0)])
interpolate_2 = Interpolate(Vertices=point, Degree=Slider(4, range=0..10), Periodic=Toggle(True), KnotStyle=1)  # -> Curve, Length, Domain
move = Move(Geometry=circle, Motion=unit_z_2)  # -> Geometry, Transform
number_slider_3 = Slider(83, range=0..100)
unit_z_3 = UnitZ(Factor=multiplication_5)
divide_curve = DivideCurve(Curve=interpolate_2.Curve, Count=Slider(99, range=0..100), Kinks=False)  # -> Points, Tangents, Parameters
move_2 = Move(Geometry=divide_curve.Points, Motion=unit_z_3)  # -> Geometry, Transform

panel_16 = Panel("""GRASHOPPER
LECTURE
4 DATA""")
surface = Surface(<surface referenced from the Rhino model>)
divide_surface = DivideSurface(Surface=surface, UCount=Slider(7, range=0..10), VCount=1)  # -> Points, Normals, Parameters
panel_17 = Panel(divide_surface.Points)
panel_18 = Panel(divide_surface.Normals)
panel_19 = Panel(divide_surface.Parameters)
number_slider_4 = Slider(0, range=0..100)
list_item = ListItem(List=panel_17, Index=Slider(1, range=0..1), Wrap=True)
list_item_2 = ListItem(List=panel_17, Index=0, Wrap=True)
panel_20 = Panel(list_item_2)
panel_21 = Panel(list_item)
line = Line(StartPoint=panel_20, EndPoint=panel_21)  # -> flatten(Line)
surface_split = SurfaceSplit(Surface=surface, Curves=line)
panel_22 = Panel(surface_split)
list_length_2 = ListLength(List=surface_split)
list_item_3 = ListItem(List=surface_split, Index=0, Wrap=True)
list_item_4 = ListItem(List=surface_split, Index=list_length_2, Wrap=True)
deconstruct_brep = DeconstructBrep(Brep=list_item_3)  # -> Faces, Edges, Vertices
panel_23 = Panel(deconstruct_brep.Vertices)
list_length_3 = ListLength(List=deconstruct_brep.Vertices)
panel_24 = Panel(list_length_3)
point_list = PointList(Points=panel_23, Size=Slider(1, range=0..10))
list_item_5 = ListItem(List=deconstruct_brep.Vertices, Index=0, Wrap=True)
panel_25 = Panel(list_item_5)
subtraction = Subtraction(A=panel_24, B=Slider(1, range=0..1))
list_item_6 = ListItem(List=deconstruct_brep.Vertices, Index=subtraction, Wrap=True)
line_2 = Line(StartPoint=list_item_5, EndPoint=list_item_6)
panel_26 = Panel(subtraction)

panel_27 = Panel("""GRASHOPPER LECTURE
4 - SHIFTING ITEMS""")
circle_2 = Circle(Plane=PlaneXY(0, 0, 0), Radius=Slider(10, range=0..10))
unit_z_4 = UnitZ(Factor=Slider(20, range=0..100))
move_3 = Move(Geometry=circle_2, Motion=unit_z_4)  # -> Geometry, Transform
series_5 = Series(Start=Slider(1, range=0..1), Step=Slider(2, range=0..10), Count=Slider(5, range=0..10))
scale = Scale(Geometry=move_3.Geometry, Center=Point(0, 0, 0), Factor=Slider(0.8, range=0..1))  # -> Geometry, Transform
panel_28 = Panel(series_5)
divide_curve_2 = DivideCurve(Curve=circle_2, Count=Slider(10, range=0..100), Kinks=False)  # -> Points, Tangents, Parameters
divide_curve_3 = DivideCurve(Curve=scale.Geometry, Count=10, Kinks=False)  # -> Points, Tangents, Parameters
shift_list = ShiftList(List=divide_curve_2.Points, Shift=1, Wrap=True)
panel_29 = Panel(divide_curve_3.Points)
panel_30 = Panel(shift_list)
line_3 = Line(StartPoint=panel_29, EndPoint=panel_30)
loft_2 = Loft(Curves=line_3, Options={Adjust=False, Closed=False, LoftEnds=0, LoftSimp=0, LoftType=0, Rebuild=10, Refit=0.01})
