# Grasshopper definition vectorgraphics_LOFT_05.gh (Grasshopper 1.0.7)

integer = Integer(1)
timer = Timer(TimerInterval=20, Target=data_recorder)
data_recorder = DataRecorder(integer, DataLimit=-360, RecordData=True)
mass_addition = MassAddition(Input=data_recorder)  # -> Result, PartialResults
panel = Panel(mass_addition.Result)
multiplication = Multiplication(A=panel, B=Slider(2, range=0..10))
number_of_lists = Slider(8, range=0..10)
series = Series(Start=panel, Step=multiplication, Count=number_of_lists)
height_between_loft_segments = Slider(1, range=0..10)
panel_2 = Panel(series)
_1 = Integer(1)
random = Random(Range=Domain(0, 1), Number=_1, Seed=series)
panel_3 = Panel(random)
addition = Addition(A=_1, B=height_between_loft_segments)
increse_distance_from_centre = Slider(2, range=0..5)
unit_z = UnitZ(Factor=_1)
series_2 = Series(Start=unit_z, Step=addition, Count=number_of_lists)
list_length = ListLength(List=series_2)  # disabled
list_item = ListItem(List=series_2, Index=expr("x-1", list_length), Wrap=True)  # disabled
addition_2 = Addition(A=random, B=increse_distance_from_centre)  # -> flatten(Result)
integer_2 = Integer(-3)
_0 = Integer(0)
panel_4 = Panel(series_2)
construct_point = ConstructPoint(XCoordinate=addition_2, YCoordinate=_0, ZCoordinate=series_2)
panel_5 = Panel(construct_point)
construct_point_2 = ConstructPoint(XCoordinate=_0, YCoordinate=_0, ZCoordinate=_0)
circle = Circle(Plane=PlaneXY(0, 0, 0), Radius=1)
number_slider = Slider(36, range=0..100)
multiplication_2 = Multiplication(A=mass_addition.Result, B=number_slider)
series_3 = Series(Start=multiplication_2, Step=30, Count=number_of_lists)
rotate_3d = Rotate3D(Geometry=construct_point, Angle=degrees(series_3), Center=construct_point_2, Axis=unit_z)  # -> graft(Geometry), Transform
panel_6 = Panel(series_3)
panel_7 = Panel(rotate_3d.Geometry)
division = Division(A=Slider(360, range=0..1000), B=number_slider)
panel_8 = Panel(division)
data_rec = PythonScript(x=rotate_3d.Geometry, enable=Toggle(True), reset=Button(), limit=panel_8)  # -> x; inputs x: tree, enable: Boolean, reset: Boolean, limit: Int32
# ---------- data_rec: Python ----------
from Grasshopper import DataTree
if reset or 'rec' not in globals(): rec = DataTree[object]()
if enable and not reset: rec.MergeTree(x)
if limit > 0:
  for branch in rec.Branches:
    if branch.Count > limit:
      branch.RemoveRange(0, branch.Count - limit)
x = rec
# ---------- end data_rec ----------
panel_9 = Panel(data_rec)
interpolate = Interpolate(Vertices=data_rec, Degree=Slider(5, range=1..11), Periodic=True, KnotStyle=1)  # -> flatten(Curve), Length, Domain

integer_3 = Integer(1)  # disabled
timer_2 = Timer(TimerInterval=20, Target=data_recorder_2)  # disabled
data_recorder_2 = DataRecorder(integer_3, DataLimit=-360, RecordData=True)  # disabled
mass_addition_2 = MassAddition(Input=data_recorder_2)  # -> Result, PartialResults; disabled
height_between_loft_segments_2 = Slider(4, range=0..10)  # disabled
_1_2 = Integer(1)  # disabled
number_of_lists_2 = Slider(10, range=0..30)  # disabled
number_slider_2 = Slider(1, range=0..10)  # disabled
addition_3 = Addition(A=_1_2, B=height_between_loft_segments_2)  # disabled
addition_4 = Addition(A=list_item, B=7)  # disabled
unit_z_2 = UnitZ(Factor=_1_2)  # disabled
series_4 = Series(Start=number_slider_2, Step=1, Count=number_of_lists_2)  # disabled
series_5 = Series(Start=addition_4, Step=addition_3, Count=number_of_lists_2)  # disabled
multiplication_3 = Multiplication(A=series_4, B=series_4)  # disabled
_0_2 = Integer(0)  # disabled
integer_4 = Integer(-3)  # disabled
_1_3 = Integer(1)  # disabled
panel_10 = Panel(multiplication_3)  # disabled
construct_point_3 = ConstructPoint(XCoordinate=multiplication_3, YCoordinate=_0_2, ZCoordinate=series_5)  # disabled
construct_point_4 = ConstructPoint(XCoordinate=_0_2, YCoordinate=_0_2, ZCoordinate=_0_2)  # disabled
panel_11 = Panel(construct_point_3)  # disabled
number_slider_3 = Slider(35, range=0..100)  # disabled
number_slider_4 = Slider(9, range=0..10)  # disabled
integer_5 = Integer(1)  # disabled
series_6 = Series(Start=mass_addition_2.Result, Step=number_slider_3, Count=number_of_lists_2)  # disabled
multiplication_4 = Multiplication(A=series_6, B=number_slider_4)  # disabled
rotate_3d_2 = Rotate3D(Geometry=construct_point_3, Angle=degrees(multiplication_4), Center=construct_point_4, Axis=unit_z_2)  # -> flatten(Geometry), Transform; disabled
panel_12 = Panel(series_6)  # disabled
number_slider_5 = Slider(0.41, range=0..1)  # disabled
panel_13 = Panel(rotate_3d_2.Geometry)  # disabled
interpolate_t = InterpolateT(Vertices=rotate_3d_2.Geometry, TangentStart=Vector(0, 0, 0), TangentEnd=Vector(0, 0, 0), KnotStyle=1)  # -> Curve, Length, Domain; disabled
number_slider_6 = Slider(60, range=0..100)  # disabled
multiplication_5 = Multiplication(A=mass_addition_2.Result, B=number_slider_5)  # disabled
divide_curve = DivideCurve(Curve=interpolate_t.Curve, Count=number_slider_6, Kinks=False)  # -> Points, Tangents, Parameters; disabled
panel_14 = Panel(divide_curve.Points)  # disabled
number_slider_7 = Slider(4, range=0..10)  # disabled
number_slider_8 = Slider(10, range=0..10)  # disabled
series_7 = Series(Start=multiplication_5, Step=1, Count=number_slider_8)  # disabled
sine = Sine(Value=series_7)  # disabled
unit_z_3 = UnitZ(Factor=sine)  # disabled
multiplication_6 = Multiplication(A=unit_z_3, B=number_slider_7)  # disabled
number_slider_9 = Slider(2, range=0..10)  # disabled
number_slider_10 = Slider(0, range=0..10)  # disabled
panel_15 = Panel(multiplication_6)  # disabled
series_8 = Series(Start=number_slider_10, Step=number_slider_9, Count=number_slider_8)  # disabled
panel_16 = Panel(series_8)  # disabled
number_slider_11 = Slider(6, range=0..10)  # disabled
division_2 = Division(A=panel_16, B=number_slider_11)  # disabled
panel_17 = Panel(division_2)  # disabled
multiplication_7 = Multiplication(A=series_8, B=panel_17)  # disabled
integer_6 = Integer(multiplication_7)  # disabled
number_slider_12 = Slider(2, range=0..10)  # disabled
list_item_2 = ListItem(List=divide_curve.Points, Index=integer_6, Wrap=True)  # disabled
move = Move(Geometry=list_item_2, Motion=multiplication_6)  # -> Geometry, Transform; disabled
division_3 = Division(A=list_item, B=number_slider_12)  # disabled
construct_point_5 = ConstructPoint(XCoordinate=0, YCoordinate=0, ZCoordinate=division_3)  # disabled
unit_z_4 = UnitZ(Factor=1)  # disabled
list_item_3 = ListItem(List=move.Geometry, Index=0, Wrap=True)  # disabled
number_slider_13 = Slider(2.3, range=0..5)  # disabled
interpolate_t_2 = InterpolateT(Vertices=move.Geometry, TangentStart=unit_z_4, TangentEnd=Vector(0, 0, 0), KnotStyle=1)  # -> Curve, Length, Domain; disabled
plane_normal = PlaneNormal(Origin=construct_point_5, ZAxis=Vector(0, 0, 1))  # disabled
plane_normal_2 = PlaneNormal(Origin=list_item_3, ZAxis=Vector(0, 0, 1))  # disabled
circle_2 = Circle(Plane=plane_normal_2, Radius=number_slider_13)  # disabled
pipe = Pipe(Curve=interpolate_t_2.Curve, Radius=number_slider_13, Caps=0)  # disabled
mirror = Mirror(Geometry=move.Geometry, Plane=plane_normal)  # -> Geometry, Transform; disabled
number_slider_14 = Slider(180, range=0..360)  # disabled
list_length_2 = ListLength(List=interpolate.Curve)  # disabled
panel_18 = Panel(pipe)  # disabled
mirror_2 = Mirror(Geometry=pipe, Plane=plane_normal)  # -> Geometry, Transform; disabled
list_item_4 = ListItem(List=interpolate.Curve, Index=expr("x-1", list_length_2), Wrap=True)  # disabled
curve = Curve([circle_2, list_item_4])  # disabled
rotate_3d_3 = Rotate3D(Geometry=mirror.Geometry, Angle=degrees(number_slider_14), Center=Point(0, 0, 0), Axis=Vector(0, 0, 1))  # -> Geometry, Transform; disabled
list_item_5 = ListItem(List=rotate_3d_3.Geometry, Index=0, Wrap=True)  # disabled
panel_19 = Panel(rotate_3d_3.Geometry)  # disabled
rotate_3d_4 = Rotate3D(Geometry=mirror_2.Geometry, Angle=degrees(number_slider_14), Center=Point(0, 0, 0), Axis=Vector(0, 0, 1))  # -> Geometry, Transform; disabled
list_item_6 = ListItem(List=interpolate.Curve, Index=0, Wrap=True)  # disabled
plane_normal_3 = PlaneNormal(Origin=list_item_5, ZAxis=Vector(0, 0, 1))  # disabled
loft = Loft(Curves=flatten(curve), Options={Adjust=True, Closed=False, LoftEnds=0, LoftSimp=0, LoftType=1, Rebuild=7, Refit=0.01})  # disabled
circle_3 = Circle(Plane=plane_normal_3, Radius=number_slider_13)  # disabled
curve_2 = Curve([list_item_6, circle_3])  # disabled
number_slider_15 = Slider(0, range=0..1)  # disabled
number_slider_16 = Slider(0, range=0..1)  # disabled
number_slider_17 = Slider(1, range=0..5)  # disabled
boolean_toggle = BooleanToggle(True)  # disabled
loft_options = LoftOptions(Closed=False, Adjust=boolean_toggle, Rebuild=number_slider_15, Refit=number_slider_16, Type=number_slider_17)  # disabled
loft_2 = Loft(Curves=flatten(curve_2), Options=loft_options)  # disabled

panel_20 = Panel(interpolate.Curve)
_2 = Integer(2)
loft_3 = Loft(
    Curves=interpolate.Curve,
    Options={Adjust=False, Closed=False, LoftEnds=0, LoftSimp=0, LoftType=1, Rebuild=10, Refit=0.01})
divide_surface = DivideSurface(Surface=loft_3, UCount=number_of_lists, VCount=_2)  # -> Points, Normals, Parameters
panel_21 = Panel(divide_surface.Points)
list_item_7 = ListItem(List=divide_surface.Points, Index=Slider(1, range=0..1), Wrap=True)
panel_22 = Panel(list_item_7)
deconstruct = Deconstruct(Point=list_item_7)  # -> XComponent, YComponent, ZComponent
panel_23 = Panel(deconstruct.YComponent)
data_recorder_3 = DataRecorder(deconstruct.YComponent, DataLimit=10, RecordData=True)
panel_24 = Panel(data_recorder_3)
average = Average(Input=data_recorder_3)
panel_25 = Panel(average)
