# Grasshopper definition vectorgraphics_LOFT_06.gh (Grasshopper 1.0.7)
# plug-ins: Firefly.X, Firefly.Core

integer = Integer(1)
timer = Timer(TimerInterval=20, Target=data_recorder)
data_recorder = DataRecorder(integer, DataLimit=-360, RecordData=True)

ports_available = COMPortsAvailable()
panel = Panel(ports_available)
open_port = OpenClosePort(OpenClosePort=Toggle(True), PortNumber="4", BaudRate=115200)
panel_2 = Panel(open_port)
timer_2 = Timer(TimerInterval=20, Target=[uno_read, serial_read_generic])
uno_read = UnoRead(StartReadingValues=Toggle(True), PortNumber="4")  # -> AnalogPin0, AnalogPin1, AnalogPin2, AnalogPin3, AnalogPin4, AnalogPin5, DigitalPin2, DigitalPin4, DigitalPin7, StatusMessage
uno_write = UnoWrite(
    StartWritingValues=Toggle(False),
    DigitalPin13=0,
    DigitalPin12=0,
    DigitalPin11=0,
    DigitalPin10=0,
    DigitalPin9=0,
    DigitalPin8=0,
    DigitalPin6=0,
    DigitalPin5=0,
    DigitalPin3=0,
    PortNumber="4")  # -> ArduinoOutput, StatusMessage
timer_3 = Timer(TimerInterval=20, Target=uno_write)
panel_3 = Panel(uno_read.AnalogPin0)
panel_4 = Panel(uno_write.StatusMessage)
panel_5 = Panel(uno_write.ArduinoOutput)
panel_6 = Panel(uno_read.AnalogPin1)
panel_7 = Panel(uno_read.DigitalPin4)
panel_8 = Panel(uno_read.DigitalPin2)
panel_9 = Panel(uno_read.DigitalPin7)
panel_10 = Panel(uno_read.AnalogPin5)
panel_11 = Panel(uno_read.AnalogPin4)
panel_12 = Panel(uno_read.AnalogPin2)
panel_13 = Panel(uno_read.AnalogPin3)
panel_14 = Panel(uno_read.StatusMessage)
number_slider = Slider(4, range=0..10)
serial_read_generic = SerialReadGeneric(StartReadingValues=Toggle(True), PortNumber=number_slider)  # -> SerialOutput, StatusMessage
panel_15 = Panel(serial_read_generic.StatusMessage)
panel_16 = Panel(serial_read_generic.SerialOutput)

mass_addition = MassAddition(Input=data_recorder)  # -> Result, PartialResults
panel_17 = Panel(mass_addition.Result)
multiplication = Multiplication(A=panel_17, B=Slider(2, range=0..10))
number_of_lists = Slider(8, range=0..10)
series = Series(Start=panel_17, Step=multiplication, Count=number_of_lists)
height_between_loft_segments = Slider(1, range=0..10)
panel_18 = Panel(series)
_1 = Integer(1)
random = Random(Range=Domain(0, 1), Number=_1, Seed=series)
panel_19 = Panel(random)
addition = Addition(A=_1, B=height_between_loft_segments)
increse_distance_from_centre = Slider(2, range=0..5)
unit_z = UnitZ(Factor=_1)
series_2 = Series(Start=unit_z, Step=addition, Count=number_of_lists)
list_length = ListLength(List=series_2)
list_item = ListItem(List=series_2, Index=expr("x-1", list_length), Wrap=True)
addition_2 = Addition(A=random, B=increse_distance_from_centre)  # -> flatten(Result)

panel_20 = Panel(series_2)
list_length_2 = ListLength(List=series_2)
list_item_2 = ListItem(List=series_2, Index=expr("x-1", list_length_2), Wrap=True)
list_item_3 = ListItem(List=series_2, Index=0, Wrap=True)
integer_2 = Integer(-10)
construct_point = ConstructPoint(XCoordinate=integer_2, YCoordinate=0, ZCoordinate=list_item_2)
construct_point_2 = ConstructPoint(XCoordinate=integer_2, YCoordinate=0, ZCoordinate=list_item_3)
line = Line(StartPoint=construct_point_2, EndPoint=construct_point)
divide_curve = DivideCurve(Curve=line, Count=number_of_lists, Kinks=False)  # -> Points, Tangents, Parameters
unit_x = UnitX(Factor=addition_2)
move = Move(Geometry=divide_curve.Points, Motion=unit_x)  # -> Geometry, Transform
line_2 = Line(StartPoint=divide_curve.Points, EndPoint=move.Geometry)

integer_3 = Integer(-3)
_0 = Integer(0)
construct_point_3 = ConstructPoint(XCoordinate=_0, YCoordinate=_0, ZCoordinate=_0)
construct_point_4 = ConstructPoint(XCoordinate=addition_2, YCoordinate=_0, ZCoordinate=series_2)
panel_21 = Panel(construct_point_4)
number_slider_2 = Slider(36, range=0..100)
multiplication_2 = Multiplication(A=mass_addition.Result, B=number_slider_2)
series_3 = Series(Start=multiplication_2, Step=30, Count=number_of_lists)
rotate_3d = Rotate3D(Geometry=construct_point_4, Angle=degrees(series_3), Center=construct_point_3, Axis=unit_z)  # -> graft(Geometry), Transform
panel_22 = Panel(series_3)
panel_23 = Panel(rotate_3d.Geometry)
division = Division(A=Slider(360, range=0..1000), B=number_slider_2)
panel_24 = Panel(division)

frame_rate = FrameRate()  # -> simplify(flatten(RefreshRate)), Frequency
panel_25 = Panel(frame_rate.RefreshRate)
panel_26 = Panel(frame_rate.Frequency)

set_wrist_rotation = Slider(146, range=0..180)
set_wrist = Slider(103, range=0..180)
set_gripper = Slider(73, range=10..73)
set_elbow = Slider(96, range=0..180)
set_base = Slider(180, range=0..180)
set_shoulder = Slider(49, range=15..165)
panel_27 = Panel(["P", set_base, set_shoulder, set_elbow, set_wrist_rotation, set_wrist, set_gripper, Slider(64, range=0..200)])
text_join = TextJoin(Text=panel_27, Join=",")
panel_28 = Panel(text_join)
write = SerialWriteGeneric(StartWritingValues=Button(), WriteData="P90,90,90,90,90,50,50", PortNumber=number_slider)  # -> ArduinoOutput, StatusMessage
write_2 = SerialWriteGeneric(StartWritingValues=Button(), WriteData=panel_28, PortNumber=number_slider)  # -> ArduinoOutput, StatusMessage
write_3 = SerialWriteGeneric(StartWritingValues=Button(), WriteData=Slider(1, range=0..1), PortNumber=number_slider)  # -> ArduinoOutput, StatusMessage
write_4 = SerialWriteGeneric(StartWritingValues=Button(), WriteData=Slider(0, range=0..1), PortNumber=number_slider)  # -> ArduinoOutput, StatusMessage
data_recorder_2 = DataRecorder(
    [write_4.ArduinoOutput, write_2.ArduinoOutput, write.ArduinoOutput, write_3.ArduinoOutput],
    DataLimit=-10,
    RecordData=True)
panel_29 = Panel(data_recorder_2)

integer_4 = Integer(1)  # disabled
timer_4 = Timer(TimerInterval=20, Target=data_recorder_3)  # disabled
data_recorder_3 = DataRecorder(integer_4, DataLimit=-360, RecordData=True)  # disabled
mass_addition_2 = MassAddition(Input=data_recorder_3)  # -> Result, PartialResults; disabled
height_between_loft_segments_2 = Slider(4, range=0..10)  # disabled
_1_2 = Integer(1)  # disabled
number_of_lists_2 = Slider(10, range=0..30)  # disabled
number_slider_3 = Slider(1, range=0..10)  # disabled
addition_3 = Addition(A=_1_2, B=height_between_loft_segments_2)  # disabled
addition_4 = Addition(A=list_item, B=7)  # disabled
unit_z_2 = UnitZ(Factor=_1_2)  # disabled
series_4 = Series(Start=number_slider_3, Step=1, Count=number_of_lists_2)  # disabled
series_5 = Series(Start=addition_4, Step=addition_3, Count=number_of_lists_2)  # disabled
multiplication_3 = Multiplication(A=series_4, B=series_4)  # disabled
_0_2 = Integer(0)  # disabled
integer_5 = Integer(-3)  # disabled
_1_3 = Integer(1)  # disabled
panel_30 = Panel(multiplication_3)  # disabled
construct_point_5 = ConstructPoint(XCoordinate=multiplication_3, YCoordinate=_0_2, ZCoordinate=series_5)  # disabled
construct_point_6 = ConstructPoint(XCoordinate=_0_2, YCoordinate=_0_2, ZCoordinate=_0_2)  # disabled
panel_31 = Panel(construct_point_5)  # disabled
number_slider_4 = Slider(35, range=0..100)  # disabled
number_slider_5 = Slider(9, range=0..10)  # disabled
integer_6 = Integer(1)  # disabled
series_6 = Series(Start=mass_addition_2.Result, Step=number_slider_4, Count=number_of_lists_2)  # disabled
multiplication_4 = Multiplication(A=series_6, B=number_slider_5)  # disabled
rotate_3d_2 = Rotate3D(Geometry=construct_point_5, Angle=degrees(multiplication_4), Center=construct_point_6, Axis=unit_z_2)  # -> flatten(Geometry), Transform; disabled
panel_32 = Panel(series_6)  # disabled
number_slider_6 = Slider(0.8, range=0..1)  # disabled
panel_33 = Panel(rotate_3d_2.Geometry)  # disabled
interpolate_t = InterpolateT(Vertices=rotate_3d_2.Geometry, TangentStart=Vector(0, 0, 0), TangentEnd=Vector(0, 0, 0), KnotStyle=1)  # -> Curve, Length, Domain; disabled
number_slider_7 = Slider(60, range=0..100)  # disabled
multiplication_5 = Multiplication(A=mass_addition_2.Result, B=number_slider_6)  # disabled
divide_curve_2 = DivideCurve(Curve=interpolate_t.Curve, Count=number_slider_7, Kinks=False)  # -> Points, Tangents, Parameters; disabled
panel_34 = Panel(divide_curve_2.Points)  # disabled
number_slider_8 = Slider(4, range=0..10)  # disabled
number_slider_9 = Slider(10, range=0..10)  # disabled
series_7 = Series(Start=multiplication_5, Step=1, Count=number_slider_9)  # disabled
sine = Sine(Value=series_7)  # disabled
unit_z_3 = UnitZ(Factor=sine)  # disabled
multiplication_6 = Multiplication(A=unit_z_3, B=number_slider_8)  # disabled
number_slider_10 = Slider(2, range=0..10)  # disabled
number_slider_11 = Slider(0, range=0..10)  # disabled
panel_35 = Panel(multiplication_6)  # disabled
series_8 = Series(Start=number_slider_11, Step=number_slider_10, Count=number_slider_9)  # disabled
panel_36 = Panel(series_8)  # disabled
number_slider_12 = Slider(6, range=0..10)  # disabled
division_2 = Division(A=panel_36, B=number_slider_12)  # disabled
panel_37 = Panel(division_2)  # disabled
multiplication_7 = Multiplication(A=series_8, B=panel_37)  # disabled
number_slider_13 = Slider(2, range=0..10)  # disabled
integer_7 = Integer(multiplication_7)  # disabled
list_item_4 = ListItem(List=divide_curve_2.Points, Index=integer_7, Wrap=True)  # disabled
move_2 = Move(Geometry=list_item_4, Motion=multiplication_6)  # -> Geometry, Transform; disabled
division_3 = Division(A=list_item, B=number_slider_13)  # disabled
construct_point_7 = ConstructPoint(XCoordinate=0, YCoordinate=0, ZCoordinate=division_3)  # disabled
unit_z_4 = UnitZ(Factor=1)  # disabled
list_item_5 = ListItem(List=move_2.Geometry, Index=0, Wrap=True)  # disabled
number_slider_14 = Slider(2.3, range=0..5)  # disabled
interpolate_t_2 = InterpolateT(Vertices=move_2.Geometry, TangentStart=unit_z_4, TangentEnd=Vector(0, 0, 0), KnotStyle=1)  # -> Curve, Length, Domain; disabled
plane_normal = PlaneNormal(Origin=construct_point_7, ZAxis=Vector(0, 0, 1))  # disabled
plane_normal_2 = PlaneNormal(Origin=list_item_5, ZAxis=Vector(0, 0, 1))  # disabled
circle = Circle(Plane=plane_normal_2, Radius=number_slider_14)  # disabled
pipe = Pipe(Curve=interpolate_t_2.Curve, Radius=number_slider_14, Caps=0)  # disabled
mirror = Mirror(Geometry=move_2.Geometry, Plane=plane_normal)  # -> Geometry, Transform; disabled
number_slider_15 = Slider(180, range=0..360)  # disabled
panel_38 = Panel(pipe)  # disabled
mirror_2 = Mirror(Geometry=pipe, Plane=plane_normal)  # -> Geometry, Transform; disabled
rotate_3d_3 = Rotate3D(Geometry=mirror.Geometry, Angle=degrees(number_slider_15), Center=Point(0, 0, 0), Axis=Vector(0, 0, 1))  # -> Geometry, Transform; disabled
list_item_6 = ListItem(List=rotate_3d_3.Geometry, Index=0, Wrap=True)  # disabled
panel_39 = Panel(rotate_3d_3.Geometry)  # disabled
rotate_3d_4 = Rotate3D(Geometry=mirror_2.Geometry, Angle=degrees(number_slider_15), Center=Point(0, 0, 0), Axis=Vector(0, 0, 1))  # -> Geometry, Transform; disabled
plane_normal_3 = PlaneNormal(Origin=list_item_6, ZAxis=Vector(0, 0, 1))  # disabled
circle_2 = Circle(Plane=plane_normal_3, Radius=number_slider_14)  # disabled
number_slider_16 = Slider(0, range=0..1)  # disabled
number_slider_17 = Slider(0, range=0..1)  # disabled
number_slider_18 = Slider(1, range=0..5)  # disabled
boolean_toggle = BooleanToggle(True)  # disabled
loft_options = LoftOptions(Closed=False, Adjust=boolean_toggle, Rebuild=number_slider_16, Refit=number_slider_17, Type=number_slider_18)  # disabled

data_rec = PythonScript(x=rotate_3d.Geometry, enable=Toggle(True), reset=Button(), limit=panel_24)  # -> x; inputs x: tree, enable: Boolean, reset: Boolean, limit: Int32
# ---------- data_rec: Python ----------
from Grasshopper import DataTree
if reset or 'rec' not in globals(): rec = DataTree[object]()
if enable and not reset: rec.MergeTree(x)
if limit > 0:
  for branch in rec.Branches:
    if branch.Count > limit:
      branch.RemoveRange(0, branch.Count - limit)
x = rec
# ---------- end data_rec ----------
panel_40 = Panel(data_rec)
interpolate = Interpolate(Vertices=data_rec, Degree=Slider(5, range=1..11), Periodic=True, KnotStyle=1)  # -> flatten(Curve), Length, Domain
panel_41 = Panel(interpolate.Curve)
_2 = Integer(2)

list_length_3 = ListLength(List=interpolate.Curve)  # disabled
list_item_7 = ListItem(List=interpolate.Curve, Index=expr("x-1", list_length_3), Wrap=True)  # disabled
curve = Curve([circle, list_item_7])  # disabled
list_item_8 = ListItem(List=interpolate.Curve, Index=0, Wrap=True)  # disabled
curve_2 = Curve([list_item_8, circle_2])  # disabled
loft = Loft(Curves=flatten(curve), Options={Adjust=True, Closed=False, LoftEnds=0, LoftSimp=0, LoftType=1, Rebuild=7, Refit=0.01})  # disabled
loft_2 = Loft(Curves=flatten(curve_2), Options=loft_options)  # disabled

loft_3 = Loft(
    Curves=interpolate.Curve,
    Options={Adjust=False, Closed=False, LoftEnds=0, LoftSimp=0, LoftType=1, Rebuild=10, Refit=0.01})

divide_surface = DivideSurface(Surface=loft_3, UCount=Slider(7, range=0..10), VCount=_2)  # -> Points, Normals, Parameters
panel_42 = Panel(divide_surface.Points)
list_item_9 = ListItem(List=divide_surface.Points, Index=Slider(1, range=0..1), Wrap=True)
panel_43 = Panel(list_item_9)
deconstruct = Deconstruct(Point=list_item_9)  # -> XComponent, YComponent, ZComponent

multiplication_8 = Multiplication(A=deconstruct.XComponent, B=deconstruct.XComponent)
multiplication_9 = Multiplication(A=deconstruct.YComponent, B=deconstruct.YComponent)
addition_5 = Addition(A=multiplication_8, B=multiplication_9)
square_root = SquareRoot(Value=addition_5)
panel_44 = Panel(square_root)
panel_45 = Panel(deconstruct.ZComponent)
construct_point_8 = ConstructPoint(XCoordinate=integer_2, YCoordinate=0, ZCoordinate=panel_45)
unit_x_2 = UnitX(Factor=panel_44)
move_3 = Move(Geometry=construct_point_8, Motion=unit_x_2)  # -> Geometry, Transform
line_3 = Line(StartPoint=construct_point_8, EndPoint=move_3.Geometry)
