# Grasshopper definition vectorgraphics_LOFT_07 (Broke).gh (Grasshopper 1.0.7)
# plug-ins: Firefly.X, Firefly.Core

frame_rate = FrameRate()  # -> simplify(flatten(RefreshRate)), Frequency
panel = Panel(frame_rate.RefreshRate)
panel_2 = Panel(frame_rate.Frequency)

integer = Integer(1)
timer = Timer(TimerInterval=20, Target=data_recorder)
data_recorder = DataRecorder(integer, DataLimit=-360, RecordData=True)

ports_available = COMPortsAvailable()
panel_3 = Panel(ports_available)
open_port = OpenClosePort(OpenClosePort=Toggle(True), PortNumber="4", BaudRate=115200)
panel_4 = Panel(open_port)
timer_2 = Timer(TimerInterval=20, Target=[uno_read, serial_read_generic])
uno_write = UnoWrite(
    StartWritingValues=Toggle(False),
    DigitalPin13=0,
    DigitalPin12=0,
    DigitalPin11=0,
    DigitalPin10=0,
    DigitalPin9=0,
    DigitalPin8=0,
    DigitalPin6=0,
    DigitalPin5=0,
    DigitalPin3=0,
    PortNumber="4")  # -> ArduinoOutput, StatusMessage
uno_read = UnoRead(StartReadingValues=Toggle(True), PortNumber="4")  # -> AnalogPin0, AnalogPin1, AnalogPin2, AnalogPin3, AnalogPin4, AnalogPin5, DigitalPin2, DigitalPin4, DigitalPin7, StatusMessage
timer_3 = Timer(TimerInterval=20, Target=uno_write)
panel_5 = Panel(uno_read.AnalogPin0)
panel_6 = Panel(uno_write.StatusMessage)
panel_7 = Panel(uno_write.ArduinoOutput)
panel_8 = Panel(uno_read.AnalogPin1)
panel_9 = Panel(uno_read.DigitalPin4)
panel_10 = Panel(uno_read.DigitalPin2)
panel_11 = Panel(uno_read.DigitalPin7)
panel_12 = Panel(uno_read.AnalogPin5)
panel_13 = Panel(uno_read.AnalogPin4)
panel_14 = Panel(uno_read.AnalogPin2)
panel_15 = Panel(uno_read.AnalogPin3)
panel_16 = Panel(uno_read.StatusMessage)
number_slider = Slider(4, range=0..10)
serial_read_generic = SerialReadGeneric(StartReadingValues=Toggle(True), PortNumber=number_slider)  # -> SerialOutput, StatusMessage
panel_17 = Panel(serial_read_generic.StatusMessage)
panel_18 = Panel(serial_read_generic.SerialOutput)

mass_addition = MassAddition(Input=data_recorder)  # -> Result, PartialResults
panel_19 = Panel(mass_addition.Result)
multiplication = Multiplication(A=panel_19, B=Slider(2, range=0..10))
number_of_lists = Slider(8, range=0..10)
series = Series(Start=panel_19, Step=multiplication, Count=number_of_lists)
height_between_loft_segments = Slider(1, range=0..10)
panel_20 = Panel(series)
_1 = Integer(1)
random = Random(Range=Domain(0, 1), Number=_1, Seed=series)
panel_21 = Panel(random)
addition = Addition(A=_1, B=height_between_loft_segments)
increse_distance_from_centre = Slider(2, range=0..5)
unit_z = UnitZ(Factor=_1)
series_2 = Series(Start=unit_z, Step=addition, Count=number_of_lists)
list_length = ListLength(List=series_2)
list_item = ListItem(List=series_2, Index=expr("x-1", list_length), Wrap=True)
addition_2 = Addition(A=random, B=increse_distance_from_centre)  # -> flatten(Result)

panel_22 = Panel(series_2)
list_length_2 = ListLength(List=series_2)
list_item_2 = ListItem(List=series_2, Index=expr("x-1", list_length_2), Wrap=True)
list_item_3 = ListItem(List=series_2, Index=0, Wrap=True)
integer_2 = Integer(-10)
construct_point = ConstructPoint(XCoordinate=integer_2, YCoordinate=0, ZCoordinate=list_item_2)
construct_point_2 = ConstructPoint(XCoordinate=integer_2, YCoordinate=0, ZCoordinate=list_item_3)
line = Line(StartPoint=construct_point_2, EndPoint=construct_point)
divide_curve = DivideCurve(Curve=line, Count=number_of_lists, Kinks=False)  # -> Points, Tangents, Parameters
unit_x = UnitX(Factor=addition_2)
move = Move(Geometry=divide_curve.Points, Motion=unit_x)  # -> Geometry, Transform
line_2 = Line(StartPoint=divide_curve.Points, EndPoint=move.Geometry)

integer_3 = Integer(-3)
_0 = Integer(0)
construct_point_3 = ConstructPoint(XCoordinate=_0, YCoordinate=_0, ZCoordinate=_0)
construct_point_4 = ConstructPoint(XCoordinate=addition_2, YCoordinate=_0, ZCoordinate=series_2)
panel_23 = Panel(construct_point_4)
number_slider_2 = Slider(36, range=0..100)
multiplication_2 = Multiplication(A=mass_addition.Result, B=number_slider_2)
series_3 = Series(Start=multiplication_2, Step=30, Count=number_of_lists)
panel_24 = Panel(series_3)
rotate_3d = Rotate3D(Geometry=construct_point_4, Angle=degrees(series_3), Center=construct_point_3, Axis=unit_z)  # -> graft(Geometry), Transform
panel_25 = Panel(rotate_3d.Geometry)
division = Division(A=Slider(360, range=0..1000), B=number_slider_2)
panel_26 = Panel(division)
set_wrist_rotation = Slider(146, range=0..180)
set_wrist = Slider(103, range=0..180)
set_gripper = Slider(73, range=10..73)
set_elbow = Slider(96, range=0..180)
set_base = Slider(180, range=0..180)
set_shoulder = Slider(49, range=15..165)
panel_27 = Panel(["P", set_base, set_shoulder, set_elbow, set_wrist_rotation, set_wrist, set_gripper, Slider(64, range=0..200)])
text_join = TextJoin(Text=panel_27, Join=",")
panel_28 = Panel(text_join)
construct_domain = ConstructDomain(DomainStart=Slider(1.9, range=0..10), DomainEnd=Slider(3.1, range=0..10))
construct_domain_2 = ConstructDomain(DomainStart=Slider(0, range=0..100), DomainEnd=Slider(1, range=0..1))
write = SerialWriteGeneric(StartWritingValues=Button(), WriteData="P90,90,90,90,90,50,50", PortNumber=number_slider)  # -> ArduinoOutput, StatusMessage
write_2 = SerialWriteGeneric(StartWritingValues=Button(), WriteData=panel_28, PortNumber=number_slider)  # -> ArduinoOutput, StatusMessage
write_3 = SerialWriteGeneric(StartWritingValues=Button(), WriteData=Slider(1, range=0..1), PortNumber=number_slider)  # -> ArduinoOutput, StatusMessage
write_4 = SerialWriteGeneric(StartWritingValues=Button(), WriteData=Slider(0, range=0..1), PortNumber=number_slider)  # -> ArduinoOutput, StatusMessage
data_recorder_2 = DataRecorder(
    [write_4.ArduinoOutput, write_2.ArduinoOutput, write.ArduinoOutput, write_3.ArduinoOutput],
    DataLimit=-10,
    RecordData=True)
panel_29 = Panel(data_recorder_2)
construct_domain_3 = ConstructDomain(DomainStart=Slider(15, range=15..100), DomainEnd=Slider(165, range=0..165))
construct_domain_4 = ConstructDomain(DomainStart=Slider(10, range=10..72), DomainEnd=Slider(72, range=10..72))
construct_domain_5 = ConstructDomain(DomainStart=Slider(0, range=0..100), DomainEnd=Slider(180, range=0..180))
panel_30 = Panel(construct_domain_5)
data_dam = DataDam(DataA=Slider(1, range=0..1), BufferDelay=10000000, BufferMode=2)
write_5 = SerialWriteGeneric(StartWritingValues=Button(), WriteData=Slider(0, range=0..1), PortNumber=number_slider)  # -> ArduinoOutput, StatusMessage
write_6 = SerialWriteGeneric(StartWritingValues=Button(), WriteData=Slider(1, range=0..1), PortNumber=number_slider)  # -> ArduinoOutput, StatusMessage
write_7 = SerialWriteGeneric(StartWritingValues=Button(), WriteData="P90,90,90,90,90,72,50", PortNumber=number_slider)  # -> ArduinoOutput, StatusMessage

integer_4 = Integer(1)
timer_4 = Timer(TimerInterval=20, Target=data_recorder_3)
data_recorder_3 = DataRecorder(integer_4, DataLimit=-360, RecordData=True)
mass_addition_2 = MassAddition(Input=data_recorder_3)  # -> Result, PartialResults
height_between_loft_segments_2 = Slider(4, range=0..10)
_1_2 = Integer(1)
number_of_lists_2 = Slider(10, range=0..30)
addition_3 = Addition(A=_1_2, B=height_between_loft_segments_2)
addition_4 = Addition(A=list_item, B=7)
unit_z_2 = UnitZ(Factor=_1_2)
series_4 = Series(Start=Slider(1, range=0..10), Step=1, Count=number_of_lists_2)
series_5 = Series(Start=addition_4, Step=addition_3, Count=number_of_lists_2)
multiplication_3 = Multiplication(A=series_4, B=series_4)
_0_2 = Integer(0)
integer_5 = Integer(-3)
_1_3 = Integer(1)
panel_31 = Panel(multiplication_3)
construct_point_5 = ConstructPoint(XCoordinate=multiplication_3, YCoordinate=_0_2, ZCoordinate=series_5)
construct_point_6 = ConstructPoint(XCoordinate=_0_2, YCoordinate=_0_2, ZCoordinate=_0_2)
panel_32 = Panel(construct_point_5)
integer_6 = Integer(1)
series_6 = Series(Start=mass_addition_2.Result, Step=Slider(35, range=0..100), Count=number_of_lists_2)
multiplication_4 = Multiplication(A=series_6, B=Slider(9, range=0..10))
rotate_3d_2 = Rotate3D(Geometry=construct_point_5, Angle=degrees(multiplication_4), Center=construct_point_6, Axis=unit_z_2)  # -> flatten(Geometry), Transform
panel_33 = Panel(series_6)
panel_34 = Panel(rotate_3d_2.Geometry)
interpolate_t = InterpolateT(Vertices=rotate_3d_2.Geometry, TangentStart=Vector(0, 0, 0), TangentEnd=Vector(0, 0, 0), KnotStyle=1)  # -> Curve, Length, Domain
multiplication_5 = Multiplication(A=mass_addition_2.Result, B=Slider(0.8, range=0..1))
divide_curve_2 = DivideCurve(Curve=interpolate_t.Curve, Count=Slider(60, range=0..100), Kinks=False)  # -> Points, Tangents, Parameters
panel_35 = Panel(divide_curve_2.Points)
number_slider_3 = Slider(10, range=0..10)
series_7 = Series(Start=multiplication_5, Step=1, Count=number_slider_3)
sine = Sine(Value=series_7)
unit_z_3 = UnitZ(Factor=sine)
multiplication_6 = Multiplication(A=unit_z_3, B=Slider(4, range=0..10))
panel_36 = Panel(multiplication_6)
series_8 = Series(Start=Slider(0, range=0..10), Step=Slider(2, range=0..10), Count=number_slider_3)
panel_37 = Panel(series_8)
division_2 = Division(A=panel_37, B=Slider(6, range=0..10))
panel_38 = Panel(division_2)
multiplication_7 = Multiplication(A=series_8, B=panel_38)
integer_7 = Integer(multiplication_7)
list_item_4 = ListItem(List=divide_curve_2.Points, Index=integer_7, Wrap=True)
move_2 = Move(Geometry=list_item_4, Motion=multiplication_6)  # -> Geometry, Transform
division_3 = Division(A=list_item, B=Slider(2, range=0..10))
construct_point_7 = ConstructPoint(XCoordinate=0, YCoordinate=0, ZCoordinate=division_3)
unit_z_4 = UnitZ(Factor=1)
list_item_5 = ListItem(List=move_2.Geometry, Index=0, Wrap=True)
number_slider_4 = Slider(2.3, range=0..5)
interpolate_t_2 = InterpolateT(Vertices=move_2.Geometry, TangentStart=unit_z_4, TangentEnd=Vector(0, 0, 0), KnotStyle=1)  # -> Curve, Length, Domain
plane_normal = PlaneNormal(Origin=construct_point_7, ZAxis=Vector(0, 0, 1))
plane_normal_2 = PlaneNormal(Origin=list_item_5, ZAxis=Vector(0, 0, 1))
circle = Circle(Plane=plane_normal_2, Radius=number_slider_4)
mirror = Mirror(Geometry=move_2.Geometry, Plane=plane_normal)  # -> Geometry, Transform
number_slider_5 = Slider(180, range=0..360)
rotate_3d_3 = Rotate3D(Geometry=mirror.Geometry, Angle=degrees(number_slider_5), Center=Point(0, 0, 0), Axis=Vector(0, 0, 1))  # -> Geometry, Transform
list_item_6 = ListItem(List=rotate_3d_3.Geometry, Index=0, Wrap=True)
panel_39 = Panel(rotate_3d_3.Geometry)
plane_normal_3 = PlaneNormal(Origin=list_item_6, ZAxis=Vector(0, 0, 1))
circle_2 = Circle(Plane=plane_normal_3, Radius=number_slider_4)
loft_options = LoftOptions(
    Closed=False,
    Adjust=Toggle(True),
    Rebuild=Slider(0, range=0..1),
    Refit=Slider(0, range=0..1),
    Type=Slider(1, range=0..5))
pipe = Pipe(Curve=interpolate_t_2.Curve, Radius=number_slider_4, Caps=0)
panel_40 = Panel(pipe)
mirror_2 = Mirror(Geometry=pipe, Plane=plane_normal)  # -> Geometry, Transform
rotate_3d_4 = Rotate3D(Geometry=mirror_2.Geometry, Angle=degrees(number_slider_5), Center=Point(0, 0, 0), Axis=Vector(0, 0, 1))  # -> Geometry, Transform

data_rec = PythonScript(x=rotate_3d.Geometry, enable=Toggle(True), reset=Button(), limit=panel_26)  # -> x; inputs x: tree, enable: Boolean, reset: Boolean, limit: Int32
# ---------- data_rec: Python ----------
from Grasshopper import DataTree
if reset or 'rec' not in globals(): rec = DataTree[object]()
if enable and not reset: rec.MergeTree(x)
if limit > 0:
  for branch in rec.Branches:
    if branch.Count > limit:
      branch.RemoveRange(0, branch.Count - limit)
x = rec
# ---------- end data_rec ----------
panel_41 = Panel(data_rec)
interpolate = Interpolate(Vertices=data_rec, Degree=Slider(5, range=1..11), Periodic=True, KnotStyle=1)  # -> flatten(Curve), Length, Domain
panel_42 = Panel(interpolate.Curve)
_2 = Integer(2)

list_length_3 = ListLength(List=interpolate.Curve)
list_item_7 = ListItem(List=interpolate.Curve, Index=expr("x-1", list_length_3), Wrap=True)
curve = Curve([circle, list_item_7])
list_item_8 = ListItem(List=interpolate.Curve, Index=0, Wrap=True)
curve_2 = Curve([list_item_8, circle_2])
loft = Loft(Curves=flatten(curve), Options={Adjust=True, Closed=False, LoftEnds=0, LoftSimp=0, LoftType=1, Rebuild=7, Refit=0.01})
loft_2 = Loft(Curves=flatten(curve_2), Options=loft_options)

loft_3 = Loft(
    Curves=interpolate.Curve,
    Options={Adjust=False, Closed=False, LoftEnds=0, LoftSimp=0, LoftType=1, Rebuild=10, Refit=0.01})

divide_surface = DivideSurface(Surface=loft_3, UCount=Slider(7, range=0..10), VCount=_2)  # -> Points, Normals, Parameters
panel_43 = Panel(divide_surface.Points)
list_item_9 = ListItem(List=divide_surface.Points, Index=Slider(1, range=0..1), Wrap=True)
panel_44 = Panel(list_item_9)
deconstruct = Deconstruct(Point=list_item_9)  # -> XComponent, YComponent, ZComponent

multiplication_8 = Multiplication(A=deconstruct.XComponent, B=deconstruct.XComponent)
multiplication_9 = Multiplication(A=deconstruct.YComponent, B=deconstruct.YComponent)
addition_5 = Addition(A=multiplication_8, B=multiplication_9)
square_root = SquareRoot(Value=addition_5)
panel_45 = Panel(square_root)
panel_46 = Panel(deconstruct.ZComponent)
construct_point_8 = ConstructPoint(XCoordinate=integer_2, YCoordinate=0, ZCoordinate=panel_46)
remap_numbers = RemapNumbers(Value=square_root, Source=construct_domain, Target=construct_domain_2)  # -> flatten(Mapped), Clipped
unit_x_2 = UnitX(Factor=square_root)
move_3 = Move(Geometry=construct_point_8, Motion=unit_x_2)  # -> Geometry, Transform
line_3 = Line(StartPoint=construct_point_8, EndPoint=move_3.Geometry)
panel_47 = Panel(remap_numbers.Mapped)
list_item_10 = ListItem(List=remap_numbers.Mapped, Index=Slider(6, range=0..10), Wrap=True)
list_item_11 = ListItem(List=remap_numbers.Mapped, Index=Slider(1, range=0..10), Wrap=True)
list_item_12 = ListItem(List=remap_numbers.Mapped, Index=Slider(2, range=0..10), Wrap=True)
list_item_13 = ListItem(List=remap_numbers.Mapped, Index=Slider(3, range=0..10), Wrap=True)
list_item_14 = ListItem(List=remap_numbers.Mapped, Index=Slider(4, range=0..10), Wrap=True)
list_item_15 = ListItem(List=remap_numbers.Mapped, Index=Slider(5, range=0..10), Wrap=True)
remap_numbers_2 = RemapNumbers(Value=list_item_12, Source=construct_domain_2, Target=construct_domain_3)  # -> Mapped, Clipped
remap_numbers_3 = RemapNumbers(Value=list_item_11, Source=construct_domain_2, Target=construct_domain_5)  # -> Mapped, Clipped
remap_numbers_4 = RemapNumbers(Value=list_item_13, Source=construct_domain_2, Target=construct_domain_5)  # -> Mapped, Clipped
remap_numbers_5 = RemapNumbers(Value=list_item_14, Source=construct_domain_2, Target=construct_domain_5)  # -> Mapped, Clipped
remap_numbers_6 = RemapNumbers(Value=list_item_15, Source=construct_domain_2, Target=construct_domain_5)  # -> Mapped, Clipped
remap_numbers_7 = RemapNumbers(Value=list_item_10, Source=construct_domain_2, Target=construct_domain_4)  # -> Mapped, Clipped
panel_48 = Panel(remap_numbers_3.Mapped)
panel_49 = Panel(remap_numbers_2.Mapped)
panel_50 = Panel(remap_numbers_4.Mapped)
panel_51 = Panel(remap_numbers_5.Mapped)
panel_52 = Panel(remap_numbers_6.Mapped)
panel_53 = Panel(remap_numbers_7.Mapped)
integer_8 = Integer(remap_numbers_3.Mapped)
integer_9 = Integer(remap_numbers_2.Mapped)
integer_10 = Integer(remap_numbers_4.Mapped)
integer_11 = Integer(remap_numbers_5.Mapped)
integer_12 = Integer(remap_numbers_6.Mapped)
integer_13 = Integer(remap_numbers_7.Mapped)
panel_54 = Panel([integer_8, integer_9, integer_10, integer_11, integer_12, integer_13])
list_item_16 = ListItem(List=panel_54, Index=0, Wrap=True)
panel_55 = Panel(["P", list_item_16])
text_join_2 = TextJoin(Text=panel_55)
panel_56 = Panel([text_join_2, panel_54, "100"])
data_dam_2 = DataDam(DataA=panel_56, BufferDelay=10000000, BufferMode=2)
text_join_3 = TextJoin(Text=data_dam_2, Join=",")
panel_57 = Panel(text_join_3)
write_8 = SerialWriteGeneric(StartWritingValues=data_dam, WriteData=panel_57, PortNumber=number_slider)  # -> ArduinoOutput, StatusMessage
data_recorder_4 = DataRecorder(
    [write_5.ArduinoOutput, write_8.ArduinoOutput, write_7.ArduinoOutput, write_6.ArduinoOutput],
    DataLimit=-10,
    RecordData=True)
panel_58 = Panel(data_recorder_4)
