# Grasshopper definition vectorgraphics_LOFT_08(testing ground_two arduinos).gh (Grasshopper 1.0.7)
# plug-ins: Firefly.X, Firefly.Core

frame_rate = FrameRate()  # -> simplify(flatten(RefreshRate)), Frequency
panel = Panel(frame_rate.RefreshRate)
panel_2 = Panel(frame_rate.Frequency)

integer = Integer(1)
timer = Timer(TimerInterval=20, Target=data_recorder)  # disabled
data_recorder = DataRecorder(integer, DataLimit=-360, RecordData=True)

ports_available = COMPortsAvailable()
panel_3 = Panel(ports_available)
open_port = OpenClosePort(OpenClosePort=Toggle(True), PortNumber="3", BaudRate=115200)
panel_4 = Panel(open_port)
timer_2 = Timer(TimerInterval=20, Target=[uno_read, serial_read_generic])
uno_write = UnoWrite(
    StartWritingValues=Toggle(False),
    DigitalPin13=0,
    DigitalPin12=0,
    DigitalPin11=0,
    DigitalPin10=0,
    DigitalPin9=0,
    DigitalPin8=0,
    DigitalPin6=0,
    DigitalPin5=0,
    DigitalPin3=0,
    PortNumber="3")  # -> ArduinoOutput, StatusMessage
timer_3 = Timer(TimerInterval=20, Target=uno_write)
uno_read = UnoRead(StartReadingValues=Toggle(True), PortNumber="3")  # -> AnalogPin0, AnalogPin1, AnalogPin2, AnalogPin3, AnalogPin4, AnalogPin5, DigitalPin2, DigitalPin4, DigitalPin7, StatusMessage
panel_5 = Panel(uno_read.AnalogPin0)
panel_6 = Panel(uno_write.StatusMessage)
panel_7 = Panel(uno_write.ArduinoOutput)
panel_8 = Panel(uno_read.AnalogPin1)
panel_9 = Panel(uno_read.DigitalPin4)
panel_10 = Panel(uno_read.DigitalPin2)
panel_11 = Panel(uno_read.DigitalPin7)
panel_12 = Panel(uno_read.AnalogPin5)
panel_13 = Panel(uno_read.AnalogPin4)
panel_14 = Panel(uno_read.AnalogPin2)
panel_15 = Panel(uno_read.AnalogPin3)
panel_16 = Panel(uno_read.StatusMessage)
number_slider = Slider(4, range=0..10)
serial_read_generic = SerialReadGeneric(StartReadingValues=Toggle(True), PortNumber=number_slider)  # -> SerialOutput, StatusMessage
panel_17 = Panel(serial_read_generic.StatusMessage)
panel_18 = Panel(serial_read_generic.SerialOutput)

mass_addition = MassAddition(Input=data_recorder)  # -> Result, PartialResults
mass_addition_2 = MassAddition(Input=data_recorder)  # -> Result, PartialResults
panel_19 = Panel(mass_addition_2.Result)
multiplication = Multiplication(A=panel_19, B=Slider(2, range=0..10))
number_of_lists = Slider(8, range=0..10)
series = Series(Start=panel_19, Step=multiplication, Count=number_of_lists)
height_between_loft_segments = Slider(10, range=0..10)
height_between_loft_segments_2 = Slider(1, range=0..10)
panel_20 = Panel(series)
_1 = Integer(1)
_1_2 = Integer(1)
random = Random(Range=Domain(0, 1), Number=_1_2, Seed=series)
number_of_lists_2 = Slider(14, range=0..30)
panel_21 = Panel(random)
addition = Addition(A=_1, B=height_between_loft_segments)
addition_2 = Addition(A=_1_2, B=height_between_loft_segments_2)
unit_z = UnitZ(Factor=_1)
series_2 = Series(Start=Slider(1, range=0..10), Step=1, Count=number_of_lists_2)
increse_distance_from_centre = Slider(2, range=0..5)
unit_z_2 = UnitZ(Factor=_1_2)
multiplication_2 = Multiplication(A=series_2, B=series_2)
_0 = Integer(0)
integer_2 = Integer(-3)
_1_3 = Integer(1)
series_3 = Series(Start=unit_z_2, Step=addition_2, Count=number_of_lists)
list_length = ListLength(List=series_3)
list_item = ListItem(List=series_3, Index=expr("x-1", list_length), Wrap=True)
addition_3 = Addition(A=list_item, B=7)
panel_22 = Panel(list_item)
series_4 = Series(Start=addition_3, Step=addition, Count=number_of_lists_2)
addition_4 = Addition(A=random, B=increse_distance_from_centre)  # -> flatten(Result)

panel_23 = Panel(series_3)
list_length_2 = ListLength(List=series_3)
list_item_2 = ListItem(List=series_3, Index=expr("x-1", list_length_2), Wrap=True)
list_item_3 = ListItem(List=series_3, Index=0, Wrap=True)
integer_3 = Integer(-10)
construct_point = ConstructPoint(XCoordinate=integer_3, YCoordinate=0, ZCoordinate=list_item_2)
construct_point_2 = ConstructPoint(XCoordinate=integer_3, YCoordinate=0, ZCoordinate=list_item_3)
line = Line(StartPoint=construct_point_2, EndPoint=construct_point)
divide_curve = DivideCurve(Curve=line, Count=number_of_lists, Kinks=False)  # -> Points, Tangents, Parameters
unit_x = UnitX(Factor=addition_4)
move = Move(Geometry=divide_curve.Points, Motion=unit_x)  # -> Geometry, Transform
line_2 = Line(StartPoint=divide_curve.Points, EndPoint=move.Geometry)

integer_4 = Integer(-3)
_0_2 = Integer(0)
panel_24 = Panel(multiplication_2)
construct_point_3 = ConstructPoint(XCoordinate=multiplication_2, YCoordinate=_0, ZCoordinate=series_4)
construct_point_4 = ConstructPoint(XCoordinate=_0, YCoordinate=_0, ZCoordinate=_0)
panel_25 = Panel(construct_point_3)
construct_point_5 = ConstructPoint(XCoordinate=_0_2, YCoordinate=_0_2, ZCoordinate=_0_2)
construct_point_6 = ConstructPoint(XCoordinate=addition_4, YCoordinate=_0_2, ZCoordinate=series_3)
panel_26 = Panel(construct_point_6)
integer_5 = Integer(1)
series_5 = Series(Start=mass_addition.Result, Step=Slider(35, range=0..100), Count=number_of_lists_2)
multiplication_3 = Multiplication(A=series_5, B=Slider(9, range=0..10))
rotate_3d = Rotate3D(Geometry=construct_point_3, Angle=degrees(multiplication_3), Center=construct_point_4, Axis=unit_z)  # -> flatten(Geometry), Transform
panel_27 = Panel(series_5)
panel_28 = Panel(rotate_3d.Geometry)
number_slider_2 = Slider(36, range=0..100)
interpolate_t = InterpolateT(Vertices=rotate_3d.Geometry, TangentStart=Vector(0, 0, 0), TangentEnd=Vector(0, 0, 0), KnotStyle=1)  # -> Curve, Length, Domain
multiplication_4 = Multiplication(A=mass_addition.Result, B=Slider(0.3, range=0..1))
multiplication_5 = Multiplication(A=mass_addition_2.Result, B=number_slider_2)
divide_curve_2 = DivideCurve(Curve=interpolate_t.Curve, Count=Slider(60, range=0..100), Kinks=False)  # -> Points, Tangents, Parameters
panel_29 = Panel(divide_curve_2.Points)
series_6 = Series(Start=multiplication_5, Step=30, Count=number_of_lists)
panel_30 = Panel(series_6)
rotate_3d_2 = Rotate3D(Geometry=construct_point_6, Angle=degrees(series_6), Center=construct_point_5, Axis=unit_z_2)  # -> graft(Geometry), Transform
panel_31 = Panel(rotate_3d_2.Geometry)
division = Division(A=Slider(360, range=0..1000), B=number_slider_2)
panel_32 = Panel(division)
number_slider_3 = Slider(10, range=0..10)
series_7 = Series(Start=multiplication_4, Step=1, Count=number_slider_3)
panel_33 = Panel(series_7)
sine = Sine(Value=series_7)
unit_z_3 = UnitZ(Factor=sine)
multiplication_6 = Multiplication(A=unit_z_3, B=Slider(4, range=0..10))
multiplication_7 = Multiplication(A=multiplication_6, B=-1)
series_8 = Series(Start=Slider(0, range=0..10), Step=Slider(2, range=0..10), Count=number_slider_3)
panel_34 = Panel(multiplication_6)
panel_35 = Panel(multiplication_7)
panel_36 = Panel(series_8)
division_2 = Division(A=panel_36, B=Slider(6, range=0..10))
panel_37 = Panel(division_2)
multiplication_8 = Multiplication(A=series_8, B=panel_37)
integer_6 = Integer(multiplication_8)
list_item_4 = ListItem(List=divide_curve_2.Points, Index=integer_6, Wrap=True)
move_2 = Move(Geometry=list_item_4, Motion=multiplication_6)  # -> Geometry, Transform
move_3 = Move(Geometry=list_item_4, Motion=multiplication_7)  # -> Geometry, Transform
division_3 = Division(A=list_item, B=Slider(2, range=0..10))
construct_point_7 = ConstructPoint(XCoordinate=0, YCoordinate=0, ZCoordinate=division_3)
number_slider_4 = Slider(2.3, range=0..5)
number_slider_5 = Slider(1, range=0..5)
plane_normal = PlaneNormal(Origin=construct_point_7, ZAxis=Vector(0, 0, 1))
mirror = Mirror(Geometry=move_2.Geometry, Plane=plane_normal)  # -> Geometry, Transform
mirror_2 = Mirror(Geometry=move_3.Geometry, Plane=plane_normal)  # -> Geometry, Transform
number_slider_6 = Slider(108, range=0..360)
multiplication_9 = Multiplication(A=number_slider_5, B=-1)
list_item_5 = ListItem(List=move_2.Geometry, Index=0, Wrap=True)
unit_z_4 = UnitZ(Factor=multiplication_9)
unit_z_5 = UnitZ(Factor=number_slider_5)
plane_normal_2 = PlaneNormal(Origin=list_item_5, ZAxis=Vector(0, 0, 1))
rotate_3d_3 = Rotate3D(Geometry=mirror.Geometry, Angle=degrees(number_slider_6), Center=Point(0, 0, 0), Axis=Vector(0, 0, 1))  # -> Geometry, Transform
rotate_3d_4 = Rotate3D(Geometry=mirror_2.Geometry, Angle=degrees(number_slider_6), Center=Point(0, 0, 0), Axis=Vector(0, 0, 1))  # -> Geometry, Transform
circle = Circle(Plane=plane_normal_2, Radius=number_slider_4)
interpolate_t_2 = InterpolateT(Vertices=rotate_3d_3.Geometry, TangentStart=unit_z_4, TangentEnd=Vector(0, 0, 0), KnotStyle=1)  # -> Curve, Length, Domain
interpolate_t_3 = InterpolateT(Vertices=move_3.Geometry, TangentStart=unit_z_5, TangentEnd=Vector(0, 0, 0), KnotStyle=1)  # -> Curve, Length, Domain
panel_38 = Panel(rotate_3d_4.Geometry)
list_item_6 = ListItem(List=rotate_3d_4.Geometry, Index=0, Wrap=True)
custom_preview = CustomPreview(
    Geometry=[interpolate_t_2.Curve, interpolate_t_3.Curve],
    Material={diffuse=RGB(255, 0, 0), emission=RGB(66, 48, 66), shine=0.5, specular=RGB(255, 255, 255), transparency=0})
plane_normal_3 = PlaneNormal(Origin=list_item_6, ZAxis=Vector(0, 0, 1))
circle_2 = Circle(Plane=plane_normal_3, Radius=number_slider_4)
unit_z_6 = UnitZ(Factor=1)
loft_options = LoftOptions(Closed=False, Adjust=True, Rebuild=0, Refit=0, Type=5)
multiplication_10 = Multiplication(A=unit_z_6, B=-1)

set_wrist_rotation = Slider(146, range=0..180)  # disabled
number_slider_7 = Slider(64, range=0..200)  # disabled
set_wrist = Slider(103, range=0..180)  # disabled
set_gripper = Slider(73, range=10..73)  # disabled
set_elbow = Slider(96, range=0..180)  # disabled
set_base = Slider(180, range=0..180)  # disabled
set_shoulder = Slider(49, range=15..165)  # disabled
panel_39 = Panel("P")  # disabled
panel_40 = Panel([panel_39, set_base, set_shoulder, set_elbow, set_wrist_rotation, set_wrist, set_gripper, number_slider_7])  # disabled
number_slider_8 = Slider(1, range=0..1)  # disabled
number_slider_9 = Slider(0, range=0..1)  # disabled
text_join = TextJoin(Text=panel_40, Join=",")  # disabled
button = Button()  # disabled
button_2 = Button()  # disabled
panel_41 = Panel(text_join)  # disabled
panel_42 = Panel("P90,90,90,90,90,50,50")  # disabled
button_3 = Button()  # disabled
button_4 = Button()  # disabled
write = SerialWriteGeneric(StartWritingValues=button_3, WriteData=panel_42, PortNumber=number_slider)  # -> ArduinoOutput, StatusMessage; disabled
write_2 = SerialWriteGeneric(StartWritingValues=button_4, WriteData=panel_41, PortNumber=number_slider)  # -> ArduinoOutput, StatusMessage; disabled
write_3 = SerialWriteGeneric(StartWritingValues=button_2, WriteData=number_slider_8, PortNumber=number_slider)  # -> ArduinoOutput, StatusMessage; disabled
write_4 = SerialWriteGeneric(StartWritingValues=button, WriteData=number_slider_9, PortNumber=number_slider)  # -> ArduinoOutput, StatusMessage; disabled
data_recorder_2 = DataRecorder(
    [write_4.ArduinoOutput, write_2.ArduinoOutput, write.ArduinoOutput, write_3.ArduinoOutput],
    DataLimit=-10,
    RecordData=True)  # disabled
panel_43 = Panel(data_recorder_2)  # disabled

interpolate_t_4 = InterpolateT(Vertices=rotate_3d_4.Geometry, TangentStart=multiplication_10, TangentEnd=Vector(0, 0, 0), KnotStyle=1)  # -> reparameterize(Curve), Length, Domain
interpolate_t_5 = InterpolateT(Vertices=move_2.Geometry, TangentStart=unit_z_6, TangentEnd=Vector(0, 0, 0), KnotStyle=1)  # -> reparameterize(Curve), Length, Domain
domain = Domain(interpolate_t_5.Curve)
panel_44 = Panel(domain)
gene_pool = GenePool(Decimals=2, Maximum=1, Minimum=0, Value=[0, 0.23, 0.5246, 0.76, 1])
gene_pool_2 = GenePool(Decimals=2, Maximum=10, Minimum=0, Value=[2.32, 0.3, 2.46, 4.43, 0])
pipe = Pipe(Curve=[interpolate_t_5.Curve, interpolate_t_4.Curve], Radius=number_slider_4, Caps=0)
pipe_variable = PipeVariable(Curve=[interpolate_t_5.Curve, interpolate_t_4.Curve], Parameters=gene_pool, Radii=gene_pool_2, Caps=0)
panel_45 = Panel(pipe)
panel_46 = Panel(pipe_variable)
custom_preview_2 = CustomPreview(
    Geometry=pipe_variable,
    Material={diffuse=RGB(30, 144, 255), emission=RGB(76, 76, 76), shine=0.5, specular=RGB(255, 255, 255), transparency=0})
rotate_3d_5 = Rotate3D(Geometry=interpolate_t_5.Curve, Angle=degrees(Slider(79, range=0..360)), Center=Point(0, 0, 0), Axis=Vector(0, 0, 1))  # -> Geometry, Transform
rotate_3d_6 = Rotate3D(Geometry=interpolate_t_5.Curve, Angle=degrees(Slider(293, range=0..360)), Center=Point(0, 0, 0), Axis=Vector(0, 0, 1))  # -> Geometry, Transform
rotate_3d_7 = Rotate3D(Geometry=interpolate_t_5.Curve, Angle=degrees(Slider(219, range=0..360)), Center=Point(0, 0, 0), Axis=Vector(0, 0, 1))  # -> Geometry, Transform
divide_curve_3 = DivideCurve(Curve=interpolate_t_4.Curve, Count=4, Kinks=False)  # -> Points, Tangents, Parameters
divide_curve_4 = DivideCurve(Curve=interpolate_t_4.Curve, Count=2, Kinks=False)  # -> Points, Tangents, Parameters
divide_curve_5 = DivideCurve(Curve=interpolate_t_4.Curve, Count=3, Kinks=False)  # -> Points, Tangents, Parameters
divide_curve_6 = DivideCurve(Curve=rotate_3d_7.Geometry, Count=3, Kinks=False)  # -> Points, Tangents, Parameters
divide_curve_7 = DivideCurve(Curve=rotate_3d_5.Geometry, Count=2, Kinks=False)  # -> Points, Tangents, Parameters
divide_curve_8 = DivideCurve(Curve=rotate_3d_6.Geometry, Count=4, Kinks=False)  # -> Points, Tangents, Parameters
interpolate_t_6 = InterpolateT(Vertices=divide_curve_3.Points, TangentStart=Vector(0, 0, 0), TangentEnd=Vector(0, 0, 0), KnotStyle=1)  # -> Curve, Length, Domain
interpolate_t_7 = InterpolateT(Vertices=divide_curve_4.Points, TangentStart=Vector(0, 0, 0), TangentEnd=Vector(0, 0, 0), KnotStyle=1)  # -> Curve, Length, Domain
interpolate_t_8 = InterpolateT(Vertices=divide_curve_8.Points, TangentStart=Vector(0, 0, 0), TangentEnd=Vector(0, 0, 0), KnotStyle=1)  # -> Curve, Length, Domain
interpolate_t_9 = InterpolateT(Vertices=divide_curve_5.Points, TangentStart=Vector(0, 0, 0), TangentEnd=Vector(0, 0, 0), KnotStyle=1)  # -> Curve, Length, Domain
multiplication_11 = Multiplication(A=number_slider_4, B=0.3)
multiplication_12 = Multiplication(A=number_slider_4, B=0.2)
interpolate_t_10 = InterpolateT(Vertices=divide_curve_7.Points, TangentStart=Vector(0, 0, 0), TangentEnd=Vector(0, 0, 0), KnotStyle=1)  # -> Curve, Length, Domain
interpolate_t_11 = InterpolateT(Vertices=divide_curve_6.Points, TangentStart=Vector(0, 0, 0), TangentEnd=Vector(0, 0, 0), KnotStyle=1)  # -> Curve, Length, Domain
plane_normal_4 = PlaneNormal(Origin=divide_curve_3.Points, ZAxis=divide_curve_3.Tangents)
plane_normal_5 = PlaneNormal(Origin=divide_curve_4.Points, ZAxis=divide_curve_4.Tangents)
plane_normal_6 = PlaneNormal(Origin=divide_curve_8.Points, ZAxis=divide_curve_8.Tangents)
plane_normal_7 = PlaneNormal(Origin=divide_curve_7.Points, ZAxis=divide_curve_7.Tangents)
multiplication_13 = Multiplication(A=multiplication_11, B=number_slider_4)
multiplication_14 = Multiplication(A=multiplication_12, B=number_slider_4)
ellipse = Ellipse(Plane=plane_normal_4, Radius1=multiplication_13, Radius2=multiplication_11)  # -> Ellipse, Focus1, Focus2
ellipse_2 = Ellipse(Plane=plane_normal_5, Radius1=multiplication_13, Radius2=multiplication_11)  # -> Ellipse, Focus1, Focus2
ellipse_3 = Ellipse(Plane=plane_normal_6, Radius1=multiplication_14, Radius2=multiplication_12)  # -> Ellipse, Focus1, Focus2
ellipse_4 = Ellipse(Plane=plane_normal_7, Radius1=multiplication_14, Radius2=multiplication_12)  # -> Ellipse, Focus1, Focus2
panel_47 = Panel(multiplication_13)
panel_48 = Panel(multiplication_14)
loft = Loft(Curves=ellipse.Ellipse, Options={Adjust=False, Closed=False, LoftEnds=0, LoftSimp=0, LoftType=0, Rebuild=10, Refit=0.01})  # disabled
loft_2 = Loft(
    Curves=ellipse_2.Ellipse,
    Options={Adjust=False, Closed=False, LoftEnds=0, LoftSimp=0, LoftType=0, Rebuild=10, Refit=0.01})  # disabled
loft_3 = Loft(
    Curves=ellipse_3.Ellipse,
    Options={Adjust=False, Closed=False, LoftEnds=0, LoftSimp=0, LoftType=0, Rebuild=10, Refit=0.01})  # disabled
loft_4 = Loft(
    Curves=ellipse_4.Ellipse,
    Options={Adjust=False, Closed=False, LoftEnds=0, LoftSimp=0, LoftType=0, Rebuild=10, Refit=0.01})  # disabled
custom_preview_3 = CustomPreview(
    Geometry=[interpolate_t_8.Curve, interpolate_t_10.Curve, interpolate_t_7.Curve, interpolate_t_6.Curve],
    Material={diffuse=RGB(255, 255, 255), emission=RGB(66, 48, 66), shine=0.5, specular=RGB(255, 255, 255), transparency=0})

data_rec = PythonScript(x=rotate_3d_2.Geometry, enable=Toggle(True), reset=Button(), limit=panel_32)  # -> x; inputs x: tree, enable: Boolean, reset: Boolean, limit: Int32
# ---------- data_rec: Python ----------
from Grasshopper import DataTree
if reset or 'rec' not in globals(): rec = DataTree[object]()
if enable and not reset: rec.MergeTree(x)
if limit > 0:
  for branch in rec.Branches:
    if branch.Count > limit:
      branch.RemoveRange(0, branch.Count - limit)
x = rec
# ---------- end data_rec ----------
panel_49 = Panel(data_rec)
interpolate = Interpolate(Vertices=data_rec, Degree=Slider(5, range=1..11), Periodic=True, KnotStyle=1)  # -> flatten(Curve), Length, Domain
panel_50 = Panel(interpolate.Curve)
_2 = Integer(2)

list_length_3 = ListLength(List=interpolate.Curve)
loft_5 = Loft(
    Curves=interpolate.Curve,
    Options={Adjust=False, Closed=False, LoftEnds=0, LoftSimp=0, LoftType=1, Rebuild=10, Refit=0.01})

divide_surface = DivideSurface(Surface=loft_5, UCount=Slider(7, range=0..10), VCount=_2)  # -> Points, Normals, Parameters
panel_51 = Panel(divide_surface.Points)
list_item_7 = ListItem(List=divide_surface.Points, Index=Slider(1, range=0..1), Wrap=True)
panel_52 = Panel(list_item_7)
deconstruct = Deconstruct(Point=list_item_7)  # -> XComponent, YComponent, ZComponent

list_item_8 = ListItem(List=interpolate.Curve, Index=expr("x-1", list_length_3), Wrap=True)
custom_preview_4 = CustomPreview(
    Geometry=loft_5,
    Material={diffuse=RGB(0, 250, 154), emission=RGB(66, 48, 66), shine=0.5, specular=RGB(255, 255, 255), transparency=0})
list_item_9 = ListItem(List=interpolate.Curve, Index=0, Wrap=True)
curve = Curve([circle, list_item_8])
curve_2 = Curve([list_item_9, circle_2])
loft_6 = Loft(Curves=flatten(curve), Options=loft_options)
loft_7 = Loft(Curves=flatten(curve_2), Options=loft_options)

multiplication_15 = Multiplication(A=deconstruct.XComponent, B=deconstruct.XComponent)
multiplication_16 = Multiplication(A=deconstruct.YComponent, B=deconstruct.YComponent)
addition_5 = Addition(A=multiplication_15, B=multiplication_16)
square_root = SquareRoot(Value=addition_5)
panel_53 = Panel(square_root)
panel_54 = Panel(deconstruct.ZComponent)
construct_domain = ConstructDomain(DomainStart=Slider(1.9, range=0..10), DomainEnd=Slider(3.1, range=0..10))
construct_domain_2 = ConstructDomain(DomainStart=Slider(0, range=0..100), DomainEnd=Slider(1, range=0..1))
construct_point_8 = ConstructPoint(XCoordinate=integer_3, YCoordinate=0, ZCoordinate=panel_54)
remap_numbers = RemapNumbers(Value=square_root, Source=construct_domain, Target=construct_domain_2)  # -> flatten(Mapped), Clipped
unit_x_2 = UnitX(Factor=square_root)
move_4 = Move(Geometry=construct_point_8, Motion=unit_x_2)  # -> Geometry, Transform
line_3 = Line(StartPoint=construct_point_8, EndPoint=move_4.Geometry)
panel_55 = Panel(remap_numbers.Mapped)
list_item_10 = ListItem(List=remap_numbers.Mapped, Index=Slider(6, range=0..10), Wrap=True)
list_item_11 = ListItem(List=remap_numbers.Mapped, Index=Slider(1, range=0..10), Wrap=True)
list_item_12 = ListItem(List=remap_numbers.Mapped, Index=Slider(2, range=0..10), Wrap=True)
list_item_13 = ListItem(List=remap_numbers.Mapped, Index=Slider(3, range=0..10), Wrap=True)
list_item_14 = ListItem(List=remap_numbers.Mapped, Index=Slider(4, range=0..10), Wrap=True)
list_item_15 = ListItem(List=remap_numbers.Mapped, Index=Slider(5, range=0..10), Wrap=True)
construct_domain_3 = ConstructDomain(DomainStart=Slider(15, range=15..100), DomainEnd=Slider(165, range=0..165))
construct_domain_4 = ConstructDomain(DomainStart=Slider(10, range=10..72), DomainEnd=Slider(72, range=10..72))
construct_domain_5 = ConstructDomain(DomainStart=Slider(0, range=0..100), DomainEnd=Slider(180, range=0..180))
panel_56 = Panel(construct_domain_5)
remap_numbers_2 = RemapNumbers(Value=list_item_12, Source=construct_domain_2, Target=construct_domain_3)  # -> Mapped, Clipped
remap_numbers_3 = RemapNumbers(Value=list_item_11, Source=construct_domain_2, Target=construct_domain_5)  # -> Mapped, Clipped
remap_numbers_4 = RemapNumbers(Value=list_item_13, Source=construct_domain_2, Target=construct_domain_5)  # -> Mapped, Clipped
remap_numbers_5 = RemapNumbers(Value=list_item_14, Source=construct_domain_2, Target=construct_domain_5)  # -> Mapped, Clipped
remap_numbers_6 = RemapNumbers(Value=list_item_15, Source=construct_domain_2, Target=construct_domain_5)  # -> Mapped, Clipped
remap_numbers_7 = RemapNumbers(Value=list_item_10, Source=construct_domain_2, Target=construct_domain_4)  # -> Mapped, Clipped
panel_57 = Panel(remap_numbers_3.Mapped)
panel_58 = Panel(remap_numbers_2.Mapped)
panel_59 = Panel(remap_numbers_4.Mapped)
panel_60 = Panel(remap_numbers_5.Mapped)
panel_61 = Panel(remap_numbers_6.Mapped)
panel_62 = Panel(remap_numbers_7.Mapped)
integer_7 = Integer(remap_numbers_3.Mapped)
integer_8 = Integer(remap_numbers_2.Mapped)
integer_9 = Integer(remap_numbers_4.Mapped)
integer_10 = Integer(remap_numbers_5.Mapped)
integer_11 = Integer(remap_numbers_6.Mapped)
integer_12 = Integer(remap_numbers_7.Mapped)
panel_63 = Panel([integer_7, integer_8, integer_9, integer_10, integer_11, integer_12])
list_item_16 = ListItem(List=panel_63, Index=0, Wrap=True)
panel_64 = Panel(["P", list_item_16])
text_join_2 = TextJoin(Text=panel_64)
panel_65 = Panel([text_join_2, panel_63, "200"])
data_dam = DataDam(DataDataA=panel_65, BufferDelay=10000000, BufferMode=0)
text_join_3 = TextJoin(Text=data_dam, Join=",")
panel_66 = Panel(text_join_3)
write_5 = SerialWriteGeneric(StartWritingValues=Button(), WriteData=Slider(0, range=0..1), PortNumber=number_slider)  # -> ArduinoOutput, StatusMessage
write_6 = SerialWriteGeneric(StartWritingValues=Button(), WriteData=Slider(1, range=0..1), PortNumber=number_slider)  # -> ArduinoOutput, StatusMessage
write_7 = SerialWriteGeneric(StartWritingValues=Button(), WriteData="P90,90,90,90,90,72,50", PortNumber=number_slider)  # -> ArduinoOutput, StatusMessage
write_8 = SerialWriteGeneric(StartWritingValues=Toggle(True), WriteData=panel_66, PortNumber=number_slider)  # -> ArduinoOutput, StatusMessage
data_recorder_3 = DataRecorder(write_6.ArduinoOutput, DataLimit=-10, RecordData=True)
data_recorder_4 = DataRecorder(write_5.ArduinoOutput, DataLimit=-10, RecordData=True)
data_recorder_5 = DataRecorder(write_7.ArduinoOutput, DataLimit=-10, RecordData=True)
data_recorder_6 = DataRecorder(write_8.ArduinoOutput, DataLimit=-10, RecordData=True)
panel_67 = Panel(data_recorder_6)
panel_68 = Panel(data_recorder_5)
panel_69 = Panel(data_recorder_4)
panel_70 = Panel(data_recorder_3)

custom_preview_5 = CustomPreview(
    Geometry=[loft_7, loft_6],
    Material={diffuse=RGB(255, 255, 255), emission=RGB(76, 76, 76), shine=0.5, specular=RGB(255, 255, 255), transparency=0.7})
