# Grasshopper definition vectorgraphics_LOFT_08_01(too hard rotate planes to an orientation).gh (Grasshopper 1.0.7)
# plug-ins: Firefly.X, Firefly.Core

integer = Integer(1)
timer = Timer(TimerInterval=20, Target=data_recorder)  # disabled
data_recorder = DataRecorder(integer, DataLimit=-360, RecordData=True)

frame_rate = FrameRate()  # -> simplify(flatten(RefreshRate)), Frequency
panel = Panel(frame_rate.RefreshRate)
panel_2 = Panel(frame_rate.Frequency)

ports_available = COMPortsAvailable()
panel_3 = Panel(ports_available)
open_port = OpenClosePort(OpenClosePort=Toggle(True), PortNumber="4", BaudRate=115200)
panel_4 = Panel(open_port)
timer_2 = Timer(TimerInterval=20, Target=[uno_read, serial_read_generic])
uno_read = UnoRead(StartReadingValues=Toggle(True), PortNumber="4")  # -> AnalogPin0, AnalogPin1, AnalogPin2, AnalogPin3, AnalogPin4, AnalogPin5, DigitalPin2, DigitalPin4, DigitalPin7, StatusMessage
uno_write = UnoWrite(
    StartWritingValues=Toggle(False),
    DigitalPin13=0,
    DigitalPin12=0,
    DigitalPin11=0,
    DigitalPin10=0,
    DigitalPin9=0,
    DigitalPin8=0,
    DigitalPin6=0,
    DigitalPin5=0,
    DigitalPin3=0,
    PortNumber="4")  # -> ArduinoOutput, StatusMessage
timer_3 = Timer(TimerInterval=20, Target=uno_write)
panel_5 = Panel(uno_read.AnalogPin0)
panel_6 = Panel(uno_write.StatusMessage)
panel_7 = Panel(uno_write.ArduinoOutput)
panel_8 = Panel(uno_read.AnalogPin1)
panel_9 = Panel(uno_read.DigitalPin4)
panel_10 = Panel(uno_read.DigitalPin2)
panel_11 = Panel(uno_read.DigitalPin7)
panel_12 = Panel(uno_read.AnalogPin5)
panel_13 = Panel(uno_read.AnalogPin4)
panel_14 = Panel(uno_read.AnalogPin2)
panel_15 = Panel(uno_read.AnalogPin3)
panel_16 = Panel(uno_read.StatusMessage)
number_slider = Slider(4, range=0..10)
serial_read_generic = SerialReadGeneric(StartReadingValues=Toggle(True), PortNumber=number_slider)  # -> SerialOutput, StatusMessage
panel_17 = Panel(serial_read_generic.StatusMessage)
panel_18 = Panel(serial_read_generic.SerialOutput)

mass_addition = MassAddition(Input=data_recorder)  # -> Result, PartialResults
mass_addition_2 = MassAddition(Input=data_recorder)  # -> Result, PartialResults
panel_19 = Panel(mass_addition_2.Result)
multiplication = Multiplication(A=panel_19, B=Slider(2, range=0..10))
height_between_loft_segments = Slider(10, range=0..10)
height_between_loft_segments_2 = Slider(1, range=0..10)
_1 = Integer(1)
_1_2 = Integer(1)
number_of_lists = Slider(14, range=0..30)
addition = Addition(A=_1, B=height_between_loft_segments)
addition_2 = Addition(A=_1_2, B=height_between_loft_segments_2)
unit_z = UnitZ(Factor=_1)
series = Series(Start=Slider(1, range=0..10), Step=1, Count=number_of_lists)
increse_distance_from_centre = Slider(2, range=0..5)
unit_z_2 = UnitZ(Factor=_1_2)
multiplication_2 = Multiplication(A=series, B=series)
_0 = Integer(0)
integer_2 = Integer(-3)
_1_3 = Integer(1)
integer_3 = Integer(-3)
_0_2 = Integer(0)
panel_20 = Panel(multiplication_2)
construct_point = ConstructPoint(XCoordinate=_0, YCoordinate=_0, ZCoordinate=_0)
construct_point_2 = ConstructPoint(XCoordinate=_0_2, YCoordinate=_0_2, ZCoordinate=_0_2)
integer_4 = Integer(1)
series_2 = Series(Start=mass_addition.Result, Step=Slider(35, range=0..100), Count=number_of_lists)
multiplication_3 = Multiplication(A=series_2, B=Slider(9, range=0..10))
panel_21 = Panel(series_2)
number_slider_2 = Slider(36, range=0..100)
multiplication_4 = Multiplication(A=mass_addition.Result, B=Slider(0.3, range=0..1))
multiplication_5 = Multiplication(A=mass_addition_2.Result, B=number_slider_2)
division = Division(A=Slider(360, range=0..1000), B=number_slider_2)
panel_22 = Panel(division)
number_slider_3 = Slider(10, range=0..10)
series_3 = Series(Start=multiplication_4, Step=1, Count=number_slider_3)
panel_23 = Panel(series_3)
sine = Sine(Value=series_3)
unit_z_3 = UnitZ(Factor=sine)
multiplication_6 = Multiplication(A=unit_z_3, B=Slider(4, range=0..10))
multiplication_7 = Multiplication(A=multiplication_6, B=-1)
series_4 = Series(Start=Slider(0, range=0..10), Step=Slider(2, range=0..10), Count=number_slider_3)
panel_24 = Panel(multiplication_6)
panel_25 = Panel(multiplication_7)
panel_26 = Panel(series_4)
division_2 = Division(A=panel_26, B=Slider(6, range=0..10))
panel_27 = Panel(division_2)
multiplication_8 = Multiplication(A=series_4, B=panel_27)
integer_5 = Integer(multiplication_8)
number_slider_4 = Slider(138, range=0..360)
unit_z_4 = UnitZ(Factor=1)
multiplication_9 = Multiplication(A=unit_z_4, B=-1)

set_wrist_rotation = Slider(146, range=0..180)  # disabled
number_slider_5 = Slider(64, range=0..200)  # disabled
set_wrist = Slider(103, range=0..180)  # disabled
set_gripper = Slider(73, range=10..73)  # disabled
set_elbow = Slider(96, range=0..180)  # disabled
set_base = Slider(180, range=0..180)  # disabled
set_shoulder = Slider(49, range=15..165)  # disabled
panel_28 = Panel("P")  # disabled
panel_29 = Panel([panel_28, set_base, set_shoulder, set_elbow, set_wrist_rotation, set_wrist, set_gripper, number_slider_5])  # disabled
number_slider_6 = Slider(1, range=0..1)  # disabled
number_slider_7 = Slider(0, range=0..1)  # disabled
text_join = TextJoin(Text=panel_29, Join=",")  # disabled
button = Button()  # disabled
button_2 = Button()  # disabled
panel_30 = Panel(text_join)  # disabled
panel_31 = Panel("P90,90,90,90,90,50,50")  # disabled
button_3 = Button()  # disabled
button_4 = Button()  # disabled
write = SerialWriteGeneric(StartWritingValues=button_3, WriteData=panel_31, PortNumber=number_slider)  # -> ArduinoOutput, StatusMessage; disabled
write_2 = SerialWriteGeneric(StartWritingValues=button_4, WriteData=panel_30, PortNumber=number_slider)  # -> ArduinoOutput, StatusMessage; disabled
write_3 = SerialWriteGeneric(StartWritingValues=button_2, WriteData=number_slider_6, PortNumber=number_slider)  # -> ArduinoOutput, StatusMessage; disabled
write_4 = SerialWriteGeneric(StartWritingValues=button, WriteData=number_slider_7, PortNumber=number_slider)  # -> ArduinoOutput, StatusMessage; disabled
data_recorder_2 = DataRecorder(
    [write_4.ArduinoOutput, write_2.ArduinoOutput, write.ArduinoOutput, write_3.ArduinoOutput],
    DataLimit=-10,
    RecordData=True)  # disabled
panel_32 = Panel(data_recorder_2)  # disabled

number_slider_8 = Slider(60, range=0..100)
number_slider_9 = Slider(2.3, range=0..5)
multiplication_10 = Multiplication(A=number_slider_9, B=0.3)
panel_33 = Panel(multiplication_10)
multiplication_11 = Multiplication(A=multiplication_10, B=number_slider_9)
multiplication_12 = Multiplication(A=multiplication_11, B=2)
panel_34 = Panel(multiplication_12)
multiplication_13 = Multiplication(A=number_slider_9, B=-1)
division_3 = Division(A=number_slider_9, B=number_slider_8)
rotate_plane = RotatePlane()
panel_35 = Panel(division_3)
series_5 = Series(Start=multiplication_13, Step=panel_35, Count=number_slider_8)
multiplication_14 = Multiplication(A=series_5, B=-1)
number_of_lists_2 = Slider(8, range=0..10)
series_6 = Series(Start=panel_19, Step=multiplication, Count=number_of_lists_2)
panel_36 = Panel(series_6)
random = Random(Range=Domain(0, 1), Number=_1_2, Seed=series_6)
panel_37 = Panel(random)
series_7 = Series(Start=unit_z_2, Step=addition_2, Count=number_of_lists_2)
list_length = ListLength(List=series_7)
list_item = ListItem(List=series_7, Index=expr("x-1", list_length), Wrap=True)
addition_3 = Addition(A=list_item, B=7)
panel_38 = Panel(list_item)
series_8 = Series(Start=addition_3, Step=addition, Count=number_of_lists)
addition_4 = Addition(A=random, B=increse_distance_from_centre)  # -> flatten(Result)

panel_39 = Panel(series_7)
list_length_2 = ListLength(List=series_7)
list_item_2 = ListItem(List=series_7, Index=expr("x-1", list_length_2), Wrap=True)
list_item_3 = ListItem(List=series_7, Index=0, Wrap=True)
integer_6 = Integer(-10)
construct_point_3 = ConstructPoint(XCoordinate=integer_6, YCoordinate=0, ZCoordinate=list_item_2)
construct_point_4 = ConstructPoint(XCoordinate=integer_6, YCoordinate=0, ZCoordinate=list_item_3)
line = Line(StartPoint=construct_point_4, EndPoint=construct_point_3)
divide_curve = DivideCurve(Curve=line, Count=number_of_lists_2, Kinks=False)  # -> Points, Tangents, Parameters
unit_x = UnitX(Factor=addition_4)
move = Move(Geometry=divide_curve.Points, Motion=unit_x)  # -> Geometry, Transform
line_2 = Line(StartPoint=divide_curve.Points, EndPoint=move.Geometry)

construct_point_5 = ConstructPoint(XCoordinate=multiplication_2, YCoordinate=_0, ZCoordinate=series_8)
panel_40 = Panel(construct_point_5)
construct_point_6 = ConstructPoint(XCoordinate=addition_4, YCoordinate=_0_2, ZCoordinate=series_7)
panel_41 = Panel(construct_point_6)
rotate_3d = Rotate3D(Geometry=construct_point_5, Angle=degrees(multiplication_3), Center=construct_point, Axis=unit_z)  # -> flatten(Geometry), Transform
panel_42 = Panel(rotate_3d.Geometry)
interpolate_t = InterpolateT(Vertices=rotate_3d.Geometry, TangentStart=Vector(0, 0, 0), TangentEnd=Vector(0, 0, 0), KnotStyle=1)  # -> Curve, Length, Domain
divide_curve_2 = DivideCurve(Curve=interpolate_t.Curve, Count=number_slider_8, Kinks=False)  # -> Points, Tangents, Parameters
panel_43 = Panel(divide_curve_2.Points)
series_9 = Series(Start=multiplication_5, Step=30, Count=number_of_lists_2)
panel_44 = Panel(series_9)
rotate_3d_2 = Rotate3D(Geometry=construct_point_6, Angle=degrees(series_9), Center=construct_point_2, Axis=unit_z_2)  # -> graft(Geometry), Transform
panel_45 = Panel(rotate_3d_2.Geometry)
list_item_4 = ListItem(List=divide_curve_2.Points, Index=integer_5, Wrap=True)
move_2 = Move(Geometry=list_item_4, Motion=multiplication_6)  # -> Geometry, Transform
move_3 = Move(Geometry=list_item_4, Motion=multiplication_7)  # -> Geometry, Transform
division_4 = Division(A=list_item, B=Slider(2, range=0..10))
construct_point_7 = ConstructPoint(XCoordinate=0, YCoordinate=0, ZCoordinate=division_4)
plane_normal = PlaneNormal(Origin=construct_point_7, ZAxis=Vector(0, 0, 1))
mirror = Mirror(Geometry=move_2.Geometry, Plane=plane_normal)  # -> Geometry, Transform
mirror_2 = Mirror(Geometry=move_3.Geometry, Plane=plane_normal)  # -> Geometry, Transform
rotate_3d_3 = Rotate3D(Geometry=mirror.Geometry, Angle=degrees(number_slider_4), Center=Point(0, 0, 0), Axis=Vector(0, 0, 1))  # -> Geometry, Transform
rotate_3d_4 = Rotate3D(Geometry=mirror_2.Geometry, Angle=degrees(number_slider_4), Center=Point(0, 0, 0), Axis=Vector(0, 0, 1))  # -> Geometry, Transform
panel_46 = Panel(rotate_3d_4.Geometry)
interpolate_t_2 = InterpolateT(Vertices=move_2.Geometry, TangentStart=unit_z_4, TangentEnd=Vector(0, 0, 0), KnotStyle=1)  # -> Curve, Length, Domain
interpolate_t_3 = InterpolateT(Vertices=rotate_3d_4.Geometry, TangentStart=multiplication_9, TangentEnd=Vector(0, 0, 0), KnotStyle=1)  # -> Curve, Length, Domain
divide_curve_3 = DivideCurve(Curve=interpolate_t_3.Curve, Count=Slider(20, range=0..100), Kinks=False)  # -> Points, Tangents, Parameters
plane_normal_2 = PlaneNormal(Origin=divide_curve_3.Points, ZAxis=divide_curve_3.Tangents)
list_item_5 = ListItem(List=move_2.Geometry, Index=0, Wrap=True)
plane_normal_3 = PlaneNormal(Origin=list_item_5, ZAxis=Vector(0, 0, 1))
circle = Circle(Plane=plane_normal_3, Radius=number_slider_9)
list_item_6 = ListItem(List=rotate_3d_4.Geometry, Index=0, Wrap=True)
ellipse = Ellipse(Plane=plane_normal_2, Radius1=number_slider_9, Radius2=multiplication_14)  # -> Ellipse, Focus1, Focus2
plane_normal_4 = PlaneNormal(Origin=list_item_6, ZAxis=Vector(0, 0, 1))
circle_2 = Circle(Plane=plane_normal_4, Radius=number_slider_9)
divide_curve_4 = DivideCurve(Curve=ellipse.Ellipse, Count=expr("x-1", number_of_lists_2), Kinks=False)  # -> Points, Tangents, Parameters
series_10 = Series(Start=0, Step=1, Count=expr("x-1", number_slider_8))
flip_matrix = FlipMatrix(Data=divide_curve_4.Points)
list_item_7 = ListItem(List=flip_matrix, Index=series_10, Wrap=True)
interpolate_t_4 = InterpolateT(Vertices=list_item_7, TangentStart=Vector(0, 0, 0), TangentEnd=Vector(0, 0, 0), KnotStyle=1)  # -> Curve, Length, Domain
panel_47 = Panel(list_item_7)
loft = Loft(
    Curves=interpolate_t_4.Curve,
    Options={Adjust=False, Closed=False, LoftEnds=0, LoftSimp=0, LoftType=0, Rebuild=10, Refit=0.01})

toggle = BooleanToggle(True)  # disabled
button_5 = Button()  # disabled
data_rec = PythonScript(x=rotate_3d_2.Geometry, enable=toggle, reset=button_5, limit=panel_22)  # -> x; inputs x: tree, enable: Boolean, reset: Boolean, limit: Int32; disabled
# ---------- data_rec: Python ----------
from Grasshopper import DataTree
if reset or 'rec' not in globals(): rec = DataTree[object]()
if enable and not reset: rec.MergeTree(x)
if limit > 0:
  for branch in rec.Branches:
    if branch.Count > limit:
      branch.RemoveRange(0, branch.Count - limit)
x = rec
# ---------- end data_rec ----------
panel_48 = Panel(data_rec)  # disabled
number_slider_10 = Slider(5, range=1..11)  # disabled
number_slider_11 = Slider(7, range=0..10)  # disabled
interpolate = Interpolate(Vertices=data_rec, Degree=number_slider_10, Periodic=True, KnotStyle=1)  # -> flatten(Curve), Length, Domain; disabled
panel_49 = Panel(interpolate.Curve)  # disabled
_2 = Integer(2)  # disabled
number_slider_12 = Slider(1, range=0..1)  # disabled

loft_2 = Loft(
    Curves=interpolate.Curve,
    Options={Adjust=False, Closed=False, LoftEnds=0, LoftSimp=0, LoftType=1, Rebuild=10, Refit=0.01})

divide_surface = DivideSurface(Surface=loft_2, UCount=number_slider_11, VCount=_2)  # -> Points, Normals, Parameters; disabled
panel_50 = Panel(divide_surface.Points)  # disabled
list_item_8 = ListItem(List=divide_surface.Points, Index=number_slider_12, Wrap=True)  # disabled
panel_51 = Panel(list_item_8)  # disabled
deconstruct = Deconstruct(Point=list_item_8)  # -> XComponent, YComponent, ZComponent; disabled

multiplication_15 = Multiplication(A=deconstruct.XComponent, B=deconstruct.XComponent)  # disabled
multiplication_16 = Multiplication(A=deconstruct.YComponent, B=deconstruct.YComponent)  # disabled
addition_5 = Addition(A=multiplication_15, B=multiplication_16)  # disabled
square_root = SquareRoot(Value=addition_5)  # disabled
panel_52 = Panel(square_root)  # disabled
number_slider_13 = Slider(3.1, range=0..10)  # disabled
number_slider_14 = Slider(1.9, range=0..10)  # disabled
number_slider_15 = Slider(1, range=0..1)  # disabled
number_slider_16 = Slider(0, range=0..100)  # disabled
panel_53 = Panel(deconstruct.ZComponent)  # disabled
construct_domain = ConstructDomain(DomainStart=number_slider_14, DomainEnd=number_slider_13)  # disabled
construct_domain_2 = ConstructDomain(DomainStart=number_slider_16, DomainEnd=number_slider_15)  # disabled
construct_point_8 = ConstructPoint(XCoordinate=integer_6, YCoordinate=0, ZCoordinate=panel_53)  # disabled
remap_numbers = RemapNumbers(Value=square_root, Source=construct_domain, Target=construct_domain_2)  # -> flatten(Mapped), Clipped; disabled
unit_x_2 = UnitX(Factor=square_root)  # disabled
move_4 = Move(Geometry=construct_point_8, Motion=unit_x_2)  # -> Geometry, Transform; disabled
line_3 = Line(StartPoint=construct_point_8, EndPoint=move_4.Geometry)  # disabled
number_slider_17 = Slider(6, range=0..10)  # disabled
number_slider_18 = Slider(4, range=0..10)  # disabled
number_slider_19 = Slider(2, range=0..10)  # disabled
number_slider_20 = Slider(3, range=0..10)  # disabled
number_slider_21 = Slider(5, range=0..10)  # disabled
number_slider_22 = Slider(1, range=0..10)  # disabled
panel_54 = Panel(remap_numbers.Mapped)  # disabled
list_item_9 = ListItem(List=remap_numbers.Mapped, Index=number_slider_17, Wrap=True)  # disabled
list_item_10 = ListItem(List=remap_numbers.Mapped, Index=number_slider_22, Wrap=True)  # disabled
list_item_11 = ListItem(List=remap_numbers.Mapped, Index=number_slider_19, Wrap=True)  # disabled
list_item_12 = ListItem(List=remap_numbers.Mapped, Index=number_slider_20, Wrap=True)  # disabled
list_item_13 = ListItem(List=remap_numbers.Mapped, Index=number_slider_18, Wrap=True)  # disabled
list_item_14 = ListItem(List=remap_numbers.Mapped, Index=number_slider_21, Wrap=True)  # disabled
number_slider_23 = Slider(72, range=10..72)  # disabled
number_slider_24 = Slider(10, range=10..72)  # disabled
number_slider_25 = Slider(15, range=15..100)  # disabled
number_slider_26 = Slider(165, range=0..165)  # disabled
number_slider_27 = Slider(180, range=0..180)  # disabled
number_slider_28 = Slider(0, range=0..100)  # disabled
construct_domain_3 = ConstructDomain(DomainStart=number_slider_25, DomainEnd=number_slider_26)  # disabled
construct_domain_4 = ConstructDomain(DomainStart=number_slider_24, DomainEnd=number_slider_23)  # disabled
construct_domain_5 = ConstructDomain(DomainStart=number_slider_28, DomainEnd=number_slider_27)  # disabled
panel_55 = Panel(construct_domain_5)  # disabled
remap_numbers_2 = RemapNumbers(Value=list_item_11, Source=construct_domain_2, Target=construct_domain_3)  # -> Mapped, Clipped; disabled
remap_numbers_3 = RemapNumbers(Value=list_item_10, Source=construct_domain_2, Target=construct_domain_5)  # -> Mapped, Clipped; disabled
remap_numbers_4 = RemapNumbers(Value=list_item_12, Source=construct_domain_2, Target=construct_domain_5)  # -> Mapped, Clipped; disabled
remap_numbers_5 = RemapNumbers(Value=list_item_13, Source=construct_domain_2, Target=construct_domain_5)  # -> Mapped, Clipped; disabled
remap_numbers_6 = RemapNumbers(Value=list_item_14, Source=construct_domain_2, Target=construct_domain_5)  # -> Mapped, Clipped; disabled
remap_numbers_7 = RemapNumbers(Value=list_item_9, Source=construct_domain_2, Target=construct_domain_4)  # -> Mapped, Clipped; disabled
panel_56 = Panel(remap_numbers_3.Mapped)  # disabled
panel_57 = Panel(remap_numbers_2.Mapped)  # disabled
panel_58 = Panel(remap_numbers_4.Mapped)  # disabled
panel_59 = Panel(remap_numbers_5.Mapped)  # disabled
panel_60 = Panel(remap_numbers_6.Mapped)  # disabled
panel_61 = Panel(remap_numbers_7.Mapped)  # disabled
integer_7 = Integer(remap_numbers_3.Mapped)  # disabled
integer_8 = Integer(remap_numbers_2.Mapped)  # disabled
integer_9 = Integer(remap_numbers_4.Mapped)  # disabled
integer_10 = Integer(remap_numbers_5.Mapped)  # disabled
integer_11 = Integer(remap_numbers_6.Mapped)  # disabled
integer_12 = Integer(remap_numbers_7.Mapped)  # disabled
panel_62 = Panel([integer_7, integer_8, integer_9, integer_10, integer_11, integer_12])  # disabled
panel_63 = Panel("P")  # disabled
panel_64 = Panel("200")  # disabled
list_item_15 = ListItem(List=panel_62, Index=0, Wrap=True)  # disabled
panel_65 = Panel([panel_63, list_item_15])  # disabled
text_join_2 = TextJoin(Text=panel_65)  # disabled
panel_66 = Panel([text_join_2, panel_62, panel_64])  # disabled
data_dam = DataDam(DataDataA=panel_66, BufferDelay=10000000, BufferMode=0)  # disabled
number_slider_29 = Slider(1, range=0..1)  # disabled
number_slider_30 = Slider(0, range=0..1)  # disabled
text_join_3 = TextJoin(Text=data_dam, Join=",")  # disabled
boolean_toggle = BooleanToggle(True)  # disabled
button_6 = Button()  # disabled
button_7 = Button()  # disabled
panel_67 = Panel(text_join_3)  # disabled
panel_68 = Panel("P90,90,90,90,90,72,50")  # disabled
button_8 = Button()  # disabled
write_5 = SerialWriteGeneric(StartWritingValues=button_6, WriteData=number_slider_30, PortNumber=number_slider)  # -> ArduinoOutput, StatusMessage; disabled
write_6 = SerialWriteGeneric(StartWritingValues=button_7, WriteData=number_slider_29, PortNumber=number_slider)  # -> ArduinoOutput, StatusMessage; disabled
write_7 = SerialWriteGeneric(StartWritingValues=button_8, WriteData=panel_68, PortNumber=number_slider)  # -> ArduinoOutput, StatusMessage; disabled
write_8 = SerialWriteGeneric(StartWritingValues=boolean_toggle, WriteData=panel_67, PortNumber=number_slider)  # -> ArduinoOutput, StatusMessage; disabled
data_recorder_3 = DataRecorder(write_6.ArduinoOutput, DataLimit=-10, RecordData=True)  # disabled
data_recorder_4 = DataRecorder(write_7.ArduinoOutput, DataLimit=-10, RecordData=True)  # disabled
data_recorder_5 = DataRecorder(write_5.ArduinoOutput, DataLimit=-10, RecordData=True)  # disabled
data_recorder_6 = DataRecorder(write_8.ArduinoOutput, DataLimit=-10, RecordData=True)  # disabled
panel_69 = Panel(data_recorder_6)  # disabled
panel_70 = Panel(data_recorder_4)  # disabled
panel_71 = Panel(data_recorder_5)  # disabled
panel_72 = Panel(data_recorder_3)  # disabled

list_length_3 = ListLength(List=interpolate.Curve)
list_item_16 = ListItem(List=interpolate.Curve, Index=expr("x-1", list_length_3), Wrap=True)
list_item_17 = ListItem(List=interpolate.Curve, Index=0, Wrap=True)
curve = Curve([circle, list_item_16])
curve_2 = Curve([list_item_17, circle_2])
loft_3 = Loft(Curves=flatten(curve), Options={Adjust=True, Closed=False, LoftEnds=0, LoftSimp=0, LoftType=1, Rebuild=7, Refit=0.01})
loft_4 = Loft(Curves=flatten(curve_2), Options={Adjust=True, Closed=False, LoftEnds=0, LoftSimp=0, LoftType=0, Rebuild=10, Refit=0.01})
