# Grasshopper definition vectorgraphics_LOFT_10 (inactive_setuP).gh (Grasshopper 1.0.7)
# plug-ins: Firefly.X, Firefly.Core

frame_rate = FrameRate()  # -> simplify(flatten(RefreshRate)), Frequency
panel = Panel(frame_rate.RefreshRate)
panel_2 = Panel(frame_rate.Frequency)

integer = Integer(1)
timer = Timer(TimerInterval=20, Target=data_recorder)
data_recorder = DataRecorder(integer, DataLimit=-360, RecordData=True)
mass_addition = MassAddition(Input=data_recorder)  # -> Result, PartialResults
mass_addition_2 = MassAddition(Input=data_recorder)  # -> Result, PartialResults
panel_3 = Panel(mass_addition.Result)
multiplication = Multiplication(A=panel_3, B=Slider(2, range=0..10))
number_of_lists = Slider(8, range=0..10)
series = Series(Start=panel_3, Step=multiplication, Count=number_of_lists)
height_between_loft_segments = Slider(1, range=0..10)
panel_4 = Panel(series)
_1 = Integer(1)
random = Random(Range=Domain(0, 1), Number=_1, Seed=series)
panel_5 = Panel(random)
addition = Addition(A=_1, B=height_between_loft_segments)
increse_distance_from_centre = Slider(2, range=0..5)
unit_z = UnitZ(Factor=_1)
series_2 = Series(Start=unit_z, Step=addition, Count=number_of_lists)
list_length = ListLength(List=series_2)
list_item = ListItem(List=series_2, Index=expr("x-1", list_length), Wrap=True)

height_between_loft_segments_2 = Slider(10, range=0..10)
_1_2 = Integer(1)
number_of_lists_2 = Slider(14, range=0..30)
addition_2 = Addition(A=_1_2, B=height_between_loft_segments_2)
addition_3 = Addition(A=list_item, B=7)
unit_z_2 = UnitZ(Factor=_1_2)
series_3 = Series(Start=Slider(1, range=0..10), Step=1, Count=number_of_lists_2)
series_4 = Series(Start=addition_3, Step=addition_2, Count=number_of_lists_2)
multiplication_2 = Multiplication(A=series_3, B=series_3)
_0 = Integer(0)
integer_2 = Integer(-3)
_1_3 = Integer(1)
panel_6 = Panel(multiplication_2)
construct_point = ConstructPoint(XCoordinate=multiplication_2, YCoordinate=_0, ZCoordinate=series_4)
construct_point_2 = ConstructPoint(XCoordinate=_0, YCoordinate=_0, ZCoordinate=_0)
panel_7 = Panel(construct_point)
integer_3 = Integer(1)
series_5 = Series(Start=mass_addition_2.Result, Step=Slider(35, range=0..100), Count=number_of_lists_2)
multiplication_3 = Multiplication(A=series_5, B=Slider(9, range=0..10))
rotate_3d = Rotate3D(Geometry=construct_point, Angle=degrees(multiplication_3), Center=construct_point_2, Axis=unit_z_2)  # -> flatten(Geometry), Transform
panel_8 = Panel(series_5)
panel_9 = Panel(rotate_3d.Geometry)
interpolate_t = InterpolateT(Vertices=rotate_3d.Geometry, TangentStart=Vector(0, 0, 0), TangentEnd=Vector(0, 0, 0), KnotStyle=1)  # -> Curve, Length, Domain
multiplication_4 = Multiplication(A=mass_addition_2.Result, B=Slider(0.3, range=0..1))
divide_curve = DivideCurve(Curve=interpolate_t.Curve, Count=Slider(60, range=0..100), Kinks=False)  # -> Points, Tangents, Parameters
panel_10 = Panel(divide_curve.Points)
number_slider = Slider(10, range=0..10)
series_6 = Series(Start=multiplication_4, Step=1, Count=number_slider)
panel_11 = Panel(series_6)
sine = Sine(Value=series_6)
unit_z_3 = UnitZ(Factor=sine)
multiplication_5 = Multiplication(A=unit_z_3, B=Slider(4, range=0..10))
multiplication_6 = Multiplication(A=multiplication_5, B=-1)
series_7 = Series(Start=Slider(0, range=0..10), Step=Slider(2, range=0..10), Count=number_slider)
panel_12 = Panel(multiplication_5)
panel_13 = Panel(multiplication_6)
panel_14 = Panel(series_7)
division = Division(A=panel_14, B=Slider(6, range=0..10))
panel_15 = Panel(division)
multiplication_7 = Multiplication(A=series_7, B=panel_15)
integer_4 = Integer(multiplication_7)
list_item_2 = ListItem(List=divide_curve.Points, Index=integer_4, Wrap=True)
move = Move(Geometry=list_item_2, Motion=multiplication_5)  # -> Geometry, Transform
move_2 = Move(Geometry=list_item_2, Motion=multiplication_6)  # -> Geometry, Transform

panel_16 = Panel(list_item)
addition_4 = Addition(A=random, B=increse_distance_from_centre)  # -> flatten(Result)

list_length_2 = ListLength(List=series_2)
list_item_3 = ListItem(List=series_2, Index=expr("x-1", list_length_2), Wrap=True)
list_item_4 = ListItem(List=series_2, Index=0, Wrap=True)
integer_5 = Integer(-10)
construct_point_3 = ConstructPoint(XCoordinate=integer_5, YCoordinate=0, ZCoordinate=list_item_3)
construct_point_4 = ConstructPoint(XCoordinate=integer_5, YCoordinate=0, ZCoordinate=list_item_4)
line = Line(StartPoint=construct_point_4, EndPoint=construct_point_3)
divide_curve_2 = DivideCurve(Curve=line, Count=number_of_lists, Kinks=False)  # -> Points, Tangents, Parameters
unit_x = UnitX(Factor=addition_4)
move_3 = Move(Geometry=divide_curve_2.Points, Motion=unit_x)  # -> Geometry, Transform
line_2 = Line(StartPoint=divide_curve_2.Points, EndPoint=move_3.Geometry)

integer_6 = Integer(-3)
_0_2 = Integer(0)
construct_point_5 = ConstructPoint(XCoordinate=_0_2, YCoordinate=_0_2, ZCoordinate=_0_2)
construct_point_6 = ConstructPoint(XCoordinate=addition_4, YCoordinate=_0_2, ZCoordinate=series_2)
panel_17 = Panel(construct_point_6)
number_slider_2 = Slider(36, range=0..100)
multiplication_8 = Multiplication(A=mass_addition.Result, B=number_slider_2)
series_8 = Series(Start=multiplication_8, Step=30, Count=number_of_lists)
rotate_3d_2 = Rotate3D(Geometry=construct_point_6, Angle=degrees(series_8), Center=construct_point_5, Axis=unit_z)  # -> graft(Geometry), Transform
panel_18 = Panel(rotate_3d_2.Geometry)
# limitation of math to describe complexity how we learnt it. pyhtagarous, sine waves etc, understand the line. Black magic is to make that line look alive.
# 
# How to draw simplicity out of complexity?
panel_19 = Panel(series_2)
division_2 = Division(A=Slider(360, range=0..1000), B=number_slider_2)
panel_20 = Panel(series_8)
panel_21 = Panel(division_2)
construct_point_7 = ConstructPoint(XCoordinate=Slider(22, range=0..40), YCoordinate=0, ZCoordinate=panel_19)
construct_point_8 = ConstructPoint(XCoordinate=Slider(7, range=0..10), YCoordinate=0, ZCoordinate=panel_19)
line_3 = Line(StartPoint=construct_point_8, EndPoint=construct_point_7)
curve = Curve(line_3)

number_slider_3 = Slider(2, range=0..10)  # disabled
division_3 = Division(A=list_item, B=number_slider_3)  # disabled
construct_point_9 = ConstructPoint(XCoordinate=0, YCoordinate=0, ZCoordinate=division_3)  # disabled
plane_normal = PlaneNormal(Origin=construct_point_9, ZAxis=Vector(0, 0, 1))  # disabled
number_slider_4 = Slider(1, range=0..5)  # disabled
mirror = Mirror(Geometry=move.Geometry, Plane=plane_normal)  # -> Geometry, Transform; disabled
mirror_2 = Mirror(Geometry=move_2.Geometry, Plane=plane_normal)  # -> Geometry, Transform; disabled
number_slider_5 = Slider(108, range=0..360)  # disabled
multiplication_9 = Multiplication(A=number_slider_4, B=-1)  # disabled
unit_z_4 = UnitZ(Factor=multiplication_9)  # disabled
unit_z_5 = UnitZ(Factor=number_slider_4)  # disabled
rotate_3d_3 = Rotate3D(Geometry=mirror.Geometry, Angle=degrees(number_slider_5), Center=Point(0, 0, 0), Axis=Vector(0, 0, 1))  # -> Geometry, Transform; disabled
rotate_3d_4 = Rotate3D(Geometry=mirror_2.Geometry, Angle=degrees(number_slider_5), Center=Point(0, 0, 0), Axis=Vector(0, 0, 1))  # -> Geometry, Transform; disabled
interpolate_t_2 = InterpolateT(Vertices=rotate_3d_3.Geometry, TangentStart=unit_z_4, TangentEnd=Vector(0, 0, 0), KnotStyle=1)  # -> Curve, Length, Domain; disabled
interpolate_t_3 = InterpolateT(Vertices=move_2.Geometry, TangentStart=unit_z_5, TangentEnd=Vector(0, 0, 0), KnotStyle=1)  # -> Curve, Length, Domain; disabled
panel_22 = Panel(rotate_3d_4.Geometry)  # disabled
custom_preview = CustomPreview(
    Geometry=[interpolate_t_2.Curve, interpolate_t_3.Curve],
    Material={diffuse=RGB(255, 0, 0), emission=RGB(66, 48, 66), shine=0.5, specular=RGB(255, 255, 255), transparency=0})  # disabled

divide_curve_3 = DivideCurve(Curve=curve, Count=10, Kinks=False)  # -> Points, Tangents, Parameters
number_slider_6 = Slider(2.3, range=0..5)
unit_z_6 = UnitZ(Factor=1)  # disabled
multiplication_10 = Multiplication(A=unit_z_6, B=-1)  # disabled
interpolate_t_4 = InterpolateT(Vertices=move.Geometry, TangentStart=unit_z_6, TangentEnd=Vector(0, 0, 0), KnotStyle=1)  # -> reparameterize(Curve), Length, Domain; disabled
interpolate_t_5 = InterpolateT(Vertices=rotate_3d_4.Geometry, TangentStart=multiplication_10, TangentEnd=Vector(0, 0, 0), KnotStyle=1)  # -> reparameterize(Curve), Length, Domain; disabled
domain = Domain(interpolate_t_4.Curve)  # disabled
panel_23 = Panel(domain)  # disabled

gene_pool = GenePool(Decimals=2, Maximum=1, Minimum=0, Value=[0, 0.23, 0.5246, 0.76, 1])  # disabled
gene_pool_2 = GenePool(Decimals=2, Maximum=10, Minimum=0, Value=[2.32, 0.3, 2.46, 4.43, 0])  # disabled
pipe = Pipe(Curve=[interpolate_t_4.Curve, interpolate_t_5.Curve], Radius=number_slider_6, Caps=0)  # disabled
pipe_variable = PipeVariable(Curve=[interpolate_t_4.Curve, interpolate_t_5.Curve], Parameters=gene_pool, Radii=gene_pool_2, Caps=0)  # disabled
panel_24 = Panel(pipe)  # disabled
panel_25 = Panel(pipe_variable)  # disabled
custom_preview_2 = CustomPreview(
    Geometry=pipe_variable,
    Material={diffuse=RGB(30, 144, 255), emission=RGB(76, 76, 76), shine=0.5, specular=RGB(255, 255, 255), transparency=0})  # disabled

number_slider_7 = Slider(293, range=0..360)  # disabled
number_slider_8 = Slider(79, range=0..360)  # disabled
number_slider_9 = Slider(219, range=0..360)  # disabled
rotate_3d_5 = Rotate3D(Geometry=interpolate_t_4.Curve, Angle=degrees(number_slider_8), Center=Point(0, 0, 0), Axis=Vector(0, 0, 1))  # -> Geometry, Transform; disabled
rotate_3d_6 = Rotate3D(Geometry=interpolate_t_4.Curve, Angle=degrees(number_slider_7), Center=Point(0, 0, 0), Axis=Vector(0, 0, 1))  # -> Geometry, Transform; disabled
rotate_3d_7 = Rotate3D(Geometry=interpolate_t_4.Curve, Angle=degrees(number_slider_9), Center=Point(0, 0, 0), Axis=Vector(0, 0, 1))  # -> Geometry, Transform; disabled
divide_curve_4 = DivideCurve(Curve=interpolate_t_5.Curve, Count=4, Kinks=False)  # -> Points, Tangents, Parameters; disabled
divide_curve_5 = DivideCurve(Curve=interpolate_t_5.Curve, Count=2, Kinks=False)  # -> Points, Tangents, Parameters; disabled
divide_curve_6 = DivideCurve(Curve=interpolate_t_5.Curve, Count=3, Kinks=False)  # -> Points, Tangents, Parameters; disabled
divide_curve_7 = DivideCurve(Curve=rotate_3d_7.Geometry, Count=3, Kinks=False)  # -> Points, Tangents, Parameters; disabled
divide_curve_8 = DivideCurve(Curve=rotate_3d_5.Geometry, Count=2, Kinks=False)  # -> Points, Tangents, Parameters; disabled
divide_curve_9 = DivideCurve(Curve=rotate_3d_6.Geometry, Count=4, Kinks=False)  # -> Points, Tangents, Parameters; disabled
interpolate_t_6 = InterpolateT(Vertices=divide_curve_4.Points, TangentStart=Vector(0, 0, 0), TangentEnd=Vector(0, 0, 0), KnotStyle=1)  # -> Curve, Length, Domain; disabled
interpolate_t_7 = InterpolateT(Vertices=divide_curve_5.Points, TangentStart=Vector(0, 0, 0), TangentEnd=Vector(0, 0, 0), KnotStyle=1)  # -> Curve, Length, Domain; disabled
interpolate_t_8 = InterpolateT(Vertices=divide_curve_9.Points, TangentStart=Vector(0, 0, 0), TangentEnd=Vector(0, 0, 0), KnotStyle=1)  # -> Curve, Length, Domain; disabled
interpolate_t_9 = InterpolateT(Vertices=divide_curve_6.Points, TangentStart=Vector(0, 0, 0), TangentEnd=Vector(0, 0, 0), KnotStyle=1)  # -> Curve, Length, Domain; disabled
multiplication_11 = Multiplication(A=number_slider_6, B=0.3)  # disabled
multiplication_12 = Multiplication(A=number_slider_6, B=0.2)  # disabled
interpolate_t_10 = InterpolateT(Vertices=divide_curve_8.Points, TangentStart=Vector(0, 0, 0), TangentEnd=Vector(0, 0, 0), KnotStyle=1)  # -> Curve, Length, Domain; disabled
interpolate_t_11 = InterpolateT(Vertices=divide_curve_7.Points, TangentStart=Vector(0, 0, 0), TangentEnd=Vector(0, 0, 0), KnotStyle=1)  # -> Curve, Length, Domain; disabled
plane_normal_2 = PlaneNormal(Origin=divide_curve_4.Points, ZAxis=divide_curve_4.Tangents)  # disabled
plane_normal_3 = PlaneNormal(Origin=divide_curve_5.Points, ZAxis=divide_curve_5.Tangents)  # disabled
plane_normal_4 = PlaneNormal(Origin=divide_curve_9.Points, ZAxis=divide_curve_9.Tangents)  # disabled
plane_normal_5 = PlaneNormal(Origin=divide_curve_8.Points, ZAxis=divide_curve_8.Tangents)  # disabled
multiplication_13 = Multiplication(A=multiplication_11, B=number_slider_6)  # disabled
multiplication_14 = Multiplication(A=multiplication_12, B=number_slider_6)  # disabled
ellipse = Ellipse(Plane=plane_normal_2, Radius1=multiplication_13, Radius2=multiplication_11)  # -> Ellipse, Focus1, Focus2; disabled
ellipse_2 = Ellipse(Plane=plane_normal_3, Radius1=multiplication_13, Radius2=multiplication_11)  # -> Ellipse, Focus1, Focus2; disabled
ellipse_3 = Ellipse(Plane=plane_normal_4, Radius1=multiplication_14, Radius2=multiplication_12)  # -> Ellipse, Focus1, Focus2; disabled
ellipse_4 = Ellipse(Plane=plane_normal_5, Radius1=multiplication_14, Radius2=multiplication_12)  # -> Ellipse, Focus1, Focus2; disabled
panel_26 = Panel(multiplication_13)  # disabled
panel_27 = Panel(multiplication_14)  # disabled
loft = Loft(Curves=ellipse.Ellipse, Options={Adjust=False, Closed=False, LoftEnds=0, LoftSimp=0, LoftType=0, Rebuild=10, Refit=0.01})  # disabled
loft_2 = Loft(
    Curves=ellipse_2.Ellipse,
    Options={Adjust=False, Closed=False, LoftEnds=0, LoftSimp=0, LoftType=0, Rebuild=10, Refit=0.01})  # disabled
loft_3 = Loft(
    Curves=ellipse_3.Ellipse,
    Options={Adjust=False, Closed=False, LoftEnds=0, LoftSimp=0, LoftType=0, Rebuild=10, Refit=0.01})  # disabled
loft_4 = Loft(
    Curves=ellipse_4.Ellipse,
    Options={Adjust=False, Closed=False, LoftEnds=0, LoftSimp=0, LoftType=0, Rebuild=10, Refit=0.01})  # disabled
custom_preview_3 = CustomPreview(
    Geometry=[interpolate_t_8.Curve, interpolate_t_10.Curve, interpolate_t_7.Curve, interpolate_t_6.Curve, interpolate_t_9.Curve, interpolate_t_11.Curve],
    Material={diffuse=RGB(255, 255, 255), emission=RGB(66, 48, 66), shine=0.5, specular=RGB(255, 255, 255), transparency=0})  # disabled

ports_available = COMPortsAvailable()  # disabled
panel_28 = Panel("3")  # disabled
panel_29 = Panel(ports_available)  # disabled
toggle = BooleanToggle(True)  # disabled
open_port = OpenClosePort(OpenClosePort=toggle, PortNumber=panel_28, BaudRate=115200)  # disabled
panel_30 = Panel(open_port)  # disabled
toggle_2 = BooleanToggle(False)  # disabled
toggle_3 = BooleanToggle(True)  # disabled
timer_2 = Timer(TimerInterval=20, Target=[uno_read, serial_read_generic])  # disabled
uno_write = UnoWrite(
    StartWritingValues=toggle_2,
    DigitalPin13=0,
    DigitalPin12=0,
    DigitalPin11=0,
    DigitalPin10=0,
    DigitalPin9=0,
    DigitalPin8=0,
    DigitalPin6=0,
    DigitalPin5=0,
    DigitalPin3=0,
    PortNumber=panel_28)  # -> ArduinoOutput, StatusMessage; disabled
timer_3 = Timer(TimerInterval=20, Target=uno_write)  # disabled
uno_read = UnoRead(StartReadingValues=toggle_3, PortNumber=panel_28)  # -> AnalogPin0, AnalogPin1, AnalogPin2, AnalogPin3, AnalogPin4, AnalogPin5, DigitalPin2, DigitalPin4, DigitalPin7, StatusMessage; disabled
panel_31 = Panel(uno_read.AnalogPin0)  # disabled
panel_32 = Panel(uno_write.StatusMessage)  # disabled
panel_33 = Panel(uno_write.ArduinoOutput)  # disabled
panel_34 = Panel(uno_read.AnalogPin1)  # disabled
panel_35 = Panel(uno_read.DigitalPin4)  # disabled
panel_36 = Panel(uno_read.DigitalPin2)  # disabled
panel_37 = Panel(uno_read.DigitalPin7)  # disabled
panel_38 = Panel(uno_read.AnalogPin5)  # disabled
panel_39 = Panel(uno_read.AnalogPin4)  # disabled
panel_40 = Panel(uno_read.AnalogPin2)  # disabled
panel_41 = Panel(uno_read.AnalogPin3)  # disabled
panel_42 = Panel(uno_read.StatusMessage)  # disabled
number_slider_10 = Slider(4, range=0..10)  # disabled
boolean_toggle = BooleanToggle(True)  # disabled
serial_read_generic = SerialReadGeneric(StartReadingValues=boolean_toggle, PortNumber=number_slider_10)  # -> SerialOutput, StatusMessage; disabled
panel_43 = Panel(serial_read_generic.StatusMessage)  # disabled
panel_44 = Panel(serial_read_generic.SerialOutput)  # disabled

set_wrist_rotation = Slider(146, range=0..180)  # disabled
number_slider_11 = Slider(64, range=0..200)  # disabled
set_wrist = Slider(103, range=0..180)  # disabled
set_gripper = Slider(73, range=10..73)  # disabled
set_base = Slider(180, range=0..180)  # disabled
set_elbow = Slider(96, range=0..180)  # disabled
set_shoulder = Slider(49, range=15..165)  # disabled
panel_45 = Panel("P")  # disabled
panel_46 = Panel([panel_45, set_base, set_shoulder, set_elbow, set_wrist_rotation, set_wrist, set_gripper, number_slider_11])  # disabled
number_slider_12 = Slider(1, range=0..1)  # disabled
number_slider_13 = Slider(0, range=0..1)  # disabled
text_join = TextJoin(Text=panel_46, Join=",")  # disabled
button = Button()  # disabled
button_2 = Button()  # disabled
panel_47 = Panel(text_join)  # disabled
panel_48 = Panel("P90,90,90,90,90,50,50")  # disabled
button_3 = Button()  # disabled
button_4 = Button()  # disabled
write = SerialWriteGeneric(StartWritingValues=button_3, WriteData=panel_48, PortNumber=number_slider_10)  # -> ArduinoOutput, StatusMessage; disabled
write_2 = SerialWriteGeneric(StartWritingValues=button_4, WriteData=panel_47, PortNumber=number_slider_10)  # -> ArduinoOutput, StatusMessage; disabled
write_3 = SerialWriteGeneric(StartWritingValues=button_2, WriteData=number_slider_12, PortNumber=number_slider_10)  # -> ArduinoOutput, StatusMessage; disabled
write_4 = SerialWriteGeneric(StartWritingValues=button, WriteData=number_slider_13, PortNumber=number_slider_10)  # -> ArduinoOutput, StatusMessage; disabled
data_recorder_2 = DataRecorder(
    [write_4.ArduinoOutput, write_2.ArduinoOutput, write.ArduinoOutput, write_3.ArduinoOutput],
    DataLimit=-10,
    RecordData=True)  # disabled
panel_49 = Panel(data_recorder_2)  # disabled

number_slider_14 = Slider(4, range=0..10)  # disabled
boolean_toggle_2 = BooleanToggle(True)  # disabled
number_slider_15 = Slider(4, range=0..10)  # disabled
boolean_toggle_3 = BooleanToggle(True)  # disabled
serial_read_generic_2 = SerialReadGeneric(StartReadingValues=boolean_toggle_2, PortNumber=number_slider_14)  # -> SerialOutput, StatusMessage; disabled
open_close_port = OpenClosePort(OpenClosePort=boolean_toggle_3, PortNumber=number_slider_15, BaudRate=115200)  # disabled
panel_50 = Panel(open_close_port)  # disabled
panel_51 = Panel(serial_read_generic_2.SerialOutput)  # disabled

data_rec = PythonScript(x=rotate_3d_2.Geometry, enable=Toggle(True), reset=Button(), limit=panel_21)  # -> x; inputs x: tree, enable: Boolean, reset: Boolean, limit: Int32
# ---------- data_rec: Python ----------
from Grasshopper import DataTree
if reset or 'rec' not in globals(): rec = DataTree[object]()
if enable and not reset: rec.MergeTree(x)
if limit > 0:
  for branch in rec.Branches:
    if branch.Count > limit:
      branch.RemoveRange(0, branch.Count - limit)
x = rec
# ---------- end data_rec ----------
panel_52 = Panel(data_rec)
interpolate = Interpolate(Vertices=data_rec, Degree=Slider(5, range=1..11), Periodic=True, KnotStyle=1)  # -> flatten(Curve), Length, Domain
panel_53 = Panel(interpolate.Curve)
_2 = Integer(2)

deconstruct = Deconstruct(Point=panel_52)  # -> XComponent, YComponent, ZComponent
multiplication_15 = Multiplication(A=deconstruct.XComponent, B=Slider(0.25, range=0..1))
unit_z_7 = UnitZ(Factor=multiplication_15)
move_4 = Move(Geometry=divide_curve_3.Points, Motion=unit_z_7)  # -> Geometry, Transform
interpolate_t_12 = InterpolateT(Vertices=move_4.Geometry, TangentStart=Vector(0, 0, 0), TangentEnd=Vector(0, 0, 0), KnotStyle=1)  # -> Curve, Length, Domain
loft_5 = Loft(
    Curves=interpolate.Curve,
    Options={Adjust=False, Closed=False, LoftEnds=0, LoftSimp=0, LoftType=1, Rebuild=10, Refit=0.01})

divide_surface = DivideSurface(Surface=loft_5, UCount=Slider(7, range=0..10), VCount=_2)  # -> Points, Normals, Parameters
panel_54 = Panel(divide_surface.Points)
list_item_5 = ListItem(List=divide_surface.Points, Index=Slider(1, range=0..1), Wrap=True)
panel_55 = Panel(list_item_5)
deconstruct_2 = Deconstruct(Point=list_item_5)  # -> XComponent, YComponent, ZComponent

custom_preview_4 = CustomPreview(
    Geometry=loft_5,
    Material={diffuse=RGB(0, 250, 154), emission=RGB(66, 48, 66), shine=0.5, specular=RGB(255, 255, 255), transparency=0})

list_length_3 = ListLength(List=interpolate.Curve)  # disabled
list_item_6 = ListItem(List=interpolate.Curve, Index=expr("x-1", list_length_3), Wrap=True)  # disabled
list_item_7 = ListItem(List=move.Geometry, Index=0, Wrap=True)  # disabled
list_item_8 = ListItem(List=interpolate.Curve, Index=0, Wrap=True)  # disabled
plane_normal_6 = PlaneNormal(Origin=list_item_7, ZAxis=Vector(0, 0, 1))  # disabled
circle = Circle(Plane=plane_normal_6, Radius=number_slider_6)  # disabled
list_item_9 = ListItem(List=rotate_3d_4.Geometry, Index=0, Wrap=True)  # disabled
plane_normal_7 = PlaneNormal(Origin=list_item_9, ZAxis=Vector(0, 0, 1))  # disabled
circle_2 = Circle(Plane=plane_normal_7, Radius=number_slider_6)  # disabled
curve_2 = Curve([circle, list_item_6])  # disabled
curve_3 = Curve([list_item_8, circle_2])  # disabled
loft_options = LoftOptions(Closed=False, Adjust=True, Rebuild=0, Refit=0, Type=5)  # disabled
loft_6 = Loft(Curves=flatten(curve_2), Options=loft_options)  # disabled
loft_7 = Loft(Curves=flatten(curve_3), Options=loft_options)  # disabled
custom_preview_5 = CustomPreview(
    Geometry=[loft_7, loft_6],
    Material={diffuse=RGB(255, 255, 255), emission=RGB(76, 76, 76), shine=0.5, specular=RGB(255, 255, 255), transparency=0.7})  # disabled

panel_56 = Panel(deconstruct_2.ZComponent)  # disabled

# ----
# pythagerous theorom to get distance
multiplication_16 = Multiplication(A=deconstruct_2.XComponent, B=deconstruct_2.XComponent)  # disabled
multiplication_17 = Multiplication(A=deconstruct_2.YComponent, B=deconstruct_2.YComponent)  # disabled
addition_5 = Addition(A=multiplication_16, B=multiplication_17)  # disabled
square_root = SquareRoot(Value=addition_5)  # disabled
panel_57 = Panel(square_root)  # disabled
number_slider_16 = Slider(3.1, range=0..10)  # disabled
number_slider_17 = Slider(1.9, range=0..10)  # disabled
number_slider_18 = Slider(1, range=0..1)  # disabled
number_slider_19 = Slider(0, range=0..100)  # disabled
construct_domain = ConstructDomain(DomainStart=number_slider_17, DomainEnd=number_slider_16)  # disabled
construct_domain_2 = ConstructDomain(DomainStart=number_slider_19, DomainEnd=number_slider_18)  # disabled
construct_point_10 = ConstructPoint(XCoordinate=integer_5, YCoordinate=0, ZCoordinate=panel_56)  # disabled
remap_numbers = RemapNumbers(Value=square_root, Source=construct_domain, Target=construct_domain_2)  # -> flatten(Mapped), Clipped; disabled
unit_x_2 = UnitX(Factor=square_root)  # disabled
move_5 = Move(Geometry=construct_point_10, Motion=unit_x_2)  # -> Geometry, Transform; disabled
line_4 = Line(StartPoint=construct_point_10, EndPoint=move_5.Geometry)  # disabled
number_slider_20 = Slider(6, range=0..10)  # disabled
number_slider_21 = Slider(4, range=0..10)  # disabled
number_slider_22 = Slider(2, range=0..10)  # disabled
number_slider_23 = Slider(3, range=0..10)  # disabled
number_slider_24 = Slider(5, range=0..10)  # disabled
number_slider_25 = Slider(1, range=0..10)  # disabled
panel_58 = Panel(remap_numbers.Mapped)  # disabled
list_item_10 = ListItem(List=remap_numbers.Mapped, Index=number_slider_20, Wrap=True)  # disabled
list_item_11 = ListItem(List=remap_numbers.Mapped, Index=number_slider_25, Wrap=True)  # disabled
list_item_12 = ListItem(List=remap_numbers.Mapped, Index=number_slider_22, Wrap=True)  # disabled
list_item_13 = ListItem(List=remap_numbers.Mapped, Index=number_slider_23, Wrap=True)  # disabled
list_item_14 = ListItem(List=remap_numbers.Mapped, Index=number_slider_21, Wrap=True)  # disabled
list_item_15 = ListItem(List=remap_numbers.Mapped, Index=number_slider_24, Wrap=True)  # disabled
number_slider_26 = Slider(72, range=10..72)  # disabled
number_slider_27 = Slider(10, range=10..72)  # disabled
number_slider_28 = Slider(15, range=15..100)  # disabled
number_slider_29 = Slider(165, range=0..165)  # disabled
number_slider_30 = Slider(180, range=0..180)  # disabled
number_slider_31 = Slider(0, range=0..100)  # disabled
construct_domain_3 = ConstructDomain(DomainStart=number_slider_28, DomainEnd=number_slider_29)  # disabled
construct_domain_4 = ConstructDomain(DomainStart=number_slider_27, DomainEnd=number_slider_26)  # disabled
construct_domain_5 = ConstructDomain(DomainStart=number_slider_31, DomainEnd=number_slider_30)  # disabled
panel_59 = Panel(construct_domain_5)  # disabled
remap_numbers_2 = RemapNumbers(Value=list_item_12, Source=construct_domain_2, Target=construct_domain_3)  # -> Mapped, Clipped; disabled
remap_numbers_3 = RemapNumbers(Value=list_item_11, Source=construct_domain_2, Target=construct_domain_5)  # -> Mapped, Clipped; disabled
remap_numbers_4 = RemapNumbers(Value=list_item_13, Source=construct_domain_2, Target=construct_domain_5)  # -> Mapped, Clipped; disabled
remap_numbers_5 = RemapNumbers(Value=list_item_14, Source=construct_domain_2, Target=construct_domain_5)  # -> Mapped, Clipped; disabled
remap_numbers_6 = RemapNumbers(Value=list_item_15, Source=construct_domain_2, Target=construct_domain_5)  # -> Mapped, Clipped; disabled
remap_numbers_7 = RemapNumbers(Value=list_item_10, Source=construct_domain_2, Target=construct_domain_4)  # -> Mapped, Clipped; disabled
panel_60 = Panel(remap_numbers_3.Mapped)  # disabled
panel_61 = Panel(remap_numbers_2.Mapped)  # disabled
panel_62 = Panel(remap_numbers_4.Mapped)  # disabled
panel_63 = Panel(remap_numbers_5.Mapped)  # disabled
panel_64 = Panel(remap_numbers_6.Mapped)  # disabled
panel_65 = Panel(remap_numbers_7.Mapped)  # disabled
integer_7 = Integer(remap_numbers_3.Mapped)  # disabled
integer_8 = Integer(remap_numbers_2.Mapped)  # disabled
integer_9 = Integer(remap_numbers_4.Mapped)  # disabled
integer_10 = Integer(remap_numbers_5.Mapped)  # disabled
integer_11 = Integer(remap_numbers_6.Mapped)  # disabled
integer_12 = Integer(remap_numbers_7.Mapped)  # disabled
panel_66 = Panel([integer_7, integer_8, integer_9, integer_10, integer_11, integer_12])  # disabled
panel_67 = Panel("P")  # disabled
panel_68 = Panel("200")  # disabled
list_item_16 = ListItem(List=panel_66, Index=0, Wrap=True)  # disabled
panel_69 = Panel([panel_67, list_item_16])  # disabled
text_join_2 = TextJoin(Text=panel_69)  # disabled
panel_70 = Panel([text_join_2, panel_66, panel_68])  # disabled
data_dam = DataDam(DataDataA=panel_70, BufferDelay=10000000, BufferMode=0)  # disabled
number_slider_32 = Slider(1, range=0..1)  # disabled
text_join_3 = TextJoin(Text=data_dam, Join=",")  # disabled
number_slider_33 = Slider(0, range=0..1)  # disabled
boolean_toggle_4 = BooleanToggle(True)  # disabled
button_5 = Button()  # disabled
button_6 = Button()  # disabled
panel_71 = Panel(text_join_3)  # disabled
panel_72 = Panel("P90,90,90,90,90,72,50")  # disabled
button_7 = Button()  # disabled
write_5 = SerialWriteGeneric(StartWritingValues=button_5, WriteData=number_slider_33, PortNumber=number_slider_10)  # -> ArduinoOutput, StatusMessage; disabled
write_6 = SerialWriteGeneric(StartWritingValues=button_6, WriteData=number_slider_32, PortNumber=number_slider_14)  # -> ArduinoOutput, StatusMessage; disabled
write_7 = SerialWriteGeneric(StartWritingValues=button_7, WriteData=panel_72, PortNumber=number_slider_10)  # -> ArduinoOutput, StatusMessage; disabled
write_8 = SerialWriteGeneric(StartWritingValues=boolean_toggle_4, WriteData=panel_71, PortNumber=number_slider_10)  # -> ArduinoOutput, StatusMessage; disabled
data_recorder_3 = DataRecorder(write_6.ArduinoOutput, DataLimit=-10, RecordData=True)  # disabled
data_recorder_4 = DataRecorder(write_5.ArduinoOutput, DataLimit=-10, RecordData=True)  # disabled
data_recorder_5 = DataRecorder(write_7.ArduinoOutput, DataLimit=-10, RecordData=True)  # disabled
data_recorder_6 = DataRecorder(write_8.ArduinoOutput, DataLimit=-10, RecordData=True)  # disabled
panel_73 = Panel(data_recorder_6)  # disabled
panel_74 = Panel(data_recorder_5)  # disabled
panel_75 = Panel(data_recorder_4)  # disabled
panel_76 = Panel(data_recorder_3)  # disabled
