# Grasshopper definition vectorgraphics_LOFT_11 (exponentialwave_twoArduinos_failWithoutFirmata)-1.gh (Grasshopper 0.9.76)
# plug-ins: Python Interpreter, Firefly.X, Firefly.Core

frame_rate = FrameRate()  # -> simplify(flatten(RefreshRate)), Frequency
panel = Panel(frame_rate.RefreshRate)
panel_2 = Panel(frame_rate.Frequency)

integer = Integer(1)
timer = Timer(TimerInterval=20, Target=data_recorder)
data_recorder = DataRecorder(integer, DataLimit=-360, RecordData=True)
mass_addition = MassAddition(Input=data_recorder)  # -> Result, PartialResults
mass_addition_2 = MassAddition(Input=data_recorder)  # -> Result, PartialResults
panel_3 = Panel(mass_addition.Result)
multiplication = Multiplication(A=panel_3, B=Slider(2, range=0..10))
number_of_lists = Slider(8, range=0..10)
series = Series(Start=panel_3, Step=multiplication, Count=number_of_lists)
panel_4 = Panel(series)
_1 = Integer(1)
random = Random(Range=Domain(0, 1), Number=_1, Seed=series)
height_between_loft_segments = Slider(1, range=0..10)
panel_5 = Panel(random)
addition = Addition(A=_1, B=height_between_loft_segments)
increse_distance_from_centre = Slider(2, range=0..5)
unit_z = UnitZ(Factor=_1)
# limitation of math to describe complexity how we learnt it. pyhtagarous, sine waves etc, understand the line. Black magic is to make that line look alive.
# 
# How to draw simplicity out of complexity?
number_slider = Slider(7, range=0..10)
series_2 = Series(Start=unit_z, Step=addition, Count=number_of_lists)
list_length = ListLength(List=series_2)
panel_6 = Panel(series_2)
list_item = ListItem(List=series_2, Index=expr("x-1", list_length), Wrap=True)

height_between_loft_segments_2 = Slider(10, range=0..10)
_1_2 = Integer(1)
number_of_lists_2 = Slider(14, range=0..30)
addition_2 = Addition(A=_1_2, B=height_between_loft_segments_2)
addition_3 = Addition(A=list_item, B=7)
unit_z_2 = UnitZ(Factor=_1_2)
series_3 = Series(Start=Slider(1, range=0..10), Step=1, Count=number_of_lists_2)
series_4 = Series(Start=addition_3, Step=addition_2, Count=number_of_lists_2)
_0 = Integer(0)
integer_2 = Integer(-3)
_1_3 = Integer(1)
construct_point = ConstructPoint(XCoordinate=0, YCoordinate=_0, ZCoordinate=series_4)
construct_point_2 = ConstructPoint(XCoordinate=_0, YCoordinate=_0, ZCoordinate=_0)
panel_7 = Panel(construct_point)
number_slider_2 = Slider(9, range=0..10)
integer_3 = Integer(1)
series_5 = Series(Start=mass_addition_2.Result, Step=Slider(35, range=0..100), Count=number_of_lists_2)
rotate_3d = Rotate3D(Geometry=construct_point, Angle=degrees(1.570796327), Center=construct_point_2, Axis=unit_z_2)  # -> flatten(Geometry), Transform
panel_8 = Panel(series_5)
number_slider_3 = Slider(0.3, range=0..1)
panel_9 = Panel(rotate_3d.Geometry)
divide_curve = DivideCurve(Count=Slider(60, range=0..100), Kinks=False)  # -> Points, Tangents, Parameters
panel_10 = Panel(divide_curve.Points)
number_slider_4 = Slider(4, range=0..10)
number_slider_5 = Slider(10, range=0..10)
series_6 = Series(Start=0, Step=1, Count=number_slider_5)
panel_11 = Panel(series_6)
sine = Sine(Value=series_6)
unit_z_3 = UnitZ(Factor=sine)
series_7 = Series(Start=Slider(0, range=0..10), Step=Slider(2, range=0..10), Count=number_slider_5)
panel_12 = Panel(series_7)
division = Division(A=panel_12, B=Slider(6, range=0..10))
panel_13 = Panel(division)
integer_4 = Integer()
list_item_2 = ListItem(List=divide_curve.Points, Index=integer_4, Wrap=True)
move = Move(Geometry=list_item_2, Motion=Vector(0, 0, 10))  # -> Geometry, Transform
move_2 = Move(Geometry=list_item_2, Motion=Vector(0, 0, 10))  # -> Geometry, Transform

panel_14 = Panel(list_item)
construct_point_3 = ConstructPoint(XCoordinate=Slider(22, range=0..40), YCoordinate=0, ZCoordinate=panel_6)
construct_point_4 = ConstructPoint(XCoordinate=number_slider, YCoordinate=0, ZCoordinate=panel_6)
addition_4 = Addition(A=random, B=increse_distance_from_centre)  # -> flatten(Result)

list_length_2 = ListLength(List=series_2)
list_item_3 = ListItem(List=series_2, Index=expr("x-1", list_length_2), Wrap=True)
list_item_4 = ListItem(List=series_2, Index=0, Wrap=True)
integer_5 = Integer(-10)
construct_point_5 = ConstructPoint(XCoordinate=integer_5, YCoordinate=0, ZCoordinate=list_item_4)
construct_point_6 = ConstructPoint(XCoordinate=integer_5, YCoordinate=0, ZCoordinate=list_item_3)
line = Line(StartPoint=construct_point_5, EndPoint=construct_point_6)
divide_curve_2 = DivideCurve(Curve=line, Count=number_of_lists, Kinks=False)  # -> Points, Tangents, Parameters
unit_x = UnitX(Factor=addition_4)
move_3 = Move(Geometry=divide_curve_2.Points, Motion=unit_x)  # -> Geometry, Transform
line_2 = Line(StartPoint=divide_curve_2.Points, EndPoint=move_3.Geometry)

number_slider_6 = Slider(36, range=0..100)
multiplication_2 = Multiplication(A=mass_addition.Result, B=number_slider_6)
series_8 = Series(Start=multiplication_2, Step=26, Count=number_of_lists)
line_3 = Line(StartPoint=construct_point_4, EndPoint=construct_point_3)
division_2 = Division(A=Slider(360, range=0..1000), B=number_slider_6)
_0_2 = Integer(0)
construct_point_7 = ConstructPoint(XCoordinate=addition_4, YCoordinate=_0_2, ZCoordinate=series_2)
panel_15 = Panel(construct_point_7)
panel_16 = Panel(series_8)
panel_17 = Panel(division_2)
curve = Curve(line_3)
construct_point_8 = ConstructPoint(XCoordinate=_0_2, YCoordinate=_0_2, ZCoordinate=_0_2)
divide_curve_3 = DivideCurve(Curve=curve, Count=9, Kinks=False)  # -> Points, Tangents, Parameters
rotate_3d_2 = Rotate3D(Geometry=construct_point_7, Angle=degrees(series_8), Center=construct_point_8, Axis=unit_z)  # -> graft(Geometry), Transform

number_slider_7 = Slider(2, range=0..10)  # disabled
division_3 = Division(A=list_item, B=number_slider_7)  # disabled
construct_point_9 = ConstructPoint(XCoordinate=0, YCoordinate=0, ZCoordinate=division_3)  # disabled
plane_normal = PlaneNormal(Origin=construct_point_9, ZAxis=Vector(0, 0, 1))  # disabled
number_slider_8 = Slider(1, range=0..5)  # disabled
mirror = Mirror(Geometry=move.Geometry, Plane=plane_normal)  # -> Geometry, Transform; disabled
mirror_2 = Mirror(Geometry=move_2.Geometry, Plane=plane_normal)  # -> Geometry, Transform; disabled
number_slider_9 = Slider(108, range=0..360)  # disabled
unit_z_4 = UnitZ(Factor=1)  # disabled
unit_z_5 = UnitZ(Factor=number_slider_8)  # disabled
rotate_3d_3 = Rotate3D(Geometry=mirror.Geometry, Angle=degrees(number_slider_9), Center=Point(0, 0, 0), Axis=Vector(0, 0, 1))  # -> Geometry, Transform; disabled
rotate_3d_4 = Rotate3D(Geometry=mirror_2.Geometry, Angle=degrees(number_slider_9), Center=Point(0, 0, 0), Axis=Vector(0, 0, 1))  # -> Geometry, Transform; disabled
panel_18 = Panel(rotate_3d_4.Geometry)  # disabled
custom_preview = CustomPreview()  # disabled

number_slider_10 = Slider(2.3, range=0..5)
unit_z_6 = UnitZ(Factor=1)  # disabled
domain = Domain()  # disabled
panel_19 = Panel(domain)  # disabled
increse_distance_from_centre_2 = Slider(25, range=0..30)
list_length_3 = ListLength(List=construct_point_7)
multiplication_3 = Multiplication(A=mass_addition.Result, B=Slider(36, range=0..36))
division_4 = Division(A=multiplication_3, B=list_length_3)
addition_5 = Addition(A=random, B=increse_distance_from_centre_2)  # -> flatten(Result)
multiplication_4 = Multiplication(A=division_4, B=Slider(1, range=0..1))
unit_z_7 = UnitZ(Factor=_1)
construct_point_10 = ConstructPoint(XCoordinate=addition_5, YCoordinate=_0_2, ZCoordinate=series_2)
panel_20 = Panel(unit_z_7)
panel_21 = Panel(multiplication_4)
construct_point_11 = ConstructPoint(XCoordinate=_0_2, YCoordinate=_0_2, ZCoordinate=_0_2)
panel_22 = Panel(construct_point_10)

gene_pool = GenePool(Decimals=2, Maximum=1, Minimum=0, Value=[0, 0.23, 0.5246, 0.76, 1])  # disabled
gene_pool_2 = GenePool(Decimals=2, Maximum=10, Minimum=0, Value=[2.32, 0.3, 2.46, 4.43, 0])  # disabled
pipe = Pipe(Radius=number_slider_10, Caps=0)  # disabled
pipe_variable = PipeVariable(Parameters=gene_pool, Radii=gene_pool_2, Caps=0)  # disabled
panel_23 = Panel(pipe)  # disabled
panel_24 = Panel(pipe_variable)  # disabled
custom_preview_2 = CustomPreview(Geometry=pipe_variable)  # disabled

number_slider_11 = Slider(293, range=0..360)  # disabled
number_slider_12 = Slider(79, range=0..360)  # disabled
number_slider_13 = Slider(219, range=0..360)  # disabled
rotate_3d_5 = Rotate3D(Angle=degrees(number_slider_12), Center=Point(0, 0, 0), Axis=Vector(0, 0, 1))  # -> Geometry, Transform; disabled
rotate_3d_6 = Rotate3D(Angle=degrees(number_slider_11), Center=Point(0, 0, 0), Axis=Vector(0, 0, 1))  # -> Geometry, Transform; disabled
rotate_3d_7 = Rotate3D(Angle=degrees(number_slider_13), Center=Point(0, 0, 0), Axis=Vector(0, 0, 1))  # -> Geometry, Transform; disabled
divide_curve_4 = DivideCurve(Count=4, Kinks=False)  # -> Points, Tangents, Parameters; disabled
divide_curve_5 = DivideCurve(Count=2, Kinks=False)  # -> Points, Tangents, Parameters; disabled
divide_curve_6 = DivideCurve(Count=3, Kinks=False)  # -> Points, Tangents, Parameters; disabled
divide_curve_7 = DivideCurve(Curve=rotate_3d_7.Geometry, Count=3, Kinks=False)  # -> Points, Tangents, Parameters; disabled
divide_curve_8 = DivideCurve(Curve=rotate_3d_5.Geometry, Count=2, Kinks=False)  # -> Points, Tangents, Parameters; disabled
divide_curve_9 = DivideCurve(Curve=rotate_3d_6.Geometry, Count=4, Kinks=False)  # -> Points, Tangents, Parameters; disabled
plane_normal_2 = PlaneNormal(Origin=divide_curve_4.Points, ZAxis=divide_curve_4.Tangents)  # disabled
plane_normal_3 = PlaneNormal(Origin=divide_curve_5.Points, ZAxis=divide_curve_5.Tangents)  # disabled
plane_normal_4 = PlaneNormal(Origin=divide_curve_9.Points, ZAxis=divide_curve_9.Tangents)  # disabled
plane_normal_5 = PlaneNormal(Origin=divide_curve_8.Points, ZAxis=divide_curve_8.Tangents)  # disabled
ellipse = Ellipse(Plane=plane_normal_2, Radius1=1, Radius2=1)  # -> Ellipse, Focus1, Focus2; disabled
ellipse_2 = Ellipse(Plane=plane_normal_3, Radius1=1, Radius2=1)  # -> Ellipse, Focus1, Focus2; disabled
ellipse_3 = Ellipse(Plane=plane_normal_4, Radius1=1, Radius2=1)  # -> Ellipse, Focus1, Focus2; disabled
ellipse_4 = Ellipse(Plane=plane_normal_5, Radius1=1, Radius2=1)  # -> Ellipse, Focus1, Focus2; disabled
loft = Loft(Curves=ellipse.Ellipse, Options={Adjust=False, Closed=False, LoftEnds=0, LoftSimp=0, LoftType=0, Rebuild=10, Refit=0.01})  # disabled
loft_2 = Loft(
    Curves=ellipse_2.Ellipse,
    Options={Adjust=False, Closed=False, LoftEnds=0, LoftSimp=0, LoftType=0, Rebuild=10, Refit=0.01})  # disabled
loft_3 = Loft(
    Curves=ellipse_3.Ellipse,
    Options={Adjust=False, Closed=False, LoftEnds=0, LoftSimp=0, LoftType=0, Rebuild=10, Refit=0.01})  # disabled
loft_4 = Loft(
    Curves=ellipse_4.Ellipse,
    Options={Adjust=False, Closed=False, LoftEnds=0, LoftSimp=0, LoftType=0, Rebuild=10, Refit=0.01})  # disabled
custom_preview_3 = CustomPreview()  # disabled

toggle = BooleanToggle(True)

open_close_port = OpenClosePort(OpenClosePort=toggle, PortNumber=Slider(4, range=0..10), BaudRate=115200)
panel_25 = Panel(open_close_port)

ports_available = COMPortsAvailable()
timer_2 = Timer(TimerInterval=20, Target=serial_read_generic)
panel_26 = Panel(ports_available)
serial_read_generic = SerialReadGeneric(StartReadingValues=toggle, PortNumber="3")  # -> SerialOutput, StatusMessage
open_port = OpenClosePort(OpenClosePort=toggle, PortNumber="3", BaudRate="9600")
panel_27 = Panel("115200")
data_recorder_2 = DataRecorder(serial_read_generic.SerialOutput, DataLimit=-10, RecordData=True)
panel_28 = Panel(open_port)
panel_29 = Panel(serial_read_generic.StatusMessage)
panel_30 = Panel(data_recorder_2)
number_slider_14 = Slider(4, range=0..10)

set_wrist_rotation = Slider(76, range=0..180)
set_wrist = Slider(97, range=0..180)
set_gripper = Slider(166, range=10..180)
set_elbow = Slider(96, range=0..180)
set_base = Slider(99, range=0..180)
set_shoulder = Slider(95, range=15..165)
panel_31 = Panel(["P", set_base, set_shoulder, set_elbow, set_wrist_rotation, set_wrist, set_gripper, Slider(64, range=0..200)])
text_join = TextJoin(Text=panel_31, Join=",")
panel_32 = Panel(text_join)
write = SerialWriteGeneric(StartWritingValues=Button(), WriteData="P90,90,90,90,90,50,50", PortNumber=number_slider_14)  # -> ArduinoOutput, StatusMessage
write_2 = SerialWriteGeneric(StartWritingValues=Button(), WriteData=panel_32, PortNumber=number_slider_14)  # -> ArduinoOutput, StatusMessage
write_3 = SerialWriteGeneric(StartWritingValues=Button(), WriteData=Slider(1, range=0..1), PortNumber=number_slider_14)  # -> ArduinoOutput, StatusMessage
write_4 = SerialWriteGeneric(StartWritingValues=Button(), WriteData=Slider(0, range=0..1), PortNumber=number_slider_14)  # -> ArduinoOutput, StatusMessage
data_recorder_3 = DataRecorder(
    [write_4.ArduinoOutput, write_2.ArduinoOutput, write.ArduinoOutput, write_3.ArduinoOutput],
    DataLimit=-10,
    RecordData=True)
panel_33 = Panel(data_recorder_3)

list_item_5 = ListItem(List=construct_point_10, Index="0", Wrap=True)
timer_3 = Timer(TimerInterval=20, Target=serial_read_generic_2)  # disabled
serial_read_generic_2 = SerialReadGeneric(StartReadingValues=Toggle(True), PortNumber=number_slider_14)  # -> SerialOutput, StatusMessage
rotate_3d_8 = Rotate3D(Geometry=list_item_5, Angle=degrees(multiplication_4), Center=construct_point_11, Axis=unit_z_7)  # -> graft(Geometry), Transform
list_item_6 = ListItem(List=construct_point_10, Index="1", Wrap=True)
number_slider_15 = Slider(4, range=0..10)  # disabled
boolean_toggle = BooleanToggle(True)  # disabled
unit_x_2 = UnitX(Factor=expr("x/2", list_item_6))
panel_34 = Panel(serial_read_generic_2.SerialOutput)
panel_35 = Panel(serial_read_generic_2.StatusMessage)
serial_read_generic_3 = SerialReadGeneric(StartReadingValues=boolean_toggle, PortNumber=number_slider_15)  # -> SerialOutput, StatusMessage; disabled
move_4 = Move(Geometry=rotate_3d_8.Geometry, Motion=unit_x_2)  # -> Geometry, Transform
list_item_7 = ListItem(List=construct_point_10, Index="2", Wrap=True)
unit_x_3 = UnitX(Factor=expr("x/3", list_item_7))
panel_36 = Panel(serial_read_generic_3.SerialOutput)  # disabled
list_item_8 = ListItem(List=construct_point_10, Index="3", Wrap=True)
rotate_3d_9 = Rotate3D(Geometry=move_4.Geometry, Angle=expr("x*2", degrees(multiplication_4)), Center=rotate_3d_8.Geometry, Axis=unit_z_7)  # -> Geometry, Transform
move_5 = Move(Geometry=rotate_3d_9.Geometry, Motion=unit_x_3)  # -> Geometry, Transform
unit_x_4 = UnitX(Factor=expr("x/3", list_item_8))
line_4 = Line(StartPoint=rotate_3d_8.Geometry, EndPoint=rotate_3d_9.Geometry)
rotate_3d_10 = Rotate3D(Geometry=move_5.Geometry, Angle=expr("x*(3)", degrees(multiplication_4)), Center=rotate_3d_9.Geometry, Axis=unit_z_7)  # -> Geometry, Transform
move_6 = Move(Geometry=rotate_3d_10.Geometry, Motion=unit_x_4)  # -> Geometry, Transform
list_item_9 = ListItem(List=construct_point_10, Index="4", Wrap=True)
line_5 = Line(StartPoint=rotate_3d_9.Geometry, EndPoint=rotate_3d_10.Geometry)
unit_x_5 = UnitX(Factor=expr("x/3", list_item_9))
rotate_3d_11 = Rotate3D(Geometry=move_6.Geometry, Angle=expr("x*(4)", degrees(multiplication_4)), Center=rotate_3d_10.Geometry, Axis=unit_z_7)  # -> Geometry, Transform
move_7 = Move(Geometry=rotate_3d_11.Geometry, Motion=unit_x_5)  # -> Geometry, Transform
line_6 = Line(StartPoint=rotate_3d_10.Geometry, EndPoint=rotate_3d_11.Geometry)
list_item_10 = ListItem(List=construct_point_10, Index="5", Wrap=True)
rotate_3d_12 = Rotate3D(Geometry=move_7.Geometry, Angle=expr("x*(5)", degrees(multiplication_4)), Center=rotate_3d_11.Geometry, Axis=unit_z_7)  # -> Geometry, Transform
unit_x_6 = UnitX(Factor=expr("x/3", list_item_10))
move_8 = Move(Geometry=rotate_3d_12.Geometry, Motion=unit_x_6)  # -> Geometry, Transform
line_7 = Line(StartPoint=rotate_3d_11.Geometry, EndPoint=rotate_3d_12.Geometry)
list_item_11 = ListItem(List=construct_point_10, Index="6", Wrap=True)
unit_x_7 = UnitX(Factor=expr("x/3", list_item_11))
rotate_3d_13 = Rotate3D(Geometry=move_8.Geometry, Angle=expr("x*(6)", degrees(multiplication_4)), Center=rotate_3d_12.Geometry, Axis=unit_z_7)  # -> Geometry, Transform
list_item_12 = ListItem(List=construct_point_10, Index="7", Wrap=True)
move_9 = Move(Geometry=rotate_3d_13.Geometry, Motion=unit_x_7)  # -> Geometry, Transform
unit_x_8 = UnitX(Factor=expr("x/3", list_item_12))
line_8 = Line(StartPoint=rotate_3d_12.Geometry, EndPoint=rotate_3d_13.Geometry)
rotate_3d_14 = Rotate3D(Geometry=move_9.Geometry, Angle=expr("x*(7)", degrees(multiplication_4)), Center=rotate_3d_13.Geometry, Axis=unit_z_7)  # -> Geometry, Transform
move_10 = Move(Geometry=rotate_3d_14.Geometry, Motion=unit_x_8)  # -> Geometry, Transform
rotate_3d_15 = Rotate3D(Geometry=move_10.Geometry, Angle=expr("x*(8)", degrees(multiplication_4)), Center=rotate_3d_14.Geometry, Axis=unit_z_7)  # -> Geometry, Transform
line_9 = Line(StartPoint=rotate_3d_13.Geometry, EndPoint=rotate_3d_14.Geometry)
line_10 = Line(StartPoint=rotate_3d_14.Geometry, EndPoint=rotate_3d_15.Geometry)
set_union = SetUnion(
    _8=rotate_3d_15.Geometry,
    _6=rotate_3d_14.Geometry,
    _5=rotate_3d_13.Geometry,
    _4=rotate_3d_12.Geometry,
    _3=rotate_3d_11.Geometry,
    _2=rotate_3d_10.Geometry,
    _1=rotate_3d_9.Geometry,
    _0=rotate_3d_8.Geometry)
data_recorder_4 = DataRecorder(rotate_3d_15.Geometry, DataLimit=-10, RecordData=True)

data_rec = PythonScript(x=rotate_3d_2.Geometry, enable=Toggle(True), reset=Button(), limit=panel_17)  # -> x; inputs x: tree, enable: Boolean, reset: Boolean, limit: Int32
# ---------- data_rec: Python ----------
from Grasshopper import DataTree
if reset or 'rec' not in globals(): rec = DataTree[object]()
if enable and not reset: rec.MergeTree(x)
if limit > 0:
  for branch in rec.Branches:
    if branch.Count > limit:
      branch.RemoveRange(0, branch.Count - limit)
x = rec
# ---------- end data_rec ----------
panel_37 = Panel(data_rec)
interpolate = Interpolate(Vertices=data_rec, Degree=Slider(5, range=1..11), Periodic=True, KnotStyle=1)  # -> flatten(Curve), Length, Domain
panel_38 = Panel(interpolate.Curve)
_2 = Integer(2)

deconstruct = Deconstruct(Point=panel_37)  # -> XComponent, YComponent, ZComponent
multiplication_5 = Multiplication(A=deconstruct.XComponent, B=Slider(0.25, range=0..1))
unit_z_8 = UnitZ(Factor=multiplication_5)
move_11 = Move(Geometry=divide_curve_3.Points, Motion=unit_z_8)  # -> flatten(Geometry), Transform
panel_39 = Panel(move_11.Geometry)
loft_5 = Loft(
    Curves=interpolate.Curve,
    Options={Adjust=False, Closed=False, LoftEnds=0, LoftSimp=0, LoftType=1, Rebuild=10, Refit=0.01})

divide_surface = DivideSurface(Surface=loft_5, UCount=Slider(7, range=0..10), VCount=_2)  # -> Points, Normals, Parameters
panel_40 = Panel(divide_surface.Points)
list_item_13 = ListItem(List=divide_surface.Points, Index=Slider(1, range=0..1), Wrap=True)
deconstruct_2 = Deconstruct(Point=list_item_13)  # -> XComponent, YComponent, ZComponent
panel_41 = Panel(list_item_13)

custom_preview_4 = CustomPreview(Geometry=loft_5)

list_length_4 = ListLength(List=interpolate.Curve)  # disabled
list_item_14 = ListItem(List=interpolate.Curve, Index=expr("x-1", list_length_4), Wrap=True)  # disabled
list_item_15 = ListItem(List=move.Geometry, Index=0, Wrap=True)  # disabled
list_item_16 = ListItem(List=interpolate.Curve, Index=0, Wrap=True)  # disabled
plane_normal_6 = PlaneNormal(Origin=list_item_15, ZAxis=Vector(0, 0, 1))  # disabled
circle = Circle(Plane=plane_normal_6, Radius=number_slider_10)  # disabled
list_item_17 = ListItem(List=rotate_3d_4.Geometry, Index=0, Wrap=True)  # disabled
plane_normal_7 = PlaneNormal(Origin=list_item_17, ZAxis=Vector(0, 0, 1))  # disabled
circle_2 = Circle(Plane=plane_normal_7, Radius=number_slider_10)  # disabled
curve_2 = Curve([circle, list_item_14])  # disabled
curve_3 = Curve([list_item_16, circle_2])  # disabled
loft_options = LoftOptions(Closed=False, Adjust=True, Rebuild=0, Refit=0, Type=5)  # disabled
loft_6 = Loft(Curves=flatten(curve_2), Options=loft_options)  # disabled
loft_7 = Loft(Curves=flatten(curve_3), Options=loft_options)  # disabled
custom_preview_5 = CustomPreview(Geometry=[loft_7, loft_6])  # disabled

# ----
# pythagerous theorom to get distance
panel_42 = Panel(deconstruct_2.ZComponent)  # disabled

addition_6 = Addition()  # disabled
square_root = SquareRoot(Value=addition_6)  # disabled
panel_43 = Panel(square_root)  # disabled
number_slider_16 = Slider(3.1, range=0..10)  # disabled
number_slider_17 = Slider(1.9, range=0..10)  # disabled
number_slider_18 = Slider(1, range=0..1)  # disabled
number_slider_19 = Slider(0, range=0..100)  # disabled
construct_domain = ConstructDomain(DomainStart=number_slider_17, DomainEnd=number_slider_16)  # disabled
construct_domain_2 = ConstructDomain(DomainStart=number_slider_19, DomainEnd=number_slider_18)  # disabled
construct_point_12 = ConstructPoint(XCoordinate=integer_5, YCoordinate=0, ZCoordinate=panel_42)  # disabled
remap_numbers = RemapNumbers(Value=square_root, Source=construct_domain, Target=construct_domain_2)  # -> flatten(Mapped), Clipped; disabled
unit_x_9 = UnitX(Factor=square_root)  # disabled
move_12 = Move(Geometry=construct_point_12, Motion=unit_x_9)  # -> Geometry, Transform; disabled
line_11 = Line(StartPoint=construct_point_12, EndPoint=move_12.Geometry)  # disabled
number_slider_20 = Slider(6, range=0..10)  # disabled
number_slider_21 = Slider(4, range=0..10)  # disabled
number_slider_22 = Slider(2, range=0..10)  # disabled
number_slider_23 = Slider(3, range=0..10)  # disabled
number_slider_24 = Slider(5, range=0..10)  # disabled
number_slider_25 = Slider(1, range=0..10)  # disabled
panel_44 = Panel(remap_numbers.Mapped)  # disabled
list_item_18 = ListItem(List=remap_numbers.Mapped, Index=number_slider_20, Wrap=True)  # disabled
list_item_19 = ListItem(List=remap_numbers.Mapped, Index=number_slider_25, Wrap=True)  # disabled
list_item_20 = ListItem(List=remap_numbers.Mapped, Index=number_slider_22, Wrap=True)  # disabled
list_item_21 = ListItem(List=remap_numbers.Mapped, Index=number_slider_23, Wrap=True)  # disabled
list_item_22 = ListItem(List=remap_numbers.Mapped, Index=number_slider_21, Wrap=True)  # disabled
list_item_23 = ListItem(List=remap_numbers.Mapped, Index=number_slider_24, Wrap=True)  # disabled
number_slider_26 = Slider(72, range=10..72)  # disabled
number_slider_27 = Slider(10, range=10..72)  # disabled
number_slider_28 = Slider(15, range=15..100)  # disabled
number_slider_29 = Slider(165, range=0..165)  # disabled
number_slider_30 = Slider(180, range=0..180)  # disabled
number_slider_31 = Slider(0, range=0..100)  # disabled
construct_domain_3 = ConstructDomain(DomainStart=number_slider_28, DomainEnd=number_slider_29)  # disabled
construct_domain_4 = ConstructDomain(DomainStart=number_slider_27, DomainEnd=number_slider_26)  # disabled
construct_domain_5 = ConstructDomain(DomainStart=number_slider_31, DomainEnd=number_slider_30)  # disabled
panel_45 = Panel(construct_domain_5)  # disabled
remap_numbers_2 = RemapNumbers(Value=list_item_20, Source=construct_domain_2, Target=construct_domain_3)  # -> Mapped, Clipped; disabled
remap_numbers_3 = RemapNumbers(Value=list_item_19, Source=construct_domain_2, Target=construct_domain_5)  # -> Mapped, Clipped; disabled
remap_numbers_4 = RemapNumbers(Value=list_item_21, Source=construct_domain_2, Target=construct_domain_5)  # -> Mapped, Clipped; disabled
remap_numbers_5 = RemapNumbers(Value=list_item_22, Source=construct_domain_2, Target=construct_domain_5)  # -> Mapped, Clipped; disabled
remap_numbers_6 = RemapNumbers(Value=list_item_23, Source=construct_domain_2, Target=construct_domain_5)  # -> Mapped, Clipped; disabled
remap_numbers_7 = RemapNumbers(Value=list_item_18, Source=construct_domain_2, Target=construct_domain_4)  # -> Mapped, Clipped; disabled
panel_46 = Panel(remap_numbers_3.Mapped)  # disabled
panel_47 = Panel(remap_numbers_2.Mapped)  # disabled
panel_48 = Panel(remap_numbers_4.Mapped)  # disabled
panel_49 = Panel(remap_numbers_5.Mapped)  # disabled
panel_50 = Panel(remap_numbers_6.Mapped)  # disabled
panel_51 = Panel(remap_numbers_7.Mapped)  # disabled
integer_6 = Integer(remap_numbers_3.Mapped)  # disabled
integer_7 = Integer(remap_numbers_2.Mapped)  # disabled
integer_8 = Integer(remap_numbers_4.Mapped)  # disabled
integer_9 = Integer(remap_numbers_5.Mapped)  # disabled
integer_10 = Integer(remap_numbers_6.Mapped)  # disabled
integer_11 = Integer(remap_numbers_7.Mapped)  # disabled
panel_52 = Panel([integer_6, integer_7, integer_8, integer_9, integer_10, integer_11])  # disabled
panel_53 = Panel("P")  # disabled
panel_54 = Panel("200")  # disabled
list_item_24 = ListItem(List=panel_52, Index=0, Wrap=True)  # disabled
panel_55 = Panel([panel_53, list_item_24])  # disabled
text_join_2 = TextJoin(Text=panel_55)  # disabled
panel_56 = Panel([text_join_2, panel_52, panel_54])  # disabled
data_dam = DataDam(DataDataA=panel_56, BufferDelay=10000000, BufferMode=0)  # disabled
number_slider_32 = Slider(1, range=0..1)  # disabled
text_join_3 = TextJoin(Text=data_dam, Join=",")  # disabled
number_slider_33 = Slider(0, range=0..1)  # disabled
boolean_toggle_2 = BooleanToggle(True)  # disabled
button = Button()  # disabled
button_2 = Button()  # disabled
panel_57 = Panel(text_join_3)  # disabled
panel_58 = Panel("P90,90,90,90,90,72,50")  # disabled
button_3 = Button()  # disabled
write_5 = SerialWriteGeneric(StartWritingValues=button, WriteData=number_slider_33, PortNumber=number_slider_14)  # -> ArduinoOutput, StatusMessage; disabled
write_6 = SerialWriteGeneric(StartWritingValues=button_2, WriteData=number_slider_32, PortNumber=number_slider_15)  # -> ArduinoOutput, StatusMessage; disabled
write_7 = SerialWriteGeneric(StartWritingValues=button_3, WriteData=panel_58, PortNumber=number_slider_14)  # -> ArduinoOutput, StatusMessage; disabled
write_8 = SerialWriteGeneric(StartWritingValues=boolean_toggle_2, WriteData=panel_57, PortNumber=number_slider_14)  # -> ArduinoOutput, StatusMessage; disabled
data_recorder_5 = DataRecorder(write_6.ArduinoOutput, DataLimit=-10, RecordData=True)  # disabled
data_recorder_6 = DataRecorder(write_5.ArduinoOutput, DataLimit=-10, RecordData=True)  # disabled
data_recorder_7 = DataRecorder(write_7.ArduinoOutput, DataLimit=-10, RecordData=True)  # disabled
data_recorder_8 = DataRecorder(write_8.ArduinoOutput, DataLimit=-10, RecordData=True)  # disabled
panel_59 = Panel(data_recorder_8)  # disabled
panel_60 = Panel(data_recorder_7)  # disabled
panel_61 = Panel(data_recorder_6)  # disabled
panel_62 = Panel(data_recorder_5)  # disabled
