# Grasshopper definition vectorgraphics_LOFT_15(all_active_2ArduinostoGo).gh (Grasshopper 1.0.7)
# plug-ins: Firefly.X, Firefly.Core

frame_rate = FrameRate()  # -> simplify(flatten(RefreshRate)), Frequency
panel = Panel(frame_rate.RefreshRate)
panel_2 = Panel(frame_rate.Frequency)

integer = Integer(1)
timer = Timer(TimerInterval=20, Target=data_recorder)
data_recorder = DataRecorder(integer, DataLimit=-360, RecordData=True)
mass_addition = MassAddition(Input=data_recorder)  # -> Result, PartialResults
panel_3 = Panel(mass_addition.Result)
multiplication = Multiplication(A=panel_3, B=Slider(2, range=0..10))
number_of_lists = Slider(8, range=0..10)
series = Series(Start=panel_3, Step=multiplication, Count=number_of_lists)
panel_4 = Panel(series)
_1 = Integer(1)
random = Random(Range=Domain(0, 1), Number=_1, Seed=series)
height_between_loft_segments = Slider(1, range=0..10)
panel_5 = Panel(random)
addition = Addition(A=_1, B=height_between_loft_segments)
increse_distance_from_centre = Slider(2, range=0..5)
unit_z = UnitZ(Factor=_1)
series_2 = Series(Start=unit_z, Step=addition, Count=number_of_lists)
list_length = ListLength(List=series_2)
list_item = ListItem(List=series_2, Index=expr("x-1", list_length), Wrap=True)
panel_6 = Panel(list_item)
addition_2 = Addition(A=random, B=increse_distance_from_centre)  # -> flatten(Result)

list_length_2 = ListLength(List=series_2)
list_item_2 = ListItem(List=series_2, Index=expr("x-1", list_length_2), Wrap=True)
list_item_3 = ListItem(List=series_2, Index=0, Wrap=True)
integer_2 = Integer(-10)
construct_point = ConstructPoint(XCoordinate=integer_2, YCoordinate=0, ZCoordinate=list_item_3)
construct_point_2 = ConstructPoint(XCoordinate=integer_2, YCoordinate=0, ZCoordinate=list_item_2)
line = Line(StartPoint=construct_point, EndPoint=construct_point_2)
divide_curve = DivideCurve(Curve=line, Count=number_of_lists, Kinks=False)  # -> Points, Tangents, Parameters
unit_x = UnitX(Factor=addition_2)
move = Move(Geometry=divide_curve.Points, Motion=unit_x)  # -> Geometry, Transform
line_2 = Line(StartPoint=divide_curve.Points, EndPoint=move.Geometry)

number_slider = Slider(36, range=0..100)
mass_addition_2 = MassAddition(Input=data_recorder)  # -> Result, PartialResults

height_between_loft_segments_2 = Slider(10, range=0..10)
_1_2 = Integer(1)
number_of_lists_2 = Slider(14, range=0..30)
addition_3 = Addition(A=_1_2, B=height_between_loft_segments_2)
addition_4 = Addition(A=list_item, B=7)
unit_z_2 = UnitZ(Factor=_1_2)
series_3 = Series(Start=Slider(1, range=0..10), Step=1, Count=number_of_lists_2)
series_4 = Series(Start=addition_4, Step=addition_3, Count=number_of_lists_2)
multiplication_2 = Multiplication(A=series_3, B=series_3)
_0 = Integer(0)
integer_3 = Integer(-3)
_1_3 = Integer(1)
panel_7 = Panel(multiplication_2)
construct_point_3 = ConstructPoint(XCoordinate=multiplication_2, YCoordinate=_0, ZCoordinate=series_4)
construct_point_4 = ConstructPoint(XCoordinate=_0, YCoordinate=_0, ZCoordinate=_0)
panel_8 = Panel(construct_point_3)
integer_4 = Integer(1)
series_5 = Series(Start=mass_addition_2.Result, Step=Slider(35, range=0..100), Count=number_of_lists_2)
multiplication_3 = Multiplication(A=series_5, B=Slider(9, range=0..10))
rotate_3d = Rotate3D(Geometry=construct_point_3, Angle=degrees(multiplication_3), Center=construct_point_4, Axis=unit_z_2)  # -> flatten(Geometry), Transform
panel_9 = Panel(series_5)
panel_10 = Panel(rotate_3d.Geometry)
interpolate_t = InterpolateT(Vertices=rotate_3d.Geometry, TangentStart=Vector(0, 0, 0), TangentEnd=Vector(0, 0, 0), KnotStyle=1)  # -> Curve, Length, Domain
multiplication_4 = Multiplication(A=mass_addition_2.Result, B=Slider(0.3, range=0..1))
divide_curve_2 = DivideCurve(Curve=interpolate_t.Curve, Count=Slider(60, range=0..100), Kinks=False)  # -> Points, Tangents, Parameters
panel_11 = Panel(divide_curve_2.Points)
number_slider_2 = Slider(10, range=0..10)
series_6 = Series(Start=multiplication_4, Step=1, Count=number_slider_2)
panel_12 = Panel(series_6)
sine = Sine(Value=series_6)
unit_z_3 = UnitZ(Factor=sine)
multiplication_5 = Multiplication(A=unit_z_3, B=Slider(4, range=0..10))
multiplication_6 = Multiplication(A=multiplication_5, B=-1)
series_7 = Series(Start=Slider(0, range=0..10), Step=Slider(2, range=0..10), Count=number_slider_2)
panel_13 = Panel(multiplication_5)
panel_14 = Panel(multiplication_6)
panel_15 = Panel(series_7)
division = Division(A=panel_15, B=Slider(6, range=0..10))
panel_16 = Panel(division)
multiplication_7 = Multiplication(A=series_7, B=panel_16)
integer_5 = Integer(multiplication_7)
list_item_4 = ListItem(List=divide_curve_2.Points, Index=integer_5, Wrap=True)
move_2 = Move(Geometry=list_item_4, Motion=multiplication_5)  # -> Geometry, Transform
move_3 = Move(Geometry=list_item_4, Motion=multiplication_6)  # -> Geometry, Transform

multiplication_8 = Multiplication(A=mass_addition.Result, B=number_slider)
series_8 = Series(Start=multiplication_8, Step=26, Count=number_of_lists)
division_2 = Division(A=Slider(360, range=0..1000), B=number_slider)
_0_2 = Integer(0)
construct_point_5 = ConstructPoint(XCoordinate=addition_2, YCoordinate=_0_2, ZCoordinate=series_2)
panel_17 = Panel(construct_point_5)
panel_18 = Panel(series_8)
panel_19 = Panel(division_2)
construct_point_6 = ConstructPoint(XCoordinate=_0_2, YCoordinate=_0_2, ZCoordinate=_0_2)
rotate_3d_2 = Rotate3D(Geometry=construct_point_5, Angle=degrees(series_8), Center=construct_point_6, Axis=unit_z)  # -> graft(Geometry), Transform

division_3 = Division(A=list_item, B=Slider(2, range=0..10))
construct_point_7 = ConstructPoint(XCoordinate=0, YCoordinate=0, ZCoordinate=division_3)
plane_normal = PlaneNormal(Origin=construct_point_7, ZAxis=Vector(0, 0, 1))
number_slider_3 = Slider(1, range=0..5)
mirror = Mirror(Geometry=move_2.Geometry, Plane=plane_normal)  # -> Geometry, Transform
mirror_2 = Mirror(Geometry=move_3.Geometry, Plane=plane_normal)  # -> Geometry, Transform
number_slider_4 = Slider(108, range=0..360)
multiplication_9 = Multiplication(A=number_slider_3, B=-1)
unit_z_4 = UnitZ(Factor=multiplication_9)
unit_z_5 = UnitZ(Factor=number_slider_3)
rotate_3d_3 = Rotate3D(Geometry=mirror.Geometry, Angle=degrees(number_slider_4), Center=Point(0, 0, 0), Axis=Vector(0, 0, 1))  # -> Geometry, Transform
rotate_3d_4 = Rotate3D(Geometry=mirror_2.Geometry, Angle=degrees(number_slider_4), Center=Point(0, 0, 0), Axis=Vector(0, 0, 1))  # -> Geometry, Transform
interpolate_t_2 = InterpolateT(Vertices=rotate_3d_3.Geometry, TangentStart=unit_z_4, TangentEnd=Vector(0, 0, 0), KnotStyle=1)  # -> Curve, Length, Domain
interpolate_t_3 = InterpolateT(Vertices=move_3.Geometry, TangentStart=unit_z_5, TangentEnd=Vector(0, 0, 0), KnotStyle=1)  # -> Curve, Length, Domain
panel_20 = Panel(rotate_3d_4.Geometry)
custom_preview = CustomPreview(
    Geometry=[interpolate_t_2.Curve, interpolate_t_3.Curve],
    Material={diffuse=RGB(255, 0, 0), emission=RGB(66, 48, 66), shine=0.5, specular=RGB(255, 255, 255), transparency=0})

number_slider_5 = Slider(2.3, range=0..5)
unit_z_6 = UnitZ(Factor=1)
number_slider_6 = Slider(36, range=0..36)

increse_distance_from_centre_2 = Slider(25, range=0..30)
list_length_3 = ListLength(List=construct_point_5)
multiplication_10 = Multiplication(A=mass_addition.Result, B=Slider(100, range=0..100))
addition_5 = Addition(A=random, B=increse_distance_from_centre_2)  # -> flatten(Result)
division_4 = Division(A=multiplication_10, B=list_length_3)
construct_point_8 = ConstructPoint(XCoordinate=addition_5, YCoordinate=_0_2, ZCoordinate=series_2)
unit_z_7 = UnitZ(Factor=_1)
multiplication_11 = Multiplication(A=division_4, B=Slider(1, range=0..1))
# pythagerous theorom to get distance
construct_point_9 = ConstructPoint(XCoordinate=_0_2, YCoordinate=_0_2, ZCoordinate=_0_2)
panel_21 = Panel(unit_z_7)
panel_22 = Panel(construct_point_8)
panel_23 = Panel(multiplication_11)
list_item_5 = ListItem(List=construct_point_8, Index="0", Wrap=True)
unit_x_2 = UnitX(Factor=list_item_5)
panel_24 = Panel(unit_x_2)
list_item_6 = ListItem(List=construct_point_8, Index="1", Wrap=True)
move_4 = Move(Geometry=construct_point_6, Motion=unit_x_2)  # -> Geometry, Transform
panel_25 = Panel(list_item_6)
unit_x_3 = UnitX(Factor=expr("x/2", list_item_6))
panel_26 = Panel(move_4.Geometry)
rotate_3d_5 = Rotate3D(Geometry=move_4.Geometry, Angle=degrees(multiplication_11), Center=construct_point_9, Axis=unit_z_7)  # -> Geometry, Transform
panel_27 = Panel(unit_x_3)
move_5 = Move(Geometry=rotate_3d_5.Geometry, Motion=unit_x_3)  # -> Geometry, Transform
list_item_7 = ListItem(List=construct_point_8, Index="2", Wrap=True)
unit_x_4 = UnitX(Factor=expr("x/3", list_item_7))
line_3 = Line(StartPoint=construct_point_6, EndPoint=rotate_3d_5.Geometry)
panel_28 = Panel(unit_x_4)
list_item_8 = ListItem(List=construct_point_8, Index="3", Wrap=True)
rotate_3d_6 = Rotate3D(Geometry=move_5.Geometry, Angle=expr("x*2", degrees(multiplication_11)), Center=rotate_3d_5.Geometry, Axis=unit_z_7)  # -> Geometry, Transform
move_6 = Move(Geometry=rotate_3d_6.Geometry, Motion=unit_x_4)  # -> Geometry, Transform
unit_x_5 = UnitX(Factor=expr("x/3", list_item_8))
rotate_3d_7 = Rotate3D(Geometry=move_6.Geometry, Angle=expr("x*(3)", degrees(multiplication_11)), Center=rotate_3d_6.Geometry, Axis=unit_z_7)  # -> Geometry, Transform
line_4 = Line(StartPoint=rotate_3d_5.Geometry, EndPoint=rotate_3d_6.Geometry)
move_7 = Move(Geometry=rotate_3d_7.Geometry, Motion=unit_x_5)  # -> Geometry, Transform
panel_29 = Panel(unit_x_5)
list_item_9 = ListItem(List=construct_point_8, Index="4", Wrap=True)
line_5 = Line(StartPoint=rotate_3d_6.Geometry, EndPoint=rotate_3d_7.Geometry)
unit_x_6 = UnitX(Factor=expr("x/3", list_item_9))
rotate_3d_8 = Rotate3D(Geometry=move_7.Geometry, Angle=expr("x*(4)", degrees(multiplication_11)), Center=rotate_3d_7.Geometry, Axis=unit_z_7)  # -> Geometry, Transform
move_8 = Move(Geometry=rotate_3d_8.Geometry, Motion=unit_x_6)  # -> Geometry, Transform
list_item_10 = ListItem(List=construct_point_8, Index="5", Wrap=True)
line_6 = Line(StartPoint=rotate_3d_7.Geometry, EndPoint=rotate_3d_8.Geometry)
rotate_3d_9 = Rotate3D(Geometry=move_8.Geometry, Angle=expr("x*(5)", degrees(multiplication_11)), Center=rotate_3d_8.Geometry, Axis=unit_z_7)  # -> Geometry, Transform
unit_x_7 = UnitX(Factor=expr("x/3", list_item_10))
move_9 = Move(Geometry=rotate_3d_9.Geometry, Motion=unit_x_7)  # -> Geometry, Transform
list_item_11 = ListItem(List=construct_point_8, Index="6", Wrap=True)
line_7 = Line(StartPoint=rotate_3d_8.Geometry, EndPoint=rotate_3d_9.Geometry)
unit_x_8 = UnitX(Factor=expr("x/3", list_item_11))
rotate_3d_10 = Rotate3D(Geometry=move_9.Geometry, Angle=expr("x*(6)", degrees(multiplication_11)), Center=rotate_3d_9.Geometry, Axis=unit_z_7)  # -> Geometry, Transform
list_item_12 = ListItem(List=construct_point_8, Index="7", Wrap=True)
move_10 = Move(Geometry=rotate_3d_10.Geometry, Motion=unit_x_8)  # -> Geometry, Transform
unit_x_9 = UnitX(Factor=expr("x/3", list_item_12))
line_8 = Line(StartPoint=rotate_3d_9.Geometry, EndPoint=rotate_3d_10.Geometry)
rotate_3d_11 = Rotate3D(Geometry=move_10.Geometry, Angle=expr("x*(7)", degrees(multiplication_11)), Center=rotate_3d_10.Geometry, Axis=unit_z_7)  # -> Geometry, Transform
move_11 = Move(Geometry=rotate_3d_11.Geometry, Motion=unit_x_9)  # -> Geometry, Transform
rotate_3d_12 = Rotate3D(Geometry=move_11.Geometry, Angle=expr("x*(8)", degrees(multiplication_11)), Center=rotate_3d_11.Geometry, Axis=unit_z_7)  # -> Geometry, Transform
line_9 = Line(StartPoint=rotate_3d_10.Geometry, EndPoint=rotate_3d_11.Geometry)
set_union = SetUnion(
    _8=rotate_3d_12.Geometry,
    _6=rotate_3d_11.Geometry,
    _5=rotate_3d_10.Geometry,
    _4=rotate_3d_9.Geometry,
    _3=rotate_3d_8.Geometry,
    _2=rotate_3d_7.Geometry,
    _1=rotate_3d_6.Geometry,
    _0=rotate_3d_5.Geometry)
line_10 = Line(StartPoint=rotate_3d_11.Geometry, EndPoint=rotate_3d_12.Geometry)
data_recorder_2 = DataRecorder(rotate_3d_12.Geometry, DataLimit=-10, RecordData=False)

multiplication_12 = Multiplication(A=unit_z_6, B=-1)
interpolate_t_4 = InterpolateT(Vertices=move_2.Geometry, TangentStart=unit_z_6, TangentEnd=Vector(0, 0, 0), KnotStyle=1)  # -> reparameterize(Curve), Length, Domain
interpolate_t_5 = InterpolateT(Vertices=rotate_3d_4.Geometry, TangentStart=multiplication_12, TangentEnd=Vector(0, 0, 0), KnotStyle=1)  # -> reparameterize(Curve), Length, Domain
domain = Domain(interpolate_t_4.Curve)
panel_30 = Panel(domain)
construct_domain = ConstructDomain(DomainStart=Slider(1.9, range=0..10), DomainEnd=Slider(3.1, range=0..10))
construct_domain_2 = ConstructDomain(DomainStart=Slider(0, range=0..100), DomainEnd=Slider(1, range=0..1))
number_slider_7 = Slider(6, range=0..10)  # disabled
number_slider_8 = Slider(4, range=0..10)  # disabled
number_slider_9 = Slider(2, range=0..10)  # disabled
number_slider_10 = Slider(3, range=0..10)  # disabled
number_slider_11 = Slider(5, range=0..10)  # disabled
number_slider_12 = Slider(1, range=0..10)  # disabled
number_slider_13 = Slider(72, range=10..72)  # disabled
number_slider_14 = Slider(10, range=10..72)  # disabled
number_slider_15 = Slider(15, range=15..100)  # disabled
number_slider_16 = Slider(165, range=0..165)  # disabled
number_slider_17 = Slider(180, range=0..180)  # disabled
number_slider_18 = Slider(0, range=0..100)  # disabled
construct_domain_3 = ConstructDomain(DomainStart=number_slider_15, DomainEnd=number_slider_16)  # disabled
construct_domain_4 = ConstructDomain(DomainStart=number_slider_14, DomainEnd=number_slider_13)  # disabled
construct_domain_5 = ConstructDomain(DomainStart=number_slider_18, DomainEnd=number_slider_17)  # disabled
panel_31 = Panel(construct_domain_5)  # disabled
toggle = BooleanToggle(True)
ports_available = COMPortsAvailable()

gene_pool = GenePool(Decimals=2, Maximum=1, Minimum=0, Value=[0, 0.23, 0.5246, 0.76, 1])
gene_pool_2 = GenePool(Decimals=2, Maximum=10, Minimum=0, Value=[2.32, 0.3, 2.46, 4.43, 0])
pipe = Pipe(Curve=[interpolate_t_4.Curve, interpolate_t_5.Curve], Radius=number_slider_5, Caps=0)
pipe_variable = PipeVariable(Curve=[interpolate_t_4.Curve, interpolate_t_5.Curve], Parameters=gene_pool, Radii=gene_pool_2, Caps=0)
panel_32 = Panel(pipe)
panel_33 = Panel(pipe_variable)
custom_preview_2 = CustomPreview(
    Geometry=pipe_variable,
    Material={diffuse=RGB(30, 144, 255), emission=RGB(76, 76, 76), shine=0.5, specular=RGB(255, 255, 255), transparency=0})

open_close_port = OpenClosePort(OpenClosePort=toggle, PortNumber=Slider(4, range=0..10), BaudRate=115200)
panel_34 = Panel(open_close_port)

timer_2 = Timer(TimerInterval=20, Target=serial_read_generic)

rotate_3d_13 = Rotate3D(Geometry=interpolate_t_4.Curve, Angle=degrees(Slider(79, range=0..360)), Center=Point(0, 0, 0), Axis=Vector(0, 0, 1))  # -> Geometry, Transform
rotate_3d_14 = Rotate3D(Geometry=interpolate_t_4.Curve, Angle=degrees(Slider(293, range=0..360)), Center=Point(0, 0, 0), Axis=Vector(0, 0, 1))  # -> Geometry, Transform
rotate_3d_15 = Rotate3D(Geometry=interpolate_t_4.Curve, Angle=degrees(Slider(219, range=0..360)), Center=Point(0, 0, 0), Axis=Vector(0, 0, 1))  # -> Geometry, Transform
divide_curve_3 = DivideCurve(Curve=interpolate_t_5.Curve, Count=4, Kinks=False)  # -> Points, Tangents, Parameters
divide_curve_4 = DivideCurve(Curve=interpolate_t_5.Curve, Count=2, Kinks=False)  # -> Points, Tangents, Parameters
divide_curve_5 = DivideCurve(Curve=interpolate_t_5.Curve, Count=3, Kinks=False)  # -> Points, Tangents, Parameters
divide_curve_6 = DivideCurve(Curve=rotate_3d_15.Geometry, Count=3, Kinks=False)  # -> Points, Tangents, Parameters
divide_curve_7 = DivideCurve(Curve=rotate_3d_13.Geometry, Count=2, Kinks=False)  # -> Points, Tangents, Parameters
divide_curve_8 = DivideCurve(Curve=rotate_3d_14.Geometry, Count=4, Kinks=False)  # -> Points, Tangents, Parameters
interpolate_t_6 = InterpolateT(Vertices=divide_curve_3.Points, TangentStart=Vector(0, 0, 0), TangentEnd=Vector(0, 0, 0), KnotStyle=1)  # -> Curve, Length, Domain
interpolate_t_7 = InterpolateT(Vertices=divide_curve_4.Points, TangentStart=Vector(0, 0, 0), TangentEnd=Vector(0, 0, 0), KnotStyle=1)  # -> Curve, Length, Domain
interpolate_t_8 = InterpolateT(Vertices=divide_curve_8.Points, TangentStart=Vector(0, 0, 0), TangentEnd=Vector(0, 0, 0), KnotStyle=1)  # -> Curve, Length, Domain
interpolate_t_9 = InterpolateT(Vertices=divide_curve_5.Points, TangentStart=Vector(0, 0, 0), TangentEnd=Vector(0, 0, 0), KnotStyle=1)  # -> Curve, Length, Domain
multiplication_13 = Multiplication(A=number_slider_5, B=0.3)
multiplication_14 = Multiplication(A=number_slider_5, B=0.2)
interpolate_t_10 = InterpolateT(Vertices=divide_curve_7.Points, TangentStart=Vector(0, 0, 0), TangentEnd=Vector(0, 0, 0), KnotStyle=1)  # -> Curve, Length, Domain
interpolate_t_11 = InterpolateT(Vertices=divide_curve_6.Points, TangentStart=Vector(0, 0, 0), TangentEnd=Vector(0, 0, 0), KnotStyle=1)  # -> Curve, Length, Domain
plane_normal_2 = PlaneNormal(Origin=divide_curve_3.Points, ZAxis=divide_curve_3.Tangents)
plane_normal_3 = PlaneNormal(Origin=divide_curve_4.Points, ZAxis=divide_curve_4.Tangents)
plane_normal_4 = PlaneNormal(Origin=divide_curve_8.Points, ZAxis=divide_curve_8.Tangents)
plane_normal_5 = PlaneNormal(Origin=divide_curve_7.Points, ZAxis=divide_curve_7.Tangents)
multiplication_15 = Multiplication(A=multiplication_13, B=number_slider_5)
multiplication_16 = Multiplication(A=multiplication_14, B=number_slider_5)
ellipse = Ellipse(Plane=plane_normal_2, Radius1=multiplication_15, Radius2=multiplication_13)  # -> Ellipse, Focus1, Focus2
ellipse_2 = Ellipse(Plane=plane_normal_3, Radius1=multiplication_15, Radius2=multiplication_13)  # -> Ellipse, Focus1, Focus2
ellipse_3 = Ellipse(Plane=plane_normal_4, Radius1=multiplication_16, Radius2=multiplication_14)  # -> Ellipse, Focus1, Focus2
ellipse_4 = Ellipse(Plane=plane_normal_5, Radius1=multiplication_16, Radius2=multiplication_14)  # -> Ellipse, Focus1, Focus2
panel_35 = Panel(multiplication_15)
panel_36 = Panel(multiplication_16)
loft = Loft(Curves=ellipse.Ellipse, Options={Adjust=False, Closed=False, LoftEnds=0, LoftSimp=0, LoftType=0, Rebuild=10, Refit=0.01})
loft_2 = Loft(
    Curves=ellipse_2.Ellipse,
    Options={Adjust=False, Closed=False, LoftEnds=0, LoftSimp=0, LoftType=0, Rebuild=10, Refit=0.01})
loft_3 = Loft(
    Curves=ellipse_3.Ellipse,
    Options={Adjust=False, Closed=False, LoftEnds=0, LoftSimp=0, LoftType=0, Rebuild=10, Refit=0.01})
loft_4 = Loft(
    Curves=ellipse_4.Ellipse,
    Options={Adjust=False, Closed=False, LoftEnds=0, LoftSimp=0, LoftType=0, Rebuild=10, Refit=0.01})
custom_preview_3 = CustomPreview(
    Geometry=[interpolate_t_8.Curve, interpolate_t_10.Curve, interpolate_t_7.Curve, interpolate_t_6.Curve, interpolate_t_9.Curve, interpolate_t_11.Curve],
    Material={diffuse=RGB(255, 255, 255), emission=RGB(66, 48, 66), shine=0.5, specular=RGB(255, 255, 255), transparency=0})

panel_37 = Panel(ports_available)
panel_38 = Panel("P")  # disabled
serial_read_generic = SerialReadGeneric(StartReadingValues=toggle, PortNumber="3")  # -> SerialOutput, StatusMessage
panel_39 = Panel("200")  # disabled
open_port = OpenClosePort(OpenClosePort=toggle, PortNumber="3", BaudRate="9600")
panel_40 = Panel("115200")
data_recorder_3 = DataRecorder(serial_read_generic.SerialOutput, DataLimit=-10, RecordData=True)
panel_41 = Panel(open_port)
panel_42 = Panel(serial_read_generic.StatusMessage)
panel_43 = Panel(data_recorder_3)
number_slider_19 = Slider(1, range=0..1)  # disabled
number_slider_20 = Slider(0, range=0..1)  # disabled
boolean_toggle = BooleanToggle(True)  # disabled
button = Button()  # disabled
button_2 = Button()  # disabled
panel_44 = Panel("P90,90,90,90,90,72,50")  # disabled
button_3 = Button()  # disabled
number_slider_21 = Slider(4, range=0..10)

set_wrist_rotation = Slider(76, range=0..180)
set_wrist = Slider(97, range=0..180)
set_gripper = Slider(166, range=10..180)
set_elbow = Slider(96, range=0..180)
set_base = Slider(99, range=0..180)
set_shoulder = Slider(95, range=15..165)
panel_45 = Panel(["P", set_base, set_shoulder, set_elbow, set_wrist_rotation, set_wrist, set_gripper, Slider(64, range=0..200)])
text_join = TextJoin(Text=panel_45, Join=",")
panel_46 = Panel(text_join)
write = SerialWriteGeneric(StartWritingValues=Button(), WriteData="P90,90,90,90,90,50,50", PortNumber=number_slider_21)  # -> ArduinoOutput, StatusMessage
write_2 = SerialWriteGeneric(StartWritingValues=Button(), WriteData=panel_46, PortNumber=number_slider_21)  # -> ArduinoOutput, StatusMessage
write_3 = SerialWriteGeneric(StartWritingValues=Button(), WriteData=Slider(1, range=0..1), PortNumber=number_slider_21)  # -> ArduinoOutput, StatusMessage
write_4 = SerialWriteGeneric(StartWritingValues=Button(), WriteData=Slider(0, range=0..1), PortNumber=number_slider_21)  # -> ArduinoOutput, StatusMessage
data_recorder_4 = DataRecorder(
    [write_4.ArduinoOutput, write_2.ArduinoOutput, write.ArduinoOutput, write_3.ArduinoOutput],
    DataLimit=-10,
    RecordData=True)
panel_47 = Panel(data_recorder_4)

timer_3 = Timer(TimerInterval=20, Target=serial_read_generic_2)  # disabled
serial_read_generic_2 = SerialReadGeneric(StartReadingValues=Toggle(True), PortNumber=number_slider_21)  # -> SerialOutput, StatusMessage
write_5 = SerialWriteGeneric(StartWritingValues=button, WriteData=number_slider_20, PortNumber=number_slider_21)  # -> ArduinoOutput, StatusMessage; disabled
write_6 = SerialWriteGeneric(StartWritingValues=button_3, WriteData=panel_44, PortNumber=number_slider_21)  # -> ArduinoOutput, StatusMessage; disabled
number_slider_22 = Slider(4, range=0..10)  # disabled
write_7 = SerialWriteGeneric(StartWritingValues=button_2, WriteData=number_slider_19, PortNumber=number_slider_22)  # -> ArduinoOutput, StatusMessage; disabled
boolean_toggle_2 = BooleanToggle(True)  # disabled
panel_48 = Panel(serial_read_generic_2.SerialOutput)
panel_49 = Panel(serial_read_generic_2.StatusMessage)
data_recorder_5 = DataRecorder(write_7.ArduinoOutput, DataLimit=-10, RecordData=True)  # disabled
data_recorder_6 = DataRecorder(write_6.ArduinoOutput, DataLimit=-10, RecordData=True)  # disabled
data_recorder_7 = DataRecorder(write_5.ArduinoOutput, DataLimit=-10, RecordData=True)  # disabled
serial_read_generic_3 = SerialReadGeneric(StartReadingValues=boolean_toggle_2, PortNumber=number_slider_22)  # -> SerialOutput, StatusMessage; disabled
panel_50 = Panel(data_recorder_6)  # disabled
panel_51 = Panel(data_recorder_7)  # disabled
panel_52 = Panel(data_recorder_5)  # disabled
panel_53 = Panel(serial_read_generic_3.SerialOutput)  # disabled

panel_54 = Panel(series_2)
construct_point_10 = ConstructPoint(XCoordinate=0, YCoordinate=Slider(22, range=0..40), ZCoordinate=panel_54)
construct_point_11 = ConstructPoint(XCoordinate=0, YCoordinate=Slider(7, range=0..10), ZCoordinate=panel_54)
line_11 = Line(StartPoint=construct_point_11, EndPoint=construct_point_10)
curve = Curve(line_11)
divide_curve_9 = DivideCurve(Curve=curve, Count=9, Kinks=False)  # -> Points, Tangents, Parameters

data_rec = PythonScript(x=rotate_3d_2.Geometry, enable=Toggle(True), reset=Button(), limit=panel_19)  # -> x; inputs x: tree, enable: Boolean, reset: Boolean, limit: Int32
# ---------- data_rec: Python ----------
from Grasshopper import DataTree
if reset or 'rec' not in globals(): rec = DataTree[object]()
if enable and not reset: rec.MergeTree(x)
if limit > 0:
  for branch in rec.Branches:
    if branch.Count > limit:
      branch.RemoveRange(0, branch.Count - limit)
x = rec
# ---------- end data_rec ----------
panel_55 = Panel(data_rec)
interpolate = Interpolate(Vertices=data_rec, Degree=Slider(5, range=1..11), Periodic=True, KnotStyle=1)  # -> flatten(Curve), Length, Domain
panel_56 = Panel(interpolate.Curve)
_2 = Integer(2)

loft_5 = Loft(
    Curves=interpolate.Curve,
    Options={Adjust=False, Closed=False, LoftEnds=0, LoftSimp=0, LoftType=1, Rebuild=10, Refit=0.01})

divide_surface = DivideSurface(Surface=loft_5, UCount=Slider(7, range=0..10), VCount=_2)  # -> Points, Normals, Parameters
list_item_13 = ListItem(List=divide_surface.Points, Index=Slider(1, range=0..1), Wrap=True)
deconstruct = Deconstruct(Point=list_item_13)  # -> flatten(XComponent), YComponent, ZComponent
panel_57 = Panel(list_item_13)

construct_point_12 = ConstructPoint(XCoordinate=0, YCoordinate=Slider(22, range=0..40), ZCoordinate=flatten(deconstruct.ZComponent))
construct_point_13 = ConstructPoint(XCoordinate=0, YCoordinate=Slider(7, range=0..10), ZCoordinate=flatten(deconstruct.ZComponent))
line_12 = Line(StartPoint=construct_point_13, EndPoint=construct_point_12)
curve_2 = Curve(line_12)
deconstruct_2 = Deconstruct(Point=panel_55)  # -> XComponent, YComponent, ZComponent
# limitation of math to describe complexity how we learnt it. pyhtagarous, sine waves etc, understand the line. Black magic is to make that line look alive.
# 
# How to draw simplicity out of complexity?
dispatch = Dispatch(List=curve_2, DispatchPattern=[False, True, True, True, True, True, True, False])  # -> ListA, ListB
multiplication_17 = Multiplication(A=deconstruct.XComponent, B=Slider(0.15, range=0..1))
divide_curve_10 = DivideCurve(Curve=dispatch.ListA, Count=9, Kinks=False)  # -> Points, Tangents, Parameters
unit_z_8 = UnitZ(Factor=multiplication_17)
multiplication_18 = Multiplication(A=deconstruct_2.XComponent, B=Slider(0.25, range=0..1))
move_12 = Move(Geometry=divide_curve_10.Points, Motion=unit_z_8)  # -> flatten(Geometry), Transform
unit_z_9 = UnitZ(Factor=multiplication_18)
panel_58 = Panel(move_12.Geometry)
move_13 = Move(Geometry=divide_curve_9.Points, Motion=unit_z_9)  # -> flatten(Geometry), Transform
panel_59 = Panel(move_13.Geometry)

custom_preview_4 = CustomPreview(
    Geometry=loft_5,
    Material={diffuse=RGB(255, 255, 255), emission=RGB(76, 76, 76), shine=0.1, specular=RGB(255, 255, 255), transparency=0})
panel_60 = Panel(deconstruct.ZComponent)
multiplication_19 = Multiplication(A=flatten(deconstruct.YComponent), B=flatten(deconstruct.YComponent))
multiplication_20 = Multiplication(A=deconstruct.XComponent, B=deconstruct.XComponent)
addition_6 = Addition(A=multiplication_19, B=multiplication_20)

list_length_4 = ListLength(List=interpolate.Curve)
list_item_14 = ListItem(List=interpolate.Curve, Index=expr("x-1", list_length_4), Wrap=True)
list_item_15 = ListItem(List=move_2.Geometry, Index=0, Wrap=True)
list_item_16 = ListItem(List=interpolate.Curve, Index=0, Wrap=True)
plane_normal_6 = PlaneNormal(Origin=list_item_15, ZAxis=Vector(0, 0, 1))
circle = Circle(Plane=plane_normal_6, Radius=number_slider_5)
list_item_17 = ListItem(List=rotate_3d_4.Geometry, Index=0, Wrap=True)
plane_normal_7 = PlaneNormal(Origin=list_item_17, ZAxis=Vector(0, 0, 1))
circle_2 = Circle(Plane=plane_normal_7, Radius=number_slider_5)
curve_3 = Curve([circle, list_item_14])
curve_4 = Curve([list_item_16, circle_2])
loft_options = LoftOptions(Closed=False, Adjust=True, Rebuild=0, Refit=0, Type=5)
loft_6 = Loft(Curves=flatten(curve_3), Options=loft_options)
loft_7 = Loft(Curves=flatten(curve_4), Options=loft_options)
custom_preview_5 = CustomPreview(
    Geometry=[loft_7, loft_6],
    Material={diffuse=RGB(255, 255, 255), emission=RGB(76, 76, 76), shine=0.5, specular=RGB(255, 255, 255), transparency=0.7})

square_root = SquareRoot(Value=addition_6)
panel_61 = Panel(square_root)
list_item_18 = ListItem(List=square_root, Index=0, Wrap=True)
construct_point_14 = ConstructPoint(XCoordinate=integer_2, YCoordinate=0, ZCoordinate=panel_60)
remap_numbers = RemapNumbers(Value=square_root, Source=construct_domain, Target=construct_domain_2)  # -> flatten(Mapped), Clipped
unit_x_10 = UnitX(Factor=list_item_18)
move_14 = Move(Geometry=construct_point_14, Motion=unit_x_10)  # -> Geometry, Transform
line_13 = Line(StartPoint=construct_point_14, EndPoint=move_14.Geometry)
panel_62 = Panel(remap_numbers.Mapped)
list_item_19 = ListItem(List=remap_numbers.Mapped, Index=number_slider_7, Wrap=True)  # disabled
list_item_20 = ListItem(List=remap_numbers.Mapped, Index=number_slider_12, Wrap=True)  # disabled
list_item_21 = ListItem(List=remap_numbers.Mapped, Index=number_slider_9, Wrap=True)  # disabled
list_item_22 = ListItem(List=remap_numbers.Mapped, Index=number_slider_10, Wrap=True)  # disabled
list_item_23 = ListItem(List=remap_numbers.Mapped, Index=number_slider_8, Wrap=True)  # disabled
list_item_24 = ListItem(List=remap_numbers.Mapped, Index=number_slider_11, Wrap=True)  # disabled
remap_numbers_2 = RemapNumbers(Value=list_item_21, Source=construct_domain_2, Target=construct_domain_3)  # -> Mapped, Clipped; disabled
remap_numbers_3 = RemapNumbers(Value=list_item_20, Source=construct_domain_2, Target=construct_domain_5)  # -> Mapped, Clipped; disabled
remap_numbers_4 = RemapNumbers(Value=list_item_22, Source=construct_domain_2, Target=construct_domain_5)  # -> Mapped, Clipped; disabled
remap_numbers_5 = RemapNumbers(Value=list_item_23, Source=construct_domain_2, Target=construct_domain_5)  # -> Mapped, Clipped; disabled
remap_numbers_6 = RemapNumbers(Value=list_item_24, Source=construct_domain_2, Target=construct_domain_5)  # -> Mapped, Clipped; disabled
panel_63 = Panel(remap_numbers_3.Mapped)  # disabled
panel_64 = Panel(remap_numbers_2.Mapped)  # disabled
panel_65 = Panel(remap_numbers_4.Mapped)  # disabled
panel_66 = Panel(remap_numbers_5.Mapped)  # disabled
panel_67 = Panel(remap_numbers_6.Mapped)  # disabled
integer_6 = Integer(remap_numbers_3.Mapped)  # disabled
integer_7 = Integer(remap_numbers_2.Mapped)  # disabled
integer_8 = Integer(remap_numbers_4.Mapped)  # disabled
integer_9 = Integer(remap_numbers_5.Mapped)  # disabled
integer_10 = Integer(remap_numbers_6.Mapped)  # disabled
panel_68 = Panel([integer_6, integer_7, integer_8, integer_9, integer_10])  # disabled
list_item_25 = ListItem(List=panel_68, Index=0, Wrap=True)  # disabled
panel_69 = Panel([panel_38, list_item_25])  # disabled
text_join_2 = TextJoin(Text=panel_69)  # disabled
panel_70 = Panel([text_join_2, panel_68, panel_39])  # disabled
data_dam = DataDam(DataDataA=panel_70, BufferDelay=10000000, BufferMode=0)  # disabled
text_join_3 = TextJoin(Text=data_dam, Join=",")  # disabled
panel_71 = Panel(text_join_3)  # disabled
write_8 = SerialWriteGeneric(StartWritingValues=boolean_toggle, WriteData=panel_71, PortNumber=number_slider_21)  # -> ArduinoOutput, StatusMessage; disabled
data_recorder_8 = DataRecorder(write_8.ArduinoOutput, DataLimit=-10, RecordData=True)  # disabled
panel_72 = Panel(data_recorder_8)  # disabled

square = Square(Value=deconstruct.XComponent)  # disabled
square_2 = Square(Value=deconstruct.YComponent)  # disabled
addition_7 = Addition(A=square, B=square_2)
panel_73 = Panel(deconstruct.XComponent)
square_root_2 = SquareRoot(Value=addition_7)
increse_distance_from_centre_3 = Slider(25, range=0..30)
list_item_26 = ListItem(List=square_root_2, Index=0, Wrap=True)  # -> flatten(Item)
list_length_5 = ListLength(List=deconstruct.XComponent)
panel_74 = Panel(deconstruct.ZComponent)
multiplication_21 = Multiplication(A=mass_addition.Result, B=Slider(100, range=0..100))
panel_75 = Panel(list_length_5)
addition_8 = Addition(A=increse_distance_from_centre_3, B=list_item_26)
division_5 = Division(A=multiplication_21, B=list_length_5)
panel_76 = Panel(multiplication_21)
flatten_tree = FlattenTree(Tree=panel_74, Path="{0}")
construct_point_15 = ConstructPoint(XCoordinate=addition_8, YCoordinate=_0_2, ZCoordinate=flatten_tree)
unit_z_10 = UnitZ(Factor=_1)
panel_77 = Panel(flatten_tree)
construct_point_16 = ConstructPoint(XCoordinate=_0_2, YCoordinate=_0_2, ZCoordinate=_0_2)
multiplication_22 = Multiplication(A=division_5, B=Slider(1, range=0..1))
panel_78 = Panel(unit_z_10)
panel_79 = Panel(construct_point_15)
addition_9 = Addition(A=multiplication_22, B="180")
panel_80 = Panel(addition_9)
list_item_27 = ListItem(List=construct_point_15, Index="0", Wrap=True)
unit_x_11 = UnitX(Factor=list_item_27)
panel_81 = Panel(unit_x_11)
list_item_28 = ListItem(List=construct_point_15, Index="1", Wrap=True)
multiplication_23 = Multiplication(A=addition_9, B="-1")
move_15 = Move(Geometry=construct_point_6, Motion=unit_x_11)  # -> Geometry, Transform
panel_82 = Panel(list_item_28)
unit_x_12 = UnitX(Factor=expr("x/2", list_item_28))
panel_83 = Panel(move_15.Geometry)
rotate_3d_16 = Rotate3D(Geometry=move_15.Geometry, Angle=degrees(multiplication_23), Center=construct_point_16, Axis=unit_z_10)  # -> Geometry, Transform
panel_84 = Panel(unit_x_12)
move_16 = Move(Geometry=rotate_3d_16.Geometry, Motion=unit_x_12)  # -> Geometry, Transform
list_item_29 = ListItem(List=construct_point_15, Index="2", Wrap=True)
unit_x_13 = UnitX(Factor=expr("x/3", list_item_29))
line_14 = Line(StartPoint=construct_point_6, EndPoint=rotate_3d_16.Geometry)
panel_85 = Panel(unit_x_13)
list_item_30 = ListItem(List=construct_point_15, Index="3", Wrap=True)
rotate_3d_17 = Rotate3D(Geometry=move_16.Geometry, Angle=expr("x*-2", degrees(addition_9)), Center=rotate_3d_16.Geometry, Axis=unit_z_10)  # -> Geometry, Transform
move_17 = Move(Geometry=rotate_3d_17.Geometry, Motion=unit_x_13)  # -> Geometry, Transform
unit_x_14 = UnitX(Factor=expr("x/3", list_item_30))
rotate_3d_18 = Rotate3D(Geometry=move_17.Geometry, Angle=expr("x*(-3)", degrees(addition_9)), Center=rotate_3d_17.Geometry, Axis=unit_z_10)  # -> Geometry, Transform
line_15 = Line(StartPoint=rotate_3d_16.Geometry, EndPoint=rotate_3d_17.Geometry)
move_18 = Move(Geometry=rotate_3d_18.Geometry, Motion=unit_x_14)  # -> Geometry, Transform
panel_86 = Panel(unit_x_14)
list_item_31 = ListItem(List=construct_point_15, Index="4", Wrap=True)
line_16 = Line(StartPoint=rotate_3d_17.Geometry, EndPoint=rotate_3d_18.Geometry)
unit_x_15 = UnitX(Factor=expr("x/3", list_item_31))
rotate_3d_19 = Rotate3D(Geometry=move_18.Geometry, Angle=expr("x*(-4)", degrees(addition_9)), Center=rotate_3d_18.Geometry, Axis=unit_z_10)  # -> Geometry, Transform
move_19 = Move(Geometry=rotate_3d_19.Geometry, Motion=unit_x_15)  # -> Geometry, Transform
list_item_32 = ListItem(List=construct_point_15, Index="5", Wrap=True)
line_17 = Line(StartPoint=rotate_3d_18.Geometry, EndPoint=rotate_3d_19.Geometry)
rotate_3d_20 = Rotate3D(Geometry=move_19.Geometry, Angle=expr("x*(-5)", degrees(addition_9)), Center=rotate_3d_19.Geometry, Axis=unit_z_10)  # -> Geometry, Transform
unit_x_16 = UnitX(Factor=expr("x/3", list_item_32))
move_20 = Move(Geometry=rotate_3d_20.Geometry, Motion=unit_x_16)  # -> Geometry, Transform
line_18 = Line(StartPoint=rotate_3d_19.Geometry, EndPoint=rotate_3d_20.Geometry)
rotate_3d_21 = Rotate3D(Geometry=move_20.Geometry, Angle=expr("x*(-6)", degrees(addition_9)), Center=rotate_3d_20.Geometry, Axis=unit_z_10)  # -> Geometry, Transform
line_19 = Line(StartPoint=rotate_3d_20.Geometry, EndPoint=rotate_3d_21.Geometry)
set_union_2 = SetUnion(
    _5=rotate_3d_21.Geometry,
    _4=rotate_3d_20.Geometry,
    _3=rotate_3d_19.Geometry,
    _2=rotate_3d_18.Geometry,
    _1=rotate_3d_17.Geometry,
    _0=rotate_3d_16.Geometry)

data_recorder_9 = DataRecorder(line_19, DataLimit=-10, RecordData=False)
