# Grasshopper definition vectorgraphics_LOFT_17(graphic_disabled_robotest).gh (Grasshopper 1.0.7)
# plug-ins: Firefly.X, Firefly.Core

toggle = BooleanToggle(True)
ports_available = COMPortsAvailable()
panel = Panel(ports_available)

open_close_port = OpenClosePort(OpenClosePort=toggle, PortNumber=Slider(4, range=0..10), BaudRate=115200)
panel_2 = Panel(open_close_port)

timer = Timer(TimerInterval=20, Target=serial_read_generic)
panel_3 = Panel("9600")
serial_read_generic = SerialReadGeneric(StartReadingValues=toggle, PortNumber="3")  # -> SerialOutput, StatusMessage
open_port = OpenClosePort(OpenClosePort=toggle, PortNumber="3", BaudRate="115200")
panel_4 = Panel(serial_read_generic.StatusMessage)
panel_5 = Panel(serial_read_generic.SerialOutput)
panel_6 = Panel(open_port)
text_split = TextSplit(Text=serial_read_generic.SerialOutput, Separators=", ")
panel_7 = Panel(text_split)
list_length = ListLength(List=text_split)
series = Series(Start=Slider(0, range=0..100), Step=Slider(2, range=0..10), Count=expr("x/2", list_length))
list_item = ListItem(List=text_split, Index=series, Wrap=True)  # -> graft(Item)
data_rec = PythonScript(x=list_item, enable=Toggle(True), reset=Button(), limit=Slider(100, range=0..100))  # -> x; inputs x: tree, enable: Boolean, reset: Boolean, limit: Int32
# ---------- data_rec: Python ----------
from Grasshopper import DataTree
if reset or 'rec' not in globals(): rec = DataTree[object]()
if enable and not reset: rec.MergeTree(x)
if limit > 0:
  for branch in rec.Branches:
    if branch.Count > limit:
      branch.RemoveRange(0, branch.Count - limit)
x = rec
# ---------- end data_rec ----------
sort_list = SortList(Keys=data_rec)  # -> Keys, ValuesValuesA
panel_8 = Panel(data_rec)
list_length_2 = ListLength(List=sort_list.Keys)
list_item_2 = ListItem(List=sort_list.Keys, Index=0, Wrap=True)
list_item_3 = ListItem(List=sort_list.Keys, Index=expr("x-1", list_length_2), Wrap=True)
panel_9 = Panel(list_item_2)
panel_10 = Panel(list_item_3)

frame_rate = FrameRate()  # -> simplify(flatten(RefreshRate)), Frequency
panel_11 = Panel(frame_rate.RefreshRate)
panel_12 = Panel(frame_rate.Frequency)

integer = Integer(1)
timer_2 = Timer(TimerInterval=20, Target=data_recorder)
data_recorder = DataRecorder(integer, DataLimit=-360, RecordData=True)
mass_addition = MassAddition(Input=data_recorder)  # -> Result, PartialResults
panel_13 = Panel(mass_addition.Result)
construct_domain = ConstructDomain(DomainStart=panel_9, DomainEnd=panel_10)
panel_14 = Panel(construct_domain)
number_of_lists = Slider(8, range=0..10)
height_between_loft_segments = Slider(1, range=0..10)
_1 = Integer(1)
addition = Addition(A=_1, B=height_between_loft_segments)
increse_distance_from_centre = Slider(2, range=0..5)
unit_z = UnitZ(Factor=_1)
series_2 = Series(Start=unit_z, Step=addition, Count=number_of_lists)
list_length_3 = ListLength(List=series_2)
list_item_4 = ListItem(List=series_2, Index=expr("x-1", list_length_3), Wrap=True)
panel_15 = Panel(list_item_4)
number_slider = Slider(36, range=0..100)
mass_addition_2 = MassAddition(Input=data_recorder)  # -> Result, PartialResults; disabled

height_between_loft_segments_2 = Slider(10, range=0..10)  # disabled
_1_2 = Integer(1)  # disabled
number_of_lists_2 = Slider(14, range=0..30)  # disabled
number_slider_2 = Slider(1, range=0..10)  # disabled
addition_2 = Addition(A=_1_2, B=height_between_loft_segments_2)  # disabled
addition_3 = Addition(A=list_item_4, B=7)  # disabled
unit_z_2 = UnitZ(Factor=_1_2)  # disabled
series_3 = Series(Start=number_slider_2, Step=1, Count=number_of_lists_2)  # disabled
series_4 = Series(Start=addition_3, Step=addition_2, Count=number_of_lists_2)  # disabled
multiplication = Multiplication(A=series_3, B=series_3)  # disabled
_0 = Integer(0)  # disabled
integer_2 = Integer(-3)  # disabled
_1_3 = Integer(1)  # disabled
panel_16 = Panel(multiplication)  # disabled
construct_point = ConstructPoint(XCoordinate=multiplication, YCoordinate=_0, ZCoordinate=series_4)  # disabled
construct_point_2 = ConstructPoint(XCoordinate=_0, YCoordinate=_0, ZCoordinate=_0)  # disabled
panel_17 = Panel(construct_point)  # disabled
number_slider_3 = Slider(35, range=0..100)  # disabled
number_slider_4 = Slider(9, range=0..10)  # disabled
integer_3 = Integer(1)  # disabled
series_5 = Series(Start=mass_addition_2.Result, Step=number_slider_3, Count=number_of_lists_2)  # disabled
multiplication_2 = Multiplication(A=series_5, B=number_slider_4)  # disabled
rotate_3d = Rotate3D(Geometry=construct_point, Angle=degrees(multiplication_2), Center=construct_point_2, Axis=unit_z_2)  # -> flatten(Geometry), Transform; disabled
panel_18 = Panel(series_5)  # disabled
number_slider_5 = Slider(0.3, range=0..1)  # disabled
panel_19 = Panel(rotate_3d.Geometry)  # disabled
interpolate_t = InterpolateT(Vertices=rotate_3d.Geometry, TangentStart=Vector(0, 0, 0), TangentEnd=Vector(0, 0, 0), KnotStyle=1)  # -> Curve, Length, Domain; disabled
number_slider_6 = Slider(60, range=0..100)  # disabled
multiplication_3 = Multiplication(A=mass_addition_2.Result, B=number_slider_5)  # disabled
divide_curve = DivideCurve(Curve=interpolate_t.Curve, Count=number_slider_6, Kinks=False)  # -> Points, Tangents, Parameters; disabled
panel_20 = Panel(divide_curve.Points)  # disabled
number_slider_7 = Slider(4, range=0..10)  # disabled
number_slider_8 = Slider(10, range=0..10)  # disabled
series_6 = Series(Start=multiplication_3, Step=1, Count=number_slider_8)  # disabled
panel_21 = Panel(series_6)  # disabled
sine = Sine(Value=series_6)  # disabled
unit_z_3 = UnitZ(Factor=sine)  # disabled
multiplication_4 = Multiplication(A=unit_z_3, B=number_slider_7)  # disabled
number_slider_9 = Slider(2, range=0..10)  # disabled
number_slider_10 = Slider(0, range=0..10)  # disabled
multiplication_5 = Multiplication(A=multiplication_4, B=-1)  # disabled
series_7 = Series(Start=number_slider_10, Step=number_slider_9, Count=number_slider_8)  # disabled
panel_22 = Panel(multiplication_4)  # disabled
panel_23 = Panel(multiplication_5)  # disabled
panel_24 = Panel(series_7)  # disabled
number_slider_11 = Slider(6, range=0..10)  # disabled
division = Division(A=panel_24, B=number_slider_11)  # disabled
panel_25 = Panel(division)  # disabled
multiplication_6 = Multiplication(A=series_7, B=panel_25)  # disabled
integer_4 = Integer(multiplication_6)  # disabled
list_item_5 = ListItem(List=divide_curve.Points, Index=integer_4, Wrap=True)  # disabled
move = Move(Geometry=list_item_5, Motion=multiplication_4)  # -> Geometry, Transform; disabled
move_2 = Move(Geometry=list_item_5, Motion=multiplication_5)  # -> Geometry, Transform; disabled

multiplication_7 = Multiplication(A=mass_addition.Result, B=number_slider)
series_8 = Series(Start=multiplication_7, Step=26, Count=number_of_lists)
division_2 = Division(A=Slider(360, range=0..1000), B=number_slider)
_0_2 = Integer(0)
panel_26 = Panel(series_8)
panel_27 = Panel(division_2)
construct_point_3 = ConstructPoint(XCoordinate=_0_2, YCoordinate=_0_2, ZCoordinate=_0_2)

number_slider_12 = Slider(2, range=0..10)  # disabled
division_3 = Division(A=list_item_4, B=number_slider_12)  # disabled
construct_point_4 = ConstructPoint(XCoordinate=0, YCoordinate=0, ZCoordinate=division_3)  # disabled
plane_normal = PlaneNormal(Origin=construct_point_4, ZAxis=Vector(0, 0, 1))  # disabled
number_slider_13 = Slider(1, range=0..5)  # disabled
mirror = Mirror(Geometry=move.Geometry, Plane=plane_normal)  # -> Geometry, Transform; disabled
mirror_2 = Mirror(Geometry=move_2.Geometry, Plane=plane_normal)  # -> Geometry, Transform; disabled
number_slider_14 = Slider(108, range=0..360)  # disabled
multiplication_8 = Multiplication(A=number_slider_13, B=-1)  # disabled
unit_z_4 = UnitZ(Factor=multiplication_8)  # disabled
unit_z_5 = UnitZ(Factor=number_slider_13)  # disabled
rotate_3d_2 = Rotate3D(Geometry=mirror.Geometry, Angle=degrees(number_slider_14), Center=Point(0, 0, 0), Axis=Vector(0, 0, 1))  # -> Geometry, Transform; disabled
rotate_3d_3 = Rotate3D(Geometry=mirror_2.Geometry, Angle=degrees(number_slider_14), Center=Point(0, 0, 0), Axis=Vector(0, 0, 1))  # -> Geometry, Transform; disabled
interpolate_t_2 = InterpolateT(Vertices=rotate_3d_2.Geometry, TangentStart=unit_z_4, TangentEnd=Vector(0, 0, 0), KnotStyle=1)  # -> Curve, Length, Domain; disabled
interpolate_t_3 = InterpolateT(Vertices=move_2.Geometry, TangentStart=unit_z_5, TangentEnd=Vector(0, 0, 0), KnotStyle=1)  # -> Curve, Length, Domain; disabled
panel_28 = Panel(rotate_3d_3.Geometry)  # disabled
custom_preview = CustomPreview(
    Geometry=[interpolate_t_2.Curve, interpolate_t_3.Curve],
    Material={diffuse=RGB(255, 0, 0), emission=RGB(66, 48, 66), shine=0.5, specular=RGB(255, 255, 255), transparency=0})  # disabled

number_slider_15 = Slider(2.3, range=0..5)  # disabled
unit_z_6 = UnitZ(Factor=1)  # disabled
number_slider_16 = Slider(36, range=0..36)  # disabled
multiplication_9 = Multiplication(A=unit_z_6, B=-1)  # disabled
interpolate_t_4 = InterpolateT(Vertices=move.Geometry, TangentStart=unit_z_6, TangentEnd=Vector(0, 0, 0), KnotStyle=1)  # -> reparameterize(Curve), Length, Domain; disabled
interpolate_t_5 = InterpolateT(Vertices=rotate_3d_3.Geometry, TangentStart=multiplication_9, TangentEnd=Vector(0, 0, 0), KnotStyle=1)  # -> reparameterize(Curve), Length, Domain; disabled
domain = Domain(interpolate_t_4.Curve)  # disabled
panel_29 = Panel(domain)  # disabled
construct_domain_2 = ConstructDomain(DomainStart=Slider(1.9, range=0..10), DomainEnd=Slider(3.1, range=0..10))
construct_domain_3 = ConstructDomain(DomainStart=Slider(0, range=0..100), DomainEnd=Slider(1, range=0..1))
remap_numbers = RemapNumbers(Value=list_item, Source=construct_domain, Target=construct_domain_3)  # -> Mapped, Clipped

multiplication_10 = Multiplication(A=panel_13, B=Slider(2, range=0..10))
series_9 = Series(Start=panel_13, Step=multiplication_10, Count=number_of_lists)
panel_30 = Panel(series_9)
_1_4 = Integer(1)
random = Random(Range=Domain(0, 1), Number=_1_4, Seed=series_9)
panel_31 = Panel(remap_numbers.Mapped)

addition_4 = Addition(A=remap_numbers.Mapped, B=increse_distance_from_centre)  # -> flatten(Result)

list_length_4 = ListLength(List=series_2)  # disabled
list_item_6 = ListItem(List=series_2, Index=expr("x-1", list_length_4), Wrap=True)  # disabled
list_item_7 = ListItem(List=series_2, Index=0, Wrap=True)  # disabled
integer_5 = Integer(-10)  # disabled
construct_point_5 = ConstructPoint(XCoordinate=integer_5, YCoordinate=0, ZCoordinate=list_item_7)  # disabled
construct_point_6 = ConstructPoint(XCoordinate=integer_5, YCoordinate=0, ZCoordinate=list_item_6)  # disabled
line = Line(StartPoint=construct_point_5, EndPoint=construct_point_6)  # disabled
divide_curve_2 = DivideCurve(Curve=line, Count=number_of_lists, Kinks=False)  # -> Points, Tangents, Parameters; disabled
unit_x = UnitX(Factor=addition_4)  # disabled
move_3 = Move(Geometry=divide_curve_2.Points, Motion=unit_x)  # -> Geometry, Transform; disabled
line_2 = Line(StartPoint=divide_curve_2.Points, EndPoint=move_3.Geometry)  # disabled

construct_point_7 = ConstructPoint(XCoordinate=addition_4, YCoordinate=_0_2, ZCoordinate=series_2)
panel_33 = Panel(construct_point_7)
rotate_3d_4 = Rotate3D(Geometry=construct_point_7, Angle=degrees(series_8), Center=construct_point_3, Axis=unit_z)  # -> graft(Geometry), Transform

number_slider_17 = Slider(100, range=0..100)  # disabled
increse_distance_from_centre_2 = Slider(25, range=0..30)  # disabled
list_length_5 = ListLength(List=construct_point_7)  # disabled
multiplication_11 = Multiplication(A=mass_addition.Result, B=number_slider_17)  # disabled
addition_5 = Addition(A=remap_numbers.Mapped, B=increse_distance_from_centre_2)  # -> flatten(Result); disabled
number_slider_18 = Slider(1, range=0..1)  # disabled
division_4 = Division(A=multiplication_11, B=list_length_5)  # disabled
construct_point_8 = ConstructPoint(XCoordinate=addition_5, YCoordinate=_0_2, ZCoordinate=series_2)  # disabled
unit_z_7 = UnitZ(Factor=_1)  # disabled
multiplication_12 = Multiplication(A=division_4, B=number_slider_18)  # disabled
# pythagerous theorom to get distance
construct_point_9 = ConstructPoint(XCoordinate=_0_2, YCoordinate=_0_2, ZCoordinate=_0_2)  # disabled
panel_34 = Panel(unit_z_7)  # disabled
panel_35 = Panel(construct_point_8)  # disabled
panel_36 = Panel(multiplication_12)  # disabled
panel_37 = Panel("0")  # disabled
list_item_8 = ListItem(List=construct_point_8, Index=panel_37, Wrap=True)  # disabled
panel_38 = Panel("1")  # disabled
unit_x_2 = UnitX(Factor=list_item_8)  # disabled
panel_39 = Panel(unit_x_2)  # disabled
list_item_9 = ListItem(List=construct_point_8, Index=panel_38, Wrap=True)  # disabled
move_4 = Move(Geometry=construct_point_3, Motion=unit_x_2)  # -> Geometry, Transform; disabled
panel_40 = Panel(list_item_9)  # disabled
unit_x_3 = UnitX(Factor=expr("x/2", list_item_9))  # disabled
panel_41 = Panel("2")  # disabled
panel_42 = Panel(move_4.Geometry)  # disabled
rotate_3d_5 = Rotate3D(Geometry=move_4.Geometry, Angle=degrees(multiplication_12), Center=construct_point_9, Axis=unit_z_7)  # -> Geometry, Transform; disabled
panel_43 = Panel(unit_x_3)  # disabled
move_5 = Move(Geometry=rotate_3d_5.Geometry, Motion=unit_x_3)  # -> Geometry, Transform; disabled
list_item_10 = ListItem(List=construct_point_8, Index=panel_41, Wrap=True)  # disabled
panel_44 = Panel("3")  # disabled
unit_x_4 = UnitX(Factor=expr("x/3", list_item_10))  # disabled
line_3 = Line(StartPoint=construct_point_3, EndPoint=rotate_3d_5.Geometry)  # disabled
panel_45 = Panel(unit_x_4)  # disabled
list_item_11 = ListItem(List=construct_point_8, Index=panel_44, Wrap=True)  # disabled
rotate_3d_6 = Rotate3D(Geometry=move_5.Geometry, Angle=expr("x*2", degrees(multiplication_12)), Center=rotate_3d_5.Geometry, Axis=unit_z_7)  # -> Geometry, Transform; disabled
move_6 = Move(Geometry=rotate_3d_6.Geometry, Motion=unit_x_4)  # -> Geometry, Transform; disabled
unit_x_5 = UnitX(Factor=expr("x/3", list_item_11))  # disabled
panel_46 = Panel("4")  # disabled
rotate_3d_7 = Rotate3D(Geometry=move_6.Geometry, Angle=expr("x*(3)", degrees(multiplication_12)), Center=rotate_3d_6.Geometry, Axis=unit_z_7)  # -> Geometry, Transform; disabled
line_4 = Line(StartPoint=rotate_3d_5.Geometry, EndPoint=rotate_3d_6.Geometry)  # disabled
move_7 = Move(Geometry=rotate_3d_7.Geometry, Motion=unit_x_5)  # -> Geometry, Transform; disabled
panel_47 = Panel(unit_x_5)  # disabled
list_item_12 = ListItem(List=construct_point_8, Index=panel_46, Wrap=True)  # disabled
line_5 = Line(StartPoint=rotate_3d_6.Geometry, EndPoint=rotate_3d_7.Geometry)  # disabled
unit_x_6 = UnitX(Factor=expr("x/3", list_item_12))  # disabled
rotate_3d_8 = Rotate3D(Geometry=move_7.Geometry, Angle=expr("x*(4)", degrees(multiplication_12)), Center=rotate_3d_7.Geometry, Axis=unit_z_7)  # -> Geometry, Transform; disabled
panel_48 = Panel("5")  # disabled
move_8 = Move(Geometry=rotate_3d_8.Geometry, Motion=unit_x_6)  # -> Geometry, Transform; disabled
list_item_13 = ListItem(List=construct_point_8, Index=panel_48, Wrap=True)  # disabled
line_6 = Line(StartPoint=rotate_3d_7.Geometry, EndPoint=rotate_3d_8.Geometry)  # disabled
rotate_3d_9 = Rotate3D(Geometry=move_8.Geometry, Angle=expr("x*(5)", degrees(multiplication_12)), Center=rotate_3d_8.Geometry, Axis=unit_z_7)  # -> Geometry, Transform; disabled
unit_x_7 = UnitX(Factor=expr("x/3", list_item_13))  # disabled
panel_49 = Panel("6")  # disabled
move_9 = Move(Geometry=rotate_3d_9.Geometry, Motion=unit_x_7)  # -> Geometry, Transform; disabled
list_item_14 = ListItem(List=construct_point_8, Index=panel_49, Wrap=True)  # disabled
line_7 = Line(StartPoint=rotate_3d_8.Geometry, EndPoint=rotate_3d_9.Geometry)  # disabled
panel_50 = Panel("7")  # disabled
unit_x_8 = UnitX(Factor=expr("x/3", list_item_14))  # disabled
rotate_3d_10 = Rotate3D(Geometry=move_9.Geometry, Angle=expr("x*(6)", degrees(multiplication_12)), Center=rotate_3d_9.Geometry, Axis=unit_z_7)  # -> Geometry, Transform; disabled
list_item_15 = ListItem(List=construct_point_8, Index=panel_50, Wrap=True)  # disabled
move_10 = Move(Geometry=rotate_3d_10.Geometry, Motion=unit_x_8)  # -> Geometry, Transform; disabled
unit_x_9 = UnitX(Factor=expr("x/3", list_item_15))  # disabled
line_8 = Line(StartPoint=rotate_3d_9.Geometry, EndPoint=rotate_3d_10.Geometry)  # disabled
rotate_3d_11 = Rotate3D(Geometry=move_10.Geometry, Angle=expr("x*(7)", degrees(multiplication_12)), Center=rotate_3d_10.Geometry, Axis=unit_z_7)  # -> Geometry, Transform; disabled
move_11 = Move(Geometry=rotate_3d_11.Geometry, Motion=unit_x_9)  # -> Geometry, Transform; disabled
rotate_3d_12 = Rotate3D(Geometry=move_11.Geometry, Angle=expr("x*(8)", degrees(multiplication_12)), Center=rotate_3d_11.Geometry, Axis=unit_z_7)  # -> Geometry, Transform; disabled
line_9 = Line(StartPoint=rotate_3d_10.Geometry, EndPoint=rotate_3d_11.Geometry)  # disabled
set_union = SetUnion(
    _8=rotate_3d_12.Geometry,
    _6=rotate_3d_11.Geometry,
    _5=rotate_3d_10.Geometry,
    _4=rotate_3d_9.Geometry,
    _3=rotate_3d_8.Geometry,
    _2=rotate_3d_7.Geometry,
    _1=rotate_3d_6.Geometry,
    _0=rotate_3d_5.Geometry)  # disabled
line_10 = Line(StartPoint=rotate_3d_11.Geometry, EndPoint=rotate_3d_12.Geometry)  # disabled
data_recorder_2 = DataRecorder(rotate_3d_12.Geometry, DataLimit=-10, RecordData=False)  # disabled

construct_domain_4 = ConstructDomain(DomainStart=Slider(10, range=10..72), DomainEnd=Slider(72, range=10..72))
construct_domain_5 = ConstructDomain(DomainStart=Slider(19, range=15..100), DomainEnd=Slider(146, range=0..165))
construct_domain_6 = ConstructDomain(DomainStart=Slider(0, range=0..100), DomainEnd=Slider(180, range=0..180))

gene_pool = GenePool(Decimals=2, Maximum=1, Minimum=0, Value=[0, 0.23, 0.5246, 0.76, 1])  # disabled
gene_pool_2 = GenePool(Decimals=2, Maximum=10, Minimum=0, Value=[2.32, 0.3, 2.46, 4.43, 0])  # disabled
pipe = Pipe(Curve=[interpolate_t_4.Curve, interpolate_t_5.Curve], Radius=number_slider_15, Caps=0)  # disabled
pipe_variable = PipeVariable(Curve=[interpolate_t_4.Curve, interpolate_t_5.Curve], Parameters=gene_pool, Radii=gene_pool_2, Caps=0)  # disabled
panel_51 = Panel(pipe)  # disabled
panel_52 = Panel(pipe_variable)  # disabled
custom_preview_2 = CustomPreview(
    Geometry=pipe_variable,
    Material={diffuse=RGB(30, 144, 255), emission=RGB(76, 76, 76), shine=0.5, specular=RGB(255, 255, 255), transparency=0})  # disabled

number_slider_19 = Slider(293, range=0..360)  # disabled
number_slider_20 = Slider(79, range=0..360)  # disabled
number_slider_21 = Slider(219, range=0..360)  # disabled
rotate_3d_13 = Rotate3D(Geometry=interpolate_t_4.Curve, Angle=degrees(number_slider_20), Center=Point(0, 0, 0), Axis=Vector(0, 0, 1))  # -> Geometry, Transform; disabled
rotate_3d_14 = Rotate3D(Geometry=interpolate_t_4.Curve, Angle=degrees(number_slider_19), Center=Point(0, 0, 0), Axis=Vector(0, 0, 1))  # -> Geometry, Transform; disabled
rotate_3d_15 = Rotate3D(Geometry=interpolate_t_4.Curve, Angle=degrees(number_slider_21), Center=Point(0, 0, 0), Axis=Vector(0, 0, 1))  # -> Geometry, Transform; disabled
divide_curve_3 = DivideCurve(Curve=interpolate_t_5.Curve, Count=4, Kinks=False)  # -> Points, Tangents, Parameters; disabled
divide_curve_4 = DivideCurve(Curve=interpolate_t_5.Curve, Count=2, Kinks=False)  # -> Points, Tangents, Parameters; disabled
divide_curve_5 = DivideCurve(Curve=interpolate_t_5.Curve, Count=3, Kinks=False)  # -> Points, Tangents, Parameters; disabled
divide_curve_6 = DivideCurve(Curve=rotate_3d_15.Geometry, Count=3, Kinks=False)  # -> Points, Tangents, Parameters; disabled
divide_curve_7 = DivideCurve(Curve=rotate_3d_13.Geometry, Count=2, Kinks=False)  # -> Points, Tangents, Parameters; disabled
divide_curve_8 = DivideCurve(Curve=rotate_3d_14.Geometry, Count=4, Kinks=False)  # -> Points, Tangents, Parameters; disabled
interpolate_t_6 = InterpolateT(Vertices=divide_curve_3.Points, TangentStart=Vector(0, 0, 0), TangentEnd=Vector(0, 0, 0), KnotStyle=1)  # -> Curve, Length, Domain; disabled
interpolate_t_7 = InterpolateT(Vertices=divide_curve_4.Points, TangentStart=Vector(0, 0, 0), TangentEnd=Vector(0, 0, 0), KnotStyle=1)  # -> Curve, Length, Domain; disabled
interpolate_t_8 = InterpolateT(Vertices=divide_curve_8.Points, TangentStart=Vector(0, 0, 0), TangentEnd=Vector(0, 0, 0), KnotStyle=1)  # -> Curve, Length, Domain; disabled
interpolate_t_9 = InterpolateT(Vertices=divide_curve_5.Points, TangentStart=Vector(0, 0, 0), TangentEnd=Vector(0, 0, 0), KnotStyle=1)  # -> Curve, Length, Domain; disabled
multiplication_13 = Multiplication(A=number_slider_15, B=0.3)  # disabled
multiplication_14 = Multiplication(A=number_slider_15, B=0.2)  # disabled
interpolate_t_10 = InterpolateT(Vertices=divide_curve_7.Points, TangentStart=Vector(0, 0, 0), TangentEnd=Vector(0, 0, 0), KnotStyle=1)  # -> Curve, Length, Domain; disabled
interpolate_t_11 = InterpolateT(Vertices=divide_curve_6.Points, TangentStart=Vector(0, 0, 0), TangentEnd=Vector(0, 0, 0), KnotStyle=1)  # -> Curve, Length, Domain; disabled
plane_normal_2 = PlaneNormal(Origin=divide_curve_3.Points, ZAxis=divide_curve_3.Tangents)  # disabled
plane_normal_3 = PlaneNormal(Origin=divide_curve_4.Points, ZAxis=divide_curve_4.Tangents)  # disabled
plane_normal_4 = PlaneNormal(Origin=divide_curve_8.Points, ZAxis=divide_curve_8.Tangents)  # disabled
plane_normal_5 = PlaneNormal(Origin=divide_curve_7.Points, ZAxis=divide_curve_7.Tangents)  # disabled
multiplication_15 = Multiplication(A=multiplication_13, B=number_slider_15)  # disabled
multiplication_16 = Multiplication(A=multiplication_14, B=number_slider_15)  # disabled
ellipse = Ellipse(Plane=plane_normal_2, Radius1=multiplication_15, Radius2=multiplication_13)  # -> Ellipse, Focus1, Focus2; disabled
ellipse_2 = Ellipse(Plane=plane_normal_3, Radius1=multiplication_15, Radius2=multiplication_13)  # -> Ellipse, Focus1, Focus2; disabled
ellipse_3 = Ellipse(Plane=plane_normal_4, Radius1=multiplication_16, Radius2=multiplication_14)  # -> Ellipse, Focus1, Focus2; disabled
ellipse_4 = Ellipse(Plane=plane_normal_5, Radius1=multiplication_16, Radius2=multiplication_14)  # -> Ellipse, Focus1, Focus2; disabled
panel_53 = Panel(multiplication_15)  # disabled
panel_54 = Panel(multiplication_16)  # disabled
loft = Loft(Curves=ellipse.Ellipse, Options={Adjust=False, Closed=False, LoftEnds=0, LoftSimp=0, LoftType=0, Rebuild=10, Refit=0.01})  # disabled
loft_2 = Loft(
    Curves=ellipse_2.Ellipse,
    Options={Adjust=False, Closed=False, LoftEnds=0, LoftSimp=0, LoftType=0, Rebuild=10, Refit=0.01})  # disabled
loft_3 = Loft(
    Curves=ellipse_3.Ellipse,
    Options={Adjust=False, Closed=False, LoftEnds=0, LoftSimp=0, LoftType=0, Rebuild=10, Refit=0.01})  # disabled
loft_4 = Loft(
    Curves=ellipse_4.Ellipse,
    Options={Adjust=False, Closed=False, LoftEnds=0, LoftSimp=0, LoftType=0, Rebuild=10, Refit=0.01})  # disabled
custom_preview_3 = CustomPreview(
    Geometry=[interpolate_t_8.Curve, interpolate_t_10.Curve, interpolate_t_7.Curve, interpolate_t_6.Curve, interpolate_t_9.Curve, interpolate_t_11.Curve],
    Material={diffuse=RGB(255, 255, 255), emission=RGB(66, 48, 66), shine=0.5, specular=RGB(255, 255, 255), transparency=0})  # disabled

timer_3 = Timer(TimerInterval=1000, Target=serial_read_generic_2)
timer_4 = Timer(TimerInterval=1000)
number_slider_22 = Slider(4, range=0..10)

set_wrist_rotation = Slider(91, range=0..180)  # disabled
set_elbow = Slider(97, range=0..180)  # disabled
set_base = Slider(44, range=0..180)  # disabled
set_shoulder = Slider(92, range=15..165)  # disabled
number_slider_23 = Slider(64, range=0..200)  # disabled
set_gripper = Slider(123, range=10..180)  # disabled
set_wrist = Slider(167, range=0..180)  # disabled
panel_55 = Panel("P")  # disabled
button = Button()  # disabled
button_2 = Button()  # disabled
button_3 = Button()  # disabled
button_4 = Button()  # disabled
panel_56 = Panel([panel_55, set_base, set_shoulder, set_elbow, set_wrist_rotation, set_wrist, set_gripper, number_slider_23])  # disabled
number_slider_24 = Slider(1, range=0..1)  # disabled
number_slider_25 = Slider(0, range=0..1)  # disabled
text_join = TextJoin(Text=panel_56, Join=",")  # disabled
panel_57 = Panel(text_join)  # disabled
panel_58 = Panel("P90,90,90,90,90,90,50")  # disabled
write = SerialWriteGeneric(StartWritingValues=button_3, WriteData=panel_58, PortNumber=number_slider_22)  # -> ArduinoOutput, StatusMessage; disabled
write_2 = SerialWriteGeneric(StartWritingValues=button, WriteData=panel_57, PortNumber=number_slider_22)  # -> ArduinoOutput, StatusMessage; disabled
write_3 = SerialWriteGeneric(StartWritingValues=button_4, WriteData=number_slider_24, PortNumber=number_slider_22)  # -> ArduinoOutput, StatusMessage; disabled
write_4 = SerialWriteGeneric(StartWritingValues=button_2, WriteData=number_slider_25, PortNumber=number_slider_22)  # -> ArduinoOutput, StatusMessage; disabled
data_recorder_3 = DataRecorder(
    [write_4.ArduinoOutput, write_2.ArduinoOutput, write.ArduinoOutput, write_3.ArduinoOutput],
    DataLimit=-10,
    RecordData=True)  # disabled
panel_59 = Panel(data_recorder_3)  # disabled

serial_read_generic_2 = SerialReadGeneric(StartReadingValues=Toggle(True), PortNumber=number_slider_22)  # -> SerialOutput, StatusMessage
panel_60 = Panel(serial_read_generic_2.SerialOutput)
write_5 = SerialWriteGeneric(StartWritingValues=Button(), WriteData=Slider(0, range=0..1), PortNumber=number_slider_22)  # -> ArduinoOutput, StatusMessage
write_6 = SerialWriteGeneric(StartWritingValues=Button(), WriteData=Slider(1, range=0..1), PortNumber=number_slider_22)  # -> ArduinoOutput, StatusMessage
write_7 = SerialWriteGeneric(StartWritingValues=Button(), WriteData="P90,90,90,90,140,140,50", PortNumber=number_slider_22)  # -> ArduinoOutput, StatusMessage
data_recorder_4 = DataRecorder(write_6.ArduinoOutput, DataLimit=-10, RecordData=True)
data_recorder_5 = DataRecorder(write_7.ArduinoOutput, DataLimit=-10, RecordData=True)
data_recorder_6 = DataRecorder(write_5.ArduinoOutput, DataLimit=-10, RecordData=True)
panel_61 = Panel(data_recorder_5)
panel_62 = Panel(data_recorder_6)
panel_63 = Panel(data_recorder_4)

panel_64 = Panel(series_2)  # disabled
number_slider_26 = Slider(22, range=0..40)  # disabled
number_slider_27 = Slider(7, range=0..10)  # disabled
number_slider_28 = Slider(22, range=0..40)  # disabled
number_slider_29 = Slider(7, range=0..10)  # disabled
construct_point_10 = ConstructPoint(XCoordinate=0, YCoordinate=number_slider_28, ZCoordinate=panel_64)  # disabled
construct_point_11 = ConstructPoint(XCoordinate=0, YCoordinate=number_slider_29, ZCoordinate=panel_64)  # disabled
number_slider_30 = Slider(0.15, range=0..1)  # disabled
line_11 = Line(StartPoint=construct_point_11, EndPoint=construct_point_10)  # disabled
number_slider_31 = Slider(0.25, range=0..1)  # disabled
curve = Curve(line_11)  # disabled
divide_curve_9 = DivideCurve(Curve=curve, Count=9, Kinks=False)  # -> Points, Tangents, Parameters; disabled

data_rec_2 = PythonScript(x=rotate_3d_4.Geometry, enable=Toggle(True), reset=Button(), limit=panel_27)  # -> x; inputs x: tree, enable: Boolean, reset: Boolean, limit: Int32; same code as data_rec
panel_65 = Panel(data_rec_2)
interpolate = Interpolate(Vertices=data_rec_2, Degree=Slider(5, range=1..11), Periodic=True, KnotStyle=1)  # -> flatten(Curve), Length, Domain
panel_66 = Panel(interpolate.Curve)
_2 = Integer(2)

loft_5 = Loft(
    Curves=interpolate.Curve,
    Options={Adjust=False, Closed=False, LoftEnds=0, LoftSimp=0, LoftType=1, Rebuild=10, Refit=0.01})

divide_surface = DivideSurface(Surface=loft_5, UCount=Slider(7, range=0..10), VCount=_2)  # -> Points, Normals, Parameters
list_item_16 = ListItem(List=divide_surface.Points, Index=Slider(1, range=0..1), Wrap=True)
deconstruct = Deconstruct(Point=list_item_16)  # -> flatten(XComponent), YComponent, ZComponent
panel_67 = Panel(list_item_16)

construct_point_12 = ConstructPoint(XCoordinate=0, YCoordinate=number_slider_26, ZCoordinate=flatten(deconstruct.ZComponent))  # disabled
construct_point_13 = ConstructPoint(XCoordinate=0, YCoordinate=number_slider_27, ZCoordinate=flatten(deconstruct.ZComponent))  # disabled
line_12 = Line(StartPoint=construct_point_13, EndPoint=construct_point_12)  # disabled
curve_2 = Curve(line_12)  # disabled
deconstruct_2 = Deconstruct(Point=panel_65)  # -> XComponent, YComponent, ZComponent; disabled
# limitation of math to describe complexity how we learnt it. pyhtagarous, sine waves etc, understand the line. Black magic is to make that line look alive.
# 
# How to draw simplicity out of complexity?
dispatch = Dispatch(List=curve_2, DispatchPattern=[False, True, True, True, True, True, True, False])  # -> ListA, ListB; disabled
multiplication_17 = Multiplication(A=deconstruct.XComponent, B=number_slider_30)  # disabled
divide_curve_10 = DivideCurve(Curve=dispatch.ListA, Count=9, Kinks=False)  # -> Points, Tangents, Parameters; disabled
unit_z_8 = UnitZ(Factor=multiplication_17)  # disabled
multiplication_18 = Multiplication(A=deconstruct_2.XComponent, B=number_slider_31)  # disabled
move_12 = Move(Geometry=divide_curve_10.Points, Motion=unit_z_8)  # -> flatten(Geometry), Transform; disabled
unit_z_9 = UnitZ(Factor=multiplication_18)  # disabled
panel_68 = Panel(move_12.Geometry)  # disabled
move_13 = Move(Geometry=divide_curve_9.Points, Motion=unit_z_9)  # -> flatten(Geometry), Transform; disabled
panel_69 = Panel(move_13.Geometry)  # disabled

custom_preview_4 = CustomPreview(
    Geometry=loft_5,
    Material={diffuse=RGB(255, 255, 255), emission=RGB(76, 76, 76), shine=0.1, specular=RGB(255, 255, 255), transparency=0})
panel_70 = Panel(deconstruct.ZComponent)
multiplication_19 = Multiplication(A=flatten(deconstruct.YComponent), B=flatten(deconstruct.YComponent))
multiplication_20 = Multiplication(A=deconstruct.XComponent, B=deconstruct.XComponent)
panel_71 = Panel(multiplication_20)
panel_72 = Panel(multiplication_19)
addition_6 = Addition(A=multiplication_19, B=multiplication_20)

list_length_6 = ListLength(List=interpolate.Curve)  # disabled
list_item_17 = ListItem(List=interpolate.Curve, Index=expr("x-1", list_length_6), Wrap=True)  # disabled
list_item_18 = ListItem(List=move.Geometry, Index=0, Wrap=True)  # disabled
list_item_19 = ListItem(List=interpolate.Curve, Index=0, Wrap=True)  # disabled
plane_normal_6 = PlaneNormal(Origin=list_item_18, ZAxis=Vector(0, 0, 1))  # disabled
circle = Circle(Plane=plane_normal_6, Radius=number_slider_15)  # disabled
list_item_20 = ListItem(List=rotate_3d_3.Geometry, Index=0, Wrap=True)  # disabled
plane_normal_7 = PlaneNormal(Origin=list_item_20, ZAxis=Vector(0, 0, 1))  # disabled
circle_2 = Circle(Plane=plane_normal_7, Radius=number_slider_15)  # disabled
curve_3 = Curve([circle, list_item_17])  # disabled
curve_4 = Curve([list_item_19, circle_2])  # disabled
loft_options = LoftOptions(Closed=False, Adjust=True, Rebuild=0, Refit=0, Type=5)  # disabled
loft_6 = Loft(Curves=flatten(curve_3), Options=loft_options)  # disabled
loft_7 = Loft(Curves=flatten(curve_4), Options=loft_options)  # disabled
custom_preview_5 = CustomPreview(
    Geometry=[loft_7, loft_6],
    Material={diffuse=RGB(255, 255, 255), emission=RGB(76, 76, 76), shine=0.5, specular=RGB(255, 255, 255), transparency=0.7})  # disabled

square_root = SquareRoot(Value=addition_6)
panel_73 = Panel(square_root)
list_item_21 = ListItem(List=square_root, Index=0, Wrap=True)
panel_74 = Panel(list_item_21)
construct_point_14 = ConstructPoint(XCoordinate=integer_5, YCoordinate=0, ZCoordinate=panel_70)
unit_x_10 = UnitX(Factor=list_item_21)
remap_numbers_2 = RemapNumbers(Value=square_root, Source=Domain(1.9, 3.1), Target=construct_domain_3)  # -> flatten(Mapped), Clipped
move_14 = Move(Geometry=construct_point_14, Motion=unit_x_10)  # -> Geometry, Transform
line_13 = Line(StartPoint=construct_point_14, EndPoint=move_14.Geometry)
panel_75 = Panel(remap_numbers_2.Mapped)
list_item_22 = ListItem(List=remap_numbers_2.Mapped, Index=Slider(6, range=0..10), Wrap=True)
list_item_23 = ListItem(List=remap_numbers_2.Mapped, Index=Slider(1, range=0..10), Wrap=True)
list_item_24 = ListItem(List=remap_numbers_2.Mapped, Index=Slider(2, range=0..10), Wrap=True)
list_item_25 = ListItem(List=remap_numbers_2.Mapped, Index=Slider(3, range=0..10), Wrap=True)
list_item_26 = ListItem(List=remap_numbers_2.Mapped, Index=Slider(4, range=0..10), Wrap=True)
list_item_27 = ListItem(List=remap_numbers_2.Mapped, Index=Slider(5, range=0..10), Wrap=True)
remap_numbers_3 = RemapNumbers(Value=list_item_24, Source=construct_domain_3, Target=construct_domain_5)  # -> Mapped, Clipped
remap_numbers_4 = RemapNumbers(Value=list_item_23, Source=construct_domain_3, Target=construct_domain_5)  # -> Mapped, Clipped
remap_numbers_5 = RemapNumbers(Value=list_item_25, Source=construct_domain_3, Target=construct_domain_5)  # -> Mapped, Clipped
remap_numbers_6 = RemapNumbers(Value=list_item_26, Source=construct_domain_3, Target=construct_domain_5)  # -> Mapped, Clipped
remap_numbers_7 = RemapNumbers(Value=list_item_27, Source=construct_domain_3, Target=construct_domain_5)  # -> Mapped, Clipped
remap_numbers_8 = RemapNumbers(Value=list_item_27, Source=construct_domain_3, Target=construct_domain_5)  # -> Mapped, Clipped
integer_6 = Integer(remap_numbers_4.Mapped)
integer_7 = Integer(remap_numbers_3.Mapped)
integer_8 = Integer(remap_numbers_5.Mapped)
integer_9 = Integer(remap_numbers_8.Mapped)
integer_10 = Integer(remap_numbers_6.Mapped)
integer_11 = Integer(remap_numbers_7.Mapped)
panel_76 = Panel([integer_6, integer_7, integer_8, integer_10, integer_11, integer_9])
list_item_28 = ListItem(List=panel_76, Index=0, Wrap=True)
panel_77 = Panel(["P", list_item_28])
text_join_2 = TextJoin(Text=panel_77)
panel_78 = Panel([text_join_2, panel_76, "50"])
text_join_3 = TextJoin(Text=panel_78, Join=",")
write_8 = SerialWriteGeneric(StartWritingValues=Toggle(False), WriteData=text_join_3, PortNumber=number_slider_22)  # -> ArduinoOutput, StatusMessage
data_recorder_7 = DataRecorder(write_8.ArduinoOutput, DataLimit=-10, RecordData=True)

square = Square(Value=deconstruct.XComponent)  # disabled
square_2 = Square(Value=deconstruct.YComponent)  # disabled
addition_7 = Addition(A=square, B=square_2)  # disabled
panel_79 = Panel(deconstruct.XComponent)  # disabled
square_root_2 = SquareRoot(Value=addition_7)  # disabled
increse_distance_from_centre_3 = Slider(25, range=0..30)  # disabled
number_slider_32 = Slider(100, range=0..100)  # disabled
list_item_29 = ListItem(List=square_root_2, Index=0, Wrap=True)  # -> flatten(Item); disabled
list_length_7 = ListLength(List=deconstruct.XComponent)  # disabled
panel_80 = Panel(deconstruct.ZComponent)  # disabled
multiplication_21 = Multiplication(A=mass_addition.Result, B=number_slider_32)  # disabled
panel_81 = Panel(list_length_7)  # disabled
addition_8 = Addition(A=increse_distance_from_centre_3, B=list_item_29)  # disabled
number_slider_33 = Slider(1, range=0..1)  # disabled
division_5 = Division(A=multiplication_21, B=list_length_7)  # disabled
panel_82 = Panel(multiplication_21)  # disabled
flatten_tree = FlattenTree(Tree=panel_80, Path="{0}")  # disabled
construct_point_15 = ConstructPoint(XCoordinate=addition_8, YCoordinate=_0_2, ZCoordinate=flatten_tree)  # disabled
unit_z_10 = UnitZ(Factor=_1)  # disabled
panel_83 = Panel(flatten_tree)  # disabled
construct_point_16 = ConstructPoint(XCoordinate=_0_2, YCoordinate=_0_2, ZCoordinate=_0_2)  # disabled
panel_84 = Panel("180")  # disabled
multiplication_22 = Multiplication(A=division_5, B=number_slider_33)  # disabled
panel_85 = Panel(unit_z_10)  # disabled
panel_86 = Panel(construct_point_15)  # disabled
addition_9 = Addition(A=multiplication_22, B=panel_84)  # disabled
panel_87 = Panel(addition_9)  # disabled
panel_88 = Panel("0")  # disabled
list_item_30 = ListItem(List=construct_point_15, Index=panel_88, Wrap=True)  # disabled
panel_89 = Panel("1")  # disabled
unit_x_11 = UnitX(Factor=list_item_30)  # disabled
panel_90 = Panel("-1")  # disabled
panel_91 = Panel(unit_x_11)  # disabled
list_item_31 = ListItem(List=construct_point_15, Index=panel_89, Wrap=True)  # disabled
multiplication_23 = Multiplication(A=addition_9, B=panel_90)  # disabled
move_15 = Move(Geometry=construct_point_3, Motion=unit_x_11)  # -> Geometry, Transform; disabled
panel_92 = Panel(list_item_31)  # disabled
unit_x_12 = UnitX(Factor=expr("x/2", list_item_31))  # disabled
panel_93 = Panel("2")  # disabled
panel_94 = Panel(move_15.Geometry)  # disabled
rotate_3d_16 = Rotate3D(Geometry=move_15.Geometry, Angle=degrees(multiplication_23), Center=construct_point_16, Axis=unit_z_10)  # -> Geometry, Transform; disabled
panel_95 = Panel(unit_x_12)  # disabled
move_16 = Move(Geometry=rotate_3d_16.Geometry, Motion=unit_x_12)  # -> Geometry, Transform; disabled
list_item_32 = ListItem(List=construct_point_15, Index=panel_93, Wrap=True)  # disabled
panel_96 = Panel("3")  # disabled
unit_x_13 = UnitX(Factor=expr("x/3", list_item_32))  # disabled
line_14 = Line(StartPoint=construct_point_3, EndPoint=rotate_3d_16.Geometry)  # disabled
panel_97 = Panel(unit_x_13)  # disabled
list_item_33 = ListItem(List=construct_point_15, Index=panel_96, Wrap=True)  # disabled
rotate_3d_17 = Rotate3D(Geometry=move_16.Geometry, Angle=expr("x*-2", degrees(addition_9)), Center=rotate_3d_16.Geometry, Axis=unit_z_10)  # -> Geometry, Transform; disabled
move_17 = Move(Geometry=rotate_3d_17.Geometry, Motion=unit_x_13)  # -> Geometry, Transform; disabled
unit_x_14 = UnitX(Factor=expr("x/3", list_item_33))  # disabled
panel_98 = Panel("4")  # disabled
rotate_3d_18 = Rotate3D(Geometry=move_17.Geometry, Angle=expr("x*(-3)", degrees(addition_9)), Center=rotate_3d_17.Geometry, Axis=unit_z_10)  # -> Geometry, Transform; disabled
line_15 = Line(StartPoint=rotate_3d_16.Geometry, EndPoint=rotate_3d_17.Geometry)  # disabled
move_18 = Move(Geometry=rotate_3d_18.Geometry, Motion=unit_x_14)  # -> Geometry, Transform; disabled
panel_99 = Panel(unit_x_14)  # disabled
list_item_34 = ListItem(List=construct_point_15, Index=panel_98, Wrap=True)  # disabled
line_16 = Line(StartPoint=rotate_3d_17.Geometry, EndPoint=rotate_3d_18.Geometry)  # disabled
unit_x_15 = UnitX(Factor=expr("x/3", list_item_34))  # disabled
rotate_3d_19 = Rotate3D(Geometry=move_18.Geometry, Angle=expr("x*(-4)", degrees(addition_9)), Center=rotate_3d_18.Geometry, Axis=unit_z_10)  # -> Geometry, Transform; disabled
panel_100 = Panel("5")  # disabled
move_19 = Move(Geometry=rotate_3d_19.Geometry, Motion=unit_x_15)  # -> Geometry, Transform; disabled
list_item_35 = ListItem(List=construct_point_15, Index=panel_100, Wrap=True)  # disabled
line_17 = Line(StartPoint=rotate_3d_18.Geometry, EndPoint=rotate_3d_19.Geometry)  # disabled
rotate_3d_20 = Rotate3D(Geometry=move_19.Geometry, Angle=expr("x*(-5)", degrees(addition_9)), Center=rotate_3d_19.Geometry, Axis=unit_z_10)  # -> Geometry, Transform; disabled
unit_x_16 = UnitX(Factor=expr("x/3", list_item_35))  # disabled
move_20 = Move(Geometry=rotate_3d_20.Geometry, Motion=unit_x_16)  # -> Geometry, Transform; disabled
line_18 = Line(StartPoint=rotate_3d_19.Geometry, EndPoint=rotate_3d_20.Geometry)  # disabled
rotate_3d_21 = Rotate3D(Geometry=move_20.Geometry, Angle=expr("x*(-6)", degrees(addition_9)), Center=rotate_3d_20.Geometry, Axis=unit_z_10)  # -> Geometry, Transform; disabled
line_19 = Line(StartPoint=rotate_3d_20.Geometry, EndPoint=rotate_3d_21.Geometry)  # disabled
set_union_2 = SetUnion(
    _5=rotate_3d_21.Geometry,
    _4=rotate_3d_20.Geometry,
    _3=rotate_3d_19.Geometry,
    _2=rotate_3d_18.Geometry,
    _1=rotate_3d_17.Geometry,
    _0=rotate_3d_16.Geometry)  # disabled

data_recorder_8 = DataRecorder(line_19, DataLimit=-10, RecordData=False)  # disabled
