# Grasshopper definition vectorgraphics_LOFT_18(graphic_disabled_robotest-alt) [May-21 '19, 1202].gh (Grasshopper 1.0.7)
# plug-ins: Firefly.X, Firefly.Core

toggle = BooleanToggle(True)
ports_available = COMPortsAvailable()
panel = Panel(ports_available)
timer = Timer(TimerInterval=20, Target=serial_read_generic)
panel_2 = Panel("9600")
serial_read_generic = SerialReadGeneric(StartReadingValues=toggle, PortNumber="3")  # -> SerialOutput, StatusMessage
open_port = OpenClosePort(OpenClosePort=toggle, PortNumber="3", BaudRate="115200")
panel_3 = Panel(serial_read_generic.StatusMessage)
panel_4 = Panel(serial_read_generic.SerialOutput)
panel_5 = Panel(open_port)
text_split = TextSplit(Text=serial_read_generic.SerialOutput, Separators=", ")
panel_6 = Panel(text_split)
list_length = ListLength(List=text_split)
series = Series(Start=Slider(0, range=0..100), Step=Slider(2, range=0..10), Count=expr("x/2", list_length))
list_item = ListItem(List=text_split, Index=series, Wrap=True)  # -> graft(Item)
data_rec = PythonScript(x=list_item, enable=Toggle(True), reset=Button(), limit=Slider(285, range=0..1500))  # -> x; inputs x: tree, enable: Boolean, reset: Boolean, limit: Int32
# ---------- data_rec: Python ----------
from Grasshopper import DataTree
if reset or 'rec' not in globals(): rec = DataTree[object]()
if enable and not reset: rec.MergeTree(x)
if limit > 0:
  for branch in rec.Branches:
    if branch.Count > limit:
      branch.RemoveRange(0, branch.Count - limit)
x = rec
# ---------- end data_rec ----------
sort_list = SortList(Keys=data_rec)  # -> Keys, ValuesValuesA
panel_7 = Panel(data_rec)
list_length_2 = ListLength(List=sort_list.Keys)
list_item_2 = ListItem(List=sort_list.Keys, Index=0, Wrap=True)
list_item_3 = ListItem(List=sort_list.Keys, Index=expr("x-1", list_length_2), Wrap=True)
panel_8 = Panel(list_item_2)
panel_9 = Panel(list_item_3)
construct_domain = ConstructDomain(DomainStart=panel_8, DomainEnd=panel_9)
panel_10 = Panel(construct_domain)

open_close_port = OpenClosePort(OpenClosePort=toggle, PortNumber=Slider(4, range=0..10), BaudRate=115200)
panel_11 = Panel(open_close_port)

frame_rate = FrameRate()  # -> simplify(flatten(RefreshRate)), Frequency
panel_12 = Panel(frame_rate.RefreshRate)
panel_13 = Panel(frame_rate.Frequency)

integer = Integer(1)
timer_2 = Timer(TimerInterval=20, Target=data_recorder)
data_recorder = DataRecorder(integer, DataLimit=-360, RecordData=True)
mass_addition = MassAddition(Input=data_recorder)  # -> Result, PartialResults
panel_14 = Panel(mass_addition.Result)
construct_point = ConstructPoint(XCoordinate=0, YCoordinate=0, ZCoordinate=0)
number_of_lists = Slider(8, range=0..10)

multiplication = Multiplication(A=panel_14, B=Slider(2, range=0..10))
series_2 = Series(Start=panel_14, Step=multiplication, Count=number_of_lists)
panel_15 = Panel(series_2)
_1 = Integer(1)
random = Random(Range=Domain(0, 1), Number=_1, Seed=series_2)

panel_16 = Panel(random)

list_item_4 = ListItem(List=flatten(random), Index=8, Wrap=True)
multiplication_2 = Multiplication(A=list_item_4, B=-1)
number_slider = Slider(0.1, range=0..1)
addition = Addition(A=number_slider, B=list_item_4)
subtraction = Subtraction(A=multiplication_2, B=number_slider)
panel_17 = Panel(subtraction)
panel_18 = Panel(addition)
multiplication_3 = Multiplication(A=addition, B=2)

division = Division(A=Slider(360, range=0..1000), B=number_of_lists)
vector = Vector("0,5,0")
move = Move(Geometry=construct_point, Motion=vector)  # -> Geometry, Transform
_1_2 = Integer(1)
increse_distance_from_centre = Slider(2, range=0..5)
unit_z = UnitZ(Factor=subtraction)
series_3 = Series(Start=unit_z, Step=Slider(2, range=0..10), Count=number_of_lists)
list_length_3 = ListLength(List=series_3)
list_item_5 = ListItem(List=series_3, Index=expr("x-1", list_length_3), Wrap=True)
panel_19 = Panel(list_item_5)
panel_20 = Panel(unit_z)
addition_2 = Addition(A=random, B=increse_distance_from_centre)  # -> flatten(Result)

list_length_4 = ListLength(List=series_3)  # disabled
list_item_6 = ListItem(List=series_3, Index=expr("x-1", list_length_4), Wrap=True)  # disabled
list_item_7 = ListItem(List=series_3, Index=0, Wrap=True)  # disabled
integer_2 = Integer(-10)  # disabled
construct_point_2 = ConstructPoint(XCoordinate=integer_2, YCoordinate=0, ZCoordinate=list_item_7)  # disabled
construct_point_3 = ConstructPoint(XCoordinate=integer_2, YCoordinate=0, ZCoordinate=list_item_6)  # disabled
line = Line(StartPoint=construct_point_2, EndPoint=construct_point_3)  # disabled
divide_curve = DivideCurve(Curve=line, Count=number_of_lists, Kinks=False)  # -> Points, Tangents, Parameters; disabled
unit_x = UnitX(Factor=addition_2)  # disabled
move_2 = Move(Geometry=divide_curve.Points, Motion=unit_x)  # -> Geometry, Transform; disabled
line_2 = Line(StartPoint=divide_curve.Points, EndPoint=move_2.Geometry)  # disabled

panel_21 = Panel(series_3)
mass_addition_2 = MassAddition(Input=data_recorder)  # -> Result, PartialResults

height_between_loft_segments = Slider(10, range=0..10)
_1_3 = Integer(1)
number_of_lists_2 = Slider(14, range=0..30)
addition_3 = Addition(A=_1_3, B=height_between_loft_segments)
addition_4 = Addition(A=list_item_5, B=7)
unit_z_2 = UnitZ(Factor=_1_3)
series_4 = Series(Start=Slider(1, range=0..10), Step=1, Count=number_of_lists_2)
series_5 = Series(Start=addition_4, Step=addition_3, Count=number_of_lists_2)
multiplication_4 = Multiplication(A=series_4, B=series_4)
_0 = Integer(0)
integer_3 = Integer(-3)
_1_4 = Integer(1)
panel_22 = Panel(multiplication_4)
construct_point_4 = ConstructPoint(XCoordinate=multiplication_4, YCoordinate=_0, ZCoordinate=series_5)
construct_point_5 = ConstructPoint(XCoordinate=_0, YCoordinate=_0, ZCoordinate=_0)
panel_23 = Panel(construct_point_4)
integer_4 = Integer(1)
series_6 = Series(Start=mass_addition_2.Result, Step=Slider(35, range=0..100), Count=number_of_lists_2)
multiplication_5 = Multiplication(A=series_6, B=Slider(9, range=0..10))
rotate_3d = Rotate3D(Geometry=construct_point_4, Angle=degrees(multiplication_5), Center=construct_point_5, Axis=unit_z_2)  # -> flatten(Geometry), Transform
panel_24 = Panel(series_6)
panel_25 = Panel(rotate_3d.Geometry)
interpolate_t = InterpolateT(Vertices=rotate_3d.Geometry, TangentStart=Vector(0, 0, 0), TangentEnd=Vector(0, 0, 0), KnotStyle=1)  # -> Curve, Length, Domain
multiplication_6 = Multiplication(A=mass_addition_2.Result, B=Slider(0.3, range=0..1))
divide_curve_2 = DivideCurve(Curve=interpolate_t.Curve, Count=Slider(60, range=0..100), Kinks=False)  # -> Points, Tangents, Parameters
panel_26 = Panel(divide_curve_2.Points)
number_slider_2 = Slider(10, range=0..10)
series_7 = Series(Start=multiplication_6, Step=1, Count=number_slider_2)
panel_27 = Panel(series_7)
sine = Sine(Value=series_7)
unit_z_3 = UnitZ(Factor=sine)
multiplication_7 = Multiplication(A=unit_z_3, B=Slider(4, range=0..10))
multiplication_8 = Multiplication(A=multiplication_7, B=-1)
series_8 = Series(Start=Slider(0, range=0..10), Step=Slider(2, range=0..10), Count=number_slider_2)
panel_28 = Panel(multiplication_7)
panel_29 = Panel(multiplication_8)
panel_30 = Panel(series_8)
division_2 = Division(A=panel_30, B=Slider(6, range=0..10))
panel_31 = Panel(division_2)
multiplication_9 = Multiplication(A=series_8, B=panel_31)
integer_5 = Integer(multiplication_9)
list_item_8 = ListItem(List=divide_curve_2.Points, Index=integer_5, Wrap=True)
move_3 = Move(Geometry=list_item_8, Motion=multiplication_7)  # -> Geometry, Transform
move_4 = Move(Geometry=list_item_8, Motion=multiplication_8)  # -> Geometry, Transform

number_slider_3 = Slider(36, range=0..100)
multiplication_10 = Multiplication(A=mass_addition.Result, B=number_slider_3)
series_9 = Series(Start=multiplication_10, Step=26, Count=number_of_lists)
division_3 = Division(A=Slider(360, range=0..1000), B=number_slider_3)
panel_32 = Panel(series_9)
panel_33 = Panel(division_3)

_0_2 = Integer(0)
construct_point_6 = ConstructPoint(XCoordinate=addition_2, YCoordinate=_0_2, ZCoordinate=series_3)
panel_35 = Panel(construct_point_6)
construct_point_7 = ConstructPoint(XCoordinate=_0_2, YCoordinate=_0_2, ZCoordinate=_0_2)
rotate_3d_2 = Rotate3D(Geometry=construct_point_6, Angle=degrees(series_9), Center=construct_point_7, Axis=unit_z)  # -> graft(Geometry), Transform

division_4 = Division(A=list_item_5, B=Slider(2, range=0..10))
construct_point_8 = ConstructPoint(XCoordinate=0, YCoordinate=0, ZCoordinate=division_4)
plane_normal = PlaneNormal(Origin=construct_point_8, ZAxis=Vector(0, 0, 1))
number_slider_4 = Slider(1, range=0..5)
mirror = Mirror(Geometry=move_3.Geometry, Plane=plane_normal)  # -> Geometry, Transform
mirror_2 = Mirror(Geometry=move_4.Geometry, Plane=plane_normal)  # -> Geometry, Transform
number_slider_5 = Slider(108, range=0..360)
multiplication_11 = Multiplication(A=number_slider_4, B=-1)
unit_z_4 = UnitZ(Factor=multiplication_11)
unit_z_5 = UnitZ(Factor=number_slider_4)
rotate_3d_3 = Rotate3D(Geometry=mirror.Geometry, Angle=degrees(number_slider_5), Center=Point(0, 0, 0), Axis=Vector(0, 0, 1))  # -> Geometry, Transform
rotate_3d_4 = Rotate3D(Geometry=mirror_2.Geometry, Angle=degrees(number_slider_5), Center=Point(0, 0, 0), Axis=Vector(0, 0, 1))  # -> Geometry, Transform
interpolate_t_2 = InterpolateT(Vertices=rotate_3d_3.Geometry, TangentStart=unit_z_4, TangentEnd=Vector(0, 0, 0), KnotStyle=1)  # -> Curve, Length, Domain
interpolate_t_3 = InterpolateT(Vertices=move_4.Geometry, TangentStart=unit_z_5, TangentEnd=Vector(0, 0, 0), KnotStyle=1)  # -> Curve, Length, Domain
panel_36 = Panel(rotate_3d_4.Geometry)
custom_preview = CustomPreview(
    Geometry=[interpolate_t_2.Curve, interpolate_t_3.Curve],
    Material={diffuse=RGB(105, 105, 105), emission=RGB(66, 48, 66), shine=0.5, specular=RGB(255, 255, 255), transparency=0})

number_slider_6 = Slider(2.3, range=0..5)
unit_z_6 = UnitZ(Factor=1)
multiplication_12 = Multiplication(A=unit_z_6, B=-1)
interpolate_t_4 = InterpolateT(Vertices=rotate_3d_4.Geometry, TangentStart=multiplication_12, TangentEnd=Vector(0, 0, 0), KnotStyle=1)  # -> reparameterize(Curve), Length, Domain
interpolate_t_5 = InterpolateT(Vertices=move_3.Geometry, TangentStart=unit_z_6, TangentEnd=Vector(0, 0, 0), KnotStyle=1)  # -> reparameterize(Curve), Length, Domain
domain = Domain(interpolate_t_5.Curve)
panel_37 = Panel(domain)
construct_domain_2 = ConstructDomain(DomainStart=Slider(1.9, range=0..10), DomainEnd=Slider(3, range=0..10))
custom_preview_2 = CustomPreview(
    Geometry=[interpolate_t_4.Curve, interpolate_t_5.Curve],
    Material={diffuse=RGB(0, 0, 0), emission=RGB(76, 76, 76), shine=1, specular=RGB(255, 255, 255), transparency=0.8})
construct_domain_3 = ConstructDomain(DomainStart=Slider(0, range=0..100), DomainEnd=Slider(1, range=0..1))
remap_numbers = RemapNumbers(Value=list_item, Source=construct_domain, Target=construct_domain_3)  # -> Mapped, Clipped
construct_domain_4 = ConstructDomain(DomainStart=Slider(10, range=10..72), DomainEnd=Slider(72, range=10..72))
construct_domain_5 = ConstructDomain(DomainStart=Slider(19, range=15..100), DomainEnd=Slider(146, range=0..165))
construct_domain_6 = ConstructDomain(DomainStart=Slider(0, range=0..100), DomainEnd=Slider(180, range=0..180))

gene_pool = GenePool(Decimals=2, Maximum=1, Minimum=0, Value=[0, 0.23, 0.5246, 0.76, 1])
gene_pool_2 = GenePool(Decimals=2, Maximum=10, Minimum=0, Value=[2.32, 0.3, 2.46, 4.43, 0])
pipe = Pipe(Curve=[interpolate_t_5.Curve, interpolate_t_4.Curve], Radius=number_slider_6, Caps=0)
pipe_variable = PipeVariable(Curve=[interpolate_t_5.Curve, interpolate_t_4.Curve], Parameters=gene_pool, Radii=gene_pool_2, Caps=0)
panel_38 = Panel(pipe)
panel_39 = Panel(pipe_variable)
custom_preview_3 = CustomPreview(
    Geometry=pipe_variable,
    Material={diffuse=RGB(255, 255, 255), emission=RGB(76, 76, 76), shine=0.5, specular=RGB(255, 255, 255), transparency=0.8})

rotate_3d_5 = Rotate3D(Geometry=interpolate_t_5.Curve, Angle=degrees(Slider(79, range=0..360)), Center=Point(0, 0, 0), Axis=Vector(0, 0, 1))  # -> Geometry, Transform
rotate_3d_6 = Rotate3D(Geometry=interpolate_t_5.Curve, Angle=degrees(Slider(293, range=0..360)), Center=Point(0, 0, 0), Axis=Vector(0, 0, 1))  # -> Geometry, Transform
rotate_3d_7 = Rotate3D(Geometry=interpolate_t_5.Curve, Angle=degrees(Slider(219, range=0..360)), Center=Point(0, 0, 0), Axis=Vector(0, 0, 1))  # -> Geometry, Transform
divide_curve_3 = DivideCurve(Curve=interpolate_t_4.Curve, Count=4, Kinks=False)  # -> Points, Tangents, Parameters
divide_curve_4 = DivideCurve(Curve=interpolate_t_4.Curve, Count=2, Kinks=False)  # -> Points, Tangents, Parameters
divide_curve_5 = DivideCurve(Curve=interpolate_t_4.Curve, Count=3, Kinks=False)  # -> Points, Tangents, Parameters
divide_curve_6 = DivideCurve(Curve=rotate_3d_7.Geometry, Count=3, Kinks=False)  # -> Points, Tangents, Parameters
divide_curve_7 = DivideCurve(Curve=rotate_3d_5.Geometry, Count=2, Kinks=False)  # -> Points, Tangents, Parameters
divide_curve_8 = DivideCurve(Curve=rotate_3d_6.Geometry, Count=4, Kinks=False)  # -> Points, Tangents, Parameters
interpolate_t_6 = InterpolateT(Vertices=divide_curve_3.Points, TangentStart=Vector(0, 0, 0), TangentEnd=Vector(0, 0, 0), KnotStyle=1)  # -> Curve, Length, Domain
interpolate_t_7 = InterpolateT(Vertices=divide_curve_4.Points, TangentStart=Vector(0, 0, 0), TangentEnd=Vector(0, 0, 0), KnotStyle=1)  # -> Curve, Length, Domain
interpolate_t_8 = InterpolateT(Vertices=divide_curve_8.Points, TangentStart=Vector(0, 0, 0), TangentEnd=Vector(0, 0, 0), KnotStyle=1)  # -> Curve, Length, Domain
interpolate_t_9 = InterpolateT(Vertices=divide_curve_5.Points, TangentStart=Vector(0, 0, 0), TangentEnd=Vector(0, 0, 0), KnotStyle=1)  # -> Curve, Length, Domain
multiplication_13 = Multiplication(A=number_slider_6, B=0.3)
multiplication_14 = Multiplication(A=number_slider_6, B=0.2)
interpolate_t_10 = InterpolateT(Vertices=divide_curve_7.Points, TangentStart=Vector(0, 0, 0), TangentEnd=Vector(0, 0, 0), KnotStyle=1)  # -> Curve, Length, Domain
interpolate_t_11 = InterpolateT(Vertices=divide_curve_6.Points, TangentStart=Vector(0, 0, 0), TangentEnd=Vector(0, 0, 0), KnotStyle=1)  # -> Curve, Length, Domain
plane_normal_2 = PlaneNormal(Origin=divide_curve_3.Points, ZAxis=divide_curve_3.Tangents)
plane_normal_3 = PlaneNormal(Origin=divide_curve_4.Points, ZAxis=divide_curve_4.Tangents)
plane_normal_4 = PlaneNormal(Origin=divide_curve_8.Points, ZAxis=divide_curve_8.Tangents)
plane_normal_5 = PlaneNormal(Origin=divide_curve_7.Points, ZAxis=divide_curve_7.Tangents)
multiplication_15 = Multiplication(A=multiplication_13, B=number_slider_6)
multiplication_16 = Multiplication(A=multiplication_14, B=number_slider_6)
ellipse = Ellipse(Plane=plane_normal_2, Radius1=multiplication_15, Radius2=multiplication_13)  # -> Ellipse, Focus1, Focus2
ellipse_2 = Ellipse(Plane=plane_normal_3, Radius1=multiplication_15, Radius2=multiplication_13)  # -> Ellipse, Focus1, Focus2
ellipse_3 = Ellipse(Plane=plane_normal_4, Radius1=multiplication_16, Radius2=multiplication_14)  # -> Ellipse, Focus1, Focus2
ellipse_4 = Ellipse(Plane=plane_normal_5, Radius1=multiplication_16, Radius2=multiplication_14)  # -> Ellipse, Focus1, Focus2
panel_40 = Panel(multiplication_15)
panel_41 = Panel(multiplication_16)
loft = Loft(Curves=ellipse.Ellipse, Options={Adjust=False, Closed=False, LoftEnds=0, LoftSimp=0, LoftType=0, Rebuild=10, Refit=0.01})
loft_2 = Loft(
    Curves=ellipse_2.Ellipse,
    Options={Adjust=False, Closed=False, LoftEnds=0, LoftSimp=0, LoftType=0, Rebuild=10, Refit=0.01})
loft_3 = Loft(
    Curves=ellipse_3.Ellipse,
    Options={Adjust=False, Closed=False, LoftEnds=0, LoftSimp=0, LoftType=0, Rebuild=10, Refit=0.01})
loft_4 = Loft(
    Curves=ellipse_4.Ellipse,
    Options={Adjust=False, Closed=False, LoftEnds=0, LoftSimp=0, LoftType=0, Rebuild=10, Refit=0.01})
custom_preview_4 = CustomPreview(
    Geometry=[interpolate_t_8.Curve, interpolate_t_10.Curve, interpolate_t_7.Curve, interpolate_t_6.Curve, interpolate_t_9.Curve, interpolate_t_11.Curve],
    Material={diffuse=RGB(255, 255, 255), emission=RGB(66, 48, 66), shine=0.5, specular=RGB(255, 255, 255), transparency=0})

timer_3 = Timer(TimerInterval=1000, Target=serial_read_generic_2)
timer_4 = Timer(TimerInterval=1000)
number_slider_7 = Slider(4, range=0..10)

set_wrist_rotation = Slider(91, range=0..180)  # disabled
set_elbow = Slider(97, range=0..180)  # disabled
set_base = Slider(44, range=0..180)  # disabled
set_shoulder = Slider(92, range=15..165)  # disabled
number_slider_8 = Slider(64, range=0..200)  # disabled
set_gripper = Slider(123, range=10..180)  # disabled
set_wrist = Slider(167, range=0..180)  # disabled
panel_42 = Panel("P")  # disabled
button = Button()  # disabled
button_2 = Button()  # disabled
button_3 = Button()  # disabled
button_4 = Button()  # disabled
panel_43 = Panel([panel_42, set_base, set_shoulder, set_elbow, set_wrist_rotation, set_wrist, set_gripper, number_slider_8])  # disabled
number_slider_9 = Slider(1, range=0..1)  # disabled
number_slider_10 = Slider(0, range=0..1)  # disabled
text_join = TextJoin(Text=panel_43, Join=",")  # disabled
panel_44 = Panel(text_join)  # disabled
panel_45 = Panel("P90,90,90,90,90,90,50")  # disabled
write = SerialWriteGeneric(StartWritingValues=button_3, WriteData=panel_45, PortNumber=number_slider_7)  # -> ArduinoOutput, StatusMessage; disabled
write_2 = SerialWriteGeneric(StartWritingValues=button, WriteData=panel_44, PortNumber=number_slider_7)  # -> ArduinoOutput, StatusMessage; disabled
write_3 = SerialWriteGeneric(StartWritingValues=button_4, WriteData=number_slider_9, PortNumber=number_slider_7)  # -> ArduinoOutput, StatusMessage; disabled
write_4 = SerialWriteGeneric(StartWritingValues=button_2, WriteData=number_slider_10, PortNumber=number_slider_7)  # -> ArduinoOutput, StatusMessage; disabled
data_recorder_2 = DataRecorder(
    [write_4.ArduinoOutput, write_2.ArduinoOutput, write.ArduinoOutput, write_3.ArduinoOutput],
    DataLimit=-10,
    RecordData=True)  # disabled
panel_46 = Panel(data_recorder_2)  # disabled

serial_read_generic_2 = SerialReadGeneric(StartReadingValues=Toggle(True), PortNumber=number_slider_7)  # -> SerialOutput, StatusMessage
panel_47 = Panel(serial_read_generic_2.SerialOutput)
write_5 = SerialWriteGeneric(StartWritingValues=Button(), WriteData=Slider(0, range=0..1), PortNumber=number_slider_7)  # -> ArduinoOutput, StatusMessage
write_6 = SerialWriteGeneric(StartWritingValues=Button(), WriteData=Slider(1, range=0..1), PortNumber=number_slider_7)  # -> ArduinoOutput, StatusMessage
write_7 = SerialWriteGeneric(StartWritingValues=Button(), WriteData="P90,90,90,90,140,140,50", PortNumber=number_slider_7)  # -> ArduinoOutput, StatusMessage
custom_preview_5 = CustomPreview(
    Geometry=[interpolate_t_8.Curve, interpolate_t_10.Curve, interpolate_t_7.Curve, interpolate_t_6.Curve, interpolate_t_9.Curve, interpolate_t_11.Curve],
    Material={diffuse=RGB(255, 255, 255), emission=RGB(66, 48, 66), shine=0.5, specular=RGB(255, 255, 255), transparency=0})
custom_preview_6 = CustomPreview(
    Geometry=[loft_4, loft_3, loft_2, loft],
    Material={diffuse=RGB(255, 255, 255), emission=RGB(66, 48, 66), shine=0.5, specular=RGB(255, 255, 255), transparency=0})
data_recorder_3 = DataRecorder(write_6.ArduinoOutput, DataLimit=-10, RecordData=True)
data_recorder_4 = DataRecorder(write_7.ArduinoOutput, DataLimit=-10, RecordData=True)
data_recorder_5 = DataRecorder(write_5.ArduinoOutput, DataLimit=-10, RecordData=True)
panel_48 = Panel(data_recorder_4)
panel_49 = Panel(data_recorder_5)
panel_50 = Panel(data_recorder_3)

# ----
# construct domain: take the mass addition of the rain sensor value at a moisture content i think is coorect and a light level indicator. When it reaches that limit, then it is 0.6 - put through an integer node, otherwise motion is computer drawing. no motion is sensors drawing
panel_51 = Panel(random)
list_item_9 = ListItem(List=flatten(panel_51), Index=0, Wrap=True)
list_item_10 = ListItem(List=flatten(panel_51), Index=0, Wrap=True)
mass_addition_3 = MassAddition(Input=panel_51)  # -> Result, PartialResults
multiplication_17 = Multiplication(A=list_item_9, B=Slider(0, range=0..100))
multiplication_18 = Multiplication(A=list_item_10, B=Slider(0, range=0..100))

number_slider_11 = Slider(36, range=0..36)
increse_distance_from_centre_2 = Slider(25, range=0..30)
list_length_5 = ListLength(List=construct_point_6)
multiplication_19 = Multiplication(A=mass_addition.Result, B=Slider(100, range=0..100))
addition_5 = Addition(A=random, B=increse_distance_from_centre_2)  # -> flatten(Result)
division_5 = Division(A=multiplication_19, B=list_length_5)
construct_point_9 = ConstructPoint(XCoordinate=addition_5, YCoordinate=_0_2, ZCoordinate=series_3)
unit_z_7 = UnitZ(Factor=_1_2)
multiplication_20 = Multiplication(A=division_5, B=Slider(1, range=0..1))
# pythagerous theorom to get distance
number_slider_12 = Slider(1, range=0..1)
construct_point_10 = ConstructPoint(XCoordinate=multiplication_17, YCoordinate=multiplication_18, ZCoordinate=number_slider_12)
panel_52 = Panel(unit_z_7)
panel_53 = Panel(construct_point_9)
panel_54 = Panel(multiplication_20)
list_item_11 = ListItem(List=construct_point_9, Index="0", Wrap=True)
unit_x_2 = UnitX(Factor=list_item_11)
panel_55 = Panel(unit_x_2)
list_item_12 = ListItem(List=construct_point_9, Index="1", Wrap=True)
move_5 = Move(Geometry=construct_point_7, Motion=unit_x_2)  # -> Geometry, Transform
panel_56 = Panel(list_item_12)
unit_x_3 = UnitX(Factor=expr("x/2", list_item_12))
panel_57 = Panel(move_5.Geometry)
rotate_3d_8 = Rotate3D(Geometry=move_5.Geometry, Angle=degrees(multiplication_20), Center=construct_point_10, Axis=unit_z_7)  # -> Geometry, Transform
panel_58 = Panel(unit_x_3)
list_item_13 = ListItem(List=construct_point_9, Index="2", Wrap=True)
move_6 = Move(Geometry=rotate_3d_8.Geometry, Motion=unit_x_3)  # -> Geometry, Transform
unit_x_4 = UnitX(Factor=expr("x/3", list_item_13))
line_3 = Line(StartPoint=construct_point_7, EndPoint=rotate_3d_8.Geometry)
panel_59 = Panel(move_6.Geometry)
panel_60 = Panel(unit_x_4)
list_item_14 = ListItem(List=construct_point_9, Index="3", Wrap=True)
rotate_3d_9 = Rotate3D(Geometry=move_6.Geometry, Angle=expr("x*2", degrees(multiplication_20)), Center=rotate_3d_8.Geometry, Axis=unit_z_7)  # -> Geometry, Transform
move_7 = Move(Geometry=rotate_3d_9.Geometry, Motion=unit_x_4)  # -> Geometry, Transform
unit_x_5 = UnitX(Factor=expr("x/3", list_item_14))
rotate_3d_10 = Rotate3D(Geometry=move_7.Geometry, Angle=expr("x*(3)", degrees(multiplication_20)), Center=rotate_3d_9.Geometry, Axis=unit_z_7)  # -> Geometry, Transform
line_4 = Line(StartPoint=rotate_3d_8.Geometry, EndPoint=rotate_3d_9.Geometry)
move_8 = Move(Geometry=rotate_3d_10.Geometry, Motion=unit_x_5)  # -> Geometry, Transform
panel_61 = Panel(unit_x_5)
list_item_15 = ListItem(List=construct_point_9, Index="4", Wrap=True)
line_5 = Line(StartPoint=rotate_3d_9.Geometry, EndPoint=rotate_3d_10.Geometry)
unit_x_6 = UnitX(Factor=expr("x/3", list_item_15))
rotate_3d_11 = Rotate3D(Geometry=move_8.Geometry, Angle=expr("x*(4)", degrees(multiplication_20)), Center=rotate_3d_10.Geometry, Axis=unit_z_7)  # -> Geometry, Transform
move_9 = Move(Geometry=rotate_3d_11.Geometry, Motion=unit_x_6)  # -> Geometry, Transform
list_item_16 = ListItem(List=construct_point_9, Index="5", Wrap=True)
line_6 = Line(StartPoint=rotate_3d_10.Geometry, EndPoint=rotate_3d_11.Geometry)
rotate_3d_12 = Rotate3D(Geometry=move_9.Geometry, Angle=expr("x*(5)", degrees(multiplication_20)), Center=rotate_3d_11.Geometry, Axis=unit_z_7)  # -> Geometry, Transform
unit_x_7 = UnitX(Factor=expr("x/3", list_item_16))
move_10 = Move(Geometry=rotate_3d_12.Geometry, Motion=unit_x_7)  # -> Geometry, Transform
list_item_17 = ListItem(List=construct_point_9, Index="6", Wrap=True)
line_7 = Line(StartPoint=rotate_3d_11.Geometry, EndPoint=rotate_3d_12.Geometry)
unit_x_8 = UnitX(Factor=expr("x/3", list_item_17))
rotate_3d_13 = Rotate3D(Geometry=move_10.Geometry, Angle=expr("x*(6)", degrees(multiplication_20)), Center=rotate_3d_12.Geometry, Axis=unit_z_7)  # -> Geometry, Transform
list_item_18 = ListItem(List=construct_point_9, Index="7", Wrap=True)
move_11 = Move(Geometry=rotate_3d_13.Geometry, Motion=unit_x_8)  # -> Geometry, Transform
unit_x_9 = UnitX(Factor=expr("x/3", list_item_18))
line_8 = Line(StartPoint=rotate_3d_12.Geometry, EndPoint=rotate_3d_13.Geometry)
rotate_3d_14 = Rotate3D(Geometry=move_11.Geometry, Angle=expr("x*(7)", degrees(multiplication_20)), Center=rotate_3d_13.Geometry, Axis=unit_z_7)  # -> Geometry, Transform
move_12 = Move(Geometry=rotate_3d_14.Geometry, Motion=unit_x_9)  # -> Geometry, Transform
panel_62 = Panel(unit_x_9)
rotate_3d_15 = Rotate3D(Geometry=move_12.Geometry, Angle=expr("x*(8)", degrees(multiplication_20)), Center=rotate_3d_14.Geometry, Axis=unit_z_7)  # -> Geometry, Transform
line_9 = Line(StartPoint=rotate_3d_13.Geometry, EndPoint=rotate_3d_14.Geometry)
set_union = SetUnion(
    _8=rotate_3d_15.Geometry,
    _6=rotate_3d_14.Geometry,
    _5=rotate_3d_13.Geometry,
    _4=rotate_3d_12.Geometry,
    _3=rotate_3d_11.Geometry,
    _2=rotate_3d_10.Geometry,
    _1=rotate_3d_9.Geometry,
    _0=rotate_3d_8.Geometry)
line_10 = Line(StartPoint=rotate_3d_14.Geometry, EndPoint=rotate_3d_15.Geometry)

panel_63 = Panel(construct_point_10)
panel_64 = Panel(random)
list_item_19 = ListItem(List=panel_64, Index=0, Wrap=True)
list_item_20 = ListItem(List=panel_64, Index=0, Wrap=True)

addition_6 = Addition(A=Slider(303, range=0..650), B=Slider(242, range=0..600))
smaller_than = SmallerThan(FirstNumber=addition_6, SecondNumber=400)  # -> SmallerThan, OrEqualTo
larger_than = LargerThan(FirstNumber=addition_6, SecondNumber=399)  # -> LargerThan, OrEqualTo
cull_pattern = CullPattern(List="false", CullPattern=smaller_than.SmallerThan)
cull_pattern_2 = CullPattern(List="true", CullPattern=larger_than.LargerThan)
panel_65 = Panel([cull_pattern_2, cull_pattern])

number_slider_13 = Slider(1, range=0..1)
smaller_than_2 = SmallerThan(FirstNumber=number_slider_13, SecondNumber=1)  # -> SmallerThan, OrEqualTo
larger_than_2 = LargerThan(FirstNumber=number_slider_13, SecondNumber=0)  # -> LargerThan, OrEqualTo
cull_pattern_3 = CullPattern(List="false", CullPattern=smaller_than_2.SmallerThan)
cull_pattern_4 = CullPattern(List="true", CullPattern=larger_than_2.LargerThan)
panel_66 = Panel([cull_pattern_4, cull_pattern_3])

increse_distance_from_centre_3 = Slider(25, range=0..30)  # disabled
number_slider_14 = Slider(100, range=0..100)  # disabled
multiplication_21 = Multiplication(A=mass_addition.Result, B=number_slider_14)  # disabled
number_slider_15 = Slider(1, range=0..1)  # disabled
panel_67 = Panel(multiplication_21)  # disabled
unit_z_8 = UnitZ(Factor=_1_2)  # disabled
construct_point_11 = ConstructPoint(XCoordinate=multiplication_17, YCoordinate=multiplication_18, ZCoordinate=mass_addition_3.Result)  # disabled
panel_68 = Panel("180")  # disabled
panel_69 = Panel(unit_z_8)  # disabled
boolean = Boolean(invert(panel_66))
panel_70 = Panel(boolean)
data_rec_2 = PythonScript(x=rotate_3d_15.Geometry, enable=panel_66, reset=Button(), limit=Slider(37, range=0..100))  # -> x; inputs x: tree, enable: Boolean, reset: Boolean, limit: Int32; same code as data_rec
panel_71 = Panel(data_rec_2)
interpolate_t_12 = InterpolateT(Vertices=panel_71, TangentStart=Vector(0, 0, 0), TangentEnd=Vector(0, 0, 0), KnotStyle=1)  # -> Curve, Length, Domain
panel_72 = Panel("0")  # disabled
panel_73 = Panel("1")  # disabled
panel_74 = Panel("-1")  # disabled
panel_75 = Panel("2")  # disabled
panel_76 = Panel("3")  # disabled
panel_77 = Panel("4")  # disabled
panel_78 = Panel("5")  # disabled

panel_79 = Panel(series_3)  # disabled
number_slider_16 = Slider(22, range=0..40)  # disabled
number_slider_17 = Slider(7, range=0..10)  # disabled
number_slider_18 = Slider(22, range=0..40)  # disabled
number_slider_19 = Slider(7, range=0..10)  # disabled
construct_point_12 = ConstructPoint(XCoordinate=0, YCoordinate=number_slider_18, ZCoordinate=panel_79)  # disabled
construct_point_13 = ConstructPoint(XCoordinate=0, YCoordinate=number_slider_19, ZCoordinate=panel_79)  # disabled
number_slider_20 = Slider(0.15, range=0..1)  # disabled
line_11 = Line(StartPoint=construct_point_13, EndPoint=construct_point_12)  # disabled
number_slider_21 = Slider(0.25, range=0..1)  # disabled
curve = Curve(line_11)  # disabled
divide_curve_9 = DivideCurve(Curve=curve, Count=9, Kinks=False)  # -> Points, Tangents, Parameters; disabled

data_rec_3 = PythonScript(x=rotate_3d_2.Geometry, enable=Toggle(True), reset=Button(), limit=panel_33)  # -> x; inputs x: tree, enable: Boolean, reset: Boolean, limit: Int32; same code as data_rec
panel_80 = Panel(data_rec_3)
interpolate = Interpolate(Vertices=data_rec_3, Degree=Slider(5, range=1..11), Periodic=True, KnotStyle=1)  # -> flatten(Curve), Length, Domain
panel_81 = Panel(interpolate.Curve)
_2 = Integer(2)

loft_5 = Loft(
    Curves=interpolate.Curve,
    Options={Adjust=False, Closed=False, LoftEnds=0, LoftSimp=0, LoftType=1, Rebuild=10, Refit=0.01})
custom_preview_7 = CustomPreview(
    Geometry=loft_5,
    Material={diffuse=RGB(255, 255, 255), emission=RGB(76, 76, 76), shine=0.1, specular=RGB(255, 255, 255), transparency=0})

divide_surface = DivideSurface(Surface=loft_5, UCount=Slider(7, range=0..10), VCount=_2)  # -> Points, Normals, Parameters
list_item_21 = ListItem(List=divide_surface.Points, Index=Slider(1, range=0..1), Wrap=True)
deconstruct = Deconstruct(Point=list_item_21)  # -> flatten(XComponent), YComponent, ZComponent
panel_82 = Panel(list_item_21)

construct_point_14 = ConstructPoint(XCoordinate=0, YCoordinate=number_slider_16, ZCoordinate=flatten(deconstruct.ZComponent))  # disabled
construct_point_15 = ConstructPoint(XCoordinate=0, YCoordinate=number_slider_17, ZCoordinate=flatten(deconstruct.ZComponent))  # disabled
line_12 = Line(StartPoint=construct_point_15, EndPoint=construct_point_14)  # disabled
curve_2 = Curve(line_12)  # disabled
deconstruct_2 = Deconstruct(Point=panel_80)  # -> XComponent, YComponent, ZComponent; disabled
# limitation of math to describe complexity how we learnt it. pyhtagarous, sine waves etc, understand the line. Black magic is to make that line look alive.
# 
# How to draw simplicity out of complexity?
dispatch = Dispatch(List=curve_2, DispatchPattern=[False, True, True, True, True, True, True, False])  # -> ListA, ListB; disabled
multiplication_22 = Multiplication(A=deconstruct.XComponent, B=number_slider_20)  # disabled
divide_curve_10 = DivideCurve(Curve=dispatch.ListA, Count=9, Kinks=False)  # -> Points, Tangents, Parameters; disabled
unit_z_9 = UnitZ(Factor=multiplication_22)  # disabled
multiplication_23 = Multiplication(A=deconstruct_2.XComponent, B=number_slider_21)  # disabled
move_13 = Move(Geometry=divide_curve_10.Points, Motion=unit_z_9)  # -> flatten(Geometry), Transform; disabled
unit_z_10 = UnitZ(Factor=multiplication_23)  # disabled
panel_83 = Panel(move_13.Geometry)  # disabled
move_14 = Move(Geometry=divide_curve_9.Points, Motion=unit_z_10)  # -> flatten(Geometry), Transform; disabled
panel_84 = Panel(move_14.Geometry)  # disabled

panel_85 = Panel(deconstruct.ZComponent)
multiplication_24 = Multiplication(A=flatten(deconstruct.YComponent), B=flatten(deconstruct.YComponent))
multiplication_25 = Multiplication(A=deconstruct.XComponent, B=deconstruct.XComponent)
panel_86 = Panel(multiplication_25)
panel_87 = Panel(multiplication_24)
addition_7 = Addition(A=multiplication_24, B=multiplication_25)

list_length_6 = ListLength(List=interpolate.Curve)
list_item_22 = ListItem(List=interpolate.Curve, Index=expr("x-1", list_length_6), Wrap=True)
list_item_23 = ListItem(List=move_3.Geometry, Index=0, Wrap=True)
list_item_24 = ListItem(List=interpolate.Curve, Index=0, Wrap=True)
plane_normal_6 = PlaneNormal(Origin=list_item_23, ZAxis=Vector(0, 0, 1))
circle = Circle(Plane=plane_normal_6, Radius=number_slider_6)
list_item_25 = ListItem(List=rotate_3d_4.Geometry, Index=0, Wrap=True)
plane_normal_7 = PlaneNormal(Origin=list_item_25, ZAxis=Vector(0, 0, 1))
circle_2 = Circle(Plane=plane_normal_7, Radius=number_slider_6)
curve_3 = Curve([circle, list_item_22])
curve_4 = Curve([list_item_24, circle_2])
loft_options = LoftOptions(Closed=False, Adjust=True, Rebuild=0, Refit=0, Type=5)
loft_6 = Loft(Curves=flatten(curve_3), Options=loft_options)
loft_7 = Loft(Curves=flatten(curve_4), Options=loft_options)
custom_preview_8 = CustomPreview(
    Geometry=[loft_7, loft_6],
    Material={diffuse=RGB(255, 255, 255), emission=RGB(76, 76, 76), shine=1, specular=RGB(255, 255, 255), transparency=0.8})

square_root = SquareRoot(Value=addition_7)
panel_88 = Panel(square_root)
list_item_26 = ListItem(List=square_root, Index=0, Wrap=True)
panel_89 = Panel(list_item_26)
construct_point_16 = ConstructPoint(XCoordinate=integer_2, YCoordinate=0, ZCoordinate=panel_85)
unit_x_10 = UnitX(Factor=list_item_26)
remap_numbers_2 = RemapNumbers(Value=square_root, Source=construct_domain_2, Target=construct_domain_3)  # -> flatten(Mapped), Clipped
move_15 = Move(Geometry=construct_point_16, Motion=unit_x_10)  # -> Geometry, Transform
panel_90 = Panel(remap_numbers_2.Mapped)
line_13 = Line(StartPoint=construct_point_16, EndPoint=move_15.Geometry)
list_item_27 = ListItem(List=remap_numbers_2.Mapped, Index=Slider(6, range=0..10), Wrap=True)
list_item_28 = ListItem(List=remap_numbers_2.Mapped, Index=Slider(1, range=0..10), Wrap=True)
list_item_29 = ListItem(List=remap_numbers_2.Mapped, Index=Slider(2, range=0..10), Wrap=True)
list_item_30 = ListItem(List=remap_numbers_2.Mapped, Index=Slider(3, range=0..10), Wrap=True)
list_item_31 = ListItem(List=remap_numbers_2.Mapped, Index=Slider(4, range=0..10), Wrap=True)
list_item_32 = ListItem(List=remap_numbers_2.Mapped, Index=Slider(5, range=0..10), Wrap=True)
remap_numbers_3 = RemapNumbers(Value=list_item_29, Source=construct_domain_3, Target=construct_domain_5)  # -> Mapped, Clipped
remap_numbers_4 = RemapNumbers(Value=list_item_28, Source=construct_domain_3, Target=construct_domain_5)  # -> Mapped, Clipped
remap_numbers_5 = RemapNumbers(Value=list_item_30, Source=construct_domain_3, Target=construct_domain_5)  # -> Mapped, Clipped
remap_numbers_6 = RemapNumbers(Value=list_item_31, Source=construct_domain_3, Target=construct_domain_5)  # -> Mapped, Clipped
remap_numbers_7 = RemapNumbers(Value=list_item_32, Source=construct_domain_3, Target=construct_domain_5)  # -> Mapped, Clipped
remap_numbers_8 = RemapNumbers(Value=list_item_32, Source=construct_domain_3, Target=construct_domain_5)  # -> Mapped, Clipped
integer_6 = Integer(remap_numbers_4.Mapped)
integer_7 = Integer(remap_numbers_3.Mapped)
integer_8 = Integer(remap_numbers_5.Mapped)
integer_9 = Integer(remap_numbers_8.Mapped)
integer_10 = Integer(remap_numbers_6.Mapped)
integer_11 = Integer(remap_numbers_7.Mapped)
panel_91 = Panel([integer_6, integer_7, integer_8, integer_10, integer_11, integer_9])
list_item_33 = ListItem(List=panel_91, Index=0, Wrap=True)
panel_92 = Panel(["P", list_item_33])
text_join_2 = TextJoin(Text=panel_92)
panel_93 = Panel([text_join_2, panel_91, "50"])
text_join_3 = TextJoin(Text=panel_93, Join=",")
write_8 = SerialWriteGeneric(StartWritingValues=Toggle(False), WriteData=text_join_3, PortNumber=number_slider_7)  # -> ArduinoOutput, StatusMessage
data_recorder_6 = DataRecorder(write_8.ArduinoOutput, DataLimit=-10, RecordData=True)
square = Square(Value=deconstruct.XComponent)  # disabled
square_2 = Square(Value=deconstruct.YComponent)  # disabled
addition_8 = Addition(A=square, B=square_2)  # disabled
panel_94 = Panel(deconstruct.XComponent)  # disabled
square_root_2 = SquareRoot(Value=addition_8)  # disabled
list_item_34 = ListItem(List=square_root_2, Index=0, Wrap=True)  # -> flatten(Item); disabled
list_length_7 = ListLength(List=deconstruct.XComponent)  # disabled
panel_95 = Panel(deconstruct.ZComponent)  # disabled
panel_96 = Panel(list_length_7)  # disabled
addition_9 = Addition(A=increse_distance_from_centre_3, B=list_item_34)  # disabled
division_6 = Division(A=multiplication_21, B=list_length_7)  # disabled
flatten_tree = FlattenTree(Tree=panel_95, Path="{0}")  # disabled
construct_point_17 = ConstructPoint(XCoordinate=addition_9, YCoordinate=_0_2, ZCoordinate=flatten_tree)  # disabled
panel_97 = Panel(flatten_tree)  # disabled
multiplication_26 = Multiplication(A=division_6, B=number_slider_15)  # disabled
panel_98 = Panel(construct_point_17)  # disabled
addition_10 = Addition(A=multiplication_26, B=panel_68)  # disabled
panel_99 = Panel(addition_10)  # disabled
list_item_35 = ListItem(List=construct_point_17, Index=panel_72, Wrap=True)  # disabled
unit_x_11 = UnitX(Factor=list_item_35)  # disabled
panel_100 = Panel(unit_x_11)  # disabled
list_item_36 = ListItem(List=construct_point_17, Index=panel_73, Wrap=True)  # disabled
multiplication_27 = Multiplication(A=addition_10, B=panel_74)  # disabled
move_16 = Move(Geometry=construct_point_7, Motion=unit_x_11)  # -> Geometry, Transform; disabled
panel_101 = Panel(list_item_36)  # disabled
unit_x_12 = UnitX(Factor=expr("x/2", list_item_36))  # disabled
panel_102 = Panel(move_16.Geometry)  # disabled
rotate_3d_16 = Rotate3D(Geometry=move_16.Geometry, Angle=degrees(multiplication_27), Center=construct_point_11, Axis=unit_z_8)  # -> Geometry, Transform; disabled
panel_103 = Panel(unit_x_12)  # disabled
move_17 = Move(Geometry=rotate_3d_16.Geometry, Motion=unit_x_12)  # -> Geometry, Transform; disabled
list_item_37 = ListItem(List=construct_point_17, Index=panel_75, Wrap=True)  # disabled
unit_x_13 = UnitX(Factor=expr("x/3", list_item_37))  # disabled
line_14 = Line(StartPoint=construct_point_7, EndPoint=rotate_3d_16.Geometry)  # disabled
panel_104 = Panel(unit_x_13)  # disabled
list_item_38 = ListItem(List=construct_point_17, Index=panel_76, Wrap=True)  # disabled
rotate_3d_17 = Rotate3D(Geometry=move_17.Geometry, Angle=expr("x*-2", degrees(addition_10)), Center=rotate_3d_16.Geometry, Axis=unit_z_8)  # -> Geometry, Transform; disabled
move_18 = Move(Geometry=rotate_3d_17.Geometry, Motion=unit_x_13)  # -> Geometry, Transform; disabled
unit_x_14 = UnitX(Factor=expr("x/3", list_item_38))  # disabled
rotate_3d_18 = Rotate3D(Geometry=move_18.Geometry, Angle=expr("x*(-3)", degrees(addition_10)), Center=rotate_3d_17.Geometry, Axis=unit_z_8)  # -> Geometry, Transform; disabled
line_15 = Line(StartPoint=rotate_3d_16.Geometry, EndPoint=rotate_3d_17.Geometry)  # disabled
move_19 = Move(Geometry=rotate_3d_18.Geometry, Motion=unit_x_14)  # -> Geometry, Transform; disabled
panel_105 = Panel(unit_x_14)  # disabled
list_item_39 = ListItem(List=construct_point_17, Index=panel_77, Wrap=True)  # disabled
line_16 = Line(StartPoint=rotate_3d_17.Geometry, EndPoint=rotate_3d_18.Geometry)  # disabled
unit_x_15 = UnitX(Factor=expr("x/3", list_item_39))  # disabled
rotate_3d_19 = Rotate3D(Geometry=move_19.Geometry, Angle=expr("x*(-4)", degrees(addition_10)), Center=rotate_3d_18.Geometry, Axis=unit_z_8)  # -> Geometry, Transform; disabled
move_20 = Move(Geometry=rotate_3d_19.Geometry, Motion=unit_x_15)  # -> Geometry, Transform; disabled
list_item_40 = ListItem(List=construct_point_17, Index=panel_78, Wrap=True)  # disabled
line_17 = Line(StartPoint=rotate_3d_18.Geometry, EndPoint=rotate_3d_19.Geometry)  # disabled
rotate_3d_20 = Rotate3D(Geometry=move_20.Geometry, Angle=expr("x*(-5)", degrees(addition_10)), Center=rotate_3d_19.Geometry, Axis=unit_z_8)  # -> Geometry, Transform; disabled
unit_x_16 = UnitX(Factor=expr("x/3", list_item_40))  # disabled
move_21 = Move(Geometry=rotate_3d_20.Geometry, Motion=unit_x_16)  # -> Geometry, Transform; disabled
line_18 = Line(StartPoint=rotate_3d_19.Geometry, EndPoint=rotate_3d_20.Geometry)  # disabled
rotate_3d_21 = Rotate3D(Geometry=move_21.Geometry, Angle=expr("x*(-6)", degrees(addition_10)), Center=rotate_3d_20.Geometry, Axis=unit_z_8)  # -> Geometry, Transform; disabled
data_rec_4 = PythonScript(x=rotate_3d_21.Geometry, enable=panel_65, reset=Button(), limit=Slider(100, range=0..100))  # -> x; inputs x: tree, enable: Boolean, reset: Boolean, limit: Int32; same code as data_rec
data_rec_5 = PythonScript(x=rotate_3d_21.Geometry, enable=boolean, reset=Button(), limit=Slider(100, range=0..100))  # -> x; inputs x: tree, enable: Boolean, reset: Boolean, limit: Int32; same code as data_rec
panel_106 = Panel(data_rec_4)
panel_107 = Panel(data_rec_5)
line_19 = Line(StartPoint=rotate_3d_20.Geometry, EndPoint=rotate_3d_21.Geometry)  # disabled
