# Grasshopper definition vectorgraphics_LOFT_19(moving drawing machine).gh (Grasshopper 1.0.7)
# plug-ins: Firefly.X, Firefly.Core

toggle = BooleanToggle(True)
ports_available = COMPortsAvailable()
panel = Panel(ports_available)
timer = Timer(TimerInterval=20, Target=serial_read_generic)
panel_2 = Panel("9600")
serial_read_generic = SerialReadGeneric(StartReadingValues=toggle, PortNumber="3")  # -> SerialOutput, StatusMessage
open_port = OpenClosePort(OpenClosePort=toggle, PortNumber="3", BaudRate="115200")
panel_3 = Panel(serial_read_generic.StatusMessage)
panel_4 = Panel(open_port)
panel_5 = Panel(serial_read_generic.SerialOutput)
text_split = TextSplit(Text=serial_read_generic.SerialOutput, Separators=", ")
panel_6 = Panel(text_split)
list_length = ListLength(List=text_split)
series = Series(Start=Slider(0, range=0..100), Step=Slider(2, range=0..10), Count=expr("x/2", list_length))
list_item = ListItem(List=text_split, Index=series, Wrap=True)  # -> graft(Item)
data_rec = PythonScript(x=list_item, enable=Toggle(True), reset=Button(), limit=Slider(285, range=0..1500))  # -> x; inputs x: tree, enable: Boolean, reset: Boolean, limit: Int32
# ---------- data_rec: Python ----------
from Grasshopper import DataTree
if reset or 'rec' not in globals(): rec = DataTree[object]()
if enable and not reset: rec.MergeTree(x)
if limit > 0:
  for branch in rec.Branches:
    if branch.Count > limit:
      branch.RemoveRange(0, branch.Count - limit)
x = rec
# ---------- end data_rec ----------
sort_list = SortList(Keys=data_rec)  # -> Keys, ValuesValuesA
panel_7 = Panel(data_rec)
list_length_2 = ListLength(List=sort_list.Keys)
list_item_2 = ListItem(List=sort_list.Keys, Index=expr("x-1", list_length_2), Wrap=True)
panel_8 = Panel(list_item_2)
construct_domain = ConstructDomain(DomainStart=list_item, DomainEnd=panel_8)
panel_9 = Panel(construct_domain)

open_close_port = OpenClosePort(OpenClosePort=toggle, PortNumber=Slider(4, range=0..10), BaudRate=115200)
panel_10 = Panel(open_close_port)

panel_11 = Panel(list_item)

directions = Slider(60, range=3..60)
explode_tree = ExplodeTree(Data=panel_7)  # -> _0000, _0001, _0002, _0003, _0004, _0005, _0006, _0007, _0008, _0009
list_length_3 = ListLength(List=explode_tree._0009)
series_2 = Series(Start=expr("x-1", list_length_3), Step=-1, Count=Slider(10, range=0..100))
construct_domain_2 = ConstructDomain(DomainStart=Slider(590, range=0..600), DomainEnd=Slider(1000, range=0..1000))
construct_domain_3 = ConstructDomain(DomainStart=Slider(0, range=0..100), DomainEnd=directions)
list_item_3 = ListItem(List=explode_tree._0009, Index=series_2, Wrap=True)
remap_numbers = RemapNumbers(Value=list_item_3, Source=construct_domain_2, Target=construct_domain_3)  # -> Mapped, Clipped
stepsize = Slider(6, range=0.1..10)
integer = Integer(remap_numbers.Mapped)
cir = Circle(Plane=PlaneXY(0, 0, 0), Radius=stepsize)
divide = DivideCurve(Curve=cir, Count=directions, Kinks=False)  # -> Points, Tangents, Parameters
vec = Vector(divide.Points)
list_item_4 = ListItem(List=vec, Index=integer, Wrap=True)
custom_preview = CustomPreview(
    Geometry=list_item_4,
    Material={diffuse=RGB(221, 160, 221), emission=RGB(66, 48, 66), shine=0.5, specular=RGB(255, 255, 255), transparency=0})
ma = MassAddition(Input=list_item_4)  # -> Result, PartialResults
start = Point(Point(0, 0, 0))
move = Move(Geometry=start, Motion=ma.PartialResults)  # -> Geometry, Transform
panel_13 = Panel(move.Geometry)
merge = Merge(Data1=flatten(start), Data2=flatten(move.Geometry))
list_length_4 = ListLength(List=merge)
list_item_5 = ListItem(List=merge, Index=expr("x-1", list_length_4), Wrap=True)
interpolate_t = InterpolateT(Vertices=merge, TangentStart=Vector(0, 0, 0), TangentEnd=Vector(0, 0, 0), KnotStyle=1)  # -> Curve, Length, Domain
custom_preview_2 = CustomPreview(
    Geometry=interpolate_t.Curve,
    Material={diffuse=RGB(221, 160, 221), emission=RGB(66, 48, 66), shine=0.5, specular=RGB(255, 255, 255), transparency=0})

frame_rate = FrameRate()  # -> simplify(flatten(RefreshRate)), Frequency
panel_14 = Panel(frame_rate.RefreshRate)
panel_15 = Panel(frame_rate.Frequency)

integer_2 = Integer(1)
timer_2 = Timer(TimerInterval=20, Target=data_recorder)
data_recorder = DataRecorder(integer_2, DataLimit=-360, RecordData=True)
mass_addition = MassAddition(Input=data_recorder)  # -> Result, PartialResults
panel_16 = Panel(mass_addition.Result)
number_of_lists = Slider(10, range=0..10)
_1 = Integer(1)
increse_distance_from_centre = Slider(2, range=0..5)
mass_addition_2 = MassAddition(Input=data_recorder)  # -> Result, PartialResults; disabled

number_slider = Slider(36, range=0..100)
multiplication = Multiplication(A=mass_addition.Result, B=number_slider)
series_3 = Series(Start=multiplication, Step=26, Count=number_of_lists)
division = Division(A=Slider(360, range=0..1000), B=number_slider)
panel_17 = Panel(series_3)
panel_18 = Panel(division)

deconstruct = Deconstruct(Point=list_item_5)  # -> XComponent, YComponent, ZComponent
point = Point(list_item_5)
number_slider_2 = Slider(42, range=0..100)
number_slider_3 = Slider(32, range=0..100)
_0 = Integer(0)
number_slider_4 = Slider(0, range=0..100)  # disabled
construct_point = ConstructPoint(XCoordinate=deconstruct.XComponent, YCoordinate=deconstruct.YComponent, ZCoordinate=_0)
number_slider_5 = Slider(2.3, range=0..5)  # disabled
unit_z = UnitZ(Factor=1)  # disabled
multiplication_2 = Multiplication(A=unit_z, B=-1)  # disabled
construct_domain_4 = ConstructDomain(DomainStart=Slider(1.9, range=0..10), DomainEnd=Slider(3, range=0..10))
construct_domain_5 = ConstructDomain(DomainStart=Slider(0, range=0..100), DomainEnd=Slider(1, range=0..1))
remap_numbers_2 = RemapNumbers(Value=list_item, Source=construct_domain, Target=construct_domain_5)  # -> Mapped, Clipped
panel_19 = Panel(remap_numbers_2.Mapped)
list_length_5 = ListLength(List=flatten(remap_numbers_2.Mapped))

multiplication_3 = Multiplication(A=panel_16, B=Slider(2, range=0..10))
series_4 = Series(Start=panel_16, Step=multiplication_3, Count=list_length_5)
panel_20 = Panel(series_4)
_1_2 = Integer(1)
random = Random(Range=Domain(0, 1), Number=_1_2, Seed=series_4)

list_item_6 = ListItem(List=flatten(remap_numbers_2.Mapped), Index=8, Wrap=True)
multiplication_4 = Multiplication(A=list_item_6, B=-1)
number_slider_6 = Slider(0.1, range=0..1)
addition = Addition(A=number_slider_6, B=list_item_6)
subtraction = Subtraction(A=multiplication_4, B=number_slider_6)
panel_21 = Panel(subtraction)
panel_22 = Panel(addition)
multiplication_5 = Multiplication(A=addition, B=2)

panel_23 = Panel(list_length_5)
unit_z_2 = UnitZ(Factor=subtraction)
series_5 = Series(Start=unit_z_2, Step=Slider(2, range=0..10), Count=number_of_lists)
list_length_6 = ListLength(List=series_5)
list_item_7 = ListItem(List=series_5, Index=expr("x-1", list_length_6), Wrap=True)
panel_24 = Panel(list_item_7)
panel_25 = Panel(unit_z_2)
addition_2 = Addition(A=remap_numbers_2.Mapped, B=increse_distance_from_centre)  # -> flatten(Result)

list_length_7 = ListLength(List=series_5)  # disabled
list_item_8 = ListItem(List=series_5, Index=expr("x-1", list_length_7), Wrap=True)  # disabled
list_item_9 = ListItem(List=series_5, Index=0, Wrap=True)  # disabled
integer_3 = Integer(-10)  # disabled
construct_point_2 = ConstructPoint(XCoordinate=integer_3, YCoordinate=0, ZCoordinate=list_item_9)  # disabled
construct_point_3 = ConstructPoint(XCoordinate=integer_3, YCoordinate=0, ZCoordinate=list_item_8)  # disabled
line = Line(StartPoint=construct_point_2, EndPoint=construct_point_3)  # disabled
divide_curve = DivideCurve(Curve=line, Count=number_of_lists, Kinks=False)  # -> Points, Tangents, Parameters; disabled
unit_x = UnitX(Factor=addition_2)  # disabled
move_2 = Move(Geometry=divide_curve.Points, Motion=unit_x)  # -> Geometry, Transform; disabled
line_2 = Line(StartPoint=divide_curve.Points, EndPoint=move_2.Geometry)  # disabled

height_between_loft_segments = Slider(10, range=0..10)  # disabled
_1_3 = Integer(1)  # disabled
number_of_lists_2 = Slider(14, range=0..30)  # disabled
number_slider_7 = Slider(1, range=0..10)  # disabled
addition_3 = Addition(A=_1_3, B=height_between_loft_segments)  # disabled
addition_4 = Addition(A=list_item_7, B=7)  # disabled
unit_z_3 = UnitZ(Factor=_1_3)  # disabled
series_6 = Series(Start=number_slider_7, Step=1, Count=number_of_lists_2)  # disabled
series_7 = Series(Start=addition_4, Step=addition_3, Count=number_of_lists_2)  # disabled
multiplication_6 = Multiplication(A=series_6, B=series_6)  # disabled
_0_2 = Integer(0)  # disabled
_1_4 = Integer(1)  # disabled
panel_26 = Panel(multiplication_6)  # disabled
construct_point_4 = ConstructPoint(XCoordinate=multiplication_6, YCoordinate=_0_2, ZCoordinate=series_7)  # disabled
construct_point_5 = ConstructPoint(XCoordinate=_0_2, YCoordinate=_0_2, ZCoordinate=number_slider_4)  # disabled
panel_27 = Panel(construct_point_4)  # disabled
number_slider_8 = Slider(35, range=0..100)  # disabled
number_slider_9 = Slider(9, range=0..10)  # disabled
integer_4 = Integer(1)  # disabled
series_8 = Series(Start=mass_addition_2.Result, Step=number_slider_8, Count=number_of_lists_2)  # disabled
multiplication_7 = Multiplication(A=series_8, B=number_slider_9)  # disabled
rotate_3d = Rotate3D(Geometry=construct_point_4, Angle=degrees(multiplication_7), Center=construct_point_5, Axis=unit_z_3)  # -> flatten(Geometry), Transform; disabled
panel_28 = Panel(series_8)  # disabled
number_slider_10 = Slider(0.3, range=0..1)  # disabled
panel_29 = Panel(rotate_3d.Geometry)  # disabled
interpolate_t_2 = InterpolateT(Vertices=rotate_3d.Geometry, TangentStart=Vector(0, 0, 0), TangentEnd=Vector(0, 0, 0), KnotStyle=1)  # -> Curve, Length, Domain; disabled
number_slider_11 = Slider(60, range=0..100)  # disabled
multiplication_8 = Multiplication(A=mass_addition_2.Result, B=number_slider_10)  # disabled
divide_curve_2 = DivideCurve(Curve=interpolate_t_2.Curve, Count=number_slider_11, Kinks=False)  # -> Points, Tangents, Parameters; disabled
panel_30 = Panel(divide_curve_2.Points)  # disabled
number_slider_12 = Slider(4, range=0..10)  # disabled
number_slider_13 = Slider(10, range=0..10)  # disabled
series_9 = Series(Start=multiplication_8, Step=1, Count=number_slider_13)  # disabled
panel_31 = Panel(series_9)  # disabled
sine = Sine(Value=series_9)  # disabled
unit_z_4 = UnitZ(Factor=sine)  # disabled
multiplication_9 = Multiplication(A=unit_z_4, B=number_slider_12)  # disabled
number_slider_14 = Slider(2, range=0..10)  # disabled
number_slider_15 = Slider(0, range=0..10)  # disabled
multiplication_10 = Multiplication(A=multiplication_9, B=-1)  # disabled
series_10 = Series(Start=number_slider_15, Step=number_slider_14, Count=number_slider_13)  # disabled
panel_32 = Panel(multiplication_9)  # disabled
panel_33 = Panel(multiplication_10)  # disabled
panel_34 = Panel(series_10)  # disabled
number_slider_16 = Slider(6, range=0..10)  # disabled
division_2 = Division(A=panel_34, B=number_slider_16)  # disabled
panel_35 = Panel(division_2)  # disabled
multiplication_11 = Multiplication(A=series_10, B=panel_35)  # disabled
integer_5 = Integer(multiplication_11)  # disabled
list_item_10 = ListItem(List=divide_curve_2.Points, Index=integer_5, Wrap=True)  # disabled
move_3 = Move(Geometry=list_item_10, Motion=multiplication_9)  # -> Geometry, Transform; disabled
move_4 = Move(Geometry=list_item_10, Motion=multiplication_10)  # -> Geometry, Transform; disabled

panel_36 = Panel(series_5)
construct_point_6 = ConstructPoint(XCoordinate=addition_2, YCoordinate=_0, ZCoordinate=series_5)
panel_38 = Panel(construct_point_6)
rotate_3d_2 = Rotate3D(Geometry=point, Angle=degrees(series_3), Center=Point(0, 0, 0), Axis=unit_z_2)  # -> Geometry, Transform
list_item_11 = ListItem(List=rotate_3d_2.Geometry, Index=0, Wrap=True)
sort_points = SortPoints(Points=list_item_11)  # -> Points, Indices
move_5 = Move(Geometry=construct_point_6, Motion=construct_point)  # -> Geometry, Transform
list_length_8 = ListLength(List=sort_points.Points)
panel_39 = Panel(move_5.Geometry)
list_item_12 = ListItem(List=sort_points.Points, Index=expr("x-1", list_length_8), Wrap=True)
rotate_3d_3 = Rotate3D(Geometry=move_5.Geometry, Angle=degrees(series_3), Center=construct_point, Axis=unit_z_2)  # -> graft(Geometry), Transform
panel_40 = Panel(rotate_3d_3.Geometry)

number_slider_17 = Slider(2, range=0..10)  # disabled
division_3 = Division(A=list_item_7, B=number_slider_17)  # disabled
construct_point_7 = ConstructPoint(XCoordinate=0, YCoordinate=0, ZCoordinate=division_3)  # disabled
plane_normal = PlaneNormal(Origin=construct_point_7, ZAxis=Vector(0, 0, 1))  # disabled
number_slider_18 = Slider(1, range=0..5)  # disabled
mirror = Mirror(Geometry=move_3.Geometry, Plane=plane_normal)  # -> Geometry, Transform; disabled
mirror_2 = Mirror(Geometry=move_4.Geometry, Plane=plane_normal)  # -> Geometry, Transform; disabled
number_slider_19 = Slider(108, range=0..360)  # disabled
multiplication_12 = Multiplication(A=number_slider_18, B=-1)  # disabled
unit_z_5 = UnitZ(Factor=multiplication_12)  # disabled
unit_z_6 = UnitZ(Factor=number_slider_18)  # disabled
rotate_3d_4 = Rotate3D(Geometry=mirror.Geometry, Angle=degrees(number_slider_19), Center=Point(0, 0, 0), Axis=Vector(0, 0, 1))  # -> Geometry, Transform; disabled
rotate_3d_5 = Rotate3D(Geometry=mirror_2.Geometry, Angle=degrees(number_slider_19), Center=Point(0, 0, 0), Axis=Vector(0, 0, 1))  # -> Geometry, Transform; disabled
interpolate_t_3 = InterpolateT(Vertices=rotate_3d_4.Geometry, TangentStart=unit_z_5, TangentEnd=Vector(0, 0, 0), KnotStyle=1)  # -> Curve, Length, Domain; disabled
interpolate_t_4 = InterpolateT(Vertices=move_4.Geometry, TangentStart=unit_z_6, TangentEnd=Vector(0, 0, 0), KnotStyle=1)  # -> Curve, Length, Domain; disabled
panel_41 = Panel(rotate_3d_5.Geometry)  # disabled
custom_preview_3 = CustomPreview(
    Geometry=[interpolate_t_3.Curve, interpolate_t_4.Curve],
    Material={diffuse=RGB(105, 105, 105), emission=RGB(66, 48, 66), shine=0.5, specular=RGB(255, 255, 255), transparency=0})  # disabled

interpolate_t_5 = InterpolateT(Vertices=rotate_3d_5.Geometry, TangentStart=multiplication_2, TangentEnd=Vector(0, 0, 0), KnotStyle=1)  # -> reparameterize(Curve), Length, Domain; disabled
interpolate_t_6 = InterpolateT(Vertices=move_3.Geometry, TangentStart=unit_z, TangentEnd=Vector(0, 0, 0), KnotStyle=1)  # -> reparameterize(Curve), Length, Domain; disabled
domain = Domain(interpolate_t_6.Curve)  # disabled
panel_42 = Panel(domain)  # disabled
custom_preview_4 = CustomPreview(
    Geometry=[interpolate_t_5.Curve, interpolate_t_6.Curve],
    Material={diffuse=RGB(0, 0, 0), emission=RGB(76, 76, 76), shine=1, specular=RGB(255, 255, 255), transparency=0.8})  # disabled
construct_domain_6 = ConstructDomain(DomainStart=Slider(10, range=10..72), DomainEnd=Slider(72, range=10..72))
construct_domain_7 = ConstructDomain(DomainStart=Slider(19, range=15..100), DomainEnd=Slider(146, range=0..165))
construct_domain_8 = ConstructDomain(DomainStart=Slider(0, range=0..100), DomainEnd=Slider(180, range=0..180))

gene_pool = GenePool(Decimals=2, Maximum=1, Minimum=0, Value=[0, 0.23, 0.5246, 0.76, 1])  # disabled
gene_pool_2 = GenePool(Decimals=2, Maximum=10, Minimum=0, Value=[2.32, 0.3, 2.46, 4.43, 0])  # disabled
pipe = Pipe(Curve=[interpolate_t_6.Curve, interpolate_t_5.Curve], Radius=number_slider_5, Caps=0)  # disabled
pipe_variable = PipeVariable(Curve=[interpolate_t_6.Curve, interpolate_t_5.Curve], Parameters=gene_pool, Radii=gene_pool_2, Caps=0)  # disabled
panel_43 = Panel(pipe)  # disabled
panel_44 = Panel(pipe_variable)  # disabled
custom_preview_5 = CustomPreview(
    Geometry=pipe_variable,
    Material={diffuse=RGB(255, 255, 255), emission=RGB(76, 76, 76), shine=0.5, specular=RGB(255, 255, 255), transparency=0.8})  # disabled

number_slider_20 = Slider(293, range=0..360)  # disabled
number_slider_21 = Slider(79, range=0..360)  # disabled
number_slider_22 = Slider(219, range=0..360)  # disabled
rotate_3d_6 = Rotate3D(Geometry=interpolate_t_6.Curve, Angle=degrees(number_slider_21), Center=Point(0, 0, 0), Axis=Vector(0, 0, 1))  # -> Geometry, Transform; disabled
rotate_3d_7 = Rotate3D(Geometry=interpolate_t_6.Curve, Angle=degrees(number_slider_20), Center=Point(0, 0, 0), Axis=Vector(0, 0, 1))  # -> Geometry, Transform; disabled
rotate_3d_8 = Rotate3D(Geometry=interpolate_t_6.Curve, Angle=degrees(number_slider_22), Center=Point(0, 0, 0), Axis=Vector(0, 0, 1))  # -> Geometry, Transform; disabled
divide_curve_3 = DivideCurve(Curve=interpolate_t_5.Curve, Count=4, Kinks=False)  # -> Points, Tangents, Parameters; disabled
divide_curve_4 = DivideCurve(Curve=interpolate_t_5.Curve, Count=2, Kinks=False)  # -> Points, Tangents, Parameters; disabled
divide_curve_5 = DivideCurve(Curve=interpolate_t_5.Curve, Count=3, Kinks=False)  # -> Points, Tangents, Parameters; disabled
divide_curve_6 = DivideCurve(Curve=rotate_3d_8.Geometry, Count=3, Kinks=False)  # -> Points, Tangents, Parameters; disabled
divide_curve_7 = DivideCurve(Curve=rotate_3d_6.Geometry, Count=2, Kinks=False)  # -> Points, Tangents, Parameters; disabled
divide_curve_8 = DivideCurve(Curve=rotate_3d_7.Geometry, Count=4, Kinks=False)  # -> Points, Tangents, Parameters; disabled
interpolate_t_7 = InterpolateT(Vertices=divide_curve_3.Points, TangentStart=Vector(0, 0, 0), TangentEnd=Vector(0, 0, 0), KnotStyle=1)  # -> Curve, Length, Domain; disabled
interpolate_t_8 = InterpolateT(Vertices=divide_curve_4.Points, TangentStart=Vector(0, 0, 0), TangentEnd=Vector(0, 0, 0), KnotStyle=1)  # -> Curve, Length, Domain; disabled
interpolate_t_9 = InterpolateT(Vertices=divide_curve_8.Points, TangentStart=Vector(0, 0, 0), TangentEnd=Vector(0, 0, 0), KnotStyle=1)  # -> Curve, Length, Domain; disabled
interpolate_t_10 = InterpolateT(Vertices=divide_curve_5.Points, TangentStart=Vector(0, 0, 0), TangentEnd=Vector(0, 0, 0), KnotStyle=1)  # -> Curve, Length, Domain; disabled
multiplication_13 = Multiplication(A=number_slider_5, B=0.3)  # disabled
multiplication_14 = Multiplication(A=number_slider_5, B=0.2)  # disabled
interpolate_t_11 = InterpolateT(Vertices=divide_curve_7.Points, TangentStart=Vector(0, 0, 0), TangentEnd=Vector(0, 0, 0), KnotStyle=1)  # -> Curve, Length, Domain; disabled
interpolate_t_12 = InterpolateT(Vertices=divide_curve_6.Points, TangentStart=Vector(0, 0, 0), TangentEnd=Vector(0, 0, 0), KnotStyle=1)  # -> Curve, Length, Domain; disabled
plane_normal_2 = PlaneNormal(Origin=divide_curve_3.Points, ZAxis=divide_curve_3.Tangents)  # disabled
plane_normal_3 = PlaneNormal(Origin=divide_curve_4.Points, ZAxis=divide_curve_4.Tangents)  # disabled
plane_normal_4 = PlaneNormal(Origin=divide_curve_8.Points, ZAxis=divide_curve_8.Tangents)  # disabled
plane_normal_5 = PlaneNormal(Origin=divide_curve_7.Points, ZAxis=divide_curve_7.Tangents)  # disabled
multiplication_15 = Multiplication(A=multiplication_13, B=number_slider_5)  # disabled
multiplication_16 = Multiplication(A=multiplication_14, B=number_slider_5)  # disabled
ellipse = Ellipse(Plane=plane_normal_2, Radius1=multiplication_15, Radius2=multiplication_13)  # -> Ellipse, Focus1, Focus2; disabled
ellipse_2 = Ellipse(Plane=plane_normal_3, Radius1=multiplication_15, Radius2=multiplication_13)  # -> Ellipse, Focus1, Focus2; disabled
ellipse_3 = Ellipse(Plane=plane_normal_4, Radius1=multiplication_16, Radius2=multiplication_14)  # -> Ellipse, Focus1, Focus2; disabled
ellipse_4 = Ellipse(Plane=plane_normal_5, Radius1=multiplication_16, Radius2=multiplication_14)  # -> Ellipse, Focus1, Focus2; disabled
panel_45 = Panel(multiplication_15)  # disabled
panel_46 = Panel(multiplication_16)  # disabled
loft = Loft(Curves=ellipse.Ellipse, Options={Adjust=False, Closed=False, LoftEnds=0, LoftSimp=0, LoftType=0, Rebuild=10, Refit=0.01})  # disabled
loft_2 = Loft(
    Curves=ellipse_2.Ellipse,
    Options={Adjust=False, Closed=False, LoftEnds=0, LoftSimp=0, LoftType=0, Rebuild=10, Refit=0.01})  # disabled
loft_3 = Loft(
    Curves=ellipse_3.Ellipse,
    Options={Adjust=False, Closed=False, LoftEnds=0, LoftSimp=0, LoftType=0, Rebuild=10, Refit=0.01})  # disabled
loft_4 = Loft(
    Curves=ellipse_4.Ellipse,
    Options={Adjust=False, Closed=False, LoftEnds=0, LoftSimp=0, LoftType=0, Rebuild=10, Refit=0.01})  # disabled
custom_preview_6 = CustomPreview(
    Geometry=[interpolate_t_9.Curve, interpolate_t_11.Curve, interpolate_t_8.Curve, interpolate_t_7.Curve, interpolate_t_10.Curve, interpolate_t_12.Curve],
    Material={diffuse=RGB(255, 255, 255), emission=RGB(66, 48, 66), shine=0.5, specular=RGB(255, 255, 255), transparency=0})  # disabled

timer_3 = Timer(TimerInterval=1000, Target=serial_read_generic_2)
timer_4 = Timer(TimerInterval=1000)
number_slider_23 = Slider(4, range=0..10)

set_wrist_rotation = Slider(91, range=0..180)  # disabled
set_elbow = Slider(97, range=0..180)  # disabled
set_base = Slider(44, range=0..180)  # disabled
set_shoulder = Slider(92, range=15..165)  # disabled
number_slider_24 = Slider(64, range=0..200)  # disabled
set_gripper = Slider(123, range=10..180)  # disabled
set_wrist = Slider(167, range=0..180)  # disabled
panel_47 = Panel("P")  # disabled
button = Button()  # disabled
button_2 = Button()  # disabled
button_3 = Button()  # disabled
button_4 = Button()  # disabled
panel_48 = Panel([panel_47, set_base, set_shoulder, set_elbow, set_wrist_rotation, set_wrist, set_gripper, number_slider_24])  # disabled
number_slider_25 = Slider(1, range=0..1)  # disabled
number_slider_26 = Slider(0, range=0..1)  # disabled
text_join = TextJoin(Text=panel_48, Join=",")  # disabled
panel_49 = Panel(text_join)  # disabled
panel_50 = Panel("P90,90,90,90,90,90,50")  # disabled
write = SerialWriteGeneric(StartWritingValues=button_3, WriteData=panel_50, PortNumber=number_slider_23)  # -> ArduinoOutput, StatusMessage; disabled
write_2 = SerialWriteGeneric(StartWritingValues=button, WriteData=panel_49, PortNumber=number_slider_23)  # -> ArduinoOutput, StatusMessage; disabled
write_3 = SerialWriteGeneric(StartWritingValues=button_4, WriteData=number_slider_25, PortNumber=number_slider_23)  # -> ArduinoOutput, StatusMessage; disabled
write_4 = SerialWriteGeneric(StartWritingValues=button_2, WriteData=number_slider_26, PortNumber=number_slider_23)  # -> ArduinoOutput, StatusMessage; disabled
data_recorder_2 = DataRecorder(
    [write_4.ArduinoOutput, write_2.ArduinoOutput, write.ArduinoOutput, write_3.ArduinoOutput],
    DataLimit=-10,
    RecordData=True)  # disabled
panel_51 = Panel(data_recorder_2)  # disabled

serial_read_generic_2 = SerialReadGeneric(StartReadingValues=Toggle(True), PortNumber=number_slider_23)  # -> SerialOutput, StatusMessage
panel_52 = Panel(serial_read_generic_2.SerialOutput)
write_5 = SerialWriteGeneric(StartWritingValues=Button(), WriteData=Slider(0, range=0..1), PortNumber=number_slider_23)  # -> ArduinoOutput, StatusMessage
write_6 = SerialWriteGeneric(StartWritingValues=Button(), WriteData=Slider(1, range=0..1), PortNumber=number_slider_23)  # -> ArduinoOutput, StatusMessage
write_7 = SerialWriteGeneric(StartWritingValues=Button(), WriteData="P90,90,90,90,140,140,50", PortNumber=number_slider_23)  # -> ArduinoOutput, StatusMessage
custom_preview_7 = CustomPreview(
    Geometry=[interpolate_t_9.Curve, interpolate_t_11.Curve, interpolate_t_8.Curve, interpolate_t_7.Curve, interpolate_t_10.Curve, interpolate_t_12.Curve],
    Material={diffuse=RGB(255, 255, 255), emission=RGB(66, 48, 66), shine=0.5, specular=RGB(255, 255, 255), transparency=0})  # disabled
custom_preview_8 = CustomPreview(
    Geometry=[loft_4, loft_3, loft_2, loft],
    Material={diffuse=RGB(255, 255, 255), emission=RGB(66, 48, 66), shine=0.5, specular=RGB(255, 255, 255), transparency=0.8})  # disabled
data_recorder_3 = DataRecorder(write_6.ArduinoOutput, DataLimit=-10, RecordData=True)
data_recorder_4 = DataRecorder(write_7.ArduinoOutput, DataLimit=-10, RecordData=True)
data_recorder_5 = DataRecorder(write_5.ArduinoOutput, DataLimit=-10, RecordData=True)
panel_53 = Panel(data_recorder_4)
panel_54 = Panel(data_recorder_5)
panel_55 = Panel(data_recorder_3)

# ----
# construct domain: take the mass addition of the rain sensor value at a moisture content i think is coorect and a light level indicator. When it reaches that limit, then it is 0.6 - put through an integer node, otherwise motion is computer drawing. no motion is sensors drawing
panel_56 = Panel(remap_numbers_2.Mapped)
list_item_13 = ListItem(List=flatten(panel_56), Index=0, Wrap=True)
list_item_14 = ListItem(List=flatten(panel_56), Index=0, Wrap=True)
mass_addition_3 = MassAddition(Input=panel_56)  # -> Result, PartialResults
multiplication_17 = Multiplication(A=list_item_13, B=Slider(0, range=0..100))
multiplication_18 = Multiplication(A=list_item_14, B=Slider(0, range=0..100))

panel_57 = Panel(remap_numbers_2.Mapped)
smoothing_temporal = SmoothingTemporal(Number=multiplication_17, SmoothingFactor=0.9)

number_slider_27 = Slider(36, range=0..36)
increse_distance_from_centre_2 = Slider(25, range=0..30)
list_length_9 = ListLength(List=construct_point_6)
multiplication_19 = Multiplication(A=mass_addition.Result, B=Slider(100, range=0..100))
addition_5 = Addition(A=remap_numbers_2.Mapped, B=increse_distance_from_centre_2)  # -> flatten(Result)
division_4 = Division(A=multiplication_19, B=list_length_9)
construct_point_8 = ConstructPoint(XCoordinate=addition_5, YCoordinate=_0, ZCoordinate=series_5)
unit_z_7 = UnitZ(Factor=_1)
multiplication_20 = Multiplication(A=division_4, B=Slider(1, range=0..1))
# pythagerous theorom to get distance
number_slider_28 = Slider(1, range=0..1)
construct_point_9 = ConstructPoint(XCoordinate=smoothing_temporal, YCoordinate=multiplication_18, ZCoordinate=number_slider_28)
panel_58 = Panel(unit_z_7)
panel_59 = Panel(construct_point_8)
panel_60 = Panel(multiplication_20)
list_item_15 = ListItem(List=construct_point_8, Index="0", Wrap=True)
unit_x_2 = UnitX(Factor=list_item_15)
panel_61 = Panel(unit_x_2)
list_item_16 = ListItem(List=construct_point_8, Index="1", Wrap=True)
move_6 = Move(Geometry=construct_point, Motion=unit_x_2)  # -> Geometry, Transform
panel_62 = Panel(list_item_16)
unit_x_3 = UnitX(Factor=expr("x/2", list_item_16))
panel_63 = Panel(move_6.Geometry)
rotate_3d_9 = Rotate3D(Geometry=move_6.Geometry, Angle=degrees(multiplication_20), Center=construct_point_9, Axis=unit_z_7)  # -> Geometry, Transform
panel_64 = Panel(unit_x_3)
list_item_17 = ListItem(List=construct_point_8, Index="2", Wrap=True)
move_7 = Move(Geometry=rotate_3d_9.Geometry, Motion=unit_x_3)  # -> Geometry, Transform
unit_x_4 = UnitX(Factor=expr("x/3", list_item_17))
line_3 = Line(StartPoint=construct_point, EndPoint=rotate_3d_9.Geometry)
panel_65 = Panel(move_7.Geometry)
panel_66 = Panel(unit_x_4)
list_item_18 = ListItem(List=construct_point_8, Index="3", Wrap=True)
rotate_3d_10 = Rotate3D(Geometry=move_7.Geometry, Angle=expr("x*2", degrees(multiplication_20)), Center=rotate_3d_9.Geometry, Axis=unit_z_7)  # -> Geometry, Transform
move_8 = Move(Geometry=rotate_3d_10.Geometry, Motion=unit_x_4)  # -> Geometry, Transform
unit_x_5 = UnitX(Factor=expr("x/3", list_item_18))
rotate_3d_11 = Rotate3D(Geometry=move_8.Geometry, Angle=expr("x*(3)", degrees(multiplication_20)), Center=rotate_3d_10.Geometry, Axis=unit_z_7)  # -> Geometry, Transform
line_4 = Line(StartPoint=rotate_3d_9.Geometry, EndPoint=rotate_3d_10.Geometry)
move_9 = Move(Geometry=rotate_3d_11.Geometry, Motion=unit_x_5)  # -> Geometry, Transform
panel_67 = Panel(unit_x_5)
list_item_19 = ListItem(List=construct_point_8, Index="4", Wrap=True)
line_5 = Line(StartPoint=rotate_3d_10.Geometry, EndPoint=rotate_3d_11.Geometry)
unit_x_6 = UnitX(Factor=expr("x/3", list_item_19))
rotate_3d_12 = Rotate3D(Geometry=move_9.Geometry, Angle=expr("x*(4)", degrees(multiplication_20)), Center=rotate_3d_11.Geometry, Axis=unit_z_7)  # -> Geometry, Transform
move_10 = Move(Geometry=rotate_3d_12.Geometry, Motion=unit_x_6)  # -> Geometry, Transform
list_item_20 = ListItem(List=construct_point_8, Index="5", Wrap=True)
line_6 = Line(StartPoint=rotate_3d_11.Geometry, EndPoint=rotate_3d_12.Geometry)
rotate_3d_13 = Rotate3D(Geometry=move_10.Geometry, Angle=expr("x*(5)", degrees(multiplication_20)), Center=rotate_3d_12.Geometry, Axis=unit_z_7)  # -> Geometry, Transform
unit_x_7 = UnitX(Factor=expr("x/3", list_item_20))
move_11 = Move(Geometry=rotate_3d_13.Geometry, Motion=unit_x_7)  # -> Geometry, Transform
list_item_21 = ListItem(List=construct_point_8, Index="6", Wrap=True)
line_7 = Line(StartPoint=rotate_3d_12.Geometry, EndPoint=rotate_3d_13.Geometry)
unit_x_8 = UnitX(Factor=expr("x/3", list_item_21))
rotate_3d_14 = Rotate3D(Geometry=move_11.Geometry, Angle=expr("x*(6)", degrees(multiplication_20)), Center=rotate_3d_13.Geometry, Axis=unit_z_7)  # -> Geometry, Transform
list_item_22 = ListItem(List=construct_point_8, Index="7", Wrap=True)
move_12 = Move(Geometry=rotate_3d_14.Geometry, Motion=unit_x_8)  # -> Geometry, Transform
unit_x_9 = UnitX(Factor=expr("x/3", list_item_22))
line_8 = Line(StartPoint=rotate_3d_13.Geometry, EndPoint=rotate_3d_14.Geometry)
rotate_3d_15 = Rotate3D(Geometry=move_12.Geometry, Angle=expr("x*(7)", degrees(multiplication_20)), Center=rotate_3d_14.Geometry, Axis=unit_z_7)  # -> Geometry, Transform
move_13 = Move(Geometry=rotate_3d_15.Geometry, Motion=unit_x_9)  # -> Geometry, Transform
panel_68 = Panel(unit_x_9)
rotate_3d_16 = Rotate3D(Geometry=move_13.Geometry, Angle=expr("x*(8)", degrees(multiplication_20)), Center=rotate_3d_15.Geometry, Axis=unit_z_7)  # -> Geometry, Transform
line_9 = Line(StartPoint=rotate_3d_14.Geometry, EndPoint=rotate_3d_15.Geometry)
set_union = SetUnion(
    _8=rotate_3d_16.Geometry,
    _6=rotate_3d_15.Geometry,
    _5=rotate_3d_14.Geometry,
    _4=rotate_3d_13.Geometry,
    _3=rotate_3d_12.Geometry,
    _2=rotate_3d_11.Geometry,
    _1=rotate_3d_10.Geometry,
    _0=rotate_3d_9.Geometry)
line_10 = Line(StartPoint=rotate_3d_15.Geometry, EndPoint=rotate_3d_16.Geometry)

panel_69 = Panel(construct_point_9)
list_item_23 = ListItem(List=panel_57, Index=0, Wrap=True)
list_item_24 = ListItem(List=panel_57, Index=0, Wrap=True)

addition_6 = Addition(A=Slider(303, range=0..650), B=Slider(242, range=0..600))
smaller_than = SmallerThan(FirstNumber=addition_6, SecondNumber=400)  # -> SmallerThan, OrEqualTo
larger_than = LargerThan(FirstNumber=addition_6, SecondNumber=399)  # -> LargerThan, OrEqualTo
cull_pattern = CullPattern(List="false", CullPattern=smaller_than.SmallerThan)
cull_pattern_2 = CullPattern(List="true", CullPattern=larger_than.LargerThan)
panel_70 = Panel([cull_pattern_2, cull_pattern])

number_slider_29 = Slider(1, range=0..1)
smaller_than_2 = SmallerThan(FirstNumber=number_slider_29, SecondNumber=1)  # -> SmallerThan, OrEqualTo
larger_than_2 = LargerThan(FirstNumber=number_slider_29, SecondNumber=0)  # -> LargerThan, OrEqualTo
cull_pattern_3 = CullPattern(List="false", CullPattern=smaller_than_2.SmallerThan)
cull_pattern_4 = CullPattern(List="true", CullPattern=larger_than_2.LargerThan)
panel_71 = Panel([cull_pattern_4, cull_pattern_3])

increse_distance_from_centre_3 = Slider(25, range=0..30)
multiplication_21 = Multiplication(A=mass_addition.Result, B=Slider(100, range=0..100))
panel_72 = Panel(multiplication_21)
unit_z_8 = UnitZ(Factor=_1)
construct_point_10 = ConstructPoint(XCoordinate=smoothing_temporal, YCoordinate=multiplication_18, ZCoordinate=mass_addition_3.Result)
panel_73 = Panel(unit_z_8)
boolean = Boolean(invert(panel_71))
panel_74 = Panel(boolean)
data_rec_2 = PythonScript(x=rotate_3d_16.Geometry, enable=panel_71, reset=Button(), limit=Slider(37, range=0..100))  # -> x; inputs x: tree, enable: Boolean, reset: Boolean, limit: Int32; same code as data_rec
panel_75 = Panel(data_rec_2)
interpolate_t_13 = InterpolateT(Vertices=panel_75, TangentStart=Vector(0, 0, 0), TangentEnd=Vector(0, 0, 0), KnotStyle=1)  # -> Curve, Length, Domain

panel_76 = Panel(series_5)  # disabled
number_slider_30 = Slider(22, range=0..40)  # disabled
number_slider_31 = Slider(7, range=0..10)  # disabled
number_slider_32 = Slider(22, range=0..40)  # disabled
number_slider_33 = Slider(7, range=0..10)  # disabled
construct_point_11 = ConstructPoint(XCoordinate=0, YCoordinate=number_slider_32, ZCoordinate=panel_76)  # disabled
construct_point_12 = ConstructPoint(XCoordinate=0, YCoordinate=number_slider_33, ZCoordinate=panel_76)  # disabled
number_slider_34 = Slider(0.15, range=0..1)  # disabled
line_11 = Line(StartPoint=construct_point_12, EndPoint=construct_point_11)  # disabled
number_slider_35 = Slider(0.25, range=0..1)  # disabled
curve = Curve(line_11)  # disabled
divide_curve_9 = DivideCurve(Curve=curve, Count=9, Kinks=False)  # -> Points, Tangents, Parameters; disabled

data_rec_3 = PythonScript(x=rotate_3d_3.Geometry, enable=Toggle(True), reset=Button(), limit=panel_18)  # -> x; inputs x: tree, enable: Boolean, reset: Boolean, limit: Int32; same code as data_rec
panel_77 = Panel(data_rec_3)
interpolate = Interpolate(Vertices=data_rec_3, Degree=Slider(5, range=1..11), Periodic=True, KnotStyle=1)  # -> flatten(Curve), Length, Domain
panel_78 = Panel(interpolate.Curve)
_2 = Integer(2)

loft_5 = Loft(
    Curves=interpolate.Curve,
    Options={Adjust=False, Closed=False, LoftEnds=0, LoftSimp=0, LoftType=1, Rebuild=10, Refit=0.01})
custom_preview_9 = CustomPreview(
    Geometry=loft_5,
    Material={diffuse=RGB(255, 255, 255), emission=RGB(76, 76, 76), shine=0.1, specular=RGB(255, 255, 255), transparency=0})

divide_surface = DivideSurface(Surface=loft_5, UCount=Slider(7, range=0..10), VCount=_2)  # -> Points, Normals, Parameters
list_item_25 = ListItem(List=divide_surface.Points, Index=Slider(1, range=0..1), Wrap=True)
deconstruct_2 = Deconstruct(Point=list_item_25)  # -> flatten(XComponent), YComponent, ZComponent
panel_79 = Panel(list_item_25)

construct_point_13 = ConstructPoint(XCoordinate=0, YCoordinate=number_slider_30, ZCoordinate=flatten(deconstruct_2.ZComponent))  # disabled
construct_point_14 = ConstructPoint(XCoordinate=0, YCoordinate=number_slider_31, ZCoordinate=flatten(deconstruct_2.ZComponent))  # disabled
line_12 = Line(StartPoint=construct_point_14, EndPoint=construct_point_13)  # disabled
curve_2 = Curve(line_12)  # disabled
deconstruct_3 = Deconstruct(Point=panel_77)  # -> XComponent, YComponent, ZComponent; disabled
# limitation of math to describe complexity how we learnt it. pyhtagarous, sine waves etc, understand the line. Black magic is to make that line look alive.
# 
# How to draw simplicity out of complexity?
dispatch = Dispatch(List=curve_2, DispatchPattern=[False, True, True, True, True, True, True, False])  # -> ListA, ListB; disabled
multiplication_22 = Multiplication(A=deconstruct_2.XComponent, B=number_slider_34)  # disabled
divide_curve_10 = DivideCurve(Curve=dispatch.ListA, Count=9, Kinks=False)  # -> Points, Tangents, Parameters; disabled
unit_z_9 = UnitZ(Factor=multiplication_22)  # disabled
multiplication_23 = Multiplication(A=deconstruct_3.XComponent, B=number_slider_35)  # disabled
move_14 = Move(Geometry=divide_curve_10.Points, Motion=unit_z_9)  # -> flatten(Geometry), Transform; disabled
unit_z_10 = UnitZ(Factor=multiplication_23)  # disabled
panel_80 = Panel(move_14.Geometry)  # disabled
move_15 = Move(Geometry=divide_curve_9.Points, Motion=unit_z_10)  # -> flatten(Geometry), Transform; disabled
panel_81 = Panel(move_15.Geometry)  # disabled

panel_82 = Panel(deconstruct_2.ZComponent)
multiplication_24 = Multiplication(A=flatten(deconstruct_2.YComponent), B=flatten(deconstruct_2.YComponent))
multiplication_25 = Multiplication(A=deconstruct_2.XComponent, B=deconstruct_2.XComponent)
panel_83 = Panel(multiplication_25)
panel_84 = Panel(multiplication_24)
addition_7 = Addition(A=multiplication_24, B=multiplication_25)

list_length_10 = ListLength(List=interpolate.Curve)  # disabled
list_item_26 = ListItem(List=interpolate.Curve, Index=expr("x-1", list_length_10), Wrap=True)  # disabled
list_item_27 = ListItem(List=move_3.Geometry, Index=0, Wrap=True)  # disabled
list_item_28 = ListItem(List=interpolate.Curve, Index=0, Wrap=True)  # disabled
plane_normal_6 = PlaneNormal(Origin=list_item_27, ZAxis=Vector(0, 0, 1))  # disabled
circle = Circle(Plane=plane_normal_6, Radius=number_slider_5)  # disabled
list_item_29 = ListItem(List=rotate_3d_5.Geometry, Index=0, Wrap=True)  # disabled
plane_normal_7 = PlaneNormal(Origin=list_item_29, ZAxis=Vector(0, 0, 1))  # disabled
circle_2 = Circle(Plane=plane_normal_7, Radius=number_slider_5)  # disabled
curve_3 = Curve([circle, list_item_26])  # disabled
curve_4 = Curve([list_item_28, circle_2])  # disabled
loft_options = LoftOptions(Closed=False, Adjust=True, Rebuild=0, Refit=0, Type=5)  # disabled
loft_6 = Loft(Curves=flatten(curve_3), Options=loft_options)  # disabled
loft_7 = Loft(Curves=flatten(curve_4), Options=loft_options)  # disabled
custom_preview_10 = CustomPreview(
    Geometry=[loft_7, loft_6],
    Material={diffuse=RGB(255, 255, 255), emission=RGB(76, 76, 76), shine=1, specular=RGB(255, 255, 255), transparency=0.8})  # disabled

square_root = SquareRoot(Value=addition_7)
panel_85 = Panel(square_root)
list_item_30 = ListItem(List=square_root, Index=0, Wrap=True)
panel_86 = Panel(list_item_30)
construct_point_15 = ConstructPoint(XCoordinate=integer_3, YCoordinate=0, ZCoordinate=panel_82)
unit_x_10 = UnitX(Factor=list_item_30)
remap_numbers_3 = RemapNumbers(Value=square_root, Source=construct_domain_4, Target=construct_domain_5)  # -> flatten(Mapped), Clipped
move_16 = Move(Geometry=construct_point_15, Motion=unit_x_10)  # -> Geometry, Transform
panel_87 = Panel(remap_numbers_3.Mapped)
line_13 = Line(StartPoint=construct_point_15, EndPoint=move_16.Geometry)
list_item_31 = ListItem(List=remap_numbers_3.Mapped, Index=Slider(6, range=0..10), Wrap=True)
list_item_32 = ListItem(List=remap_numbers_3.Mapped, Index=Slider(1, range=0..10), Wrap=True)
list_item_33 = ListItem(List=remap_numbers_3.Mapped, Index=Slider(2, range=0..10), Wrap=True)
list_item_34 = ListItem(List=remap_numbers_3.Mapped, Index=Slider(3, range=0..10), Wrap=True)
list_item_35 = ListItem(List=remap_numbers_3.Mapped, Index=Slider(4, range=0..10), Wrap=True)
list_item_36 = ListItem(List=remap_numbers_3.Mapped, Index=Slider(5, range=0..10), Wrap=True)
remap_numbers_4 = RemapNumbers(Value=list_item_33, Source=construct_domain_5, Target=construct_domain_7)  # -> Mapped, Clipped
remap_numbers_5 = RemapNumbers(Value=list_item_32, Source=construct_domain_5, Target=construct_domain_7)  # -> Mapped, Clipped
remap_numbers_6 = RemapNumbers(Value=list_item_34, Source=construct_domain_5, Target=construct_domain_7)  # -> Mapped, Clipped
remap_numbers_7 = RemapNumbers(Value=list_item_35, Source=construct_domain_5, Target=construct_domain_7)  # -> Mapped, Clipped
remap_numbers_8 = RemapNumbers(Value=list_item_36, Source=construct_domain_5, Target=construct_domain_7)  # -> Mapped, Clipped
remap_numbers_9 = RemapNumbers(Value=list_item_36, Source=construct_domain_5, Target=construct_domain_7)  # -> Mapped, Clipped
integer_6 = Integer(remap_numbers_5.Mapped)
integer_7 = Integer(remap_numbers_4.Mapped)
integer_8 = Integer(remap_numbers_6.Mapped)
integer_9 = Integer(remap_numbers_9.Mapped)
integer_10 = Integer(remap_numbers_7.Mapped)
integer_11 = Integer(remap_numbers_8.Mapped)
panel_88 = Panel([integer_6, integer_7, integer_8, integer_10, integer_11, integer_9])
list_item_37 = ListItem(List=panel_88, Index=0, Wrap=True)
panel_89 = Panel(["P", list_item_37])
text_join_2 = TextJoin(Text=panel_89)
panel_90 = Panel([text_join_2, panel_88, "50"])
text_join_3 = TextJoin(Text=panel_90, Join=",")
write_8 = SerialWriteGeneric(StartWritingValues=Toggle(False), WriteData=text_join_3, PortNumber=number_slider_23)  # -> ArduinoOutput, StatusMessage
data_recorder_6 = DataRecorder(write_8.ArduinoOutput, DataLimit=-10, RecordData=True)
square = Square(Value=deconstruct_2.XComponent)
square_2 = Square(Value=deconstruct_2.YComponent)
addition_8 = Addition(A=square, B=square_2)
panel_91 = Panel(deconstruct_2.XComponent)
square_root_2 = SquareRoot(Value=addition_8)
list_item_38 = ListItem(List=square_root_2, Index=0, Wrap=True)  # -> flatten(Item)
list_length_11 = ListLength(List=deconstruct_2.XComponent)
panel_92 = Panel(deconstruct_2.ZComponent)
panel_93 = Panel(list_length_11)
addition_9 = Addition(A=increse_distance_from_centre_3, B=list_item_38)
division_5 = Division(A=multiplication_21, B=list_length_11)
flatten_tree = FlattenTree(Tree=panel_92, Path="{0}")
construct_point_16 = ConstructPoint(XCoordinate=addition_9, YCoordinate=_0, ZCoordinate=flatten_tree)
panel_94 = Panel(flatten_tree)
multiplication_26 = Multiplication(A=division_5, B=Slider(1, range=0..1))
panel_95 = Panel(construct_point_16)
addition_10 = Addition(A=multiplication_26, B="180")
panel_96 = Panel(addition_10)
list_item_39 = ListItem(List=construct_point_16, Index="0", Wrap=True)
unit_x_11 = UnitX(Factor=list_item_39)
panel_97 = Panel(unit_x_11)
list_item_40 = ListItem(List=construct_point_16, Index="1", Wrap=True)
multiplication_27 = Multiplication(A=addition_10, B="-1")
move_17 = Move(Geometry=construct_point, Motion=unit_x_11)  # -> Geometry, Transform
panel_98 = Panel(list_item_40)
unit_x_12 = UnitX(Factor=expr("x/2", list_item_40))
panel_99 = Panel(move_17.Geometry)
rotate_3d_17 = Rotate3D(Geometry=move_17.Geometry, Angle=degrees(multiplication_27), Center=construct_point_10, Axis=unit_z_8)  # -> Geometry, Transform
panel_100 = Panel(unit_x_12)
move_18 = Move(Geometry=rotate_3d_17.Geometry, Motion=unit_x_12)  # -> Geometry, Transform
list_item_41 = ListItem(List=construct_point_16, Index="2", Wrap=True)
unit_x_13 = UnitX(Factor=expr("x/3", list_item_41))
line_14 = Line(StartPoint=construct_point, EndPoint=rotate_3d_17.Geometry)
panel_101 = Panel(unit_x_13)
list_item_42 = ListItem(List=construct_point_16, Index="3", Wrap=True)
rotate_3d_18 = Rotate3D(Geometry=move_18.Geometry, Angle=expr("x*-2", degrees(addition_10)), Center=rotate_3d_17.Geometry, Axis=unit_z_8)  # -> Geometry, Transform
move_19 = Move(Geometry=rotate_3d_18.Geometry, Motion=unit_x_13)  # -> Geometry, Transform
unit_x_14 = UnitX(Factor=expr("x/3", list_item_42))
rotate_3d_19 = Rotate3D(Geometry=move_19.Geometry, Angle=expr("x*(-3)", degrees(addition_10)), Center=rotate_3d_18.Geometry, Axis=unit_z_8)  # -> Geometry, Transform
line_15 = Line(StartPoint=rotate_3d_17.Geometry, EndPoint=rotate_3d_18.Geometry)
move_20 = Move(Geometry=rotate_3d_19.Geometry, Motion=unit_x_14)  # -> Geometry, Transform
panel_102 = Panel(unit_x_14)
list_item_43 = ListItem(List=construct_point_16, Index="4", Wrap=True)
line_16 = Line(StartPoint=rotate_3d_18.Geometry, EndPoint=rotate_3d_19.Geometry)
unit_x_15 = UnitX(Factor=expr("x/3", list_item_43))
rotate_3d_20 = Rotate3D(Geometry=move_20.Geometry, Angle=expr("x*(-4)", degrees(addition_10)), Center=rotate_3d_19.Geometry, Axis=unit_z_8)  # -> Geometry, Transform
move_21 = Move(Geometry=rotate_3d_20.Geometry, Motion=unit_x_15)  # -> Geometry, Transform
list_item_44 = ListItem(List=construct_point_16, Index="5", Wrap=True)
line_17 = Line(StartPoint=rotate_3d_19.Geometry, EndPoint=rotate_3d_20.Geometry)
rotate_3d_21 = Rotate3D(Geometry=move_21.Geometry, Angle=expr("x*(-5)", degrees(addition_10)), Center=rotate_3d_20.Geometry, Axis=unit_z_8)  # -> Geometry, Transform
unit_x_16 = UnitX(Factor=expr("x/3", list_item_44))
move_22 = Move(Geometry=rotate_3d_21.Geometry, Motion=unit_x_16)  # -> Geometry, Transform
line_18 = Line(StartPoint=rotate_3d_20.Geometry, EndPoint=rotate_3d_21.Geometry)
rotate_3d_22 = Rotate3D(Geometry=move_22.Geometry, Angle=expr("x*(-6)", degrees(addition_10)), Center=rotate_3d_21.Geometry, Axis=unit_z_8)  # -> Geometry, Transform
data_rec_4 = PythonScript(x=rotate_3d_22.Geometry, enable=panel_70, reset=Button(), limit=Slider(100, range=0..100))  # -> x; inputs x: tree, enable: Boolean, reset: Boolean, limit: Int32; same code as data_rec
data_rec_5 = PythonScript(x=rotate_3d_22.Geometry, enable=boolean, reset=Button(), limit=Slider(100, range=0..100))  # -> x; inputs x: tree, enable: Boolean, reset: Boolean, limit: Int32; same code as data_rec
panel_103 = Panel(data_rec_4)
panel_104 = Panel(data_rec_5)
interpolate_t_14 = InterpolateT(Vertices=panel_104, TangentStart=Vector(0, 0, 0), TangentEnd=Vector(0, 0, 0), KnotStyle=1)  # -> Curve, Length, Domain
line_19 = Line(StartPoint=rotate_3d_21.Geometry, EndPoint=rotate_3d_22.Geometry)
