# Grasshopper definition vectorgraphics_LOFT_23(moving drawing machine-test)_autosave.gh (Grasshopper 1.0.7)
# plug-ins: Firefly.X, Kangaroo2 Components, Firefly.Core

timer = Timer(TimerInterval=20, Target=[data_recorder, serial_read_generic_2])
number_of_lists = Slider(10, range=0..10)

frame_rate = FrameRate()  # -> simplify(flatten(RefreshRate)), Frequency
panel = Panel(frame_rate.RefreshRate)
panel_2 = Panel(frame_rate.Frequency)

integer = Integer(1)
data_recorder = DataRecorder(integer, DataLimit=-360, RecordData=True)
mass_addition = MassAddition(Input=data_recorder)  # -> Result, PartialResults
panel_3 = Panel(mass_addition.Result)
increse_distance_from_centre = Slider(2, range=0..5)
mass_addition_2 = MassAddition(Input=data_recorder)  # -> Result, PartialResults; disabled

number_slider = Slider(36, range=0..100)
multiplication = Multiplication(A=mass_addition.Result, B=number_slider)
series = Series(Start=multiplication, Step=26, Count=number_of_lists)
division = Division(A=Slider(360, range=0..1000), B=number_slider)
panel_4 = Panel(series)
panel_5 = Panel(division)

panel_6 = Panel(multiplication)
number_slider_2 = Slider(0, range=0..100)  # disabled
_0 = Integer(0)
_1 = Integer(1)
unit_z = UnitZ(Factor=1)
surface = Surface()  # disabled
custom_preview = CustomPreview(Material={diffuse=RGB(255, 255, 255), emission=RGB(76, 76, 76), shine=0.1, specular=RGB(255, 255, 255), transparency=0})
number_slider_3 = Slider(74, range=0..1000)
number_slider_4 = Slider(2.3, range=0..5)  # disabled
unit_z_2 = UnitZ(Factor=1)  # disabled
multiplication_2 = Multiplication(A=unit_z_2, B=-1)  # disabled
construct_domain = ConstructDomain(DomainStart=Slider(0, range=0..100), DomainEnd=Slider(1, range=0..1))
construct_domain_2 = ConstructDomain(DomainStart=Slider(10, range=10..72), DomainEnd=Slider(72, range=10..72))
construct_domain_3 = ConstructDomain(DomainStart=Slider(19, range=15..100), DomainEnd=Slider(146, range=0..165))
construct_domain_4 = ConstructDomain(DomainStart=Slider(0, range=0..100), DomainEnd=Slider(180, range=0..180))
number_slider_5 = Slider(4, range=0..10)

set_wrist_rotation = Slider(91, range=0..180)  # disabled
set_elbow = Slider(97, range=0..180)  # disabled
set_base = Slider(44, range=0..180)  # disabled
set_shoulder = Slider(92, range=15..165)  # disabled
number_slider_6 = Slider(64, range=0..200)  # disabled
set_gripper = Slider(123, range=10..180)  # disabled
set_wrist = Slider(167, range=0..180)  # disabled
panel_7 = Panel("P")  # disabled
button = Button()  # disabled
button_2 = Button()  # disabled
button_3 = Button()  # disabled
button_4 = Button()  # disabled
panel_8 = Panel([panel_7, set_base, set_shoulder, set_elbow, set_wrist_rotation, set_wrist, set_gripper, number_slider_6])  # disabled
number_slider_7 = Slider(1, range=0..1)  # disabled
number_slider_8 = Slider(0, range=0..1)  # disabled
text_join = TextJoin(Text=panel_8, Join=",")  # disabled
panel_9 = Panel(text_join)  # disabled
panel_10 = Panel("P90,90,90,90,90,90,50")  # disabled
write = SerialWriteGeneric(StartWritingValues=button_3, WriteData=panel_10, PortNumber=number_slider_5)  # -> ArduinoOutput, StatusMessage; disabled
write_2 = SerialWriteGeneric(StartWritingValues=button, WriteData=panel_9, PortNumber=number_slider_5)  # -> ArduinoOutput, StatusMessage; disabled
write_3 = SerialWriteGeneric(StartWritingValues=button_4, WriteData=number_slider_7, PortNumber=number_slider_5)  # -> ArduinoOutput, StatusMessage; disabled
write_4 = SerialWriteGeneric(StartWritingValues=button_2, WriteData=number_slider_8, PortNumber=number_slider_5)  # -> ArduinoOutput, StatusMessage; disabled
data_recorder_2 = DataRecorder(
    [write_4.ArduinoOutput, write_2.ArduinoOutput, write.ArduinoOutput, write_3.ArduinoOutput],
    DataLimit=-10,
    RecordData=True)  # disabled
panel_11 = Panel(data_recorder_2)  # disabled

timer_2 = Timer(TimerInterval=1000, Target=serial_read_generic)
serial_read_generic = SerialReadGeneric(StartReadingValues=Toggle(True), PortNumber=number_slider_5)  # -> SerialOutput, StatusMessage
timer_3 = Timer(TimerInterval=1000)
panel_12 = Panel(serial_read_generic.SerialOutput)
write_5 = SerialWriteGeneric(StartWritingValues=Button(), WriteData=Slider(0, range=0..1), PortNumber=number_slider_5)  # -> ArduinoOutput, StatusMessage
write_6 = SerialWriteGeneric(StartWritingValues=Button(), WriteData=Slider(1, range=0..1), PortNumber=number_slider_5)  # -> ArduinoOutput, StatusMessage
write_7 = SerialWriteGeneric(StartWritingValues=Button(), WriteData="P90,90,90,90,140,140,50", PortNumber=number_slider_5)  # -> ArduinoOutput, StatusMessage
data_recorder_3 = DataRecorder(write_6.ArduinoOutput, DataLimit=-10, RecordData=True)
data_recorder_4 = DataRecorder(write_5.ArduinoOutput, DataLimit=-10, RecordData=True)
data_recorder_5 = DataRecorder(write_7.ArduinoOutput, DataLimit=-10, RecordData=True)
panel_13 = Panel(data_recorder_5)
panel_14 = Panel(data_recorder_4)
panel_15 = Panel(data_recorder_3)
number_slider_9 = Slider(0.678, range=0..1)
number_slider_10 = Slider(63, range=0..100)
number_slider_11 = Slider(52, range=0..100)
integer_2 = Integer(1)
number_slider_12 = Slider(0, range=0..100)

frame_rate_2 = FrameRate()  # -> simplify(flatten(RefreshRate)), Frequency
panel_16 = Panel(frame_rate_2.RefreshRate)
panel_17 = Panel(frame_rate_2.Frequency)

colour_hsv = ColourHSV(Alpha=expr("-(x)", Slider(0, range=0..1)), Hue=0, Saturation=0, Value=Slider(0.6, range=0..1))

toggle = BooleanToggle(True)
ports_available = COMPortsAvailable()
panel_18 = Panel(ports_available)
panel_19 = Panel("9600")
serial_read_generic_2 = SerialReadGeneric(StartReadingValues=toggle, PortNumber="3")  # -> SerialOutput, StatusMessage
open_port = OpenClosePort(OpenClosePort=toggle, PortNumber="3", BaudRate="115200")
panel_20 = Panel(serial_read_generic_2.StatusMessage)
panel_21 = Panel(open_port)
panel_22 = Panel(serial_read_generic_2.SerialOutput)
text_split = TextSplit(Text=serial_read_generic_2.SerialOutput, Separators=", ")
panel_23 = Panel(text_split)
list_length = ListLength(List=text_split)
series_2 = Series(Start=Slider(0, range=0..100), Step=Slider(2, range=0..10), Count=expr("x/2", list_length))
list_item = ListItem(List=text_split, Index=series_2, Wrap=True)  # -> graft(Item)
data_rec = PythonScript(x=list_item, enable=Toggle(True), reset=Button(), limit=Slider(365, range=0..1500))  # -> x; inputs x: tree, enable: Boolean, reset: Boolean, limit: Int32
# ---------- data_rec: Python ----------
from Grasshopper import DataTree
if reset or 'rec' not in globals(): rec = DataTree[object]()
if enable and not reset: rec.MergeTree(x)
if limit > 0:
  for branch in rec.Branches:
    if branch.Count > limit:
      branch.RemoveRange(0, branch.Count - limit)
x = rec
# ---------- end data_rec ----------
sort_list = SortList(Keys=data_rec)  # -> Keys, ValuesValuesA
panel_24 = Panel(data_rec)
list_length_2 = ListLength(List=sort_list.Keys)
list_item_2 = ListItem(List=sort_list.Keys, Index=expr("x-1", list_length_2), Wrap=True)
panel_25 = Panel(list_item_2)

open_close_port = OpenClosePort(OpenClosePort=toggle, PortNumber=Slider(4, range=0..10), BaudRate=115200)
panel_26 = Panel(open_close_port)

panel_27 = Panel(list_item)
list_item_3 = ListItem(List=sort_list.Keys, Index=0, Wrap=True)

directions = Slider(60, range=3..60)
explode_tree = ExplodeTree(Data=panel_24)  # -> Branch0, Branch1, Branch2, Branch3, Branch4, Branch5, Branch6, Branch7, Branch8, Branch9
list_length_3 = ListLength(List=explode_tree.Branch9)
series_3 = Series(Start=expr("x-1", list_length_3), Step=-1, Count=Slider(10, range=0..100))
construct_domain_5 = ConstructDomain(DomainStart=Slider(590, range=0..600), DomainEnd=Slider(1000, range=0..1000))
construct_domain_6 = ConstructDomain(DomainStart=Slider(0, range=0..100), DomainEnd=directions)
list_item_4 = ListItem(List=explode_tree.Branch9, Index=series_3, Wrap=True)
remap_numbers = RemapNumbers(Value=list_item_4, Source=construct_domain_5, Target=construct_domain_6)  # -> Mapped, Clipped
stepsize = Slider(6, range=0.1..10)
integer_3 = Integer(remap_numbers.Mapped)
cir = Circle(Plane=PlaneXY(0, 0, 0), Radius=stepsize)
divide = DivideCurve(Curve=cir, Count=directions, Kinks=False)  # -> Points, Tangents, Parameters
vec = Vector(divide.Points)
list_item_5 = ListItem(List=vec, Index=integer_3, Wrap=True)
custom_preview_2 = CustomPreview(
    Geometry=list_item_5,
    Material={diffuse=RGB(221, 160, 221), emission=RGB(66, 48, 66), shine=0.5, specular=RGB(255, 255, 255), transparency=0})
ma = MassAddition(Input=list_item_5)  # -> Result, PartialResults
start = Point(Point(0, 0, 0))
move = Move(Geometry=start, Motion=ma.PartialResults)  # -> Geometry, Transform
panel_29 = Panel(move.Geometry)
merge = Merge(Data1=flatten(start), Data2=flatten(move.Geometry))
list_length_4 = ListLength(List=merge)
list_item_6 = ListItem(List=merge, Index=expr("x-1", list_length_4), Wrap=True)
interpolate_t = InterpolateT(Vertices=merge, TangentStart=Vector(0, 0, 0), TangentEnd=Vector(0, 0, 0), KnotStyle=1)  # -> Curve, Length, Domain
custom_preview_3 = CustomPreview(
    Geometry=interpolate_t.Curve,
    Material={diffuse=RGB(221, 160, 221), emission=RGB(66, 48, 66), shine=0.5, specular=RGB(255, 255, 255), transparency=0})

construct_domain_7 = ConstructDomain(DomainStart=list_item_3, DomainEnd=list_item_2)
panel_30 = Panel(construct_domain_7)

remap_numbers_2 = RemapNumbers(Value=list_item, Source=construct_domain_7, Target=construct_domain)  # -> Mapped, Clipped
list_length_5 = ListLength(List=flatten(remap_numbers_2.Mapped))

multiplication_3 = Multiplication(A=panel_3, B=Slider(2, range=0..10))
series_4 = Series(Start=panel_3, Step=multiplication_3, Count=list_length_5)
panel_31 = Panel(series_4)
_1_2 = Integer(1)
random = Random(Range=Domain(0, 1), Number=_1_2, Seed=series_4)

panel_32 = Panel(list_length_5)
panel_33 = Panel(remap_numbers_2.Mapped)
addition = Addition(A=remap_numbers_2.Mapped, B=increse_distance_from_centre)  # -> flatten(Result)
deconstruct = Deconstruct(Point=list_item_6)  # -> XComponent, YComponent, ZComponent
panel_34 = Panel(deconstruct.XComponent)
panel_35 = Panel(deconstruct.YComponent)
deconstruct_2 = Deconstruct(Point=list_item_6)  # -> XComponent, YComponent, ZComponent
number = Number(addition)
list_item_7 = ListItem(List=flatten(remap_numbers_2.Mapped), Index="9", Wrap=True)
list_item_8 = ListItem(List=flatten(remap_numbers_2.Mapped), Index="8", Wrap=True)
average = Average(Input=[list_item_8, list_item_7])
panel_37 = Panel(list_item_8)
panel_38 = Panel(list_item_7)

smaller_than = SmallerThan(FirstNumber=number_slider_9, SecondNumber=average)  # -> SmallerThan, OrEqualTo
larger_than = LargerThan(FirstNumber=number_slider_9, SecondNumber=average)  # -> LargerThan, OrEqualTo
cull_pattern = CullPattern(List="true", CullPattern=smaller_than.SmallerThan)
cull_pattern_2 = CullPattern(List="false", CullPattern=larger_than.LargerThan)
panel_39 = Panel([cull_pattern_2, cull_pattern])

bang = Bang(BooleanInput=panel_39)  # -> TrueState, FalseState
panel_40 = Panel(bang.TrueState)
list_item_9 = ListItem(List=flatten(remap_numbers_2.Mapped), Index="7", Wrap=True)
panel_41 = Panel(list_item_9)

smaller_than_2 = SmallerThan(FirstNumber=list_item_9, SecondNumber=1)  # -> SmallerThan, OrEqualTo
larger_than_2 = LargerThan(FirstNumber=list_item_9, SecondNumber=0)  # -> LargerThan, OrEqualTo
cull_pattern_3 = CullPattern(List="false", CullPattern=smaller_than_2.SmallerThan)
cull_pattern_4 = CullPattern(List="true", CullPattern=larger_than_2.LargerThan)
panel_42 = Panel([cull_pattern_4, cull_pattern_3])

boolean = Boolean(invert(panel_42))
bang_2 = Bang(BooleanInput=panel_42)  # -> TrueState, FalseState
bang_3 = Bang(BooleanInput=boolean)  # -> TrueState, FalseState
panel_43 = Panel(bang_2.TrueState)
panel_44 = Panel(bang_3.FalseState)
data_rec_2 = PythonScript(x=integer_2, enable=Toggle(True), reset=bang.TrueState, limit=number_slider_11)  # -> x; inputs x: tree, enable: Boolean, reset: Boolean, limit: Int32; same code as data_rec
mass_addition_3 = MassAddition(Input=data_rec_2)  # -> Result, PartialResults
larger_than_3 = LargerThan(FirstNumber=mass_addition_3.Result, SecondNumber=expr("x-1", number_slider_11))  # -> LargerThan, OrEqualTo
panel_45 = Panel(mass_addition_3.Result)
cull_pattern_5 = CullPattern(List="true", CullPattern=larger_than_3.LargerThan)
boolean_2 = Boolean(invert(cull_pattern_5))
panel_46 = Panel(boolean_2)

integer_4 = Integer(-10)
unit_x = UnitX(Factor=addition)

construct_point = ConstructPoint(XCoordinate=integer_4, YCoordinate=0, ZCoordinate=0)

list_item_10 = ListItem(List=flatten(remap_numbers_2.Mapped), Index="9", Wrap=True)

multiplication_4 = Multiplication(A=Slider(2, range=0..2), B=list_item_10)

panel_47 = Panel(multiplication_4)

unit_z_3 = UnitZ(Factor=multiplication_4)
series_5 = Series(Start=unit_z_3, Step=Slider(2, range=0..10), Count=number_of_lists)

list_length_6 = ListLength(List=series_5)
list_item_11 = ListItem(List=series_5, Index=expr("x-1", list_length_6), Wrap=True)
list_item_12 = ListItem(List=series_5, Index=0, Wrap=True)
construct_point_2 = ConstructPoint(XCoordinate=integer_4, YCoordinate=0, ZCoordinate=list_item_12)
construct_point_3 = ConstructPoint(XCoordinate=integer_4, YCoordinate=0, ZCoordinate=list_item_11)
line = Line(StartPoint=construct_point_2, EndPoint=construct_point_3)
divide_curve = DivideCurve(Curve=line, Count=number_of_lists, Kinks=False)  # -> Points, Tangents, Parameters
move_2 = Move(Geometry=divide_curve.Points, Motion=unit_x)  # -> Geometry, Transform
line_2 = Line(StartPoint=divide_curve.Points, EndPoint=move_2.Geometry)

list_length_7 = ListLength(List=series_5)
list_item_13 = ListItem(List=series_5, Index=expr("x-1", list_length_7), Wrap=True)
panel_48 = Panel(list_item_13)
panel_49 = Panel(series_5)
panel_50 = Panel(unit_z_3)

height_between_loft_segments = Slider(10, range=0..10)  # disabled
_1_3 = Integer(1)  # disabled
number_of_lists_2 = Slider(14, range=0..30)  # disabled
number_slider_13 = Slider(1, range=0..10)  # disabled
addition_2 = Addition(A=_1_3, B=height_between_loft_segments)  # disabled
addition_3 = Addition(A=list_item_13, B=7)  # disabled
unit_z_4 = UnitZ(Factor=_1_3)  # disabled
series_6 = Series(Start=number_slider_13, Step=1, Count=number_of_lists_2)  # disabled
series_7 = Series(Start=addition_3, Step=addition_2, Count=number_of_lists_2)  # disabled
multiplication_5 = Multiplication(A=series_6, B=series_6)  # disabled
_0_2 = Integer(0)  # disabled
_1_4 = Integer(1)  # disabled
panel_51 = Panel(multiplication_5)  # disabled
construct_point_4 = ConstructPoint(XCoordinate=multiplication_5, YCoordinate=_0_2, ZCoordinate=series_7)  # disabled
construct_point_5 = ConstructPoint(XCoordinate=_0_2, YCoordinate=_0_2, ZCoordinate=number_slider_2)  # disabled
panel_52 = Panel(construct_point_4)  # disabled
number_slider_14 = Slider(35, range=0..100)  # disabled
number_slider_15 = Slider(9, range=0..10)  # disabled
integer_5 = Integer(1)  # disabled
series_8 = Series(Start=mass_addition_2.Result, Step=number_slider_14, Count=number_of_lists_2)  # disabled
multiplication_6 = Multiplication(A=series_8, B=number_slider_15)  # disabled
rotate_3d = Rotate3D(Geometry=construct_point_4, Angle=degrees(multiplication_6), Center=construct_point_5, Axis=unit_z_4)  # -> flatten(Geometry), Transform; disabled
panel_53 = Panel(series_8)  # disabled
number_slider_16 = Slider(0.3, range=0..1)  # disabled
panel_54 = Panel(rotate_3d.Geometry)  # disabled
interpolate_t_2 = InterpolateT(Vertices=rotate_3d.Geometry, TangentStart=Vector(0, 0, 0), TangentEnd=Vector(0, 0, 0), KnotStyle=1)  # -> Curve, Length, Domain; disabled
number_slider_17 = Slider(60, range=0..100)  # disabled
multiplication_7 = Multiplication(A=mass_addition_2.Result, B=number_slider_16)  # disabled
divide_curve_2 = DivideCurve(Curve=interpolate_t_2.Curve, Count=number_slider_17, Kinks=False)  # -> Points, Tangents, Parameters; disabled
panel_55 = Panel(divide_curve_2.Points)  # disabled
number_slider_18 = Slider(4, range=0..10)  # disabled
number_slider_19 = Slider(10, range=0..10)  # disabled
series_9 = Series(Start=multiplication_7, Step=1, Count=number_slider_19)  # disabled
panel_56 = Panel(series_9)  # disabled
sine = Sine(Value=series_9)  # disabled
unit_z_5 = UnitZ(Factor=sine)  # disabled
multiplication_8 = Multiplication(A=unit_z_5, B=number_slider_18)  # disabled
number_slider_20 = Slider(2, range=0..10)  # disabled
number_slider_21 = Slider(0, range=0..10)  # disabled
multiplication_9 = Multiplication(A=multiplication_8, B=-1)  # disabled
series_10 = Series(Start=number_slider_21, Step=number_slider_20, Count=number_slider_19)  # disabled
panel_57 = Panel(multiplication_8)  # disabled
panel_58 = Panel(multiplication_9)  # disabled
panel_59 = Panel(series_10)  # disabled
number_slider_22 = Slider(6, range=0..10)  # disabled
division_2 = Division(A=panel_59, B=number_slider_22)  # disabled
panel_60 = Panel(division_2)  # disabled
multiplication_10 = Multiplication(A=series_10, B=panel_60)  # disabled
integer_6 = Integer(multiplication_10)  # disabled
list_item_14 = ListItem(List=divide_curve_2.Points, Index=integer_6, Wrap=True)  # disabled
move_3 = Move(Geometry=list_item_14, Motion=multiplication_8)  # -> Geometry, Transform; disabled
move_4 = Move(Geometry=list_item_14, Motion=multiplication_9)  # -> Geometry, Transform; disabled

construct_point_6 = ConstructPoint(XCoordinate=addition, YCoordinate=_0, ZCoordinate=series_5)
panel_61 = Panel(construct_point_6)
construct_point_7 = ConstructPoint(XCoordinate=deconstruct.XComponent, YCoordinate=deconstruct.YComponent, ZCoordinate=multiplication_4)
move_5 = Move(Geometry=construct_point_6, Motion=construct_point_7)  # -> Geometry, Transform
panel_62 = Panel(construct_point_7)
panel_63 = Panel(move_5.Geometry)
rotate_3d_2 = Rotate3D(Geometry=move_5.Geometry, Angle=degrees(series), Center=construct_point_7, Axis=unit_z)  # -> graft(Geometry), Transform
panel_64 = Panel(rotate_3d_2.Geometry)
panel_65 = Panel(rotate_3d_2.Geometry)
deconstruct_3 = Deconstruct(Point=flatten(panel_65))  # -> XComponent, YComponent, ZComponent
subtraction = Subtraction(A=deconstruct_3.YComponent)
subtraction_2 = Subtraction(A=deconstruct_3.XComponent)
multiplication_11 = Multiplication(A=flatten(subtraction), B=flatten(subtraction))
multiplication_12 = Multiplication(A=flatten(subtraction_2), B=flatten(subtraction_2))
addition_4 = Addition(A=multiplication_12, B=multiplication_11)
square_root = SquareRoot(Value=addition_4)
panel_66 = Panel(square_root)

number_slider_23 = Slider(2, range=0..10)  # disabled
division_3 = Division(A=list_item_13, B=number_slider_23)  # disabled
construct_point_8 = ConstructPoint(XCoordinate=0, YCoordinate=0, ZCoordinate=division_3)  # disabled
plane_normal = PlaneNormal(Origin=construct_point_8, ZAxis=Vector(0, 0, 1))  # disabled
number_slider_24 = Slider(1, range=0..5)  # disabled
mirror = Mirror(Geometry=move_3.Geometry, Plane=plane_normal)  # -> Geometry, Transform; disabled
mirror_2 = Mirror(Geometry=move_4.Geometry, Plane=plane_normal)  # -> Geometry, Transform; disabled
number_slider_25 = Slider(108, range=0..360)  # disabled
multiplication_13 = Multiplication(A=number_slider_24, B=-1)  # disabled
unit_z_6 = UnitZ(Factor=multiplication_13)  # disabled
unit_z_7 = UnitZ(Factor=number_slider_24)  # disabled
rotate_3d_3 = Rotate3D(Geometry=mirror.Geometry, Angle=degrees(number_slider_25), Center=Point(0, 0, 0), Axis=Vector(0, 0, 1))  # -> Geometry, Transform; disabled
rotate_3d_4 = Rotate3D(Geometry=mirror_2.Geometry, Angle=degrees(number_slider_25), Center=Point(0, 0, 0), Axis=Vector(0, 0, 1))  # -> Geometry, Transform; disabled
interpolate_t_3 = InterpolateT(Vertices=rotate_3d_3.Geometry, TangentStart=unit_z_6, TangentEnd=Vector(0, 0, 0), KnotStyle=1)  # -> Curve, Length, Domain; disabled
interpolate_t_4 = InterpolateT(Vertices=move_4.Geometry, TangentStart=unit_z_7, TangentEnd=Vector(0, 0, 0), KnotStyle=1)  # -> Curve, Length, Domain; disabled
panel_67 = Panel(rotate_3d_4.Geometry)  # disabled
custom_preview_4 = CustomPreview(
    Geometry=[interpolate_t_3.Curve, interpolate_t_4.Curve],
    Material={diffuse=RGB(105, 105, 105), emission=RGB(66, 48, 66), shine=0.5, specular=RGB(255, 255, 255), transparency=0})  # disabled

point = Point(construct_point_7)
deconstruct_4 = Deconstruct(Point=point)  # -> XComponent, YComponent, ZComponent

number_2 = Number(multiplication_4)
multiplication_14 = Multiplication(A=number_2, B=Slider(10, range=0..10))
construct_point_9 = ConstructPoint(XCoordinate=0, YCoordinate=0, ZCoordinate=multiplication_14)
panel_68 = Panel(construct_point_9)
addition_5 = Addition(A=panel_68, B=construct_point_7)
panel_69 = Panel(addition_5)

interpolate_t_5 = InterpolateT(Vertices=rotate_3d_4.Geometry, TangentStart=multiplication_2, TangentEnd=Vector(0, 0, 0), KnotStyle=1)  # -> reparameterize(Curve), Length, Domain; disabled
interpolate_t_6 = InterpolateT(Vertices=move_3.Geometry, TangentStart=unit_z_2, TangentEnd=Vector(0, 0, 0), KnotStyle=1)  # -> reparameterize(Curve), Length, Domain; disabled
domain = Domain(interpolate_t_6.Curve)  # disabled
panel_70 = Panel(domain)  # disabled
custom_preview_5 = CustomPreview(
    Geometry=[interpolate_t_5.Curve, interpolate_t_6.Curve],
    Material={diffuse=RGB(0, 0, 0), emission=RGB(76, 76, 76), shine=1, specular=RGB(255, 255, 255), transparency=0.8})  # disabled

gene_pool = GenePool(Decimals=2, Maximum=1, Minimum=0, Value=[0, 0.23, 0.5246, 0.76, 1])  # disabled
gene_pool_2 = GenePool(Decimals=2, Maximum=10, Minimum=0, Value=[2.32, 0.3, 2.46, 4.43, 0])  # disabled
pipe = Pipe(Curve=[interpolate_t_6.Curve, interpolate_t_5.Curve], Radius=number_slider_4, Caps=0)  # disabled
pipe_variable = PipeVariable(Curve=[interpolate_t_6.Curve, interpolate_t_5.Curve], Parameters=gene_pool, Radii=gene_pool_2, Caps=0)  # disabled
panel_71 = Panel(pipe)  # disabled
panel_72 = Panel(pipe_variable)  # disabled
custom_preview_6 = CustomPreview(
    Geometry=pipe_variable,
    Material={diffuse=RGB(255, 255, 255), emission=RGB(76, 76, 76), shine=0.5, specular=RGB(255, 255, 255), transparency=0.8})  # disabled

number_slider_26 = Slider(293, range=0..360)  # disabled
number_slider_27 = Slider(79, range=0..360)  # disabled
number_slider_28 = Slider(219, range=0..360)  # disabled
rotate_3d_5 = Rotate3D(Geometry=interpolate_t_6.Curve, Angle=degrees(number_slider_27), Center=Point(0, 0, 0), Axis=Vector(0, 0, 1))  # -> Geometry, Transform; disabled
rotate_3d_6 = Rotate3D(Geometry=interpolate_t_6.Curve, Angle=degrees(number_slider_26), Center=Point(0, 0, 0), Axis=Vector(0, 0, 1))  # -> Geometry, Transform; disabled
rotate_3d_7 = Rotate3D(Geometry=interpolate_t_6.Curve, Angle=degrees(number_slider_28), Center=Point(0, 0, 0), Axis=Vector(0, 0, 1))  # -> Geometry, Transform; disabled
divide_curve_3 = DivideCurve(Curve=interpolate_t_5.Curve, Count=4, Kinks=False)  # -> Points, Tangents, Parameters; disabled
divide_curve_4 = DivideCurve(Curve=interpolate_t_5.Curve, Count=2, Kinks=False)  # -> Points, Tangents, Parameters; disabled
divide_curve_5 = DivideCurve(Curve=interpolate_t_5.Curve, Count=3, Kinks=False)  # -> Points, Tangents, Parameters; disabled
divide_curve_6 = DivideCurve(Curve=rotate_3d_7.Geometry, Count=3, Kinks=False)  # -> Points, Tangents, Parameters; disabled
divide_curve_7 = DivideCurve(Curve=rotate_3d_5.Geometry, Count=2, Kinks=False)  # -> Points, Tangents, Parameters; disabled
divide_curve_8 = DivideCurve(Curve=rotate_3d_6.Geometry, Count=4, Kinks=False)  # -> Points, Tangents, Parameters; disabled
interpolate_t_7 = InterpolateT(Vertices=divide_curve_3.Points, TangentStart=Vector(0, 0, 0), TangentEnd=Vector(0, 0, 0), KnotStyle=1)  # -> Curve, Length, Domain; disabled
interpolate_t_8 = InterpolateT(Vertices=divide_curve_4.Points, TangentStart=Vector(0, 0, 0), TangentEnd=Vector(0, 0, 0), KnotStyle=1)  # -> Curve, Length, Domain; disabled
interpolate_t_9 = InterpolateT(Vertices=divide_curve_8.Points, TangentStart=Vector(0, 0, 0), TangentEnd=Vector(0, 0, 0), KnotStyle=1)  # -> Curve, Length, Domain; disabled
interpolate_t_10 = InterpolateT(Vertices=divide_curve_5.Points, TangentStart=Vector(0, 0, 0), TangentEnd=Vector(0, 0, 0), KnotStyle=1)  # -> Curve, Length, Domain; disabled
multiplication_15 = Multiplication(A=number_slider_4, B=0.3)  # disabled
multiplication_16 = Multiplication(A=number_slider_4, B=0.2)  # disabled
interpolate_t_11 = InterpolateT(Vertices=divide_curve_7.Points, TangentStart=Vector(0, 0, 0), TangentEnd=Vector(0, 0, 0), KnotStyle=1)  # -> Curve, Length, Domain; disabled
interpolate_t_12 = InterpolateT(Vertices=divide_curve_6.Points, TangentStart=Vector(0, 0, 0), TangentEnd=Vector(0, 0, 0), KnotStyle=1)  # -> Curve, Length, Domain; disabled
plane_normal_2 = PlaneNormal(Origin=divide_curve_3.Points, ZAxis=divide_curve_3.Tangents)  # disabled
plane_normal_3 = PlaneNormal(Origin=divide_curve_4.Points, ZAxis=divide_curve_4.Tangents)  # disabled
plane_normal_4 = PlaneNormal(Origin=divide_curve_8.Points, ZAxis=divide_curve_8.Tangents)  # disabled
plane_normal_5 = PlaneNormal(Origin=divide_curve_7.Points, ZAxis=divide_curve_7.Tangents)  # disabled
multiplication_17 = Multiplication(A=multiplication_15, B=number_slider_4)  # disabled
multiplication_18 = Multiplication(A=multiplication_16, B=number_slider_4)  # disabled
ellipse = Ellipse(Plane=plane_normal_2, Radius1=multiplication_17, Radius2=multiplication_15)  # -> Ellipse, Focus1, Focus2; disabled
ellipse_2 = Ellipse(Plane=plane_normal_3, Radius1=multiplication_17, Radius2=multiplication_15)  # -> Ellipse, Focus1, Focus2; disabled
ellipse_3 = Ellipse(Plane=plane_normal_4, Radius1=multiplication_18, Radius2=multiplication_16)  # -> Ellipse, Focus1, Focus2; disabled
ellipse_4 = Ellipse(Plane=plane_normal_5, Radius1=multiplication_18, Radius2=multiplication_16)  # -> Ellipse, Focus1, Focus2; disabled
panel_73 = Panel(multiplication_17)  # disabled
panel_74 = Panel(multiplication_18)  # disabled
loft = Loft(Curves=ellipse.Ellipse, Options={Adjust=False, Closed=False, LoftEnds=0, LoftSimp=0, LoftType=0, Rebuild=10, Refit=0.01})  # disabled
loft_2 = Loft(
    Curves=ellipse_2.Ellipse,
    Options={Adjust=False, Closed=False, LoftEnds=0, LoftSimp=0, LoftType=0, Rebuild=10, Refit=0.01})  # disabled
loft_3 = Loft(
    Curves=ellipse_3.Ellipse,
    Options={Adjust=False, Closed=False, LoftEnds=0, LoftSimp=0, LoftType=0, Rebuild=10, Refit=0.01})  # disabled
loft_4 = Loft(
    Curves=ellipse_4.Ellipse,
    Options={Adjust=False, Closed=False, LoftEnds=0, LoftSimp=0, LoftType=0, Rebuild=10, Refit=0.01})  # disabled
custom_preview_7 = CustomPreview(
    Geometry=[interpolate_t_9.Curve, interpolate_t_11.Curve, interpolate_t_8.Curve, interpolate_t_7.Curve, interpolate_t_10.Curve, interpolate_t_12.Curve],
    Material={diffuse=RGB(255, 255, 255), emission=RGB(66, 48, 66), shine=0.5, specular=RGB(255, 255, 255), transparency=0})  # disabled

point_2 = Point(addition_5)

number_slider_29 = Slider(36, range=0..36)
# limitation of math to describe complexity how we learnt it. pyhtagarous, sine waves etc, understand the line. Black magic is to make that line look alive.
# 
# How to draw simplicity out of complexity?
number_slider_30 = Slider(100, range=0..100)
increse_distance_from_centre_2 = Slider(25, range=0..30)
list_length_8 = ListLength(List=construct_point_6)
multiplication_19 = Multiplication(A=mass_addition.Result, B=number_slider_30)
addition_6 = Addition(A=number, B=increse_distance_from_centre_2)  # -> flatten(Result)
division_4 = Division(A=multiplication_19, B=list_length_8)
construct_point_10 = ConstructPoint(XCoordinate=addition_6, YCoordinate=_0, ZCoordinate=series_5)
unit_z_8 = UnitZ(Factor=_1)
multiplication_20 = Multiplication(A=division_4, B=Slider(1, range=0..1))
panel_75 = Panel(unit_z_8)
panel_76 = Panel(construct_point_10)
panel_77 = Panel(multiplication_20)
list_item_15 = ListItem(List=construct_point_10, Index="0", Wrap=True)
unit_x_2 = UnitX(Factor=list_item_15)
panel_78 = Panel(unit_x_2)
list_item_16 = ListItem(List=construct_point_10, Index="1", Wrap=True)
move_6 = Move(Geometry=addition_5, Motion=unit_x_2)  # -> Geometry, Transform
panel_79 = Panel(list_item_16)
unit_x_3 = UnitX(Factor=expr("x/2", list_item_16))
panel_80 = Panel(move_6.Geometry)
rotate_3d_8 = Rotate3D(Geometry=move_6.Geometry, Angle=degrees(multiplication_20), Center=point_2, Axis=unit_z_8)  # -> Geometry, Transform
panel_81 = Panel(unit_x_3)
list_item_17 = ListItem(List=construct_point_10, Index="2", Wrap=True)
move_7 = Move(Geometry=rotate_3d_8.Geometry, Motion=unit_x_3)  # -> Geometry, Transform
unit_x_4 = UnitX(Factor=expr("x/3", list_item_17))
line_3 = Line(StartPoint=addition_5, EndPoint=rotate_3d_8.Geometry)
panel_82 = Panel(move_7.Geometry)
panel_83 = Panel(unit_x_4)
list_item_18 = ListItem(List=construct_point_10, Index="3", Wrap=True)
rotate_3d_9 = Rotate3D(Geometry=move_7.Geometry, Angle=expr("x*2", degrees(multiplication_20)), Center=rotate_3d_8.Geometry, Axis=unit_z_8)  # -> Geometry, Transform
move_8 = Move(Geometry=rotate_3d_9.Geometry, Motion=unit_x_4)  # -> Geometry, Transform
unit_x_5 = UnitX(Factor=expr("x/3", list_item_18))
rotate_3d_10 = Rotate3D(Geometry=move_8.Geometry, Angle=expr("x*(3)", degrees(multiplication_20)), Center=rotate_3d_9.Geometry, Axis=unit_z_8)  # -> Geometry, Transform
line_4 = Line(StartPoint=rotate_3d_8.Geometry, EndPoint=rotate_3d_9.Geometry)
move_9 = Move(Geometry=rotate_3d_10.Geometry, Motion=unit_x_5)  # -> Geometry, Transform
panel_84 = Panel(unit_x_5)
list_item_19 = ListItem(List=construct_point_10, Index="4", Wrap=True)
line_5 = Line(StartPoint=rotate_3d_9.Geometry, EndPoint=rotate_3d_10.Geometry)
unit_x_6 = UnitX(Factor=expr("x/3", list_item_19))
rotate_3d_11 = Rotate3D(Geometry=move_9.Geometry, Angle=expr("x*(4)", degrees(multiplication_20)), Center=rotate_3d_10.Geometry, Axis=unit_z_8)  # -> Geometry, Transform
move_10 = Move(Geometry=rotate_3d_11.Geometry, Motion=unit_x_6)  # -> Geometry, Transform
list_item_20 = ListItem(List=construct_point_10, Index="5", Wrap=True)
line_6 = Line(StartPoint=rotate_3d_10.Geometry, EndPoint=rotate_3d_11.Geometry)
rotate_3d_12 = Rotate3D(Geometry=move_10.Geometry, Angle=expr("x*(5)", degrees(multiplication_20)), Center=rotate_3d_11.Geometry, Axis=unit_z_8)  # -> Geometry, Transform
unit_x_7 = UnitX(Factor=expr("x/3", list_item_20))
move_11 = Move(Geometry=rotate_3d_12.Geometry, Motion=unit_x_7)  # -> Geometry, Transform
list_item_21 = ListItem(List=construct_point_10, Index="6", Wrap=True)
line_7 = Line(StartPoint=rotate_3d_11.Geometry, EndPoint=rotate_3d_12.Geometry)
unit_x_8 = UnitX(Factor=expr("x/3", list_item_21))
rotate_3d_13 = Rotate3D(Geometry=move_11.Geometry, Angle=expr("x*(6)", degrees(multiplication_20)), Center=rotate_3d_12.Geometry, Axis=unit_z_8)  # -> Geometry, Transform
list_item_22 = ListItem(List=construct_point_10, Index="7", Wrap=True)
move_12 = Move(Geometry=rotate_3d_13.Geometry, Motion=unit_x_8)  # -> Geometry, Transform
unit_x_9 = UnitX(Factor=expr("x/3", list_item_22))
line_8 = Line(StartPoint=rotate_3d_12.Geometry, EndPoint=rotate_3d_13.Geometry)
rotate_3d_14 = Rotate3D(Geometry=move_12.Geometry, Angle=expr("x*(7)", degrees(multiplication_20)), Center=rotate_3d_13.Geometry, Axis=unit_z_8)  # -> Geometry, Transform
move_13 = Move(Geometry=rotate_3d_14.Geometry, Motion=unit_x_9)  # -> Geometry, Transform
panel_85 = Panel(unit_x_9)
rotate_3d_15 = Rotate3D(Geometry=move_13.Geometry, Angle=expr("x*(8)", degrees(multiplication_20)), Center=rotate_3d_14.Geometry, Axis=unit_z_8)  # -> Geometry, Transform
line_9 = Line(StartPoint=rotate_3d_13.Geometry, EndPoint=rotate_3d_14.Geometry)
line_10 = Line(StartPoint=rotate_3d_14.Geometry, EndPoint=rotate_3d_15.Geometry)
set_union = SetUnion(
    _8=rotate_3d_15.Geometry,
    _6=rotate_3d_14.Geometry,
    _5=rotate_3d_13.Geometry,
    _4=rotate_3d_12.Geometry,
    _3=rotate_3d_11.Geometry,
    _2=rotate_3d_10.Geometry,
    _1=rotate_3d_9.Geometry,
    _0=rotate_3d_8.Geometry)

custom_preview_8 = CustomPreview(
    Geometry=[interpolate_t_9.Curve, interpolate_t_11.Curve, interpolate_t_8.Curve, interpolate_t_7.Curve, interpolate_t_10.Curve, interpolate_t_12.Curve],
    Material={diffuse=RGB(255, 255, 255), emission=RGB(66, 48, 66), shine=0.5, specular=RGB(255, 255, 255), transparency=0})  # disabled
custom_preview_9 = CustomPreview(
    Geometry=[loft_4, loft_3, loft_2, loft],
    Material={diffuse=RGB(255, 255, 255), emission=RGB(66, 48, 66), shine=0.5, specular=RGB(255, 255, 255), transparency=0.8})  # disabled
line_11 = Line([line_10, line_9, line_8, line_7, line_6, line_5, line_4, line_3])
data_rec_3 = PythonScript(x=rotate_3d_15.Geometry, enable=panel_42, reset=bang_2.TrueState, limit=number_slider_10)  # -> x; inputs x: tree, enable: Boolean, reset: Boolean, limit: Int32; same code as data_rec
panel_86 = Panel(data_rec_3)
interpolate = Interpolate(Vertices=panel_86, Degree=3, Periodic=False, KnotStyle=1)  # -> Curve, Length, Domain
custom_preview_10 = CustomPreview(
    Geometry=[interpolate.Curve, line_11],
    Material={diffuse=RGB(0, 255, 255), emission=RGB(66, 48, 66), shine=0.5, specular=RGB(255, 255, 255), transparency=0})
point_3 = Point(set_union)

number_slider_31 = Slider(22, range=0..40)  # disabled
number_slider_32 = Slider(7, range=0..10)  # disabled
panel_87 = Panel(series_5)  # disabled
construct_point_11 = ConstructPoint(XCoordinate=0, YCoordinate=number_slider_31, ZCoordinate=panel_87)  # disabled
construct_point_12 = ConstructPoint(XCoordinate=0, YCoordinate=number_slider_32, ZCoordinate=panel_87)  # disabled
number_slider_33 = Slider(0.25, range=0..1)  # disabled
line_12 = Line(StartPoint=construct_point_12, EndPoint=construct_point_11)  # disabled
curve = Curve(line_12)  # disabled
divide_curve_9 = DivideCurve(Curve=curve, Count=9, Kinks=False)  # -> Points, Tangents, Parameters; disabled

data_rec_4 = PythonScript(x=rotate_3d_2.Geometry, enable=Toggle(True), reset=Button(), limit=panel_5)  # -> x; inputs x: tree, enable: Boolean, reset: Boolean, limit: Int32; same code as data_rec
panel_88 = Panel(data_rec_4)
interpolate_2 = Interpolate(Vertices=data_rec_4, Degree=Slider(5, range=1..11), Periodic=True, KnotStyle=1)  # -> flatten(Curve), Length, Domain
panel_89 = Panel(interpolate_2.Curve)

loft_5 = Loft(
    Curves=interpolate_2.Curve,
    Options={Adjust=False, Closed=False, LoftEnds=0, LoftSimp=0, LoftType=1, Rebuild=10, Refit=0.01})

divide_surface = DivideSurface(Surface=loft_5, UCount=Slider(6, range=0..10), VCount=Slider(2, range=0..10))  # -> Points, Normals, Parameters
list_item_23 = ListItem(List=divide_surface.Points, Index=Slider(1, range=0..1), Wrap=True)
deconstruct_5 = Deconstruct(Point=list_item_23)  # -> XComponent, YComponent, ZComponent
panel_90 = Panel(list_item_23)

number_3 = Number(deconstruct_5.XComponent)  # disabled
number_4 = Number(deconstruct_5.ZComponent)  # disabled

construct_point_13 = ConstructPoint(XCoordinate=0, YCoordinate=number_slider_31, ZCoordinate=flatten(number_4))  # disabled
construct_point_14 = ConstructPoint(XCoordinate=0, YCoordinate=number_slider_32, ZCoordinate=flatten(number_4))  # disabled
line_13 = Line(StartPoint=construct_point_14, EndPoint=construct_point_13)  # disabled
curve_2 = Curve(line_13)  # disabled
deconstruct_6 = Deconstruct(Point=panel_88)  # -> XComponent, YComponent, ZComponent; disabled
dispatch = Dispatch(List=curve_2, DispatchPattern=[False, True, True, True, True, True, True, False])  # -> ListA, ListB; disabled
multiplication_21 = Multiplication(A=flatten(number_3), B=number_slider_33)  # disabled
divide_curve_10 = DivideCurve(Curve=curve_2, Count=9, Kinks=False)  # -> Points, Tangents, Parameters; disabled
unit_z_9 = UnitZ(Factor=multiplication_21)  # disabled
multiplication_22 = Multiplication(A=deconstruct_6.XComponent, B=number_slider_33)  # disabled
move_14 = Move(Geometry=divide_curve_10.Points, Motion=unit_z_9)  # -> flatten(Geometry), Transform; disabled
unit_z_10 = UnitZ(Factor=multiplication_22)  # disabled
move_15 = Move(Geometry=divide_curve_9.Points, Motion=unit_z_10)  # -> flatten(Geometry), Transform; disabled
panel_91 = Panel(move_14.Geometry)  # disabled
panel_92 = Panel(move_15.Geometry)  # disabled

custom_preview_11 = CustomPreview(
    Geometry=[move_14.Geometry, move_15.Geometry],
    Material={diffuse=RGB(221, 160, 221), emission=RGB(66, 48, 66), shine=0.5, specular=RGB(255, 255, 255), transparency=0})  # disabled
number_5 = Number(flatten(deconstruct_5.XComponent))
subtraction_3 = Subtraction(A=deconstruct_5.XComponent, B=deconstruct_4.XComponent)
subtraction_4 = Subtraction(A=deconstruct_5.YComponent, B=deconstruct_4.YComponent)
multiplication_23 = Multiplication(A=flatten(subtraction_4), B=flatten(subtraction_4))
multiplication_24 = Multiplication(A=flatten(subtraction_3), B=flatten(subtraction_3))
addition_7 = Addition(A=multiplication_24, B=multiplication_23)
square_root_2 = SquareRoot(Value=addition_7)
data_rec_5 = PythonScript(x=square_root_2, enable=Toggle(True), reset=Button(), limit=number_slider_3)  # -> x; inputs x: tree, enable: Boolean, reset: Boolean, limit: Int32; same code as data_rec
sort_list_2 = SortList(Keys=data_rec_5)  # -> Keys, ValuesValuesA
list_item_24 = ListItem(List=sort_list_2.Keys, Index=0, Wrap=True)
list_item_25 = ListItem(List=sort_list_2.Keys, Index=expr("x-1", number_slider_3), Wrap=True)
panel_93 = Panel(square_root_2)
construct_domain_8 = ConstructDomain(DomainStart=list_item_24, DomainEnd=list_item_25)

list_length_9 = ListLength(List=interpolate_2.Curve)  # disabled
list_item_26 = ListItem(List=interpolate_2.Curve, Index=expr("x-1", list_length_9), Wrap=True)  # disabled
list_item_27 = ListItem(List=move_3.Geometry, Index=0, Wrap=True)  # disabled
list_item_28 = ListItem(List=interpolate_2.Curve, Index=0, Wrap=True)  # disabled
plane_normal_6 = PlaneNormal(Origin=list_item_27, ZAxis=Vector(0, 0, 1))  # disabled
circle = Circle(Plane=plane_normal_6, Radius=number_slider_4)  # disabled
list_item_29 = ListItem(List=rotate_3d_4.Geometry, Index=0, Wrap=True)  # disabled
plane_normal_7 = PlaneNormal(Origin=list_item_29, ZAxis=Vector(0, 0, 1))  # disabled
circle_2 = Circle(Plane=plane_normal_7, Radius=number_slider_4)  # disabled
curve_3 = Curve([circle, list_item_26])  # disabled
curve_4 = Curve([list_item_28, circle_2])  # disabled
loft_options = LoftOptions(Closed=False, Adjust=True, Rebuild=0, Refit=0, Type=5)  # disabled
loft_6 = Loft(Curves=flatten(curve_3), Options=loft_options)  # disabled
loft_7 = Loft(Curves=flatten(curve_4), Options=loft_options)  # disabled
custom_preview_12 = CustomPreview(
    Geometry=[loft_7, loft_6],
    Material={diffuse=RGB(255, 255, 255), emission=RGB(76, 76, 76), shine=1, specular=RGB(255, 255, 255), transparency=0.8})  # disabled

panel_94 = Panel(construct_domain_8)
list_item_30 = ListItem(List=square_root_2, Index=0, Wrap=True)
panel_95 = Panel(list_item_30)
remap_numbers_3 = RemapNumbers(Value=square_root_2, Source=construct_domain_8, Target=construct_domain)  # -> flatten(Mapped), Clipped
panel_96 = Panel(remap_numbers_3.Mapped)
unit_x_10 = UnitX(Factor=list_item_30)
move_16 = Move(Geometry=construct_point, Motion=unit_x_10)  # -> Geometry, Transform
line_14 = Line(StartPoint=construct_point, EndPoint=move_16.Geometry)
list_item_31 = ListItem(List=remap_numbers_3.Mapped, Index=Slider(6, range=0..10), Wrap=True)
list_item_32 = ListItem(List=remap_numbers_3.Mapped, Index=Slider(1, range=0..10), Wrap=True)
list_item_33 = ListItem(List=remap_numbers_3.Mapped, Index=Slider(2, range=0..10), Wrap=True)
list_item_34 = ListItem(List=remap_numbers_3.Mapped, Index=Slider(3, range=0..10), Wrap=True)
list_item_35 = ListItem(List=remap_numbers_3.Mapped, Index=Slider(4, range=0..10), Wrap=True)
list_item_36 = ListItem(List=remap_numbers_3.Mapped, Index=Slider(5, range=0..10), Wrap=True)
remap_numbers_4 = RemapNumbers(Value=list_item_33, Source=construct_domain, Target=construct_domain_3)  # -> Mapped, Clipped
remap_numbers_5 = RemapNumbers(Value=list_item_32, Source=construct_domain, Target=construct_domain_3)  # -> Mapped, Clipped
remap_numbers_6 = RemapNumbers(Value=list_item_34, Source=construct_domain, Target=construct_domain_3)  # -> Mapped, Clipped
remap_numbers_7 = RemapNumbers(Value=list_item_35, Source=construct_domain, Target=construct_domain_3)  # -> Mapped, Clipped
remap_numbers_8 = RemapNumbers(Value=list_item_36, Source=construct_domain, Target=construct_domain_3)  # -> Mapped, Clipped
remap_numbers_9 = RemapNumbers(Value=list_item_36, Source=construct_domain, Target=construct_domain_3)  # -> Mapped, Clipped
integer_7 = Integer(remap_numbers_5.Mapped)
integer_8 = Integer(remap_numbers_4.Mapped)
integer_9 = Integer(remap_numbers_6.Mapped)
integer_10 = Integer(remap_numbers_9.Mapped)
integer_11 = Integer(remap_numbers_7.Mapped)
integer_12 = Integer(remap_numbers_8.Mapped)
panel_97 = Panel([integer_7, integer_8, integer_9, integer_11, integer_12, integer_10])
list_item_37 = ListItem(List=panel_97, Index=0, Wrap=True)
panel_98 = Panel(["P", list_item_37])
text_join_2 = TextJoin(Text=panel_98)
panel_99 = Panel([text_join_2, panel_97, "50"])
text_join_3 = TextJoin(Text=panel_99, Join=",")
write_8 = SerialWriteGeneric(StartWritingValues=Toggle(False), WriteData=text_join_3, PortNumber=number_slider_5)  # -> ArduinoOutput, StatusMessage
data_recorder_6 = DataRecorder(write_8.ArduinoOutput, DataLimit=-10, RecordData=True)

increse_distance_from_centre_3 = Slider(25, range=0..30)
number_6 = Number(square_root_2)
list_length_10 = ListLength(List=number_5)
panel_100 = Panel(deconstruct_5.ZComponent)
multiplication_25 = Multiplication(A=mass_addition.Result, B=Slider(100, range=0..100))
panel_101 = Panel(list_length_10)
addition_8 = Addition(A=increse_distance_from_centre_3, B=number_6)
division_5 = Division(A=multiplication_25, B=list_length_10)
flatten_tree = FlattenTree(Tree=panel_100, Path="{0}")
construct_point_15 = ConstructPoint(XCoordinate=addition_8, YCoordinate=_0, ZCoordinate=flatten_tree)
unit_z_11 = UnitZ(Factor=_1)
panel_102 = Panel(flatten_tree)
multiplication_26 = Multiplication(A=division_5, B=Slider(1, range=0..1))
panel_103 = Panel(unit_z_11)
panel_104 = Panel(construct_point_15)
panel_105 = Panel(multiplication_25)
addition_9 = Addition(A=multiplication_26, B="180")
panel_106 = Panel(addition_9)
list_item_38 = ListItem(List=construct_point_15, Index="0", Wrap=True)
unit_x_11 = UnitX(Factor=list_item_38)
panel_107 = Panel(unit_x_11)
list_item_39 = ListItem(List=construct_point_15, Index="1", Wrap=True)
multiplication_27 = Multiplication(A=addition_9, B="-1")
move_17 = Move(Geometry=addition_5, Motion=unit_x_11)  # -> Geometry, Transform
panel_108 = Panel(list_item_39)
unit_x_12 = UnitX(Factor=expr("x/2", list_item_39))
panel_109 = Panel(move_17.Geometry)
rotate_3d_16 = Rotate3D(Geometry=move_17.Geometry, Angle=degrees(multiplication_27), Center=point_2, Axis=unit_z_11)  # -> Geometry, Transform
panel_110 = Panel(unit_x_12)
move_18 = Move(Geometry=rotate_3d_16.Geometry, Motion=unit_x_12)  # -> Geometry, Transform
list_item_40 = ListItem(List=construct_point_15, Index="2", Wrap=True)
unit_x_13 = UnitX(Factor=expr("x/3", list_item_40))
line_15 = Line(StartPoint=addition_5, EndPoint=rotate_3d_16.Geometry)
panel_111 = Panel(unit_x_13)
list_item_41 = ListItem(List=construct_point_15, Index="3", Wrap=True)
rotate_3d_17 = Rotate3D(Geometry=move_18.Geometry, Angle=expr("x*-2", degrees(addition_9)), Center=rotate_3d_16.Geometry, Axis=unit_z_11)  # -> Geometry, Transform
move_19 = Move(Geometry=rotate_3d_17.Geometry, Motion=unit_x_13)  # -> Geometry, Transform
unit_x_14 = UnitX(Factor=expr("x/3", list_item_41))
rotate_3d_18 = Rotate3D(Geometry=move_19.Geometry, Angle=expr("x*(-3)", degrees(addition_9)), Center=rotate_3d_17.Geometry, Axis=unit_z_11)  # -> Geometry, Transform
line_16 = Line(StartPoint=rotate_3d_16.Geometry, EndPoint=rotate_3d_17.Geometry)
move_20 = Move(Geometry=rotate_3d_18.Geometry, Motion=unit_x_14)  # -> Geometry, Transform
panel_112 = Panel(unit_x_14)
list_item_42 = ListItem(List=construct_point_15, Index="4", Wrap=True)
line_17 = Line(StartPoint=rotate_3d_17.Geometry, EndPoint=rotate_3d_18.Geometry)
unit_x_15 = UnitX(Factor=expr("x/3", list_item_42))
rotate_3d_19 = Rotate3D(Geometry=move_20.Geometry, Angle=expr("x*(-4)", degrees(addition_9)), Center=rotate_3d_18.Geometry, Axis=unit_z_11)  # -> Geometry, Transform
move_21 = Move(Geometry=rotate_3d_19.Geometry, Motion=unit_x_15)  # -> Geometry, Transform
list_item_43 = ListItem(List=construct_point_15, Index="5", Wrap=True)
line_18 = Line(StartPoint=rotate_3d_18.Geometry, EndPoint=rotate_3d_19.Geometry)
rotate_3d_20 = Rotate3D(Geometry=move_21.Geometry, Angle=expr("x*(-5)", degrees(addition_9)), Center=rotate_3d_19.Geometry, Axis=unit_z_11)  # -> Geometry, Transform
unit_x_16 = UnitX(Factor=expr("x/3", list_item_43))
move_22 = Move(Geometry=rotate_3d_20.Geometry, Motion=unit_x_16)  # -> Geometry, Transform
line_19 = Line(StartPoint=rotate_3d_19.Geometry, EndPoint=rotate_3d_20.Geometry)
rotate_3d_21 = Rotate3D(Geometry=move_22.Geometry, Angle=expr("x*(-6)", degrees(addition_9)), Center=rotate_3d_20.Geometry, Axis=unit_z_11)  # -> Geometry, Transform
line_20 = Line(StartPoint=rotate_3d_20.Geometry, EndPoint=rotate_3d_21.Geometry)
set_union_2 = SetUnion(
    _5=rotate_3d_21.Geometry,
    _4=rotate_3d_20.Geometry,
    _3=rotate_3d_19.Geometry,
    _2=rotate_3d_18.Geometry,
    _1=rotate_3d_17.Geometry,
    _0=rotate_3d_16.Geometry)

data_rec_6 = PythonScript(x=rotate_3d_21.Geometry, enable=boolean, reset=bang_3.FalseState, limit=number_slider_10)  # -> x; inputs x: tree, enable: Boolean, reset: Boolean, limit: Int32; same code as data_rec
panel_113 = Panel(data_rec_6)
interpolate_t_13 = InterpolateT(Vertices=panel_113, TangentStart=Vector(0, 0, 0), TangentEnd=Vector(0, 0, 0), KnotStyle=1)  # -> Curve, Length, Domain
line_21 = Line([line_20, line_19, line_18, line_17, line_16, line_15])
custom_preview_13 = CustomPreview(
    Geometry=[interpolate_t_13.Curve, line_21],
    Material={diffuse=RGB(255, 255, 0), emission=RGB(66, 48, 66), shine=0.5, specular=RGB(255, 255, 255), transparency=0})
point_4 = Point(set_union_2)
data_rec_7 = PythonScript(x=[point_3, point_4], enable=panel_39, reset=bang.TrueState, limit=Slider(29, range=0..100))  # -> x; inputs x: tree, enable: Boolean, reset: Boolean, limit: Int32; same code as data_rec
panel_114 = Panel(data_rec_7)
point_5 = Point(data_rec_7)
dispatch_2 = Dispatch(List=data_rec_7, DispatchPattern=boolean_2)  # -> ListA, ListB
interconnectpoints = InterconnectPoints(Pts=dispatch_2.ListA)
custom_preview_14 = CustomPreview(Geometry=interconnectpoints, Material=colour_hsv)
