# Grasshopper definition vectorgraphics_LOFT_24(moving drawing machine).gh (Grasshopper 1.0.7)
# plug-ins: Firefly.X, Kangaroo2 Components, Firefly.Core

timer = Timer(TimerInterval=20, Target=[data_recorder, serial_read_generic_2])
number_of_lists = Slider(10, range=0..10)

frame_rate = FrameRate()  # -> simplify(flatten(RefreshRate)), Frequency
panel = Panel(frame_rate.RefreshRate)
panel_2 = Panel(frame_rate.Frequency)

integer = Integer(1)
data_recorder = DataRecorder(integer, DataLimit=-360, RecordData=True)
mass_addition = MassAddition(Input=data_recorder)  # -> Result, PartialResults
panel_3 = Panel(mass_addition.Result)
number_of_lists_2 = Slider(14, range=0..30)
height_between_loft_segments = Slider(10, range=0..10)
mass_addition_2 = MassAddition(Input=data_recorder)  # -> Result, PartialResults

number_slider = Slider(36, range=0..100)
multiplication = Multiplication(A=mass_addition.Result, B=number_slider)
series = Series(Start=multiplication, Step=26, Count=number_of_lists)
division = Division(A=Slider(360, range=0..1000), B=number_slider)
panel_4 = Panel(series)
panel_5 = Panel(division)

_1 = Integer(1)
series_2 = Series(Start=Slider(1, range=0..10), Step=0.7, Count=number_of_lists_2)
addition = Addition(A=_1, B=height_between_loft_segments)
unit_z = UnitZ(Factor=_1)
multiplication_2 = Multiplication(A=series_2, B=series_2)
panel_6 = Panel(multiplication)
panel_7 = Panel(multiplication_2)
surface = Surface()  # disabled

series_3 = Series(Start=mass_addition_2.Result, Step=Slider(35, range=0..100), Count=number_of_lists_2)
multiplication_3 = Multiplication(A=series_3, B=Slider(9, range=0..10))
panel_8 = Panel(series_3)

unit_z_2 = UnitZ(Factor=1)
number_slider_2 = Slider(74, range=0..1000)
number_slider_3 = Slider(0.4, range=0..5)
unit_z_3 = UnitZ(Factor=1)
multiplication_4 = Multiplication(A=unit_z_3, B=-1)
construct_domain = ConstructDomain(DomainStart=Slider(0, range=0..100), DomainEnd=Slider(1, range=0..1))
_1_2 = Integer(1)
_0 = Integer(0)
construct_domain_2 = ConstructDomain(DomainStart=Slider(10, range=10..72), DomainEnd=Slider(72, range=10..72))
construct_domain_3 = ConstructDomain(DomainStart=Slider(19, range=15..100), DomainEnd=Slider(146, range=0..165))
construct_domain_4 = ConstructDomain(DomainStart=Slider(0, range=0..100), DomainEnd=Slider(180, range=0..180))
number_slider_4 = Slider(4, range=0..10)
timer_2 = Timer(TimerInterval=1000, Target=serial_read_generic)
serial_read_generic = SerialReadGeneric(StartReadingValues=Toggle(True), PortNumber=number_slider_4)  # -> SerialOutput, StatusMessage
timer_3 = Timer(TimerInterval=1000)
panel_9 = Panel(serial_read_generic.SerialOutput)
write = SerialWriteGeneric(StartWritingValues=Button(), WriteData=Slider(0, range=0..1), PortNumber=number_slider_4)  # -> ArduinoOutput, StatusMessage
write_2 = SerialWriteGeneric(StartWritingValues=Button(), WriteData=Slider(1, range=0..1), PortNumber=number_slider_4)  # -> ArduinoOutput, StatusMessage
write_3 = SerialWriteGeneric(StartWritingValues=Button(), WriteData="P90,90,90,90,140,140,50", PortNumber=number_slider_4)  # -> ArduinoOutput, StatusMessage
data_recorder_2 = DataRecorder(write_2.ArduinoOutput, DataLimit=-10, RecordData=True)
data_recorder_3 = DataRecorder(write.ArduinoOutput, DataLimit=-10, RecordData=True)
data_recorder_4 = DataRecorder(write_3.ArduinoOutput, DataLimit=-10, RecordData=True)
panel_10 = Panel(data_recorder_4)
panel_11 = Panel(data_recorder_3)
panel_12 = Panel(data_recorder_2)
number_slider_5 = Slider(0.678, range=0..1)
number_slider_6 = Slider(60, range=0..100)
button = Button()
integer_2 = Integer(1)
number_slider_7 = Slider(4, range=0..10)

frame_rate_2 = FrameRate()  # -> simplify(flatten(RefreshRate)), Frequency
panel_13 = Panel(frame_rate_2.RefreshRate)
panel_14 = Panel(frame_rate_2.Frequency)

toggle = BooleanToggle(True)
ports_available = COMPortsAvailable()
panel_15 = Panel(ports_available)
panel_16 = Panel("9600")
serial_read_generic_2 = SerialReadGeneric(StartReadingValues=toggle, PortNumber="3")  # -> SerialOutput, StatusMessage
open_port = OpenClosePort(OpenClosePort=toggle, PortNumber="3", BaudRate="115200")
panel_17 = Panel(serial_read_generic_2.StatusMessage)
panel_18 = Panel(open_port)
panel_19 = Panel(serial_read_generic_2.SerialOutput)
text_split = TextSplit(Text=serial_read_generic_2.SerialOutput, Separators=", ")
panel_20 = Panel(text_split)
list_length = ListLength(List=text_split)
series_4 = Series(Start=Slider(0, range=0..100), Step=Slider(2, range=0..10), Count=expr("x/2", list_length))
list_item = ListItem(List=text_split, Index=series_4, Wrap=True)  # -> graft(Item)
data_rec = PythonScript(x=list_item, enable=Toggle(True), reset=Button(), limit=Slider(365, range=0..1500))  # -> x; inputs x: tree, enable: Boolean, reset: Boolean, limit: Int32
# ---------- data_rec: Python ----------
from Grasshopper import DataTree
if reset or 'rec' not in globals(): rec = DataTree[object]()
if enable and not reset: rec.MergeTree(x)
if limit > 0:
  for branch in rec.Branches:
    if branch.Count > limit:
      branch.RemoveRange(0, branch.Count - limit)
x = rec
# ---------- end data_rec ----------
sort_list = SortList(Keys=data_rec)  # -> Keys, ValuesValuesA
panel_21 = Panel(data_rec)
list_length_2 = ListLength(List=sort_list.Keys)
list_item_2 = ListItem(List=sort_list.Keys, Index=expr("x-1", list_length_2), Wrap=True)
panel_22 = Panel(list_item_2)

open_close_port = OpenClosePort(OpenClosePort=toggle, PortNumber=Slider(4, range=0..10), BaudRate=115200)
panel_23 = Panel(open_close_port)

panel_24 = Panel(list_item)
list_item_3 = ListItem(List=sort_list.Keys, Index=0, Wrap=True)

directions = Slider(60, range=3..60)
explode_tree = ExplodeTree(Data=panel_21)  # -> _0000, _0001, _0002, _0003, _0004, _0005, _0006, _0007, _0008, _0009
list_length_3 = ListLength(List=explode_tree._0009)
series_5 = Series(Start=expr("x-1", list_length_3), Step=-1, Count=Slider(10, range=0..100))
construct_domain_5 = ConstructDomain(DomainStart=Slider(590, range=0..600), DomainEnd=Slider(1000, range=0..1000))
construct_domain_6 = ConstructDomain(DomainStart=Slider(0, range=0..100), DomainEnd=directions)
list_item_4 = ListItem(List=explode_tree._0009, Index=series_5, Wrap=True)
remap_numbers = RemapNumbers(Value=list_item_4, Source=construct_domain_5, Target=construct_domain_6)  # -> Mapped, Clipped
stepsize = Slider(6, range=0.1..10)
integer_3 = Integer(remap_numbers.Mapped)
cir = Circle(Plane=PlaneXY(0, 0, 0), Radius=stepsize)
divide = DivideCurve(Curve=cir, Count=directions, Kinks=False)  # -> Points, Tangents, Parameters
vec = Vector(divide.Points)
list_item_5 = ListItem(List=vec, Index=integer_3, Wrap=True)
custom_preview = CustomPreview(
    Geometry=list_item_5,
    Material={diffuse=RGB(221, 160, 221), emission=RGB(66, 48, 66), shine=0.5, specular=RGB(255, 255, 255), transparency=0})
ma = MassAddition(Input=list_item_5)  # -> Result, PartialResults
start = Point(Point(0, 0, 0))
move = Move(Geometry=start, Motion=ma.PartialResults)  # -> Geometry, Transform
panel_26 = Panel(move.Geometry)
merge = Merge(Data1=flatten(start), Data2=flatten(move.Geometry))
list_length_4 = ListLength(List=merge)
list_item_6 = ListItem(List=merge, Index=expr("x-1", list_length_4), Wrap=True)
interpolate_t = InterpolateT(Vertices=merge, TangentStart=Vector(0, 0, 0), TangentEnd=Vector(0, 0, 0), KnotStyle=1)  # -> Curve, Length, Domain
custom_preview_2 = CustomPreview(
    Geometry=interpolate_t.Curve,
    Material={diffuse=RGB(221, 160, 221), emission=RGB(66, 48, 66), shine=0.5, specular=RGB(255, 255, 255), transparency=0})

construct_domain_7 = ConstructDomain(DomainStart=list_item_3, DomainEnd=list_item_2)
panel_27 = Panel(construct_domain_7)

remap_numbers_2 = RemapNumbers(Value=list_item, Source=construct_domain_7, Target=construct_domain)  # -> Mapped, Clipped
list_length_5 = ListLength(List=flatten(remap_numbers_2.Mapped))

multiplication_5 = Multiplication(A=panel_3, B=Slider(2, range=0..10))
series_6 = Series(Start=panel_3, Step=multiplication_5, Count=list_length_5)
panel_28 = Panel(series_6)
_1_3 = Integer(1)
random = Random(Range=Domain(0, 1), Number=_1_3, Seed=series_6)

panel_29 = Panel(list_length_5)
panel_30 = Panel(remap_numbers_2.Mapped)
deconstruct = Deconstruct(Point=list_item_6)  # -> XComponent, YComponent, ZComponent
list_item_7 = ListItem(List=flatten(remap_numbers_2.Mapped), Index="9", Wrap=True)
list_item_8 = ListItem(List=flatten(remap_numbers_2.Mapped), Index="8", Wrap=True)
average = Average(Input=[list_item_8, list_item_7])
panel_32 = Panel(list_item_8)
panel_33 = Panel(list_item_7)

smaller_than = SmallerThan(FirstNumber=number_slider_5, SecondNumber=average)  # -> SmallerThan, OrEqualTo
larger_than = LargerThan(FirstNumber=number_slider_5, SecondNumber=average)  # -> LargerThan, OrEqualTo
cull_pattern = CullPattern(List="true", CullPattern=smaller_than.SmallerThan)
cull_pattern_2 = CullPattern(List="false", CullPattern=larger_than.LargerThan)
panel_34 = Panel([cull_pattern_2, cull_pattern])

list_item_9 = ListItem(List=flatten(remap_numbers_2.Mapped), Index="7", Wrap=True)
panel_35 = Panel(list_item_9)
bang = Bang(BooleanInput=panel_34)  # -> TrueState, FalseState
panel_36 = Panel(bang.TrueState)

larger_than_2 = LargerThan(FirstNumber=list_item_9, SecondNumber=0)  # -> LargerThan, OrEqualTo
smaller_than_2 = SmallerThan(FirstNumber=list_item_9, SecondNumber=1)  # -> SmallerThan, OrEqualTo
cull_pattern_3 = CullPattern(List="true", CullPattern=larger_than_2.LargerThan)
cull_pattern_4 = CullPattern(List="false", CullPattern=smaller_than_2.SmallerThan)
panel_37 = Panel([cull_pattern_3, cull_pattern_4])

bang_2 = Bang(BooleanInput=panel_37)  # -> TrueState, FalseState
panel_38 = Panel(bang_2.TrueState)
data_rec_2 = PythonScript(x=integer_2, enable=Toggle(True), reset=bang_2.TrueState, limit=Slider(80, range=0..200))  # -> x; inputs x: tree, enable: Boolean, reset: Boolean, limit: Int32; same code as data_rec
mass_addition_3 = MassAddition(Input=data_rec_2)  # -> Result, PartialResults
panel_39 = Panel(mass_addition_3.Result)
modulus = Modulus(A=mass_addition_3.Result, B=number_slider_7)
panel_40 = Panel(modulus)
smaller_than_3 = SmallerThan(FirstNumber=modulus, SecondNumber=expr("x-1", number_slider_7))  # -> SmallerThan, OrEqualTo
boolean = Boolean(invert(panel_37))
panel_41 = Panel(boolean)
bang_3 = Bang(BooleanInput=boolean)  # -> TrueState, FalseState
panel_42 = Panel(bang_3.FalseState)

integer_4 = Integer(-10)  # disabled

list_item_10 = ListItem(List=flatten(remap_numbers_2.Mapped), Index="9", Wrap=True)

multiplication_6 = Multiplication(A=Slider(2, range=0..2), B=list_item_10)

panel_43 = Panel(multiplication_6)

unit_z_4 = UnitZ(Factor=multiplication_6)
series_7 = Series(Start=unit_z_4, Step=Slider(2, range=0..10), Count=number_of_lists)
list_length_6 = ListLength(List=series_7)
list_item_11 = ListItem(List=series_7, Index=expr("x-1", list_length_6), Wrap=True)
panel_44 = Panel(list_item_11)
panel_45 = Panel(series_7)
panel_46 = Panel(unit_z_4)

increse_distance_from_centre = Slider(2, range=0..5)
addition_2 = Addition(A=remap_numbers_2.Mapped, B=increse_distance_from_centre)  # -> flatten(Result)
construct_point = ConstructPoint(XCoordinate=addition_2, YCoordinate=Slider(0, range=0..100), ZCoordinate=series_7)
panel_47 = Panel(construct_point)

list_length_7 = ListLength(List=series_7)  # disabled
list_item_12 = ListItem(List=series_7, Index=expr("x-1", list_length_7), Wrap=True)  # disabled
list_item_13 = ListItem(List=series_7, Index=0, Wrap=True)  # disabled
construct_point_2 = ConstructPoint(XCoordinate=integer_4, YCoordinate=0, ZCoordinate=list_item_13)  # disabled
construct_point_3 = ConstructPoint(XCoordinate=integer_4, YCoordinate=0, ZCoordinate=list_item_12)  # disabled
line = Line(StartPoint=construct_point_2, EndPoint=construct_point_3)  # disabled
divide_curve = DivideCurve(Curve=line, Count=number_of_lists, Kinks=False)  # -> Points, Tangents, Parameters; disabled
unit_x = UnitX(Factor=addition_2)  # disabled
move_2 = Move(Geometry=divide_curve.Points, Motion=unit_x)  # -> Geometry, Transform; disabled
line_2 = Line(StartPoint=divide_curve.Points, EndPoint=move_2.Geometry)  # disabled

addition_3 = Addition(A=list_item_11, B=7)
series_8 = Series(Start=addition_3, Step=addition, Count=number_of_lists_2)
construct_point_4 = ConstructPoint(XCoordinate=deconstruct.XComponent, YCoordinate=deconstruct.YComponent, ZCoordinate=multiplication_6)
point = Point(construct_point_4)
deconstruct_2 = Deconstruct(Point=point)  # -> XComponent, YComponent, ZComponent
addition_4 = Addition(A=[deconstruct_2.XComponent, deconstruct_2.YComponent], B=multiplication_2)
construct_point_5 = ConstructPoint(XCoordinate=flatten(addition_4), YCoordinate=deconstruct_2.YComponent, ZCoordinate=series_8)
construct_point_6 = ConstructPoint(XCoordinate=deconstruct_2.XComponent, YCoordinate=deconstruct_2.YComponent, ZCoordinate=Slider(0, range=0..100))
panel_48 = Panel(construct_point_6)
panel_49 = Panel(construct_point_5)
move_3 = Move(Geometry=construct_point, Motion=construct_point_4)  # -> Geometry, Transform
rotate_3d = Rotate3D(Geometry=move_3.Geometry, Angle=degrees(series), Center=construct_point_4, Axis=unit_z_2)  # -> graft(Geometry), Transform

rotate_3d_2 = Rotate3D(Geometry=construct_point_5, Angle=degrees(multiplication_3), Center=construct_point_6, Axis=unit_z)  # -> flatten(Geometry), Transform
panel_50 = Panel(rotate_3d_2.Geometry)
interpolate_t_2 = InterpolateT(Vertices=rotate_3d_2.Geometry, TangentStart=Vector(0, 0, 0), TangentEnd=Vector(0, 0, 0), KnotStyle=1)  # -> Curve, Length, Domain
divide_curve_2 = DivideCurve(Curve=interpolate_t_2.Curve, Count=Slider(60, range=0..100), Kinks=False)  # -> Points, Tangents, Parameters
panel_51 = Panel(divide_curve_2.Points)

panel_52 = Panel(rotate_3d.Geometry)  # disabled
deconstruct_3 = Deconstruct(Point=list_item_6)  # -> XComponent, YComponent, ZComponent; disabled
deconstruct_4 = Deconstruct(Point=flatten(panel_52))  # -> XComponent, YComponent, ZComponent; disabled
subtraction = Subtraction(A=deconstruct_4.YComponent)  # disabled
subtraction_2 = Subtraction(A=deconstruct_4.XComponent)  # disabled
multiplication_7 = Multiplication(A=flatten(subtraction), B=flatten(subtraction))  # disabled
multiplication_8 = Multiplication(A=flatten(subtraction_2), B=flatten(subtraction_2))  # disabled
addition_5 = Addition(A=multiplication_8, B=multiplication_7)  # disabled
square_root = SquareRoot(Value=addition_5)  # disabled
panel_53 = Panel(square_root)  # disabled

number_slider_8 = Slider(18, range=0..20)
series_9 = Series(Start=Slider(0, range=0..10), Step=Slider(2, range=0..10), Count=number_slider_8)
panel_54 = Panel(series_9)
division_2 = Division(A=panel_54, B=Slider(20, range=0..20))
panel_55 = Panel(division_2)
multiplication_9 = Multiplication(A=series_9, B=panel_55)
integer_5 = Integer(multiplication_9)
list_item_14 = ListItem(List=divide_curve_2.Points, Index=integer_5, Wrap=True)

multiplication_10 = Multiplication(A=mass_addition_2.Result, B=Slider(1, range=0..1))
series_10 = Series(Start=multiplication_10, Step=1, Count=number_slider_8)
sine = Sine(Value=series_10)
unit_z_5 = UnitZ(Factor=sine)
multiplication_11 = Multiplication(A=unit_z_5, B=Slider(4, range=0..10))
multiplication_12 = Multiplication(A=multiplication_11, B=-1)

move_4 = Move(Geometry=list_item_14, Motion=multiplication_11)  # -> Geometry, Transform
move_5 = Move(Geometry=list_item_14, Motion=multiplication_12)  # -> Geometry, Transform
construct_point_7 = ConstructPoint(XCoordinate=deconstruct_2.XComponent, YCoordinate=deconstruct_2.YComponent, ZCoordinate=0)
division_3 = Division(A=list_item_11, B=Slider(2, range=0..10))
construct_point_8 = ConstructPoint(XCoordinate=0, YCoordinate=0, ZCoordinate=division_3)
plane_normal = PlaneNormal(Origin=construct_point_8, ZAxis=Vector(0, 0, 1))
number_slider_9 = Slider(1, range=0..5)
number_slider_10 = Slider(167, range=0..360)
mirror = Mirror(Geometry=move_5.Geometry, Plane=plane_normal)  # -> Geometry, Transform
mirror_2 = Mirror(Geometry=move_4.Geometry, Plane=plane_normal)  # -> Geometry, Transform
multiplication_13 = Multiplication(A=number_slider_9, B=-1)
unit_z_6 = UnitZ(Factor=multiplication_13)
unit_z_7 = UnitZ(Factor=number_slider_9)
rotate_3d_3 = Rotate3D(Geometry=mirror_2.Geometry, Angle=degrees(number_slider_10), Center=construct_point_7, Axis=Vector(0, 0, 1))  # -> Geometry, Transform
rotate_3d_4 = Rotate3D(Geometry=mirror.Geometry, Angle=degrees(number_slider_10), Center=construct_point_7, Axis=Vector(0, 0, 1))  # -> Geometry, Transform
interpolate_t_3 = InterpolateT(Vertices=move_5.Geometry, TangentStart=unit_z_7, TangentEnd=Vector(0, 0, 0), KnotStyle=1)  # -> Curve, Length, Domain
interpolate_t_4 = InterpolateT(Vertices=rotate_3d_3.Geometry, TangentStart=unit_z_6, TangentEnd=Vector(0, 0, 0), KnotStyle=1)  # -> Curve, Length, Domain

deconstruct_5 = Deconstruct(Point=construct_point_4)  # -> XComponent, YComponent, ZComponent

multiplication_14 = Multiplication(A=multiplication_6, B=Slider(10, range=0..10))
construct_point_9 = ConstructPoint(XCoordinate=0, YCoordinate=0, ZCoordinate=multiplication_14)
panel_56 = Panel(construct_point_9)
addition_6 = Addition(A=panel_56, B=construct_point_4)
panel_57 = Panel(addition_6)

number = Number(addition_2)
interpolate_t_5 = InterpolateT(Vertices=move_4.Geometry, TangentStart=unit_z_3, TangentEnd=Vector(0, 0, 0), KnotStyle=1)  # -> reparameterize(Curve), Length, Domain
interpolate_t_6 = InterpolateT(Vertices=rotate_3d_4.Geometry, TangentStart=multiplication_4, TangentEnd=Vector(0, 0, 0), KnotStyle=1)  # -> reparameterize(Curve), Length, Domain
point_2 = Point(construct_point_7)
rotate_3d_5 = Rotate3D(
    Geometry=[interpolate_t_5.Curve, interpolate_t_6.Curve],
    Angle=degrees(Slider(90, range=0..360)),
    Center=point_2,
    Axis=Vector(0, 0, 1))  # -> Geometry, Transform
rotate_3d_6 = Rotate3D(
    Geometry=[interpolate_t_5.Curve, interpolate_t_6.Curve],
    Angle=degrees(Slider(270, range=0..360)),
    Center=point_2,
    Axis=Vector(0, 0, 1))  # -> Geometry, Transform
rotate_3d_7 = Rotate3D(
    Geometry=[interpolate_t_5.Curve, interpolate_t_6.Curve],
    Angle=degrees(Slider(180, range=0..360)),
    Center=point_2,
    Axis=Vector(0, 0, 1))  # -> Geometry, Transform
point_3 = Point(addition_6)

number_slider_11 = Slider(36, range=0..36)
# limitation of math to describe complexity how we learnt it. pyhtagarous, sine waves etc, understand the line. Black magic is to make that line look alive.
# 
# How to draw simplicity out of complexity?
number_slider_12 = Slider(100, range=0..100)
increse_distance_from_centre_2 = Slider(25, range=0..30)
list_length_8 = ListLength(List=construct_point)
multiplication_15 = Multiplication(A=mass_addition.Result, B=number_slider_12)
addition_7 = Addition(A=number, B=increse_distance_from_centre_2)  # -> flatten(Result)
division_4 = Division(A=multiplication_15, B=list_length_8)
construct_point_10 = ConstructPoint(XCoordinate=addition_7, YCoordinate=_0, ZCoordinate=series_7)
unit_z_8 = UnitZ(Factor=_1_2)
multiplication_16 = Multiplication(A=division_4, B=Slider(1, range=0..1))
panel_58 = Panel(unit_z_8)
panel_59 = Panel(construct_point_10)
panel_60 = Panel(multiplication_16)
list_item_15 = ListItem(List=construct_point_10, Index="0", Wrap=True)
unit_x_2 = UnitX(Factor=list_item_15)
panel_61 = Panel(unit_x_2)
list_item_16 = ListItem(List=construct_point_10, Index="1", Wrap=True)
move_6 = Move(Geometry=addition_6, Motion=unit_x_2)  # -> Geometry, Transform
panel_62 = Panel(list_item_16)
unit_x_3 = UnitX(Factor=expr("x/2", list_item_16))
panel_63 = Panel(move_6.Geometry)
rotate_3d_8 = Rotate3D(Geometry=move_6.Geometry, Angle=degrees(multiplication_16), Center=point_3, Axis=unit_z_8)  # -> Geometry, Transform
panel_64 = Panel(unit_x_3)
list_item_17 = ListItem(List=construct_point_10, Index="2", Wrap=True)
move_7 = Move(Geometry=rotate_3d_8.Geometry, Motion=unit_x_3)  # -> Geometry, Transform
unit_x_4 = UnitX(Factor=expr("x/3", list_item_17))
line_3 = Line(StartPoint=addition_6, EndPoint=rotate_3d_8.Geometry)
panel_65 = Panel(move_7.Geometry)
panel_66 = Panel(unit_x_4)
list_item_18 = ListItem(List=construct_point_10, Index="3", Wrap=True)
rotate_3d_9 = Rotate3D(Geometry=move_7.Geometry, Angle=expr("x*2", degrees(multiplication_16)), Center=rotate_3d_8.Geometry, Axis=unit_z_8)  # -> Geometry, Transform
move_8 = Move(Geometry=rotate_3d_9.Geometry, Motion=unit_x_4)  # -> Geometry, Transform
unit_x_5 = UnitX(Factor=expr("x/3", list_item_18))
rotate_3d_10 = Rotate3D(Geometry=move_8.Geometry, Angle=expr("x*(3)", degrees(multiplication_16)), Center=rotate_3d_9.Geometry, Axis=unit_z_8)  # -> Geometry, Transform
line_4 = Line(StartPoint=rotate_3d_8.Geometry, EndPoint=rotate_3d_9.Geometry)
move_9 = Move(Geometry=rotate_3d_10.Geometry, Motion=unit_x_5)  # -> Geometry, Transform
panel_67 = Panel(unit_x_5)
list_item_19 = ListItem(List=construct_point_10, Index="4", Wrap=True)
line_5 = Line(StartPoint=rotate_3d_9.Geometry, EndPoint=rotate_3d_10.Geometry)
unit_x_6 = UnitX(Factor=expr("x/3", list_item_19))
rotate_3d_11 = Rotate3D(Geometry=move_9.Geometry, Angle=expr("x*(4)", degrees(multiplication_16)), Center=rotate_3d_10.Geometry, Axis=unit_z_8)  # -> Geometry, Transform
move_10 = Move(Geometry=rotate_3d_11.Geometry, Motion=unit_x_6)  # -> Geometry, Transform
list_item_20 = ListItem(List=construct_point_10, Index="5", Wrap=True)
line_6 = Line(StartPoint=rotate_3d_10.Geometry, EndPoint=rotate_3d_11.Geometry)
rotate_3d_12 = Rotate3D(Geometry=move_10.Geometry, Angle=expr("x*(5)", degrees(multiplication_16)), Center=rotate_3d_11.Geometry, Axis=unit_z_8)  # -> Geometry, Transform
unit_x_7 = UnitX(Factor=expr("x/3", list_item_20))
move_11 = Move(Geometry=rotate_3d_12.Geometry, Motion=unit_x_7)  # -> Geometry, Transform
list_item_21 = ListItem(List=construct_point_10, Index="6", Wrap=True)
line_7 = Line(StartPoint=rotate_3d_11.Geometry, EndPoint=rotate_3d_12.Geometry)
unit_x_8 = UnitX(Factor=expr("x/3", list_item_21))
rotate_3d_13 = Rotate3D(Geometry=move_11.Geometry, Angle=expr("x*(6)", degrees(multiplication_16)), Center=rotate_3d_12.Geometry, Axis=unit_z_8)  # -> Geometry, Transform
list_item_22 = ListItem(List=construct_point_10, Index="7", Wrap=True)
move_12 = Move(Geometry=rotate_3d_13.Geometry, Motion=unit_x_8)  # -> Geometry, Transform
unit_x_9 = UnitX(Factor=expr("x/3", list_item_22))
line_8 = Line(StartPoint=rotate_3d_12.Geometry, EndPoint=rotate_3d_13.Geometry)
rotate_3d_14 = Rotate3D(Geometry=move_12.Geometry, Angle=expr("x*(7)", degrees(multiplication_16)), Center=rotate_3d_13.Geometry, Axis=unit_z_8)  # -> Geometry, Transform
move_13 = Move(Geometry=rotate_3d_14.Geometry, Motion=unit_x_9)  # -> Geometry, Transform
panel_68 = Panel(unit_x_9)
rotate_3d_15 = Rotate3D(Geometry=move_13.Geometry, Angle=expr("x*(8)", degrees(multiplication_16)), Center=rotate_3d_14.Geometry, Axis=unit_z_8)  # -> Geometry, Transform
line_9 = Line(StartPoint=rotate_3d_13.Geometry, EndPoint=rotate_3d_14.Geometry)
line_10 = Line(StartPoint=rotate_3d_14.Geometry, EndPoint=rotate_3d_15.Geometry)
set_union = SetUnion(
    _8=rotate_3d_15.Geometry,
    _6=rotate_3d_14.Geometry,
    _5=rotate_3d_13.Geometry,
    _4=rotate_3d_12.Geometry,
    _3=rotate_3d_11.Geometry,
    _2=rotate_3d_10.Geometry,
    _1=rotate_3d_9.Geometry,
    _0=rotate_3d_8.Geometry)

line_11 = Line([line_10, line_9, line_8, line_7, line_6, line_5, line_4, line_3])
data_rec_3 = PythonScript(x=rotate_3d_15.Geometry, enable=Toggle(True), reset=bang_2.TrueState, limit=number_slider_6)  # -> x; inputs x: tree, enable: Boolean, reset: Boolean, limit: Int32; same code as data_rec
panel_69 = Panel(data_rec_3)
custom_preview_3 = CustomPreview(
    Geometry=line_11,
    Material={diffuse=RGB(0, 255, 255), emission=RGB(66, 48, 66), shine=0.5, specular=RGB(255, 255, 255), transparency=0})
cull_pattern_5 = CullPattern(List=data_rec_3, CullPattern=smaller_than_3.SmallerThan)
interpolate = Interpolate(Vertices=cull_pattern_5, Degree=3, Periodic=False, KnotStyle=1)  # -> Curve, Length, Domain
panel_70 = Panel(cull_pattern_5)
custom_preview_4 = CustomPreview(
    Geometry=interpolate.Curve,
    Material={diffuse=RGB(0, 255, 255), emission=RGB(66, 48, 66), shine=0.5, specular=RGB(255, 255, 255), transparency=0})

number_slider_13 = Slider(22, range=0..40)  # disabled
number_slider_14 = Slider(7, range=0..10)  # disabled
panel_71 = Panel(series_7)  # disabled
construct_point_11 = ConstructPoint(XCoordinate=0, YCoordinate=number_slider_13, ZCoordinate=panel_71)  # disabled
construct_point_12 = ConstructPoint(XCoordinate=0, YCoordinate=number_slider_14, ZCoordinate=panel_71)  # disabled
number_slider_15 = Slider(0.25, range=0..1)  # disabled
line_12 = Line(StartPoint=construct_point_12, EndPoint=construct_point_11)  # disabled
curve = Curve(line_12)  # disabled
divide_curve_3 = DivideCurve(Curve=curve, Count=9, Kinks=False)  # -> Points, Tangents, Parameters; disabled

data_rec_4 = PythonScript(x=rotate_3d.Geometry, enable=Toggle(True), reset=Button(), limit=panel_5)  # -> x; inputs x: tree, enable: Boolean, reset: Boolean, limit: Int32; same code as data_rec
panel_72 = Panel(data_rec_4)
interpolate_2 = Interpolate(Vertices=data_rec_4, Degree=Slider(5, range=1..11), Periodic=True, KnotStyle=1)  # -> flatten(Curve), Length, Domain
panel_73 = Panel(interpolate_2.Curve)

loft = Loft(
    Curves=interpolate_2.Curve,
    Options={Adjust=False, Closed=False, LoftEnds=0, LoftSimp=0, LoftType=1, Rebuild=10, Refit=0.01})

divide_surface = DivideSurface(Surface=loft, UCount=Slider(6, range=0..10), VCount=Slider(2, range=0..10))  # -> Points, Normals, Parameters
list_item_23 = ListItem(List=divide_surface.Points, Index=Slider(1, range=0..1), Wrap=True)
deconstruct_6 = Deconstruct(Point=list_item_23)  # -> XComponent, YComponent, ZComponent
panel_74 = Panel(list_item_23)

number_2 = Number(deconstruct_6.XComponent)  # disabled
number_3 = Number(deconstruct_6.ZComponent)  # disabled

construct_point_13 = ConstructPoint(XCoordinate=0, YCoordinate=number_slider_13, ZCoordinate=flatten(number_3))  # disabled
construct_point_14 = ConstructPoint(XCoordinate=0, YCoordinate=number_slider_14, ZCoordinate=flatten(number_3))  # disabled
line_13 = Line(StartPoint=construct_point_14, EndPoint=construct_point_13)  # disabled
curve_2 = Curve(line_13)  # disabled
deconstruct_7 = Deconstruct(Point=panel_72)  # -> XComponent, YComponent, ZComponent; disabled
dispatch = Dispatch(List=curve_2, DispatchPattern=[False, True, True, True, True, True, True, False])  # -> ListA, ListB; disabled
multiplication_17 = Multiplication(A=flatten(number_2), B=number_slider_15)  # disabled
divide_curve_4 = DivideCurve(Curve=curve_2, Count=9, Kinks=False)  # -> Points, Tangents, Parameters; disabled
unit_z_9 = UnitZ(Factor=multiplication_17)  # disabled
multiplication_18 = Multiplication(A=deconstruct_7.XComponent, B=number_slider_15)  # disabled
move_14 = Move(Geometry=divide_curve_4.Points, Motion=unit_z_9)  # -> flatten(Geometry), Transform; disabled
unit_z_10 = UnitZ(Factor=multiplication_18)  # disabled
move_15 = Move(Geometry=divide_curve_3.Points, Motion=unit_z_10)  # -> flatten(Geometry), Transform; disabled
panel_75 = Panel(move_14.Geometry)  # disabled
panel_76 = Panel(move_15.Geometry)  # disabled

custom_preview_5 = CustomPreview(
    Geometry=[move_14.Geometry, move_15.Geometry],
    Material={diffuse=RGB(221, 160, 221), emission=RGB(66, 48, 66), shine=0.5, specular=RGB(255, 255, 255), transparency=0})  # disabled
interpolate_3 = Interpolate(Vertices=list_item_23, Degree=3, Periodic=False, KnotStyle=1)  # -> Curve, Length, Domain
number_4 = Number(flatten(deconstruct_6.XComponent))
subtraction_3 = Subtraction(A=deconstruct_6.XComponent, B=deconstruct_5.XComponent)
subtraction_4 = Subtraction(A=deconstruct_6.YComponent, B=deconstruct_5.YComponent)
multiplication_19 = Multiplication(A=flatten(subtraction_4), B=flatten(subtraction_4))
multiplication_20 = Multiplication(A=flatten(subtraction_3), B=flatten(subtraction_3))
addition_8 = Addition(A=multiplication_20, B=multiplication_19)
square_root_2 = SquareRoot(Value=addition_8)
data_rec_5 = PythonScript(x=square_root_2, enable=Toggle(True), reset=Button(), limit=number_slider_2)  # -> x; inputs x: tree, enable: Boolean, reset: Boolean, limit: Int32; same code as data_rec
sort_list_2 = SortList(Keys=data_rec_5)  # -> Keys, ValuesValuesA
list_item_24 = ListItem(List=sort_list_2.Keys, Index=0, Wrap=True)
list_item_25 = ListItem(List=sort_list_2.Keys, Index=expr("x-1", number_slider_2), Wrap=True)
panel_77 = Panel(square_root_2)
construct_domain_8 = ConstructDomain(DomainStart=list_item_24, DomainEnd=list_item_25)

list_length_9 = ListLength(List=interpolate_2.Curve)
list_item_26 = ListItem(List=interpolate_2.Curve, Index=expr("x-1", list_length_9), Wrap=True)
list_item_27 = ListItem(List=move_4.Geometry, Index=0, Wrap=True)
list_item_28 = ListItem(List=interpolate_2.Curve, Index=0, Wrap=True)
plane_normal_2 = PlaneNormal(Origin=list_item_27, ZAxis=Vector(0, 0, 1))
circle = Circle(Plane=plane_normal_2, Radius=number_slider_3)
list_item_29 = ListItem(List=rotate_3d_4.Geometry, Index=0, Wrap=True)
plane_normal_3 = PlaneNormal(Origin=list_item_29, ZAxis=Vector(0, 0, 1))
circle_2 = Circle(Plane=plane_normal_3, Radius=number_slider_3)
curve_3 = Curve([circle, list_item_26])
curve_4 = Curve([list_item_28, circle_2])
loft_options = LoftOptions(Closed=False, Adjust=True, Rebuild=0, Refit=0, Type=1)
loft_2 = Loft(Curves=flatten(curve_3), Options=loft_options)
loft_3 = Loft(Curves=flatten(curve_4), Options=loft_options)

panel_78 = Panel(construct_domain_8)

list_item_30 = ListItem(List=square_root_2, Index=0, Wrap=True)  # disabled
panel_79 = Panel(list_item_30)  # disabled
construct_point_15 = ConstructPoint(XCoordinate=integer_4, YCoordinate=0, ZCoordinate=0)  # disabled
unit_x_10 = UnitX(Factor=list_item_30)  # disabled
move_16 = Move(Geometry=construct_point_15, Motion=unit_x_10)  # -> Geometry, Transform; disabled
line_14 = Line(StartPoint=construct_point_15, EndPoint=move_16.Geometry)  # disabled

remap_numbers_3 = RemapNumbers(Value=square_root_2, Source=construct_domain_8, Target=construct_domain)  # -> flatten(Mapped), Clipped
panel_80 = Panel(remap_numbers_3.Mapped)
list_item_31 = ListItem(List=remap_numbers_3.Mapped, Index=Slider(6, range=0..10), Wrap=True)
list_item_32 = ListItem(List=remap_numbers_3.Mapped, Index=Slider(1, range=0..10), Wrap=True)
list_item_33 = ListItem(List=remap_numbers_3.Mapped, Index=Slider(2, range=0..10), Wrap=True)
list_item_34 = ListItem(List=remap_numbers_3.Mapped, Index=Slider(3, range=0..10), Wrap=True)
list_item_35 = ListItem(List=remap_numbers_3.Mapped, Index=Slider(4, range=0..10), Wrap=True)
list_item_36 = ListItem(List=remap_numbers_3.Mapped, Index=Slider(5, range=0..10), Wrap=True)
remap_numbers_4 = RemapNumbers(Value=list_item_33, Source=construct_domain, Target=construct_domain_3)  # -> Mapped, Clipped
remap_numbers_5 = RemapNumbers(Value=list_item_32, Source=construct_domain, Target=construct_domain_3)  # -> Mapped, Clipped
remap_numbers_6 = RemapNumbers(Value=list_item_34, Source=construct_domain, Target=construct_domain_3)  # -> Mapped, Clipped
remap_numbers_7 = RemapNumbers(Value=list_item_35, Source=construct_domain, Target=construct_domain_3)  # -> Mapped, Clipped
remap_numbers_8 = RemapNumbers(Value=list_item_36, Source=construct_domain, Target=construct_domain_3)  # -> Mapped, Clipped
remap_numbers_9 = RemapNumbers(Value=list_item_36, Source=construct_domain, Target=construct_domain_3)  # -> Mapped, Clipped
integer_6 = Integer(remap_numbers_5.Mapped)
integer_7 = Integer(remap_numbers_4.Mapped)
integer_8 = Integer(remap_numbers_6.Mapped)
integer_9 = Integer(remap_numbers_9.Mapped)
integer_10 = Integer(remap_numbers_7.Mapped)
integer_11 = Integer(remap_numbers_8.Mapped)
panel_81 = Panel([integer_6, integer_7, integer_8, integer_10, integer_11, integer_9])
list_item_37 = ListItem(List=panel_81, Index=0, Wrap=True)
panel_82 = Panel(["P", list_item_37])
text_join = TextJoin(Text=panel_82)
panel_83 = Panel([text_join, panel_81, "50"])
text_join_2 = TextJoin(Text=panel_83, Join=",")
write_4 = SerialWriteGeneric(StartWritingValues=Toggle(False), WriteData=text_join_2, PortNumber=number_slider_4)  # -> ArduinoOutput, StatusMessage
data_recorder_5 = DataRecorder(write_4.ArduinoOutput, DataLimit=-10, RecordData=True)

increse_distance_from_centre_3 = Slider(25, range=0..30)
number_5 = Number(square_root_2)
list_length_10 = ListLength(List=number_4)
panel_84 = Panel(deconstruct_6.ZComponent)
multiplication_21 = Multiplication(A=mass_addition.Result, B=Slider(100, range=0..100))
panel_85 = Panel(list_length_10)
addition_9 = Addition(A=increse_distance_from_centre_3, B=number_5)
division_5 = Division(A=multiplication_21, B=list_length_10)
flatten_tree = FlattenTree(Tree=panel_84, Path="{0}")
construct_point_16 = ConstructPoint(XCoordinate=addition_9, YCoordinate=_0, ZCoordinate=flatten_tree)
unit_z_11 = UnitZ(Factor=_1_2)
panel_86 = Panel(flatten_tree)
multiplication_22 = Multiplication(A=division_5, B=Slider(1, range=0..1))
panel_87 = Panel(unit_z_11)
panel_88 = Panel(construct_point_16)
panel_89 = Panel(multiplication_21)
addition_10 = Addition(A=multiplication_22, B="180")
panel_90 = Panel(addition_10)
list_item_38 = ListItem(List=construct_point_16, Index="0", Wrap=True)
unit_x_11 = UnitX(Factor=list_item_38)
panel_91 = Panel(unit_x_11)
list_item_39 = ListItem(List=construct_point_16, Index="1", Wrap=True)
multiplication_23 = Multiplication(A=addition_10, B="-1")
move_17 = Move(Geometry=addition_6, Motion=unit_x_11)  # -> Geometry, Transform
panel_92 = Panel(list_item_39)
unit_x_12 = UnitX(Factor=expr("x/2", list_item_39))
panel_93 = Panel(move_17.Geometry)
rotate_3d_16 = Rotate3D(Geometry=move_17.Geometry, Angle=degrees(multiplication_23), Center=point_3, Axis=unit_z_11)  # -> Geometry, Transform
panel_94 = Panel(unit_x_12)
move_18 = Move(Geometry=rotate_3d_16.Geometry, Motion=unit_x_12)  # -> Geometry, Transform
list_item_40 = ListItem(List=construct_point_16, Index="2", Wrap=True)
unit_x_13 = UnitX(Factor=expr("x/3", list_item_40))
line_15 = Line(StartPoint=addition_6, EndPoint=rotate_3d_16.Geometry)
panel_95 = Panel(unit_x_13)
list_item_41 = ListItem(List=construct_point_16, Index="3", Wrap=True)
rotate_3d_17 = Rotate3D(Geometry=move_18.Geometry, Angle=expr("x*-2", degrees(addition_10)), Center=rotate_3d_16.Geometry, Axis=unit_z_11)  # -> Geometry, Transform
move_19 = Move(Geometry=rotate_3d_17.Geometry, Motion=unit_x_13)  # -> Geometry, Transform
unit_x_14 = UnitX(Factor=expr("x/3", list_item_41))
rotate_3d_18 = Rotate3D(Geometry=move_19.Geometry, Angle=expr("x*(-3)", degrees(addition_10)), Center=rotate_3d_17.Geometry, Axis=unit_z_11)  # -> Geometry, Transform
line_16 = Line(StartPoint=rotate_3d_16.Geometry, EndPoint=rotate_3d_17.Geometry)
move_20 = Move(Geometry=rotate_3d_18.Geometry, Motion=unit_x_14)  # -> Geometry, Transform
panel_96 = Panel(unit_x_14)
list_item_42 = ListItem(List=construct_point_16, Index="4", Wrap=True)
line_17 = Line(StartPoint=rotate_3d_17.Geometry, EndPoint=rotate_3d_18.Geometry)
unit_x_15 = UnitX(Factor=expr("x/3", list_item_42))
rotate_3d_19 = Rotate3D(Geometry=move_20.Geometry, Angle=expr("x*(-4)", degrees(addition_10)), Center=rotate_3d_18.Geometry, Axis=unit_z_11)  # -> Geometry, Transform
move_21 = Move(Geometry=rotate_3d_19.Geometry, Motion=unit_x_15)  # -> Geometry, Transform
list_item_43 = ListItem(List=construct_point_16, Index="5", Wrap=True)
line_18 = Line(StartPoint=rotate_3d_18.Geometry, EndPoint=rotate_3d_19.Geometry)
rotate_3d_20 = Rotate3D(Geometry=move_21.Geometry, Angle=expr("x*(-5)", degrees(addition_10)), Center=rotate_3d_19.Geometry, Axis=unit_z_11)  # -> Geometry, Transform
unit_x_16 = UnitX(Factor=expr("x/3", list_item_43))
move_22 = Move(Geometry=rotate_3d_20.Geometry, Motion=unit_x_16)  # -> Geometry, Transform
line_19 = Line(StartPoint=rotate_3d_19.Geometry, EndPoint=rotate_3d_20.Geometry)
rotate_3d_21 = Rotate3D(Geometry=move_22.Geometry, Angle=expr("x*(-6)", degrees(addition_10)), Center=rotate_3d_20.Geometry, Axis=unit_z_11)  # -> Geometry, Transform
line_20 = Line(StartPoint=rotate_3d_20.Geometry, EndPoint=rotate_3d_21.Geometry)
set_union_2 = SetUnion(
    _5=rotate_3d_21.Geometry,
    _4=rotate_3d_20.Geometry,
    _3=rotate_3d_19.Geometry,
    _2=rotate_3d_18.Geometry,
    _1=rotate_3d_17.Geometry,
    _0=rotate_3d_16.Geometry)

data_rec_6 = PythonScript(x=rotate_3d_21.Geometry, enable=boolean, reset=bang_3.FalseState, limit=number_slider_6)  # -> x; inputs x: tree, enable: Boolean, reset: Boolean, limit: Int32; same code as data_rec

integer_12 = Integer(1)
data_rec_7 = PythonScript(x=integer_12, enable=boolean, reset=bang_3.FalseState, limit=Slider(100, range=0..200))  # -> x; inputs x: tree, enable: Boolean, reset: Boolean, limit: Int32; same code as data_rec
number_slider_16 = Slider(4, range=0..10)
mass_addition_4 = MassAddition(Input=data_rec_7)  # -> Result, PartialResults
panel_97 = Panel(mass_addition_4.Result)
modulus_2 = Modulus(A=mass_addition_4.Result, B=number_slider_16)
smaller_than_4 = SmallerThan(FirstNumber=modulus_2, SecondNumber=expr("x-1", number_slider_16))  # -> SmallerThan, OrEqualTo
panel_98 = Panel(modulus_2)
bang_4 = Bang(BooleanInput=smaller_than_4.SmallerThan)  # -> TrueState, FalseState
panel_99 = Panel(smaller_than_4.SmallerThan)
cull_pattern_6 = CullPattern(List=data_rec_6, CullPattern=bang_4.TrueState)

line_21 = Line([line_20, line_19, line_18, line_17, line_16, line_15])
interpolate_4 = Interpolate(Vertices=cull_pattern_6, Degree=3, Periodic=False, KnotStyle=1)  # -> Curve, Length, Domain
custom_preview_6 = CustomPreview(
    Geometry=[interpolate_4.Curve, line_21],
    Material={diffuse=RGB(255, 255, 0), emission=RGB(66, 48, 66), shine=0.5, specular=RGB(255, 255, 255), transparency=0})

point_4 = Point(set_union)
point_5 = Point(set_union_2)
data_rec_8 = PythonScript(x=[point_4, point_5], enable=panel_34, reset=bang.TrueState, limit=Slider(29, range=0..100))  # -> x; inputs x: tree, enable: Boolean, reset: Boolean, limit: Int32; same code as data_rec
panel_100 = Panel(data_rec_8)

number_slider_17 = Slider(50, range=0..100)
integer_13 = Integer(1)
data_rec_9 = PythonScript(x=integer_13, enable=Toggle(True), reset=bang.TrueState, limit=number_slider_17)  # -> x; inputs x: tree, enable: Boolean, reset: Boolean, limit: Int32; same code as data_rec
mass_addition_5 = MassAddition(Input=data_rec_9)  # -> Result, PartialResults
panel_101 = Panel(mass_addition_5.Result)
larger_than_3 = LargerThan(FirstNumber=mass_addition_5.Result, SecondNumber=expr("x-1", number_slider_17))  # -> LargerThan, OrEqualTo
cull_pattern_7 = CullPattern(List=data_rec_8, CullPattern=invert(larger_than_3.LargerThan))

interconnectpoints = InterconnectPoints(Pts=cull_pattern_7)
custom_preview_7 = CustomPreview(
    Geometry=interconnectpoints,
    Material={diffuse=RGB(124, 252, 0), emission=RGB(66, 48, 66), shine=0.5, specular=RGB(255, 255, 255), transparency=0})
